# Dynamo graph 0001TestPythonScript.dyn (Dynamo 2.0.4.12684)

pyTestScript = Python()  # unwired: IN[0]
# ---------- pyTestScript.python (48 lines) ----------
import clr

clr.AddReference('RevitAPI')
from Autodesk.Revit.DB import *
from Autodesk.Revit.DB.Structure import *

clr.AddReference('RevitAPIUI')
from Autodesk.Revit.UI import *

clr.AddReference('System')
from System.Collections.Generic import List

clr.AddReference('RevitNodes')
import Revit
clr.ImportExtensions(Revit.GeometryConversion)
clr.ImportExtensions(Revit.Elements)

clr.AddReference('RevitServices')
import RevitServices
from RevitServices.Persistence import DocumentManager
from RevitServices.Transactions import TransactionManager

doc = DocumentManager.Instance.CurrentDBDocument
uidoc = DocumentManager.Instance.CurrentUIApplication.ActiveUIDocument


res = []

#Preparing input from dynamo to revit
element = UnwrapElement(IN[0])

#Do some action in a Transaction
TransactionManager.Instance.EnsureInTransaction(doc)


# Get all model lines in the current view
collector = FilteredElementCollector(doc).OfCategory(BuiltInCategory.OST_RoomSeparationLines)
modelLines = collector.WhereElementIsNotElementType().ToElements()

view = uidoc.ActiveView
# Filter the model lines by category to get RoomSeparationLines
for line in modelLines:
	line.SetVisibility(view)
	res.append(line.Category.Name)

TransactionManager.Instance.TransactionTaskDone()

OUT = res
# ----------------------------------------
