# Dynamo graph Copy_paramater_value.dyn (Dynamo 2.0.4.12684)

путь_к_файлу_python = Filename("..\MyScripts\Copy_paramater_value.py")
find_file_and_import_it = Python(IN[0]=путь_к_файлу_python)
# ---------- find_file_and_import_it.python (12 lines) ----------
import sys
#sys.path.append('C:\Program Files\IronPython 2.7\Lib')
sys.path.append('C:\Program Files (x86)\IronPython 2.7\Lib')
import codecs

try:
	filePath = IN[0]
	with codecs.open(filePath, 'rb', "utf-8") as inf:
		lines = inf.readlines()
	OUT = ''.join(lines)
except:
	OUT = "No file"
# ----------------------------------------
categories = Categories(index=61)
all_elements_of_category = ElementsOfCategory(Category=categories)
имя_общего_параметра = StringInput("BI_марка_конструкции")
имя_параметра_ресурса = StringInput("Марка")
python_script_from_string = PythonStringNode(script=find_file_and_import_it, IN[0]=all_elements_of_category, IN[1]=имя_общего_параметра, IN[2]=имя_параметра_ресурса)
watch = Watch(python_script_from_string)
