# Dynamo graph Modify railing paths in groups.dyn (Dynamo 1.3.3.4651)

# group: Group Edition
# note: Group Edition

# group: Get all Groups
element_types = ElementTypes("Group")
all_elements_of_type = ElementsOfType(element_types)

name = Element.Name(all_elements_of_type)
code_block = CodeBlock { "Rail"; }
contains = String.Contains(str=name, searchFor=code_block)
filterByBoolMask = List.FilterByBoolMask(list=all_elements_of_type, mask=contains)

# group: Sort by type name
code_block_2 = CodeBlock { "Type"; }
getParameterValueByName = Element.GetParameterValueByName(element=filterByBoolMask.in, parameterName=code_block_2)
code_block_3 = CodeBlock { "Type Name"; }
getParameterValueByName_2 = Element.GetParameterValueByName(element=getParameterValueByName, parameterName=code_block_3)
sortByKey = List.SortByKey(list=filterByBoolMask.in, keys=getParameterValueByName_2)

code_block_4 = CodeBlock(x=sortByKey.sorted_list) { x; }

# group: Group Groups by Name
code_block_5 = CodeBlock { "Type"; }
getParameterValueByName_3 = Element.GetParameterValueByName(element=sortByKey.sorted_list, parameterName=code_block_5)
uniqueItems = List.UniqueItems(getParameterValueByName_3)
if_equal_return_index = Custom[If Equal Return Index](listA=getParameterValueByName_3, listB=uniqueItems)
groupByKey = List.GroupByKey(list=getParameterValueByName_3, keys=if_equal_return_index)
watch = Watch(groupByKey.groups)

# group: Create temporary Group suffixes
code_block_6 = CodeBlock { "("; ")"; }
code_block_7 = CodeBlock { 1; }
count = Count(sortByKey.sorted_list)
range = Range(start=code_block_7, end=count, step=code_block_7, lacing=Longest)
string_from_object = FromObject(range)
code_block_8 = CodeBlock(a=code_block_6.out0, b=string_from_object, c=code_block_6.out1) { a+b+c; }

# group: Create temporary Group names
code_block_9 = CodeBlock { "Type Name"; }
getParameterValueByName_4 = Element.GetParameterValueByName(element=watch, parameterName=code_block_9)
count_2 = Count(getParameterValueByName_4@L2)
takeItems = List.TakeItems(list=code_block_8, amount=count_2)
code_block_10 = CodeBlock(a=getParameterValueByName_4, b=takeItems) { a+b; }

# group: Get all the Group types, sort them by name then duplicate them with unique names as many times as there are groups, now group members can have their attributes changed without being ungrouped from outside the group edit environment
element_types_2 = ElementTypes("GroupType")
all_elements_of_type_2 = ElementsOfType(element_types_2)
code_block_11 = CodeBlock { "Type Name"; }
getParameterValueByName_5 = Element.GetParameterValueByName(element=all_elements_of_type_2, parameterName=code_block_11)
sortByKey_2 = List.SortByKey(list=all_elements_of_type_2, keys=getParameterValueByName_5)
code_block_12 = CodeBlock { 1; }
chop = List.Chop(list=sortByKey_2.sorted_list, lengths=code_block_12)
chop_2 = List.Chop(list=count_2, lengths=code_block_12)
cycle = List.Cycle(list=chop@L2, amount=chop_2@L2)
flatten = Flatten(code_block_10)
watch_2 = Watch(flatten)
duplicate = Custom[ElementType.Duplicate](elementType=cycle, name=watch_2)  # "FamilyType.Duplicate"; Duplicates an element type

# group: Swap Groups to temporary Groups
flatten_2 = Flatten(duplicate)
passthrough = Custom[Passthrough](passThrough=code_block_4, waitFor=flatten_2)  # Forces a sequential order of execution. The node wired into the output of the Passthrough node will be executed *after* the node wired into the waitFor input (e.g. important for some Revit operations). The value of the passThrough input will be passed on to the node wired into the output port of the Passthrough node.
code_block_13 = CodeBlock { "Type"; }
setParameterByName = Element.SetParameterByName(element=passthrough, parameterName=code_block_13, value=flatten_2)

# group: INPUTS
string = StringInput("Railing")

# group: Get Group members and filter by category
members = Custom[Group.Members](group=setParameterByName)  # Retrieves the members of a group
string_from_object_2 = FromObject(members)
contains_2 = String.Contains(str=string_from_object_2@L2, searchFor=string)
filterByBoolMask_2 = List.FilterByBoolMask(list=members, mask=contains_2)

getPath = Custom[Railing.GetPath](railing=filterByBoolMask_2.in@L1)  # Extract railing path as Dynamo curves from the input railing element. Only single railing element allowed.
count_3 = Count(getPath@L2)

# group: INPUTS (Offset)
code_block_14 = CodeBlock()
# ---------- code_block_14.designscript (4 lines) ----------
//Start Offset
100;
//End Offset
-100;
# ----------------------------------------

# group: 1 Segment
code_block_15 = CodeBlock { 1; }
eq = count_3 == code_block_15
filterByBoolMask_3 = List.FilterByBoolMask(list=filterByBoolMask_2.in, mask=eq)
getPath_2 = Custom[Railing.GetPath](railing=filterByBoolMask_3.in@L1)
curve = dtGeometry.Deconstruct.Curve(getPath_2)
translate = Geometry.Translate(geometry=curve.out0, direction=curve.out3, distance=code_block_14.out0)
translate_2 = Geometry.Translate(geometry=curve.out2, direction=curve.out3, distance=code_block_14.out1)
byStartPointEndPoint = Line.ByStartPointEndPoint(startPoint=translate, endPoint=translate_2)

flatten_3 = Flatten(filterByBoolMask_3.in)
railing_setpath = Custom[Railing SetPath](Railing=flatten_3@L1, Curves=byStartPointEndPoint@L2)  # Modify the path of an existing railing.

# group: 2 Segments
code_block_16 = CodeBlock { 2; }
eq_2 = count_3 == code_block_16
filterByBoolMask_4 = List.FilterByBoolMask(list=filterByBoolMask_2.in, mask=eq_2)
getPath_3 = Custom[Railing.GetPath](railing=filterByBoolMask_4.in@L1)
code_block_17 = CodeBlock { 0; }
getItemAtIndex = List.GetItemAtIndex(list=getPath_3@L2, index=code_block_17)
curve_2 = dtGeometry.Deconstruct.Curve(getItemAtIndex)
translate_3 = Geometry.Translate(geometry=curve_2.out0, direction=curve_2.out3, distance=code_block_14.out0)
byStartPointEndPoint_2 = Line.ByStartPointEndPoint(startPoint=translate_3, endPoint=curve_2.out2)
code_block_18 = CodeBlock { 1; }
chop_3 = List.Chop(list=byStartPointEndPoint_2, lengths=code_block_18)
code_block_19 = CodeBlock { 1; }
getItemAtIndex_2 = List.GetItemAtIndex(list=getPath_3@L2, index=code_block_19)
curve_3 = dtGeometry.Deconstruct.Curve(getItemAtIndex_2)
translate_4 = Geometry.Translate(geometry=curve_3.out2, direction=curve_3.out3, distance=code_block_14.out1)
byStartPointEndPoint_3 = Line.ByStartPointEndPoint(startPoint=curve_3.out0, endPoint=translate_4)
chop_4 = List.Chop(list=byStartPointEndPoint_3, lengths=code_block_18)
create = List.Create(chop_3, chop_4)
transpose = List.Transpose(create)
flatten_4 = Flatten(transpose)
code_block_20 = CodeBlock { 2; }
chop_5 = List.Chop(list=flatten_4, lengths=code_block_20)

flatten_5 = Flatten(filterByBoolMask_4.in)
railing_setpath_2 = Custom[Railing SetPath](Railing=flatten_5@L1, Curves=chop_5@L2)

# group: 3 Segments
code_block_21 = CodeBlock { 3; }
eq_3 = count_3 == code_block_21
filterByBoolMask_5 = List.FilterByBoolMask(list=filterByBoolMask_2.in, mask=eq_3)
getPath_4 = Custom[Railing.GetPath](railing=filterByBoolMask_5.in@L1)
code_block_22 = CodeBlock { 0; }
getItemAtIndex_3 = List.GetItemAtIndex(list=getPath_4@L2, index=code_block_22)
curve_4 = dtGeometry.Deconstruct.Curve(getItemAtIndex_3)
translate_5 = Geometry.Translate(geometry=curve_4.out0, direction=curve_4.out3, distance=code_block_14.out0)
byStartPointEndPoint_4 = Line.ByStartPointEndPoint(startPoint=translate_5, endPoint=curve_4.out2)
code_block_23 = CodeBlock { 1; }
chop_6 = List.Chop(list=byStartPointEndPoint_4, lengths=code_block_23)
code_block_24 = CodeBlock { 1; }
getItemAtIndex_4 = List.GetItemAtIndex(list=getPath_4@L2, index=code_block_24)
chop_7 = List.Chop(list=getItemAtIndex_4, lengths=code_block_23)
code_block_25 = CodeBlock { 2; }
getItemAtIndex_5 = List.GetItemAtIndex(list=getPath_4@L2, index=code_block_25)
curve_5 = dtGeometry.Deconstruct.Curve(getItemAtIndex_5)
translate_6 = Geometry.Translate(geometry=curve_5.out2, direction=curve_5.out3, distance=code_block_14.out1)
byStartPointEndPoint_5 = Line.ByStartPointEndPoint(startPoint=curve_5.out0, endPoint=translate_6)
chop_8 = List.Chop(list=byStartPointEndPoint_5, lengths=code_block_23)
create_2 = List.Create(chop_6, chop_7, chop_8)
transpose_2 = List.Transpose(create_2)
flatten_6 = Flatten(transpose_2)
code_block_26 = CodeBlock { 3; }
chop_9 = List.Chop(list=flatten_6, lengths=code_block_26)

code_block_27 = CodeBlock { 0; }
flatten_7 = List.Flatten(list=filterByBoolMask_5.in, amt=code_block_27)
flatten_8 = Flatten(flatten_7)
railing_setpath_3 = Custom[Railing SetPath](Railing=flatten_8@L1, Curves=chop_9@L2)
create_3 = List.Create(railing_setpath, railing_setpath_2, railing_setpath_3)
flatten_9 = Flatten(create_3)

# group: Sort by type name
code_block_28 = CodeBlock { "Type"; }
getParameterValueByName_6 = Element.GetParameterValueByName(element=setParameterByName, parameterName=code_block_28)
code_block_29 = CodeBlock { "Type Name"; }
getParameterValueByName_7 = Element.GetParameterValueByName(element=getParameterValueByName_6, parameterName=code_block_29)

# group: Split the list, we only want 1 type to swap out later, the others we'll want to delete
code_block_30 = CodeBlock { "(1)"; }
contains_3 = String.Contains(str=getParameterValueByName_7, searchFor=code_block_30)
filterByBoolMask_6 = List.FilterByBoolMask(list=setParameterByName, mask=contains_3)

code_block_31 = CodeBlock(x=count_2) { x; }

# group: We only want the new groups to be a single new type
code_block_32 = CodeBlock { 1; }
chop_10 = List.Chop(list=filterByBoolMask_6.in, lengths=code_block_32)
code_block_33 = CodeBlock(x=code_block_31) { x; }
chop_11 = List.Chop(list=code_block_33, lengths=code_block_32)
cycle_2 = List.Cycle(list=chop_10@L2, amount=chop_11@L2)

# group: Get Group from members and type to single for each type
group = Custom[Element.Group](element=flatten_9)  # Retrieves the group an element belongs to (if any)
uniqueItems_2 = List.UniqueItems(group)
code_block_34 = CodeBlock { "Type"; }
flatten_10 = Flatten(cycle_2)
code_block_35 = CodeBlock { "Type"; }
getParameterValueByName_8 = Element.GetParameterValueByName(element=flatten_10, parameterName=code_block_35)
setParameterByName_2 = Element.SetParameterByName(element=uniqueItems_2, parameterName=code_block_34, value=getParameterValueByName_8)

# group: Delete unneeded Group types
element_types_3 = ElementTypes("GroupType")
passthrough_2 = Custom[Passthrough](passThrough=element_types_3, waitFor=setParameterByName_2)
all_elements_of_type_3 = ElementsOfType(passthrough_2)
code_block_36 = CodeBlock { "Type Name"; }
getParameterValueByName_9 = Element.GetParameterValueByName(element=all_elements_of_type_3, parameterName=code_block_36)
code_block_37 = CodeBlock { "(1)"; }
contains_4 = String.Contains(str=getParameterValueByName_9, searchFor=code_block_37)
filterByBoolMask_7 = List.FilterByBoolMask(list=all_elements_of_type_3, mask=contains_4)
eraser = Custom[Tool.Eraser](List=filterByBoolMask_7.out)  # Try to delete any element from project

code_block_38 = CodeBlock(x=watch) { x; }
code_block_39 = CodeBlock(x=getParameterValueByName_4) { x; }

# group: Create new Group types with old name
code_block_40 = CodeBlock(x=filterByBoolMask_7.in) { x; }
code_block_41 = CodeBlock { "Type Name"; }
getParameterValueByName_10 = Element.GetParameterValueByName(element=code_block_40, parameterName=code_block_41)
code_block_42 = CodeBlock { -3; 3; }
remove = String.Remove(str=getParameterValueByName_10, startIndex=code_block_42.out0, count=code_block_42.out1)
duplicate_2 = Custom[ElementType.Duplicate](elementType=code_block_40, name=remove)  # "FamilyType.Duplicate"

# group: Check type name
code_block_43 = CodeBlock { "Type"; }
getParameterValueByName_11 = Element.GetParameterValueByName(element=setParameterByName_2, parameterName=code_block_43)
code_block_44 = CodeBlock { "Type Name"; }
getParameterValueByName_12 = Element.GetParameterValueByName(element=getParameterValueByName_11, parameterName=code_block_44)

groupByKey_2 = List.GroupByKey(list=getParameterValueByName_11, keys=getParameterValueByName_12)

# group: Multiply Group types by number of groups to allow Groups to be swapped back to old type names
code_block_45 = CodeBlock { 1; }
chop_12 = List.Chop(list=duplicate_2, lengths=code_block_45)
count_4 = Count(groupByKey_2.groups@L2)
chop_13 = List.Chop(list=count_4, lengths=code_block_45)
cycle_3 = List.Cycle(list=chop_12@L2, amount=chop_13@L2)
flatten_11 = Flatten(cycle_3)

# group: Set Groups back to old name
code_block_46 = CodeBlock { "Type"; }
setParameterByName_3 = Element.SetParameterByName(element=setParameterByName_2, parameterName=code_block_46, value=flatten_11)

# group: Delete unneeded Group types
element_types_4 = ElementTypes("GroupType")
passthrough_3 = Custom[Passthrough](passThrough=element_types_4, waitFor=setParameterByName_3)
all_elements_of_type_4 = ElementsOfType(passthrough_3)
code_block_47 = CodeBlock { "Type Name"; }
getParameterValueByName_13 = Element.GetParameterValueByName(element=all_elements_of_type_4, parameterName=code_block_47)
code_block_48 = CodeBlock { "(1)"; }
contains_5 = String.Contains(str=getParameterValueByName_13, searchFor=code_block_48)
filterByBoolMask_8 = List.FilterByBoolMask(list=all_elements_of_type_4, mask=contains_5)
eraser_2 = Custom[Tool.Eraser](List=filterByBoolMask_8.in)
