# Dynamo graph (WIP)Dimension Linked Model Curtain Grids in Plan View.dyn (Dynamo 2.0.2.6826)

all_elements_in_active_view = ElementsInView()
watch = Watch(all_elements_in_active_view)

# group: Collect Curtain Wall
getCategory = Element.GetCategory(element=all_elements_in_active_view)
string_from_object = FromObject(obj=getCategory)
code_block = CodeBlock { "Walls"; }
eq = string_from_object == code_block
filterByBoolMask = List.FilterByBoolMask(list=all_elements_in_active_view, mask=eq)
isCurtainWall = Custom[Springs.Wall.IsCurtainWall](wall=filterByBoolMask.in)  # Returns true if the wall is a curtain wall.
filterByBoolMask_2 = List.FilterByBoolMask(list=filterByBoolMask.in, mask=isCurtainWall)

parameters = Element.Parameters(element=filterByBoolMask_2.in)
watch_2 = Watch(filterByBoolMask_2.in)
# note: Note:
# 1. It is intended to be run with Dynamo Player, so it only run on Current Active View. If not run with Dynamo Player, it required to close the Dynamo session after each run in order to refresh the Current Active View.
# 2. It only dimension Curtain Wall on Plan View, and the Curtain Wall must be straight not curved.
# 3. It required additional packages, Rhythm node and designtech node.
# 4. Dimension is place according to the external face of Curtain Wall
current = Document.Current()
activeView = Document.ActiveView(document=current)

# group: Collect View Range
code_block_2 = CodeBlock(view=activeView) { view; }
getViewRange = Python(IN[0]=code_block_2)  # "PynSpt.GetViewRange"
# ---------- getViewRange.python (79 lines) ----------
import clr

clr.AddReference("RevitServices")
import RevitServices
from RevitServices.Persistence import DocumentManager
from RevitServices.Transactions import TransactionManager
doc = DocumentManager.Instance.CurrentDBDocument

clr.AddReference("RevitAPI")
import Autodesk
from Autodesk.Revit.DB import *

clr.AddReference("RevitNodes")
import Revit
clr.ImportExtensions(Revit.Elements)
clr.ImportExtensions(Revit.GeometryConversion)
#The inputs to this node will be stored as a list in the IN variables.
if isinstance(IN[0], list):
	views  = UnwrapElement(IN[0])
else:
	views = [UnwrapElement(IN[0])]

def getViewRange(view):
	if view.GetType() == Autodesk.Revit.DB.ViewPlan:
		viewrange = view.GetViewRange()
		try:
			cutId = viewrange.GetLevelId(PlanViewPlane.CutPlane)
			cutlevel = doc.GetElement(cutId)
			cut = cutlevel.Elevation + viewrange.GetOffset(PlanViewPlane.CutPlane)
		except:
			cut = None
		
		try:
			topId = viewrange.GetLevelId(PlanViewPlane.TopClipPlane)
			toplevel = doc.GetElement(topId)
			topelev = toplevel.Elevation
			top = topelev + viewrange.GetOffset(PlanViewPlane.TopClipPlane)
		except:
			top = None
			
		try:
			bottomId = viewrange.GetLevelId(PlanViewPlane.BottomClipPlane)
			bottomlevel = doc.GetElement(bottomId)
			bottomelev = bottomlevel.Elevation
			bottom = bottomelev + viewrange.GetOffset(PlanViewPlane.BottomClipPlane)
		except:
			bottom = None
		
		try:
			depthId = viewrange.GetLevelId(PlanViewPlane.ViewDepthPlane)
			depthlevel = doc.GetElement(depthId)
			depthelev = depthlevel.Elevation
			depth = depthelev + viewrange.GetOffset(PlanViewPlane.ViewDepthPlane)
		except:
			depth = None

	return depth, bottom,cut,top

depth = []
bottom = []
cut = []
top = []

for view in views:
	try:
		depth.append(getViewRange(view)[0])
		bottom.append(getViewRange(view)[1])
		cut.append(getViewRange(view)[2])
		top.append(getViewRange(view)[3])
	except:
		depth.append(None)
		bottom.append(None)
		cut.append(None)
		top.append(None)
#Assign your output to the OUT variable.
if len(depth) == 1:
	OUT = depth[0], bottom[0], cut[0], top[0]
else:
	OUT = depth, bottom, cut, top
# ----------------------------------------
convert_between_units = DynamoConvert(getViewRange, MeasurementType="Length", FromConversion="Feet", ToConversion="Millimeters")
topPlane = CodeBlock(x=convert_between_units) { x[3]; }
btmPlane = CodeBlock(x=convert_between_units) { x[1]; }
viewDepth = CodeBlock(x=convert_between_units) { x[0]; }
cutPlane = CodeBlock(x=convert_between_units) { x[2]; }

# group: Collect RevitLinkInstance in View
getCategory_2 = Element.GetCategory(element=all_elements_in_active_view)
string_from_object_2 = FromObject(obj=getCategory_2)
code_block_3 = CodeBlock { "RVT Links"; }
eq_2 = string_from_object_2 == code_block_3
filterByBoolMask_3 = List.FilterByBoolMask(list=all_elements_in_active_view, mask=eq_2)
watch_3 = Watch(filterByBoolMask_3.in)

categories = Categories(index=604)
linkedInstanceElements = Custom[Springs.Collector.LinkedInstanceElements](linkInstance=watch_3, category=categories)  # Extract elements by category from the selected linked instances. The transform CS can be used to get the exact location of the elements in the host file. If an error occurs or the linked document is unloaded, an error will be returned in the elements output and the appropriate transform will be a null. You can use those nulls to filter out the errors.
isCurtainWall_2 = Custom[Springs.Wall.IsCurtainWall](wall=linkedInstanceElements.elements)
filterByBoolMask_4 = List.FilterByBoolMask(list=linkedInstanceElements.elements, mask=isCurtainWall_2)
flatten = List.Flatten(list=filterByBoolMask_4.in)
watch_4 = Watch(flatten)
list_create = List.Create(item0=filterByBoolMask_2.in, item1=watch_4)
flatten_2 = List.Flatten(list=list_create)
watch_5 = Watch(flatten_2)

# group: Create ref location line for dimension placement
getLocation = Element.GetLocation(element=watch_5)
boundingBox = Element.BoundingBox(element=watch_5)
minPoint = BoundingBox.MinPoint(boundingBox=boundingBox)
X = Point.X(point=minPoint)
Y = Point.Y(point=minPoint)
code_block_4 = CodeBlock(z=cutPlane) { z-100; }
byCoordinates = Point.ByCoordinates(x=X, y=Y, z=code_block_4)
ZAxis = Vector.ZAxis()
byOriginNormal = Plane.ByOriginNormal(origin=byCoordinates, normal=ZAxis)
pullOntoPlane = Curve.PullOntoPlane(curve=getLocation, plane=byOriginNormal)
# note: archilab node
exteriorDirection = Custom[Wall.ExteriorDirection](Wall=watch_5)  # This node returns exterior direction of the wall as a vector.
code_block_5 = CodeBlock { 1000; }
translate = Geometry.Translate(geometry=pullOntoPlane, direction=exteriorDirection, distance=code_block_5)
startPoint = Curve.StartPoint(curve=translate)
endPoint = Curve.EndPoint(curve=translate)
byStartPointEndPoint = Line.ByStartPointEndPoint(startPoint=startPoint, endPoint=endPoint)

# group: Get the edges of curtain wall
# note: designtech Node
curtainWallReferences = dtRevit.Element.CurtainWallReferences(curtainWall=watch_5)
list_create_2 = List.Create(item0=curtainWallReferences.startRef, item1=curtainWallReferences.endRef)
transpose = List.Transpose(lists=list_create_2)

# group: Get Link models
# note: archilab node
get_documents = Custom[Get Documents]()  # Queries all linked Revit files and retrieves their Name, LinkInstance and Document properties.
watch_6 = Watch(get_documents.Link_Doc)
name = dtRevit.RvtLink.Name(linkIns=get_documents.Link_Instance)
watch_7 = Watch(get_documents.Link_Instance)

# group: Get curtain wall girds
# note: Rhythm node
# note: Host Model
byWallElement = Rhythm.Revit.Elements.CurtainGrid.ByWallElement(curtainWall=watch_2)
# note: Linked Model
pyS_GetLinkedModelCurtainWallVerticalGri = Python(IN[0]=watch_4, IN[1]=watch_6)  # "PyS_GetLinkedModelCurtainWallVerticalGrids"
# ---------- pyS_GetLinkedModelCurtainWallVerticalGri.python (44 lines) ----------
# Enable Python support and load DesignScript library
import clr
clr.AddReference('RevitAPI')
import Autodesk
from Autodesk.Revit.DB import *

clr.AddReference('RevitServices')
import RevitServices
from RevitServices.Persistence import DocumentManager
from RevitServices.Transactions import TransactionManager

clr.AddReference('RevitAPIUI')
from Autodesk.Revit.UI import *

#doc = DocumentManager.Instance.CurrentDBDocument

def toList(obj1):
	if hasattr(obj1,'__iter__'):return obj1
	else: return [obj1]

# The inputs to this node will be stored as a list in the IN variables.
refs=toList(UnwrapElement(IN[0]))
doc = IN[1]
#outList= ReferenceArray()
outList=[]
opt=Options()
opt.ComputeReferences=True
opt.IncludeNonVisibleObjects=True
#opt.View=doc.ActiveView

for ref in refs:
	#outList.Append(Reference(ref))
	cWall=UnwrapElement(ref)
	#vGrids = []
for vG in cWall.CurtainGrid.GetVGridLineIds():
	vGrids =[]
	for dc in doc:
		vGrids.append(dc.GetElement(vG))
	outList.append(vGrids)
	
# Place your code below this line

# Assign your output to the OUT variable.
OUT = outList
# ----------------------------------------
transpose_2 = List.Transpose(lists=pyS_GetLinkedModelCurtainWallVerticalGri)

watch_8 = Watch(byWallElement.curtainGrid)
watch_9 = Watch(byWallElement.uGrids)
join = List.Join(list0=byWallElement.vGrids, list1=transpose_2)
watch_10 = Watch(join)

# group: Casting list of CurtainGrids to Revit.DB.Reference
code_block_6 = CodeBlock(inList=watch_10) { inList; }
flatten_3 = List.Flatten(list=code_block_6)
python_script = Python(IN[0]=flatten_3)
# ---------- python_script.python (40 lines) ----------
# Enable Python support and load DesignScript library
import clr
clr.AddReference('RevitAPI')
import Autodesk
from Autodesk.Revit.DB import *

clr.AddReference('RevitServices')
import RevitServices
from RevitServices.Persistence import DocumentManager
from RevitServices.Transactions import TransactionManager

clr.AddReference('RevitAPIUI')
from Autodesk.Revit.UI import *

doc = DocumentManager.Instance.CurrentDBDocument

def toList(obj1):
	if hasattr(obj1,'__iter__'):return obj1
	else: return [obj1]

# The inputs to this node will be stored as a list in the IN variables.
refs=toList(UnwrapElement(IN[0]))
#outList= ReferenceArray()
outList=[]
opt=Options()
opt.ComputeReferences=True
opt.IncludeNonVisibleObjects=True
opt.View=doc.ActiveView

for ref in refs:
	#outList.Append(Reference(ref))
	for obj in ref.get_Geometry(opt):
		if isinstance(obj, Line):
			gline = obj
			outList.append(gline.Reference)
	
# Place your code below this line

# Assign your output to the OUT variable.
OUT = outList
# ----------------------------------------
count = List.Count(list=code_block_6@L2)
chop = List.Chop(list=python_script, lengths=count)

# group: prepare the reference element list to be dimension
addItemToFront = List.AddItemToFront()  # unwired: item, list
combine = List.Combine(comb=addItemToFront, list1=transpose, list2=chop)
flatten_4 = List.Flatten()  # unwired: list
map = List.Map(list=combine, f_x=flatten_4)

# group: prepare view
watch_11 = Watch(activeView)
count_2 = List.Count(list=watch_5)
ofRepeatedItem = List.OfRepeatedItem(item=watch_11, amount=count_2)

# group: Create Dimension
code_block_7 = CodeBlock(setoutDimLineList=byStartPointEndPoint) { setoutDimLineList; }
code_block_8 = CodeBlock(refGeometryList=map) { refGeometryList; }
code_block_9 = CodeBlock(viewList=ofRepeatedItem) { viewList; }
python_script_2 = Python(IN[0]=code_block_7, IN[1]=code_block_8, IN[2]=code_block_9)
# ---------- python_script_2.python (47 lines) ----------
import clr

clr.AddReference("RevitServices")
import RevitServices
from RevitServices.Persistence import DocumentManager
from RevitServices.Transactions import TransactionManager
doc = DocumentManager.Instance.CurrentDBDocument
app = DocumentManager.Instance.CurrentUIApplication.Application

clr.AddReference("RevitNodes")
import Revit
clr.ImportExtensions(Revit.Elements)
clr.ImportExtensions(Revit.GeometryConversion)

clr.AddReference("RevitAPI")
from Autodesk.Revit.DB import *

def tolist(obj1):
	if hasattr(obj1,"__iter__"): return obj1
	else: return [obj1]

# Requested Inputs
dimSetoutLines = tolist(UnwrapElement(IN[0]))
refs = tolist(UnwrapElement(IN[1]))
views = tolist(UnwrapElement(IN[2]))

# Prepare lists to store 
refArrays = []
outList = []

for refList in refs:
	rArr = ReferenceArray()
	for l in refList:
		rArr.Append(l)
	refArrays.append(rArr)
	
TransactionManager.Instance.EnsureInTransaction(doc)
for l,r,v in zip(dimSetoutLines,refArrays,views):
	try:
		outList.append(doc.Create.NewDimension(v,l.ToRevitType(),r))
	except Exception,e:
		outList.append(e.message)

TransactionManager.Instance.TransactionTaskDone()
	
# Assign your output to the OUT variable.
OUT = outList
# ----------------------------------------

watch_12 = Watch(python_script_2)

# group: designtech nodes
curtainGrid = dtRevit.Element.CurtainGrid(curtainWall=flatten)
curtainWallReferences_2 = dtRevit.Element.CurtainWallReferences(curtainWall=flatten)

# group: Rhythm node
byWallElement_2 = Rhythm.Revit.Elements.CurtainGrid.ByWallElement(curtainWall=flatten)

list_create_3 = List.Create(item0=curtainWallReferences_2.startRef, item1=curtainWallReferences_2.endRef)

# group: prepare view
watch_13 = Watch(activeView)
count_3 = List.Count(list=list_create_3)
ofRepeatedItem_2 = List.OfRepeatedItem(item=watch_13, amount=count_3)

getLocation_2 = Element.GetLocation(element=flatten)
transform = Geometry.Transform(geometry=getLocation_2, cs=linkedInstanceElements.transform)
join_2 = List.Join()  # unwired: list0, list1
transpose_3 = List.Transpose(lists=list_create_3)
createLinkReference = dtRevit.Element.CreateLinkReference(linkIns=watch_7, linkElement=transpose_2)
combine_2 = List.Combine(comb=join_2, list1=transpose_3, list2=createLinkReference)

# group: Create Dimension
code_block_10 = CodeBlock(viewList=ofRepeatedItem_2) { viewList; }
code_block_11 = CodeBlock(setoutDimLineList=transform) { setoutDimLineList; }
code_block_12 = CodeBlock(refGeometryList=combine_2) { refGeometryList; }
python_script_3 = Python(IN[0]=code_block_11, IN[1]=code_block_12, IN[2]=code_block_10)  # same code as python_script_2
watch_14 = Watch(python_script_3)

# group: Create Dimension with designtech node
# note: designtech node
dimensionWithReference = dtRevit.Annotation.DimensionWithReference(view=code_block_10, line=code_block_11, references=code_block_12)

# group: Inspection tool to which elements a dimension refer to
select_model_element = DSModelElementSelection()  # 1 picked in the model
dimensionElements = dtRevit.Element.DimensionElements(dimension=select_model_element)
parameters_2 = Element.Parameters(element=dimensionElements)

categories_2 = Categories(index=606)
linkedInstanceElements_2 = Custom[Springs.Collector.LinkedInstanceElements](linkInstance=get_documents.Link_Instance, category=categories_2)
curtainGridLine = dtRevit.Element.CurtainGridLine(curtainGridLine=linkedInstanceElements_2.elements)
watch_15 = Watch(curtainGridLine.referenceLine)
transform_2 = Geometry.Transform(geometry=curtainGridLine.dynCurtainGridLine, cs=linkedInstanceElements_2.transform)
watch_16 = Watch(transform_2)
parameters_3 = Element.Parameters(element=watch_3)
