# Dynamo graph 2.06_Площадь проемов_3.dyn (Dynamo 1.3.3.4111)

# group: Наименования параметров
площадь_проемов = StringInput("ADSK_Площадь проемов")

retry = BoolSelector(false)

# group: Параметры ширины и высоты окон и дверей
параметр_ширины_параметр_высоты = CodeBlock { {"Примерная ширина","Примерная высота","Э"}; }  # "Параметр ширины, Параметр высоты, Э/Т (Экземпляр/Типоразмер)"
параметр_ширины_параметр_высоты_2 = CodeBlock { {"Ширина","Высота","Э"}; }  # "Параметр ширины, Параметр высоты, Э/Т (Экземпляр/Типоразмер)"
параметр_ширины_параметр_высоты_3 = CodeBlock { {"Примерная ширина","Примерная высота","Т"}; }  # "Параметр ширины, Параметр высоты, Э/Т (Экземпляр/Типоразмер)"
параметр_ширины_параметр_высоты_4 = CodeBlock { {"Ширина","Высота","Т"}; }  # "Параметр ширины, Параметр высоты, Э/Т (Экземпляр/Типоразмер)"
create = List.Create(параметр_ширины_параметр_высоты, параметр_ширины_параметр_высоты_2, параметр_ширины_параметр_высоты_3, параметр_ширины_параметр_высоты_4)

# group: Расчет
python_script = Python(IN[0]=площадь_проемов, IN[1]=retry, IN[2]=create)
# ---------- python_script.python (101 lines) ----------
import clr
clr.AddReference('ProtoGeometry')
from Autodesk.DesignScript.Geometry import *
clr.AddReference('RevitAPI')
from Autodesk.Revit.DB import *
clr.AddReference("RevitServices")
import RevitServices
from RevitServices.Persistence import DocumentManager
from RevitServices.Transactions import TransactionManager
doc = DocumentManager.Instance.CurrentDBDocument
opt = SpatialElementBoundaryOptions()
doors = FilteredElementCollector(doc).OfCategory(BuiltInCategory.OST_Doors).WhereElementIsNotElementType().ToElements()
windows = FilteredElementCollector(doc).OfCategory(BuiltInCategory.OST_Windows).WhereElementIsNotElementType().ToElements()
pS = IN[0]
pars=IN[2]

def get_selected_elements():
	ids = uidoc.Selection.GetElementIds()
	if isinstance(ids, list) == True:
		ids=[ids]
	els = []
	for id in ids:
		el = doc.GetElement(id)
		els.append(el)
	return els
	
rooms = FilteredElementCollector(doc).OfCategory(BuiltInCategory.OST_Rooms).WhereElementIsNotElementType().ToElements()
#rooms = UnwrapElement(IN[3])
#rooms = get_selected_elements()

def get_S(window):
	h=None
	list=[]
	type = doc.GetElement(window.get_Parameter(BuiltInParameter.ELEM_TYPE_PARAM).AsElementId())
	for par in pars:
		if par[2]=="Т":
			el = type
		else:
			el = window
		w = el.LookupParameter(par[0])
		h = el.LookupParameter(par[1])
		list.append([w,h])
		if w is not None and h is not None:
			S = w.AsDouble()*h.AsDouble()
			break
	return S
def get_id(d1):
	id=0
	try:
		id= d1.Id
	except:
		id=0
	return id		
def to_dict(id,window):
	if id!=0:
		S=get_S(window)
		if id not in dict:
			dict[id]=S
		else:
			dict[id]+=S
	return dict	
def add_S(windows):
	for window in windows:
		phase = doc.GetElement(window.get_Parameter(BuiltInParameter.PHASE_CREATED).AsElementId())
		d1 = window.FromRoom[phase]
		d2 = window.ToRoom[phase]	
		id1 = str(get_id(d1))
		to_dict(id1,window)	
		id2 = str(get_id(d2))
		to_dict(id2,window)
	return dict			
#
dict={}
list=[]
add_S(windows)
add_S(doors)
TransactionManager.Instance.EnsureInTransaction(doc)
for room in rooms:
	if room.Area>0:
		id = room.Id
		if str(id) in dict:
			S = dict[str(id)]
		else:
			S=0		
		bounds = room.GetBoundarySegments(opt)
		for contour in bounds:
			for bound in contour:
				el = doc.GetElement(bound.ElementId)
				if el is not None:					
					type = el.GetType().Name
					if type == 'ModelLine':
						S = S + room.UnboundedHeight*bound.GetCurve().Length
					try:	
						if el.CurtainGrid is not None:
							S = S+room.UnboundedHeight*bound.GetCurve().Length
					except:
						0				
			room.LookupParameter(pS).Set(S)				
TransactionManager.Instance.TransactionTaskDone()		
#Назначьте вывод переменной OUT"""	
OUT = rooms
# ----------------------------------------
