# Dynamo graph 2.42_Обновить изображение по активному виду.dyn (Dynamo 1.3.3.4111)

retry = BoolSelector(true)
python_script = Python(IN[0]=retry)
# ---------- python_script.python (45 lines) ----------
import clr
import sys
sys.path.append(r'C:\Program Files (x86)\IronPython 2.7\Lib')
import os
appdata = os.getenv('APPDATA')
clr.AddReference("RevitServices")
import RevitServices
from RevitServices.Persistence import DocumentManager
from RevitServices.Transactions import TransactionManager
clr.AddReference("RevitAPI")
import Autodesk
from Autodesk.Revit.DB import *
clr.AddReference('System.Windows.Forms')
clr.AddReference('System.Drawing')
from System.Drawing import *
from System.Windows.Forms import *
doc = DocumentManager.Instance.CurrentDBDocument
uidoc = DocumentManager.Instance.CurrentUIApplication.ActiveUIDocument
views = FilteredElementCollector(doc).OfCategory(BuiltInCategory.OST_Views).WhereElementIsNotElementType().ToElements()
images = FilteredElementCollector(doc).OfCategory(BuiltInCategory.OST_RasterImages).WhereElementIsElementType().ToElements()
ex_opts = ImageExportOptions()
ex_opts.PixelSize = 3000

legend = doc.ActiveView
TransactionManager.Instance.EnsureInTransaction(doc)
name = legend.get_Parameter(BuiltInParameter.VIEW_NAME).AsString()
file = appdata+"\\"+name+".jpg"
ex_opts.FilePath = file
doc.ExportImage(ex_opts)
check=0
for image in images:
	name2 = image.get_Parameter(BuiltInParameter.SYMBOL_NAME_PARAM).AsString()
	if name2==name:
		image.ReloadFrom(file)
		image.Name = name
		check=1
		break
if check==0:	
	view2 = ImageType.Create(doc,file)
	view2.Name = name
os.remove(file)	
TransactionManager.Instance.TransactionTaskDone()
TransactionManager.Instance.ForceCloseTransaction()
	
OUT = "ok"
# ----------------------------------------
