# Dynamo graph 6.13_Арм. контура плиты_4.dyn (Dynamo 2.0.4.12684)

# group: Ввод значений
# note: Требуется установка пакета
# Dynamo for Rebar
шаг_п_шек = DoubleSlider(400, range=100..1000 step 50)  # graph input

длина_п_шек = DoubleSlider(500, range=0..1000 step 50)  # graph input
pys_усиление_контура_плиты = Python(IN[2]=шаг_п_шек, IN[3]=длина_п_шек)  # unwired: IN[0], IN[1]
# ---------- pys_усиление_контура_плиты.python (238 lines) ----------
#Подключение библиотек
import clr
from System.Threading import Thread, ThreadStart
from operator import itemgetter
import math
clr.AddReference('ProtoGeometry')
from Autodesk.DesignScript.Geometry import *
clr.AddReference('RevitAPI')
from Autodesk.Revit.DB import *
import Autodesk
DPoint = Autodesk.DesignScript.Geometry.Point
DPolyCurve = Autodesk.DesignScript.Geometry.PolyCurve
DCurve = Autodesk.DesignScript.Geometry.Curve
DLine = Autodesk.DesignScript.Geometry.Line
DSurface = Autodesk.DesignScript.Geometry.Surface
DPolySurface = Autodesk.DesignScript.Geometry.PolySurface
DGeometry = Autodesk.DesignScript.Geometry.Geometry
DSolid = Autodesk.DesignScript.Geometry.Solid
DPlane = Autodesk.DesignScript.Geometry.Plane
DVector = Autodesk.DesignScript.Geometry.Vector
clr.AddReference("RevitServices")
import RevitServices
from RevitServices.Persistence import DocumentManager
from RevitServices.Transactions import TransactionManager
doc = DocumentManager.Instance.CurrentDBDocument
clr.AddReference("RevitNodes")
import Revit
clr.ImportExtensions(Revit.Elements)
from System.Collections.Generic import *
RS = Autodesk.Revit.DB.Structure
#--------------Взятие элементов------------------------
#---------------------------------------------------------------
hook_type = None
#--------------Входные данные--------------------
Dy_el = IN[0]
Dy_g = Dy_el.Geometry()[0]
el = UnwrapElement(Dy_el)
RebarType1 = UnwrapElement(IN[1])
s1 = IN[2]/304.8
l_U = IN[3]/304.8
s15=15/304.8
message=[]
#------------Берем параметры------
#------------Вычисляем параметры----------
d1 = RebarType1.BarDiameter
#-------------ФУНКЦИИ----------------------
def toPoint(pt):
	x=pt.X*304.8
	y=pt.Y*304.8
	z=pt.Z*304.8
	return DPoint.ByCoordinates(x,y,z)
def toXYZ(pt):
	x=pt.X/304.8
	y=pt.Y/304.8
	z=pt.Z/304.8
	return XYZ(x,y,z)
def get_zs(el,parameter):
	zs_id = el.get_Parameter(parameter).AsElementId()
	zs_el = doc.GetElement(zs_id)
	zs = zs_el.CoverDistance
	return zs
def get_pars_floor(el):
	floor = el
	type = get_type(floor)
	val_thickness = type.get_Parameter(BuiltInParameter.FLOOR_ATTR_DEFAULT_THICKNESS_PARAM).AsDouble()
	zs_other = get_zs(floor,BuiltInParameter.CLEAR_COVER_OTHER)
	zs_top = get_zs(floor,BuiltInParameter.CLEAR_COVER_TOP)
	zs_bottom = get_zs(floor,BuiltInParameter.CLEAR_COVER_BOTTOM)
	return val_thickness,zs_other,zs_top,zs_bottom
def get_type(el):
	type_id = el.get_Parameter(BuiltInParameter.ELEM_TYPE_PARAM).AsElementId()
	type = doc.GetElement(type_id)
	return type

def get_check_point(pt1,pt2,a):
	x1=pt1.X
	y1=pt1.Y
	z1=pt1.Z
	x2=pt2.X
	y2=pt2.Y
	z2=pt2.Z
	x3 = (x1+x2)/2
	y3 = (y1+y2)/2
	pt3 = get_new_point(x3,y3,z1,0,1,a)
	return pt3
def create_U_bylinepoints(pts,l,s1,zs_other,zs_top,zs_bottom,t,Dy_el):
	pt1 = pts[0]
	pt2 = pts[1]
	ln = Line.CreateBound(pt1,pt2)	
	o1 = ln.Direction	
	a = -get_angle(o1)
	ch_pt = get_check_point(pt1,pt2,a)
	y = DGeometry.DoesIntersect(Dy_el,toPoint(ch_pt))
	message.append(y)
	k=-1
	if not y:
		pt3=pt1
		pt1=pt2
		pt2=pt3
		ln = Line.CreateBound(pt1,pt2)	
		o1 = ln.Direction	
		a = -get_angle(o1)
		k=1
	x1 = pt1.X
	y1 = pt1.Y
	z1 = pt1.Z
	zs1 = (zs_other+s15)*k	
	pt3 = get_new_point(x1,y1,z1-zs_top,zs1,l+zs_other,a)
	pt4 = get_new_point(x1,y1,z1-zs_top,zs1,zs_other,a)
	pt5 = get_new_point(x1,y1,z1-t+zs_bottom,zs1,zs_other,a)
	pt6 = get_new_point(x1,y1,z1-t+zs_bottom,zs1,l+zs_other,a)
	stirrup = get_lines([pt3,pt4,pt5,pt6])
	l1 = ln.Length-zs_other*2-30/304.8
	n = l1//s1+1
	last_s = round((l1*304.8-(n-1)*s1*304.8)/10)*10/304.8
	norm2 = XYZ(o1.X,o1.Y,o1.Z)
	rebar = RS.Rebar.CreateFromCurves(doc,RS.RebarStyle.StirrupTie,RebarType1,hook_type,hook_type,el,norm2,stirrup,RS.RebarHookOrientation.Right,RS.RebarHookOrientation.Left,True,True)
	rebar.SetLayoutAsNumberWithSpacing(n,s1,True,True,True)
	if last_s>(50/304.8):
		x1 = pt2.X
		y1 = pt2.Y
		z1 = pt2.Z
		zs1 = (-zs_other-s15)*k
		pt3 = get_new_point(x1,y1,z1-zs_top,zs1,l+zs_other,a)
		pt4 = get_new_point(x1,y1,z1-zs_top,zs1,zs_other,a)
		pt5 = get_new_point(x1,y1,z1-t+zs_bottom,zs1,zs_other,a)
		pt6 = get_new_point(x1,y1,z1-t+zs_bottom,zs1,l+zs_other,a)
		stirrup =  get_lines([pt3,pt4,pt5,pt6])
		rebar = RS.Rebar.CreateFromCurves(doc,RS.RebarStyle.StirrupTie,RebarType1,hook_type,hook_type,el,norm2,stirrup,RS.RebarHookOrientation.Right,RS.RebarHookOrientation.Left,True,True)
	return rebar
def get_new_point(x1,y1,z1,fx,fy,a):
	x2 = x1+(fx)*math.cos(math.radians(a))-(fy)*math.sin(math.radians(a))
	y2 = y1+(fx)*math.sin(math.radians(a))+(fy)*math.cos(math.radians(a))
	pt2 = XYZ(x2,y2,z1)
	#pt2 = DPoint.ByCoordinates(x2,y2,z1)
	return pt2
def get_angle(a):
	x1 = a.X
	y1 = a.Y
	a1 = DVector.ByCoordinates(x1,y1,0)
	angle = DVector.AngleAboutAxis(a1,DVector.XAxis(),DVector.ZAxis())
	return angle
def get_lines(stirrup_pts):
	list=[]
	i=0
	for pt in stirrup_pts:
		if i==0:
			new_pt1=pt
			new_pt3=pt
		else:
			list.append(Line.CreateBound(new_pt1,pt))
			new_pt1=pt			
		i=i+1
	return list	
def iterate(src, res):
	for k, i in enumerate(src):
		vec1 = Vector.ByTwoPoints(i.EndPoint, res[-1].StartPoint).Length 
		vec2 = Vector.ByTwoPoints(i.StartPoint, res[-1].EndPoint).Length 
		vec3 = Vector.ByTwoPoints(i.EndPoint, res[-1].EndPoint).Length
		vec4 = Vector.ByTwoPoints(i.StartPoint, res[-1].StartPoint).Length
		gap = 0.000001 
		if vec1 < gap or vec2 < gap or vec3 < gap or vec4 < gap :
			res.Add(src.pop(k)) 
			return iterate(src, res) 
	return res	
def getpolycurves(slab):	
	crvs=[]
	_points = None
	z3 = None
	geom = slab
	faces = geom.Faces
	facelist=[]
	areas=[]
	for face in faces:
		areas.append(face.SurfaceGeometry().Area)
	A1 = max(areas)
	i=0
	for A2 in areas:
		if round(A2)==round(A1):
			facelist.append(faces[i])
		i=i+1	
	f2=None
	z=-1000
	for face in facelist:		
		pts = face.Vertices
		z2 = pts[0].PointGeometry.Z
		if z2>z:
			f2=face
			z=z2
			_edges = face.Edges
	src=[]
	for e in _edges:
		src.append(e.CurveGeometry)
	contour = [] 
	contours = []
	while src.Count>0:
		contour.Add(src.pop(0))
		contour = iterate(src, contour)
		contours.Add(contour)
		contour = []
	L=0
	pc=None
	for contour in contours:
		c = DPolyCurve.ByJoinedCurves(contour)
		len = c.Length
		if len > L:
			pc = c
			L = len
	crvs.append(pc)
	return crvs	
def get_center(el):
	bb = el.BoundingBox
	p1 = bb.MinPoint
	p2 = bb.MaxPoint
	x = (p1.X+p2.X)/2
	y = (p1.Y+p2.Y)/2
	z = (p1.Z+p2.Z)/2
	return XYZ(x,y,z)
#----ОСНОВНОЙ КОД-----
pars = get_pars_floor(el)
val_thickness = pars[0]
zs_other = pars[1]
zs_top = pars[2]
zs_bottom = pars[3]
contour1 = getpolycurves(Dy_g)[0]
curves = contour1.Curves()
list_pts=[]
for curve in curves:
	pt1=toXYZ(curve.StartPoint)
	pt2=toXYZ(curve.EndPoint)
	list_pts.append([pt1,pt2])

TransactionManager.Instance.EnsureInTransaction(doc)
for pts in list_pts:
	rebar = create_U_bylinepoints(pts,l_U,s1,zs_other,zs_top,zs_bottom,val_thickness,Dy_g)
TransactionManager.Instance.TransactionTaskDone()
#Назначьте вывод переменной OUT.
OUT = rebar
# ----------------------------------------
