# Dynamo graph AR_ROOMNUMBER TO explication of floors.dyn (Dynamo 2.0.4.12684)

# group: Параметры
retry = BoolSelector(true)  # graph input
тип_пола = StringInput("Тип пола")  # graph input
заполняемый_параметр = StringInput("Комментарии")  # graph input

тире = StringInput("-")  # graph input
разделитель = StringInput(";")  # graph input
pys_тип_пола_и_номера_помещений = Python(IN[0]=retry, IN[1]=тип_пола, IN[2]=заполняемый_параметр, IN[3]=тире, IN[4]=разделитель)  # "PyS Тип пола и Номера помещений в помещениях"; frozen
# ---------- pys_тип_пола_и_номера_помещений.python (229 lines) ----------
import clr
clr.AddReference('ProtoGeometry')
from Autodesk.DesignScript.Geometry import *
clr.AddReference('RevitAPI')
from Autodesk.Revit.DB import *
clr.AddReference("RevitServices")
import RevitServices
from RevitServices.Persistence import DocumentManager
from RevitServices.Transactions import TransactionManager	
doc = DocumentManager.Instance.CurrentDBDocument
rooms = FilteredElementCollector(doc).OfCategory(BuiltInCategory.OST_Rooms).WhereElementIsNotElementType().ToElements()
floor = FilteredElementCollector(doc).OfCategory(BuiltInCategory.OST_Floors).WhereElementIsNotElementType().ToElements()
#-----------ВХОДНЫЕ ДАННЫЕ------------------
par1=IN[1]
setpar=IN[2]
tire = "-"#IN[3]
zap = ";" #IN[4]
#----------ФУНКЦИИ------------------
def get3p(room):
	try:
		val1 = room.LookupParameter(par1).AsValueString()
	except:
		val1=""		
	if val1 is None:
		val1=""
	valob=val1
	return valob	
#----------СОРТИРОВКА ПОМЕЩЕНИЙ ПО НОМЕРУ--------------
r1=[]
list1=[]
for room in rooms:
	if room.Area>0:
		r1.append(room)
		num1=room.get_Parameter(BuiltInParameter.ROOM_NUMBER).AsString()
		num2=""
		num3=""
		num4=""
		num5=""
		num6=""
		if "." in num1:
			c1=num1.find(".")
			num2=num1[c1+1:]
			num1=num1[:c1]
			if "." in num2:
				c2=num2.find(".")
				num3=num2[c2+1:]
				num2=num2[:c2]
				if "." in num3:
					c3=num3.find(".")
					num4=num3[c3+1:]
					num3=num3[:c3]
					if "." in num4:
						c4=num4.find(".")
						num5=num4[c4+1:]
						num4=num4[:c4]
						if "." in num5:
							c5=num5.find(".")
							num6=num5[c5+1:]
							num5=num5[:c5]
		if num1!="":
			num1=int(float(num1))
		if num2!="":
			num2=int(float(num2))
		if num3!="":
			num3=int(float(num3))
		if num4!="":
			num4=int(float(num4))
		if num5!="":
			num5=int(float(num5))
		if num6!="":
			num6=int(float(num6))		
		list1.append([room,num1,num2,num3,num4,num5,num6])
		#list1.append(UnwrapElement(room).get_Parameter(BuiltInParameter.ROOM_NUMBER).AsString())
from operator import itemgetter
b = sorted(list1,key = itemgetter(1,2,3,4,5,6))
list2=[]
for b1 in b:
	nm1 = str(b1[1])
	if b1[2]!="":
		nm1=nm1+"."+str(b1[2])
	if b1[3]!="":
		nm1=nm1+"."+str(b1[3])		
	if b1[4]!="":
		nm1=nm1+"."+str(b1[4])
	if b1[5]!="":
		nm1=nm1+"."+str(b1[5])
	if b1[6]!="":
		nm1=nm1+"."+str(b1[6])		
	list2.append([b1[0],nm1])	
#---------------БЕРЕМ ПАРАМЕТРЫ-----------------------
uniq=[]
for room1 in list2:
	room = room1[0]
	valob = get3p(room)
	if valob not in uniq:
		uniq.append(valob)
numlist=[]
roomlist=[]
roomtxt=[]
for val in uniq:
	list=[]
	text=[]
	txt=""
	for room1 in list2:
		room=room1[0]
		num = room1[1]
		valob = get3p(room)
		if valob==val:
			list.append(room)
			text.append(num)
			txt=txt+num+zap
	roomtxt.append(txt[:len(txt)-1])		
	numlist.append(text)
	roomlist.append(list)
	
"""	
i=0
list3=[]
list4=[]
for num in numlist:
	i=0
	list5=[]
	for n in num:
		num1=n
		num2=""
		num3=""
		num4=""
		num5=""
		num6=""
		if "." in num1:
			c1=num1.find(".")
			num2=num1[c1+1:]
			num1=num1[:c1]
			if "." in num2:
				c2=num2.find(".")
				num3=num2[c2+1:]
				num2=num2[:c2]
				if "." in num3:
					c3=num3.find(".")
					num4=num3[c3+1:]
					num3=num3[:c3]
					if "." in num4:
						c4=num4.find(".")
						num5=num4[c4+1:]
						num4=num4[:c4]
						if "." in num5:
							c5=num5.find(".")
							num6=num5[c5+1:]
							num5=num5[:c5]
		if num1!="":
			num1=int(float(num1))
		if num2!="":
			num2=int(float(num2))
		if num3!="":
			num3=int(float(num3))
		if num4!="":
			num4=int(float(num4))
		if num5!="":
			num5=int(float(num5))
		if num6!="":
			num6=int(float(num6))		
		list5.append([num1,num2,num3,num4,num5,num6,n])


#---------Вносим в группы номера, идущие подряд-----------

	j=0
	gr=[]
	gr1=[]
	while j<list5.Count:
		if j==list5.Count-1:
			gr.append(list5[j][6])	
			gr1.append(gr)
		else:
			gr.append(list5[j][6])
			if list5[j][5]=="" and list5[j+1][5]=="":
				if list5[j][4]=="" and list5[j+1][4]=="":
					if list5[j][3]=="" and list5[j+1][3]=="":
						if list5[j][2]=="" and list5[j+1][2]=="":
							if list5[j][1]=="" and list5[j+1][1]=="":
								if list5[j][0]=="" and list5[j+1][0]=="":
									a=1
								else: 
									if list5[j][0]+1!=list5[j+1][0]:	
										gr1.append(gr)
										gr=[]
							else:
								if list5[j][1]+1!=list5[j+1][1] or list5[j][0]!=list5[j+1][0]:	
									gr1.append(gr)
									gr=[]	
						else:
							if list5[j][2]+1!=list5[j+1][2] or list5[j][1]!=list5[j+1][1] or list5[j][0]!=list5[j+1][0]:	
								gr1.append(gr)
								gr=[]			
					else:
						if list5[j][3]+1!=list5[j+1][3] or list5[j][2]!=list5[j+1][2] or list5[j][1]!=list5[j+1][1] or list5[j][0]!=list5[j+1][0]:	
							gr1.append(gr)
							gr=[]
				else:
					if list5[j][4]+1!=list5[j+1][4] or list5[j][3]!=list5[j+1][3] or list5[j][2]!=list5[j+1][2] or list5[j][1]!=list5[j+1][1] or list5[j][0]!=list5[j+1][0]:	
						gr1.append(gr)
						gr=[]	
			else:
				if list5[j][5]+1!=list5[j+1][5] or list5[j][4]!=list5[j+1][4] or list5[j][3]!=list5[j+1][3] or list5[j][2]!=list5[j+1][2] or list5[j][1]!=list5[j+1][1] or list5[j][0]!=list5[j+1][0]:	
					gr1.append(gr)
					gr=[]
		list3.append(gr1)					
		j=j+1
	txt=""
#--------------Добавляем запятые и тире, раскрывая группы в список-----	
	for gr1 in list3:
		for k in gr1:
			if k.Count==1:
				txt=txt+k[0]+zap
			elif k.Count==2:
				txt=txt+k[0]+zap+k[1]+zap
			elif k.Count>2:
				txt=k[0]+tire+k[k.Count-1]+zap	
	list4.append(txt[:len(txt)-1])
	i=i+1"""
TransactionManager.Instance.EnsureInTransaction(doc)
i=0
for rooms in roomlist:
	for room in rooms:
		room.LookupParameter(setpar).Set(roomtxt[i])
	i=i+1
TransactionManager.Instance.TransactionTaskDone()
	
OUT = roomlist
# ----------------------------------------

# group: Element collector by level ДОПИЛИТЬ НАДО
LINK = BoolSelector(true)  # graph input
link_name = StringInput("BI TOWER_AR_B1_WIP_R18")  # graph input
categories = Categories(index=435)  # graph input
levels = Levels()  # nothing selected; graph input
pyscr_elements_collector = Python(IN[0]=LINK, IN[1]=link_name, IN[2]=categories, IN[3]=levels)  # frozen
# ---------- pyscr_elements_collector.python (66 lines) ----------
# Default imports
import System
import clr
clr.AddReference('ProtoGeometry')
from Autodesk.DesignScript.Geometry import *

# Import RevitAPI
clr.AddReference("RevitAPI")
import Autodesk
from Autodesk.Revit.DB import *

# Import DocumentManager and TransactionManager
clr.AddReference("RevitServices")
import RevitServices
from RevitServices.Persistence import DocumentManager
from RevitServices.Transactions import TransactionManager

# Import ToDSType(bool) extension method
clr.AddReference("RevitNodes")
import Revit
clr.ImportExtensions(Revit.Elements)
clr.ImportExtensions(Revit.GeometryConversion)

#Import Collections
from System.Collections.Generic import *

#The inputs to this node will be stored as a list in the IN variable.
dataEnteringNode = IN

ToggleLink = IN[0]

Linkinstname = IN[1]

Category = IN[2]

levelInput = IN[3]

app =  DocumentManager.Instance.CurrentUIApplication.Application
doc = DocumentManager.Instance.CurrentDBDocument
linkInstances = Autodesk.Revit.DB.FilteredElementCollector(doc).OfClass(Autodesk.Revit.DB.RevitLinkInstance)
BuiltIn = System.Enum.ToObject(BuiltInCategory, Category.Id)


if ToggleLink == False:

	filter = ElementCategoryFilter(BuiltIn)
	Listelem = Autodesk.Revit.DB.FilteredElementCollector(doc).WherePasses(filter).WhereElementIsNotElementType().ToElements()
	levelFilter = ElementLevelFilter(UnwrapElement(levelInput).Id)
	logicalFilter = LogicalAndFilter(levelFilter, filter)
	OUT = FilteredElementCollector(doc).OfCategory(BuiltIn).WherePasses(logicalFilter).ToElements()
	
if ToggleLink == True:

	i = ()
	for i in linkInstances:
		if Linkinstname.ToLower() in i.Name.ToLower():
			linkDoc = i.GetLinkDocument()
			
	filter = ElementCategoryFilter(BuiltIn)			
	Listelem = FilteredElementCollector(linkDoc).WherePasses(filter).ToElements()
	#levelFilter = ElementLevelFilter(UnwrapElement(levelInput).Id)
	#logicalFilter = LogicalAndFilter(levelFilter, filter)
	OUT = FilteredElementCollector(linkDoc).OfCategory(BuiltIn).WherePasses(filter).ToElements()
	
	# Level filter does not work?
	
# ----------------------------------------

# group: Room collector by level
LINK_2 = BoolSelector(true)  # graph input
link_name_2 = StringInput("BI TOWER_AR_B1_WIP_R18")  # graph input
levels_2 = Levels()  # nothing selected; graph input
pyscr_room_collector = Python(IN[0]=LINK_2, IN[1]=link_name_2, IN[2]=levels_2)  # frozen
# ---------- pyscr_room_collector.python (95 lines) ----------
# Default imports
import System
import clr
clr.AddReference('ProtoGeometry')
from Autodesk.DesignScript.Geometry import *

# Import RevitAPI
clr.AddReference("RevitAPI")
import Autodesk
from Autodesk.Revit.DB import *

# Import DocumentManager and TransactionManager
clr.AddReference("RevitServices")
import RevitServices
from RevitServices.Persistence import DocumentManager
from RevitServices.Transactions import TransactionManager

# Import ToDSType(bool) extension method
clr.AddReference("RevitNodes")
import Revit
clr.ImportExtensions(Revit.Elements)
clr.ImportExtensions(Revit.GeometryConversion)

#Import Collections
from System.Collections.Generic import *

#The inputs to this node will be stored as a list in the IN variable.
dataEnteringNode = IN

ToggleLink = IN[0]

Linkinstname = IN[1]

levelInput = IN[2]

app =  DocumentManager.Instance.CurrentUIApplication.Application
linkInstances = Autodesk.Revit.DB.FilteredElementCollector(DocumentManager.Instance.CurrentDBDocument).OfClass(Autodesk.Revit.DB.RevitLinkInstance)

if ToggleLink == False:

	selectDOC = DocumentManager.Instance.CurrentDBDocument
	levelFilter = ElementLevelFilter(UnwrapElement(levelInput).Id)
		
if ToggleLink == True:

	i = ()
	for i in linkInstances:
		if Linkinstname.ToLower() in i.Name.ToLower():
			selectDOC = i.GetLinkDocument()
	
	bipELEV = BuiltInParameter.LEVEL_ELEV
	LevelElev = UnwrapElement(levelInput).get_Parameter(bipELEV).AsDouble()
			
	ruleValDb = LevelElev
	pvp = ParameterValueProvider(ElementId(bipELEV))
	fnrv = FilterNumericEquals()
	levelparamfilter = ElementParameterFilter(FilterDoubleRule(pvp, fnrv, ruleValDb, 10.-3))
	levels = FilteredElementCollector(selectDOC).OfClass(Level)
	Levelcollect = FilteredElementCollector(selectDOC).OfClass(Level).WherePasses(levelparamfilter).FirstElement()
	levelFilter = ElementLevelFilter(Levelcollect.Id)


################################################# FIND VALID ROOMS ############################################

collector = FilteredElementCollector(selectDOC)

areaFilter = AreaFilter()
areaExcludes = collector.WherePasses(areaFilter).ToElements()
areaExcludes = list(areaExcludes)
element_set = ElementSet()
excludes = List[ElementId]()
if len(areaExcludes) == 0:
	logicalFilter = levelFilter
else:
	for i in areaExcludes:
		element_set.Insert(i)
		elemIter = element_set.ForwardIterator()
		elemIter.Reset()
		while elemIter.MoveNext():
			curElem = elemIter.Current
			excludes.Add(curElem.Id)
	filter = ExclusionFilter(excludes)
	logicalFilter = LogicalAndFilter(levelFilter, filter)


allRoomsOnLevel = FilteredElementCollector(selectDOC).OfClass(Autodesk.Revit.DB.SpatialElement).WherePasses(logicalFilter).ToElements()
validRooms = []
RoomlevelName = []

for i in allRoomsOnLevel:
	if i.Area != 0:
		validRooms.append(UnwrapElement(i))
		RoomlevelName.append(i.Level)

OUT = validRooms
# ----------------------------------------

categories_2 = Categories(index=451)  # graph input
all_elements_of_category = ElementsOfCategory(Category=categories_2)
