# Dynamo graph CurtainGenerators.dyn (Dynamo 1.2.0.2690)

# group: USER INPUTS
code_block = CodeBlock()
# ---------- code_block.designscript (4 lines) ----------
//vertical pattern
{10,2,3};
//horizontal pattern
{5,2,8};
# ----------------------------------------
select_model_element = DSModelElementSelection()  # 1 picked in the model
# note: Packages:  ReAnimation and Spring Nodes
# Instructions:
# - Select a Curtain Wall in Revit
# - Select the Horizontal and Vertical Alignment Style
# - Select the Curtain Panel Tag and the and an Elevation View
# - Switch back and forth the Redraw toggle upon any input change to rebuild curtain wall;  True: Removes all Grid, False: Redraw the Grids
toggle = BoolSelector(false)
horizontal_alignment_style = HorizontalAlignmentStyleUI("Right")
vertical_alignment_style = VerticalAlignmentStyleUI("Bottom")
family_types = FamilyTypes("Curtain Panel Tag:Curtain Panel Tag")
views = Views("South")

# group: GET WALL GEOMETRY BOUNDARIES
code_block_2 = CodeBlock { "Length"; }
getParameterValueByName = Element.GetParameterValueByName(element=select_model_element, parameterName=code_block_2)
boundingBox = Geometry.BoundingBox(select_model_element)
toCuboid = BoundingBox.ToCuboid(boundingBox)
height = Cuboid.Height(toCuboid)
create = List.Create(getParameterValueByName, height)

# group: LIST OF PATTERNS ALONG THE WALL GEOMETRY
create_2 = List.Create(code_block.out0, code_block.out1)
code_block_3 = CodeBlock(len=create, input=create_2) { len/Math.Sum(input); }
cycle = List.Cycle(list=create_2, amount=code_block_3, lacing=Longest)
# note: Reanimation
incremental_addition = Custom[Incremental Addition](Numbers=cycle)  # Steps through a list of numbers and adds the previous sum to the current number
le = incremental_addition <= create
filterByBoolMask = List.FilterByBoolMask(list=incremental_addition, mask=le)
code_block_4 = CodeBlock { 0; }
addItemToFront = List.AddItemToFront(item=code_block_4, list=filterByBoolMask.in@L2)

# group: RESIDUAL PANELS
lastItem = List.LastItem(addItemToFront@L2)
residual_length = CodeBlock(length=create, last=lastItem, list=addItemToFront) { r=(length-last); r2=(length-last)/2; list+r2; }

# group: JUSTIFICATION PATTERN OPTIONS
code_block_5 = CodeBlock(x=filterByBoolMask.in)
# ---------- code_block_5.designscript (4 lines) ----------
//left
x[0];
//bottom
x[1];
# ----------------------------------------
code_block_6 = CodeBlock(x=residual_length.out2)
# ---------- code_block_6.designscript (4 lines) ----------
//center
x[0];
//middle
x[1];
# ----------------------------------------
code_block_7 = CodeBlock(len=create, list=addItemToFront) { len-list; }
reverse = List.Reverse(code_block_7@L2)
code_block_8 = CodeBlock(x=reverse)
# ---------- code_block_8.designscript (4 lines) ----------
//right
x[0];
//top
x[1];
# ----------------------------------------
create_3 = List.Create(code_block_5.out0, code_block_6.out0, code_block_8.out0)
create_4 = List.Create(code_block_5.out1, code_block_6.out1, code_block_8.out1)

# group: JUSTIFICATION PATTERN
boolean = BoolSelector(false)
create_5 = List.Create(boolean, boolean, boolean)
create_6 = List.Create(create_5, create_5)
code_block_9 = CodeBlock { {"Left", "Center", "Right"}; {"Bottom", "Middle", "Top"}; }
create_7 = List.Create(code_block_9.out0, code_block_9.out1)
create_8 = List.Create(horizontal_alignment_style, vertical_alignment_style)
code_block_10 = CodeBlock(i=create_7, alignment=create_8) { i==alignment?true:false; }
if_ = If(test=toggle, true=create_6, false=code_block_10)

# group: CREATE CURTAIN GRIDS
code_block_11 = CodeBlock(X=if_) { X[0]; X[1]; }
filterByBoolMask_2 = List.FilterByBoolMask(list=create_3, mask=code_block_11.out0)
flatten = Flatten(filterByBoolMask_2.in)
filterByBoolMask_3 = List.FilterByBoolMask(list=create_4, mask=code_block_11.out1)
flatten_2 = Flatten(filterByBoolMask_3.in)
identity = Object.Identity(select_model_element)
# note: ReAnimation,  Edited.  Removed the Output
create_curtain_grids = Custom[Create Curtain Grids](CurtainWalls=identity, HorizSpacing=flatten_2, VertSpacing=flatten)  # Generates curtain grid lines on selected curtainwalls - starts horizontally from bottom and vertically from beginning of panel(s)

python_script = Python(IN[0]=select_model_element)
# ---------- python_script.python (10 lines) ----------
import clr
clr.AddReference("RevitServices")
import RevitServices
from RevitServices.Persistence import DocumentManager
doc = DocumentManager.Instance.CurrentDBDocument

cWall = UnwrapElement(IN[0])
OUT = []
for id1 in cWall.CurtainGrid.GetUGridLineIds():
	OUT.append(doc.GetElement(id1))
# ----------------------------------------
python_script_2 = Python(IN[0]=select_model_element)
# ---------- python_script_2.python (10 lines) ----------
import clr
clr.AddReference("RevitServices")
import RevitServices
from RevitServices.Persistence import DocumentManager
doc = DocumentManager.Instance.CurrentDBDocument

cWall = UnwrapElement(IN[0])
OUT = []
for id1 in cWall.CurtainGrid.GetVGridLineIds():
	OUT.append(doc.GetElement(id1))
# ----------------------------------------
create_9 = List.Create(python_script, python_script_2)
flatten_3 = Flatten(create_9)

# group: DELETE GRIDS
create_10 = List.Create(flatten, flatten_2)
isEmpty = List.IsEmpty()  # unwired: arg0
trueForAny = TrueForAny(create_10, isEmpty)
boolean_2 = BoolSelector(false)
if_2 = If(test=trueForAny, true=flatten_3, false=boolean_2)
boolean_3 = BoolSelector(true)
# note: Spring Nodes
deleteElements = Custom[Springs.Doc.DeleteElements](element=if_2, confirm=boolean_3)  # Attempts to delete the input list of elements from the active Revit document.The node returns the number of successfully deleted elements and their Ids as a string. Carefully observe the deleted elements count. It may be greater than the input list because hosted elements or tags will be deleted as well. If an element in the list can not be deleted (for example last revision or last view), the whole list will fail to be deleted.

end = Revit.Transaction.Transaction.End(create_curtain_grids)

# group: ASSIGN COLOR OVERRIDES TO CURTAIN PANELS OF DIFFERENT AREAS
byElement = CurtainPanel.ByElement()  # unwired: arg0
compose = ComposeFunctions(byElement, end)  # "Function.Compose"
apply = ApplyFunction(compose, select_model_element)  # "Function.Apply"
lastItem_2 = List.LastItem(apply)
code_block_12 = CodeBlock { "Area"; }
getParameterValueByName_2 = Element.GetParameterValueByName(element=lastItem_2, parameterName=code_block_12)
code_block_13 = CodeBlock { 0; }
gt = getParameterValueByName_2 > code_block_13
# note: Lunchbox
code_block_14 = CodeBlock { false; }
replaceNulls = Lists.Manage.ReplaceNulls(gt, code_block_14)
filterByBoolMask_4 = List.FilterByBoolMask(list=lastItem_2, mask=replaceNulls)
filterByBoolMask_5 = List.FilterByBoolMask(list=getParameterValueByName_2, mask=replaceNulls)

code_block_15 = CodeBlock { 4; }
round = Math.Round(number=filterByBoolMask_5.in, digits=code_block_15)

# group (continued): ASSIGN COLOR OVERRIDES TO CURTAIN PANELS OF DIFFERENT AREAS
uniqueItems = List.UniqueItems(round)
count = Count(uniqueItems)
randomList = Math.RandomList(count)
color_range = ColorRange(arg2=randomList)  # unwired: arg0, arg1
byKeysValues = Custom[Springs.Dictionary.ByKeysValues](keys=uniqueItems, values=color_range, searchKeys=round)  # Dictionaries are an incredibly powerful tool for making associative sets between two equal length lists. The first list must be of unique strings (or numbers) and will be the key and the second list will be the matching values (it can be made up of geometry, elements, even other lists) The search keys list will provide the corresponding value to the input key.
overrideColorInView = Element.OverrideColorInView(element=filterByBoolMask_4.in, color=byKeysValues)

# group: TAG PANELS
boundaries = CurtainPanel.Boundaries(filterByBoolMask_4.in)
deconstructPolyCurve = Geometry.Curves.DeconstructPolyCurve(boundaries@L1)
byPoints = Polygon.ByPoints(deconstructPolyCurve.out1)
center = Polygon.Center(byPoints)
code_block_16 = CodeBlock { "Mark"; }
code_block_17 = CodeBlock { "A".."Z"; }
add = code_block_17 + code_block_17  # lacing=CrossProduct
create_11 = List.Create(code_block_17, add)
flatten_4 = Flatten(create_11)
takeItems = List.TakeItems(list=flatten_4, amount=count)
# note: Springs Nodes
byKeysValues_2 = Custom[Springs.Dictionary.ByKeysValues](keys=uniqueItems, values=takeItems, searchKeys=round)
setParameterByName = Element.SetParameterByName(element=filterByBoolMask_4.in, parameterName=code_block_16, value=byKeysValues_2)
boolean_4 = BoolSelector(true)
# note: Archi-Lab
create_annotation_tag = Custom[Create Annotation Tag](TagLocations=center, TagType=family_types, Elements=setParameterByName, Views=views, RunIt=boolean_4)  # This node will create an annotation tag at a given location, of given type and in a supplied view. If only single view is supplied then all tags will be created in that view.
