# Dynamo graph Dynamo#25 Razvertka.dyn (Dynamo 0.9.0.3067)

# group: 1. Получение геометрии
forceChildrensEval = ForceChildrensEval()
on_off = BoolSelector(true)
select_model_element = DSModelElementSelection()  # 1 picked in the model
pys_get_geometry = Python(IN[0]=forceChildrensEval, IN[1]=on_off, IN[2]=select_model_element)
# ---------- pys_get_geometry.python (14 lines) ----------
reset = IN[0]
if IN[1] != True: off = 1/0

import clr

clr.AddReference("RevitAPI")
from Autodesk.Revit.DB import *

elem = UnwrapElement(IN[2])

opt = Options()
geo = elem.get_Geometry(opt)

OUT = [i for i in geo][0]
# ----------------------------------------

# group: 2. Создание эскизов развертки
forceChildrensEval_2 = ForceChildrensEval()
on_off_2 = BoolSelector(true)
pys_roof_surface_scan = Python(IN[0]=forceChildrensEval_2, IN[1]=on_off_2, IN[2]=pys_get_geometry)
# ---------- pys_roof_surface_scan.python (121 lines) ----------
# Roof Surface Scan
# ©2016, Khasan Mamaev
# www.dynamobim.ru

reset = IN[0]
if IN[1] != True: off = 1/0

import clr
clr.AddReference('ProtoGeometry')
import Autodesk
from Autodesk.DesignScript.Geometry import *

DPoint = Autodesk.DesignScript.Geometry.Point
DSurface = Autodesk.DesignScript.Geometry.Surface
DLine = Autodesk.DesignScript.Geometry.Line
DPlane = Autodesk.DesignScript.Geometry.Plane

clr.AddReference("RevitAPI")
from Autodesk.Revit.DB import *

clr.AddReference('DSCoreNodes')
import DSCore
from DSCore import *

clr.AddReference("RevitNodes")
import Revit
clr.ImportExtensions(Revit.Elements)
clr.ImportExtensions(Revit.GeometryConversion)

faces = IN[2].Faces

сurveLo = []
vectors = []
for i in faces:
	if i.FaceNormal.Z >0:
		сurveLo.append(i.GetEdgesAsCurveLoops())
		vectors.append([i.Normal.ToVector(), i.Origin.ToPoint()])
		
сurveLo = [i[0] for i in сurveLo]

pps = []
lins = []
for i in сurveLo:
	gg = []
	hh = []
	for j in i:
		gg.append(j.ToProtoType().StartPoint)
		gg.append(j.ToProtoType().EndPoint)
		hh.append(j.ToProtoType())
	pps.append(gg)
	lins.append(hh)

def RotaVec(el,vec,pt):
	zVec = Vector.ZAxis()
	angl = zVec.AngleBetween(vec)
	crosVec = vec.Cross(zVec)
	return el.Rotate(pt,crosVec,angl)

def PtRnd(p):
	n = 6
	pt = DPoint.ByCoordinates(round(float(p.X),n),round(float(p.Y),n),round(float(p.Z),n))
	return pt

pts = []
for i in pps:
	ss = []
	for j in i:
		ss.append(PtRnd(j))
	pts.append(ss)

rotLins = []
for i,j in enumerate(lins):
	bb = []
	for x in j:
		bb.append(RotaVec(x,vectors[i][0],vectors[i][1]))
	rotLins.append(bb)

ontoPlan = []
bBox = []
for i in rotLins:
	kk = []
	for j in i:
		kk.append(j.PullOntoPlane(DPlane.XY()))
	ontoPlan.append(PolyCurve.ByJoinedCurves(kk))
	bBox.append(BoundingBox.ByGeometry(PolyCurve.ByJoinedCurves(kk)))

def pt3(p1,p2):
	return DPoint.ByCoordinates(p2.X,p1.Y,p2.Z)

def delt(p1,p2):
	return [p1.X-p2.X, p1.Y-p2.Y]

def listSum(lis):
	su = []
	for i,k in enumerate(lis):
		a=[]
		for j in range(i):
			a.append(lis[j])
		su.append(sum(a))
	return su

bBoxPt = []
for i in bBox:
	bBoxPt.append([i.MinPoint, pt3(i.MinPoint,i.MaxPoint)])

lents = [abs(delt(i[0],i[1])[0]) for i in bBoxPt]

lentsDel = [i+0.2*lents[0] for i in lents]

xSum = listSum(lentsDel)

yDelt = [delt(bBoxPt[0][0],i[0])[1] for i in bBoxPt]

xDelt = [delt(bBoxPt[0][0],i[0])[0]+xSum[k] for k,i in enumerate(bBoxPt)]


series = []
for i,k in enumerate(ontoPlan): 
	series.append(k.Translate(xDelt[i],yDelt[i],0))

OUT = series
# ----------------------------------------
explode = Geometry.Explode(pys_roof_surface_scan)

# group: 3. Построение в Revit цветовых областей по эскизам развертки
forceChildrensEval_3 = ForceChildrensEval()
on_off_3 = BoolSelector(true)
pys_create_detail_filled_region = Python(IN[0]=forceChildrensEval_3, IN[1]=on_off_3, IN[2]=explode)
# ---------- pys_create_detail_filled_region.python (59 lines) ----------
# Create Detail Filled Region
# ©2016, Khasan Mamaev
# www.dynamobim.ru

reset = IN[0]
if IN[1] != True: off = 1/0

import clr 

clr.AddReference("RevitServices")
import RevitServices
from RevitServices.Persistence import DocumentManager
from RevitServices.Transactions import TransactionManager
doc = DocumentManager.Instance.CurrentDBDocument

clr.AddReference("RevitAPI")
import Autodesk
from Autodesk.Revit.DB import *

clr.AddReference("RevitNodes")
import Revit
clr.ImportExtensions(Revit.GeometryConversion)

clr.AddReference("System")
import System
from System.Collections.Generic import List

curves1 = IN[2]

fec = FilteredElementCollector(doc).OfClass(ViewFamilyType).ToElements()
vDraft = FilteredElementCollector(doc).OfClass(ViewDrafting).ToElements()
fecIds = FilteredElementCollector(doc).OfClass(ViewFamilyType).ToElementIds()
fillR = FilteredElementCollector(doc).OfClass(FilledRegionType)

ff = [i for i in fillR][0]

vv = [i for i in fec if i.FamilyName == "Чертежный вид"]

vdd = [i for i in vDraft if i.Name == "Развертка крыши"]

cLoo2 = []
for n in curves1:
	cc = List[Curve]()
	for j in n:
		cc.Add(j.ToRevitType())
	cLoop = CurveLoop.Create(cc)
	curveLoops = List[CurveLoop]()
	curveLoops.Add(cLoop)
	cLoo2.append(curveLoops)

viewId = doc.ActiveView.Id

TransactionManager.Instance.EnsureInTransaction(doc)

Fill = [FilledRegion.Create(doc, ff.Id, vdd[0].Id, i) for i in cLoo2]

TransactionManager.Instance.TransactionTaskDone()

OUT = Fill
# ----------------------------------------
