# Dynamo graph Element - Pre-Delete.dyn (Dynamo 1.3.2.2480)

# group: Toggle to Refresh Selection
refresh = BoolSelector(false)

# group: Pre-Deletes Element
python_script = Python(IN[0]=refresh)
# ---------- python_script.python (62 lines) ----------
import clr
import sys
sys.path.append('C:\Program Files (x86)\IronPython 2.7\Lib')
import System
from System import Array
from System.Collections.Generic import *

clr.AddReference('ProtoGeometry')
from Autodesk.DesignScript.Geometry import *

clr.AddReference("RevitNodes")
import Revit
clr.ImportExtensions(Revit.Elements)

clr.ImportExtensions(Revit.GeometryConversion)

clr.AddReference("RevitServices")
import RevitServices
from RevitServices.Persistence import DocumentManager
from RevitServices.Transactions import TransactionManager
from System.Collections.Generic import *

clr.AddReference("RevitAPI")
clr.AddReference("RevitAPIUI")
import Autodesk
from Autodesk.Revit.DB import *
from Autodesk.Revit.DB import Transaction
from Autodesk.Revit.UI.Selection import *

doc = DocumentManager.Instance.CurrentDBDocument
uiapp = DocumentManager.Instance.CurrentUIApplication
uidoc = uiapp.ActiveUIDocument
app = uiapp.Application

refresh = IN[0]
element_ids = []
elements = []

if refresh == True or refresh == False:
	selection = uidoc.Selection
	reference = selection.PickObject(ObjectType.Element, "Select Element to Delete")
	
	deleted_ids = list([ElementId])
	
	#We begin, then roll-back the transaction
	t = Transaction(doc, 'Name')
	t.Start()
	deleted_ids = doc.Delete(reference.ElementId)
	t.RollBack()
	
	if not t.HasEnded:
		t.Dispose()	
	string = "Object Selected: {}".format(reference.ElementId)

#Formatting a list of Element IDs the way Revit accepts them
for id in deleted_ids:
	element_ids.append(id.ToString())

for deleted_id in deleted_ids:
	elements.append(doc.GetElement(deleted_id))

OUT = string, elements, ";".join(element_ids)
# ----------------------------------------
code_block = CodeBlock(x=python_script) { x[0]; x[1]; x[2]; }

# group: Formatted Element ID List
# note: This list is pre-formatted to enable easy transferral to Revit's 'Select By ID' tool.
watch = Watch(code_block.out2)

# group: Selected Element Id
watch_2 = Watch(code_block.out0)

# group: Elements which would be deleted
# note: Any elements which would be deleted, if you deleted the selected element.
watch_3 = Watch(code_block.out1)
