# Dynamo graph Floor from Room.dyn (Dynamo 1.3.1.1736)

project_delivery_logo = Custom[Project Delivery Logo]()
code_block = CodeBlock { "Make it Rain!"; "Stop the madness!"; }
code_block_2 = CodeBlock { "Click FINISH after selecting Rooms"; "Select Roof-as-Floor"; }
categories = Categories("Rooms")
ui_selectmodelelements_data = Custom[UI.SelectModelElements Data](InputName=code_block_2.out0, CategoryFilter=categories)  # Creates a Revit element selection input for UI.MultipleInputForm++ . Check out www.data-shapes.net for more infos!
element_types = ElementTypes("RoofType")
all_elements_of_type = ElementsOfType(element_types)
name = Element.Name(all_elements_of_type)
code_block_3 = CodeBlock { "INT FIN"; }
startsWith = String.StartsWith(str=name, searchFor=code_block_3)
filterByBoolMask = List.FilterByBoolMask(list=name, mask=startsWith)
filterByBoolMask_2 = List.FilterByBoolMask(list=all_elements_of_type, mask=startsWith)
code_block_4 = CodeBlock { 0; }
ui_dropdown_data = Custom[UI.DropDown Data](InputName=code_block_2.out1, Keys=filterByBoolMask.in, Values=filterByBoolMask_2.in, DefaultValueIndex=code_block_4)  # Create data for DropDown input in UI.MultiInputForm ++ . Check out www.data-shapes.net for more infos.
join = List.Join(ui_selectmodelelements_data, ui_dropdown_data)
boolean = BoolSelector(true)
ui_multipleinputform = Custom[UI.MultipleInputForm ++](Logo_optional=project_delivery_logo, ButtonText_optional=code_block.out0, Inputs=join, Toggle=boolean, CancelButtonText_optional=code_block.out1)  # Create a form with multiple inputs. see www.data-shapes.net for tutorials and infos!
flatten = Flatten(ui_multipleinputform.User_Inputs)
dropLastItem = Custom[List.DropLastItem](list=flatten)  # Drops the last item from a given list.
code_block_5 = CodeBlock(rooms=dropLastItem) { rooms; }
room_location_centering = Custom[Room Location Centering](Rooms=code_block_5)  # Move room location point to its centroid. If centroid is located outside the room, location point stays at its origin coords. It's a good tool for auto-tagging.
finishBoundary = Room.FinishBoundary(code_block_5)
group_curves = Custom[Group Curves](Curves=finishBoundary@@L2)  # This node will take any input of flat list of curves and group them into sublists containing "joinable" curves that is continous curves. They might form closed curves or open curves. Use PolyCurve.ByJoinedCurves to convert output groups of curves into single PolyCurves
remove_overlapping_lines_from = Custom[Remove Overlapping Lines from Curve Network](curve_network=group_curves@@L2)
merge_collinear_in_grouped = Custom[Merge Collinear in Grouped Curves](grouped_curves=remove_overlapping_lines_from@@L2)
flatten_2 = Flatten(merge_collinear_in_grouped@@L3)
group_curves_2 = Custom[Group Curves](Curves=merge_collinear_in_grouped@@L2)
length = Curve.Length(group_curves_2)
sum = Math.Sum(length@@L2)
flatten_3 = Flatten(sum@L3)
maximumItem = List.MaximumItem(flatten_3)
eq = flatten_3 == maximumItem
filterByBoolMask_3 = List.FilterByBoolMask(list=group_curves_2@@L4, mask=eq@L2)
byJoinedCurves = PolyCurve.ByJoinedCurves(filterByBoolMask_3.in)
flatten_4 = Flatten(byJoinedCurves)
isNull = Object.IsNull(flatten_4)
rooms = List.FilterByBoolMask(list=code_block_5, mask=isNull)
flatten_5 = Flatten(rooms.out)
boolean_2 = BoolSelector(true)
activeView = Custom[Springs.Doc.ActiveView](refresh=boolean_2)  # Selects the current document's active view. Supports more view types than the built-in option. Will be depreciated once the bult in node works with all plan types.
phase = Custom[View.Phase](view=activeView)  # Returns the phase of a given view
doors = Custom[Room.Doors](room=flatten_5, phase=phase)  # Retrieves all doors that are associated with a room (hosted in walls and roofs).
nestedFamily = Custom[Get.NestedFamily](Elements=doors@@L2)  # This node uses the SuperComponent and SubComponets properties of Revit API to organize the elements into lists based on there make-up. I haven't tested multiple nested families but have found it helpfull esp. on Doors, Plumbing Fixtures, & Casework to find out which family is nested in which parent
isEmpty = List.IsEmpty(nestedFamily.Parent_Family@L2)
filterByBoolMask_4 = List.FilterByBoolMask(list=flatten_2, mask=isEmpty)
firstItem = List.FirstItem(flatten_5)
level = Custom[Element.Level](element=firstItem)  # Gets an element's level
plane = Custom[Level.Plane](level=level)  # Retrieves the plane of a given level
pullOntoPlane = Curve.PullOntoPlane(curve=filterByBoolMask_4.out, plane=plane)
code_block_6 = CodeBlock(data=pullOntoPlane) { data; }
length_2 = Curve.Length(code_block_6)
sum_2 = Math.Sum(length_2)
flatten_6 = Flatten(sum_2@@L3)
maximumItem_2 = List.MaximumItem(flatten_6@@L2)
eq_2 = flatten_6 == maximumItem_2
filterByBoolMask_5 = List.FilterByBoolMask(list=code_block_6, mask=eq_2)
flatten_7 = Flatten(filterByBoolMask_5.in@L2)
flatten_8 = Flatten(code_block_6@@L4)
filterByBoolMask_6 = List.FilterByBoolMask(list=nestedFamily.Parent_Family, mask=isEmpty)
turnIntoList = Custom[TurnIntoList](unknownItem=filterByBoolMask_6.out@@L1)  # Turns an element (or a nested list) into a flat list
nestedFamily_2 = Custom[Get.NestedFamily](Elements=turnIntoList@@L2)
familyName = Custom[Get.FamilyName](Elements=nestedFamily_2.Nested_Family@@L2)  # Get the Famiily Name of an Element
code_block_7 = CodeBlock { "L"; }
startsWith_2 = String.StartsWith(str=familyName, searchFor=code_block_7)
allFalse = AllFalse(startsWith_2@@L2)
filterByBoolMask_7 = List.FilterByBoolMask(list=nestedFamily_2.Parent_Family, mask=allFalse)
watch = Watch(filterByBoolMask_7.out)
removeEmpty = Custom[List.RemoveEmpty](list=filterByBoolMask_7.in)  # Removes empty indices from a list.

# group: Doors w/ Default Leaf Solids
solids = Element.Solids(removeEmpty@@L2)
flatten_9 = Flatten(solids@@L2)
isNull_2 = Object.IsNull(flatten_9)
filterByBoolMask_8 = List.FilterByBoolMask(list=flatten_9, mask=isNull_2)
volume = Solid.Volume(filterByBoolMask_8.out@@L2)
maximumItem_3 = List.MaximumItem(volume@@L2)
eq_3 = volume == maximumItem_3
filterByBoolMask_9 = List.FilterByBoolMask(list=filterByBoolMask_8.out@@L2, mask=eq_3@L2)
flatten_10 = Flatten(filterByBoolMask_9.in@@L3)
byUnion = Solid.ByUnion(flatten_10)
bySolid = PolySurface.BySolid(byUnion)

# group: Geometric Center of Doors w/ Default Leaf at Level
surfaces = PolySurface.Surfaces(bySolid)
filterByOrientation = Custom[Surface.FilterByOrientation](surfaces=surfaces)  # Sorts surfaces in three lists based on their orientation (vertical, horizontal up & horizontal down) and also returns three corresponding lists of booleans.
flatten_11 = Flatten(filterByOrientation.horizontalDown@@L2)
area = Surface.Area(flatten_11)
maximumItem_4 = List.MaximumItem(area)
eq_4 = area == maximumItem_4
filterByBoolMask_10 = List.FilterByBoolMask(list=filterByOrientation.horizontalDown, mask=eq_4)
flatten_12 = Flatten(filterByBoolMask_10.in@@L2)
code_block_8 = CodeBlock { 0.5; }
pointAtParameter = Surface.PointAtParameter(surface=flatten_12, u=code_block_8, v=code_block_8)
pullOntoPlane_2 = Custom[Springs.Point.PullOntoPlane](point=pointAtParameter, plane=plane)  # Pulls (projects) the point onto the input plane, following the plane normal.
average = Custom[Point.Average](points=pullOntoPlane_2)  # Determines the average of a list of points

watch_2 = Watch(filterByBoolMask_7.in)
isEmpty_2 = List.IsEmpty(watch_2@L3)
code_block_9 = CodeBlock { true; false; }
allIndicesOf = List.AllIndicesOf(list=isEmpty_2, item=code_block_9.out1)
create = List.Create(average, allIndicesOf)
flatten_13 = Flatten(average)
isNull_3 = Object.IsNull(flatten_13)
turnIntoList_2 = Custom[TurnIntoList](unknownItem=isNull_3)
allTrue = AllTrue(turnIntoList_2)
code_block_10 = CodeBlock { 0; 1; }
if_ = If(test=allTrue, true=code_block_10.out0, false=code_block_10.out1)
getItemAtIndex = List.GetItemAtIndex(list=create, index=if_)
code_block_11 = CodeBlock(watch, getItemAtIndex, average)
# ---------- code_block_11.designscript (16 lines) ----------
MulRep(lst,idx,itm);

def MulRep(lst:var[]..[],
idx:var[]..[],itm:var[]..[])
{
return=[Imperative]
 {
 c=0;
 for (i in idx)
  {
  lst[i]=itm[c];
  c=c+1;
  }
 return=lst;
 }
};
# ----------------------------------------
isEmpty_3 = List.IsEmpty(watch@L3)
allIndicesOf_2 = List.AllIndicesOf(list=isEmpty_3, item=code_block_9.out1)
# note: In = Custom Leaf
filterByBoolMask_11 = List.FilterByBoolMask(list=nestedFamily_2.Nested_Family, mask=startsWith_2)
isEmpty_4 = List.IsEmpty(filterByBoolMask_11.in@@L2)
# note: Out = Custom Leaf
filterByBoolMask_12 = List.FilterByBoolMask(list=filterByBoolMask_11.in@@L3, mask=isEmpty_4@L2)
removeEmpty_2 = Custom[List.RemoveEmpty](list=filterByBoolMask_12.out)

# group: Custom Leaf Solids
solids_2 = Element.Solids(removeEmpty_2@@L2)
flatten_14 = Flatten(solids_2@@L2)
isNull_4 = Object.IsNull(flatten_14)
filterByBoolMask_13 = List.FilterByBoolMask(list=flatten_14, mask=isNull_4)
volume_2 = Solid.Volume(filterByBoolMask_13.out@@L2)
maximumItem_5 = List.MaximumItem(volume_2@@L2)
eq_5 = volume_2 == maximumItem_5
filterByBoolMask_14 = List.FilterByBoolMask(list=filterByBoolMask_13.out@@L2, mask=eq_5@L2)
flatten_15 = Flatten(filterByBoolMask_14.in@@L3)
byUnion_2 = Solid.ByUnion(flatten_15)
bySolid_2 = PolySurface.BySolid(byUnion_2)

# group: Geometric Center of Custom Leaf at Level
surfaces_2 = PolySurface.Surfaces(bySolid_2)
filterByOrientation_2 = Custom[Surface.FilterByOrientation](surfaces=surfaces_2)
flatten_16 = Flatten(filterByOrientation_2.horizontalDown@@L2)
area_2 = Surface.Area(flatten_16)
maximumItem_6 = List.MaximumItem(area_2)
eq_6 = area_2 == maximumItem_6
filterByBoolMask_15 = List.FilterByBoolMask(list=filterByOrientation_2.horizontalDown, mask=eq_6)
flatten_17 = Flatten(filterByBoolMask_15.in@@L2)
code_block_12 = CodeBlock { 0.5; }
pointAtParameter_2 = Surface.PointAtParameter(surface=flatten_17, u=code_block_12, v=code_block_12)
pullOntoPlane_3 = Custom[Springs.Point.PullOntoPlane](point=pointAtParameter_2, plane=plane)
average_2 = Custom[Point.Average](points=pullOntoPlane_3)

code_block_13 = CodeBlock(watch_2, allIndicesOf_2, average_2)  # same code as code_block_11
create_2 = List.Create(code_block_11, code_block_13)
transpose = List.Transpose(create_2)
flatten_18 = Flatten(transpose@@L3)
string_from_object = FromObject(flatten_18)
code_block_14 = CodeBlock { "Point"; }
startsWith_3 = String.StartsWith(str=string_from_object, searchFor=code_block_14)
filterByBoolMask_16 = List.FilterByBoolMask(list=flatten_18, mask=startsWith_3)
flatten_19 = Flatten(filterByBoolMask_16.in@@L3)
removeEmpty_3 = Custom[List.RemoveEmpty](list=flatten_19@L2)
closestTo = Custom[Geometry.ClosestTo](geometry=flatten_8@@L2, other=removeEmpty_3@L2)  # Finds the closest entity in a list of geometric entities from another given entity
flatten_20 = Flatten(closestTo.ClosestObject@@L3)
containsItem = List.ContainsItem(list=filterByBoolMask_5.in@@L2, item=flatten_20@L2)
filterByBoolMask_17 = List.FilterByBoolMask(list=flatten_20@@L2, mask=containsItem@L2)
flatten_21 = Flatten(filterByBoolMask_17.in@L2)
uniqueItems = List.UniqueItems(flatten_21@L2)
containsItem_2 = List.ContainsItem(list=uniqueItems@@L2, item=flatten_7@L2)
filterByBoolMask_18 = List.FilterByBoolMask(list=flatten_7@@L2, mask=containsItem_2@L2)
flatten_22 = Flatten(filterByBoolMask_18.out@@L2)
filterByBoolMask_19 = List.FilterByBoolMask(list=removeEmpty_3@@L2, mask=containsItem@L2)
vector_midpoint_from_curve = Custom[Vector-MidPoint from Curve](CurveElement=uniqueItems@@L2)
reverse = Vector.Reverse(vector_midpoint_from_curve.Vector)
isEmpty_5 = List.IsEmpty(watch_2@L3)
code_block_15 = CodeBlock { true; false; }
allIndicesOf_3 = List.AllIndicesOf(list=isEmpty_5, item=code_block_15.out1)
create_3 = List.Create(average, allIndicesOf_3)
getItemAtIndex_2 = List.GetItemAtIndex(list=create_3, index=if_)
flatten_23 = Flatten(removeEmpty@@L3)
code_block_16 = CodeBlock(watch, getItemAtIndex_2, flatten_23)  # same code as code_block_11
isEmpty_6 = List.IsEmpty(watch@L3)
allIndicesOf_4 = List.AllIndicesOf(list=isEmpty_6, item=code_block_15.out1)
removeEmpty_4 = Custom[List.RemoveEmpty](list=filterByBoolMask_7.out)
flatten_24 = Flatten(removeEmpty_4@@L3)
code_block_17 = CodeBlock(watch_2, allIndicesOf_4, flatten_24)  # same code as code_block_11
create_4 = List.Create(code_block_16, code_block_17)
transpose_2 = List.Transpose(create_4)
flatten_25 = Flatten(transpose_2@@L3)
uniqueItems_2 = List.UniqueItems(flatten_25@@L3)
watch_3 = Watch(uniqueItems_2)
code_block_18 = CodeBlock { "Door_Leaf Opening_Total Width"; "Jamb Width"; "Rough In Jamb Additional Width"; }
getParameterValueByName = Element.GetParameterValueByName(element=watch_3, parameterName=code_block_18.out0)
getParameterValueByName_2 = Element.GetParameterValueByName(element=watch_3, parameterName=code_block_18.out1)
code_block_19 = CodeBlock(X=getParameterValueByName_2) { X+0; }
string_from_object_2 = FromObject(code_block_19)
toNumber = String.ToNumber(string_from_object_2@@L2)
getParameterValueByName_3 = Element.GetParameterValueByName(element=watch_3, parameterName=code_block_18.out2)
code_block_20 = CodeBlock(X=getParameterValueByName_3) { X+0; }
string_from_object_3 = FromObject(code_block_20)
toNumber_2 = String.ToNumber(string_from_object_3@@L2)
code_block_21 = CodeBlock(width=getParameterValueByName, jamb=toNumber, rough=toNumber_2) { width+2*jamb+2*rough; }
flatten_26 = Flatten(code_block_21@L3)
filterByBoolMask_20 = List.FilterByBoolMask(list=flatten_26@@L2, mask=containsItem@L2)
code_block_22 = CodeBlock(x=filterByBoolMask_20.in) { x/2; }
byStartPointDirectionLength = Line.ByStartPointDirectionLength(startPoint=filterByBoolMask_19.in@L2, direction=reverse@L2, length=code_block_22@L2)
endPoint = Curve.EndPoint(byStartPointDirectionLength)

# group: Leaf Line
byStartPointDirectionLength_2 = Line.ByStartPointDirectionLength(startPoint=endPoint@L2, direction=vector_midpoint_from_curve.Vector@L2, length=filterByBoolMask_20.in@L2)

watch_4 = Watch(uniqueItems)
endPoint_2 = Curve.EndPoint(byStartPointDirectionLength_2@@L2)
create_5 = List.Create(endPoint, endPoint_2)
transpose_3 = List.Transpose(create_5)
transpose_4 = List.Transpose(transpose_3@@L3)
projectOnLine = Custom[Point.ProjectOnLine](Line=watch_4@@L1, Point=transpose_4@L2)  # Projects a point on a line
flatten_27 = Flatten(projectOnLine@@L3)
byStartPointEndPoint = Line.ByStartPointEndPoint(startPoint=flatten_27@@L2, endPoint=transpose_4@L2)
isNull_5 = Object.IsNull(byStartPointEndPoint@@L2)
allTrue_2 = AllTrue(isNull_5@@L2)
filterByBoolMask_21 = List.FilterByBoolMask(list=byStartPointDirectionLength_2, mask=allTrue_2)
flatten_28 = Flatten(filterByBoolMask_21.out@@L2)
flatten_29 = Flatten(flatten_28@@L2)
filterByBoolMask_22 = List.FilterByBoolMask(list=byStartPointEndPoint, mask=allTrue_2)
flatten_30 = Flatten(filterByBoolMask_22.out@@L3)
groupByKey = List.GroupByKey(list=flatten_27@L3, keys=watch_4@L2)
flatten_31 = Flatten(groupByKey.groups@@L3)
splitByPoints = Curve.SplitByPoints(curve=groupByKey.unique_keys, points=flatten_31)
flatten_32 = Flatten(splitByPoints@@L3)
uniqueItems_3 = List.UniqueItems(flatten_32@L2)
turnIntoList_3 = Custom[TurnIntoList](unknownItem=flatten_28@@L2)
uniqueItems_4 = List.UniqueItems(turnIntoList_3@L2)
midPoint = Custom[Curve.MidPoint](curve=uniqueItems_4)  # Get the midpoint along the Curve
closestTo_2 = Custom[Geometry.ClosestTo](geometry=uniqueItems_3@@L2, other=midPoint@L2)
flatten_33 = Flatten(closestTo_2.ClosestObject@@L3)
containsItem_3 = List.ContainsItem(list=flatten_33@L2, item=uniqueItems_3@L2)
filterByBoolMask_23 = List.FilterByBoolMask(list=uniqueItems_3, mask=containsItem_3)
flatten_34 = Flatten(filterByBoolMask_23.out@@L2)
create_6 = List.Create(flatten_22, flatten_29, flatten_30, flatten_34)
transpose_5 = List.Transpose(create_6)
flatten_35 = Flatten(transpose_5@L3)
byJoinedCurves_2 = PolyCurve.ByJoinedCurves(flatten_35@L2)
closeWithLine = PolyCurve.CloseWithLine(byJoinedCurves_2)
deconstructPolyCurve = Geometry.Curves.DeconstructPolyCurve(closeWithLine)
lastItem = List.LastItem(flatten)
code_block_23 = CodeBlock(RoofAsFloor=lastItem) { RoofAsFloor; }
byOutlineTypeAndLevel = Custom[Roof.ByOutlineTypeAndLevel](Curves=deconstructPolyCurve@L2, Roof_Type=code_block_23, Level=level)
joinGeometry = Custom[Element.JoinGeometry](element1=byOutlineTypeAndLevel.Roof, element2=byOutlineTypeAndLevel.Roof, lacing=CrossProduct)  # frozen; Joins two model elements (if possible). Only works inside the project environment.
