# Dynamo graph GET PARAMETERS TESTING 001.dyn (Dynamo 2.0.4.12684)

family_types = FamilyTypes()  # nothing selected
superJoin = Custom[CW.Curve.SuperJoin]()  # Join all connected curves into Polycurves even they are intersected; unwired: VARCurves
startPoint = Curve.StartPoint(curve=superJoin.VARCurvesamp)
endPoint = Curve.EndPoint(curve=superJoin.VARCurvesamp)
byStartPointEndPoint = Line.ByStartPointEndPoint(startPoint=startPoint, endPoint=endPoint)
byLine = archilab.Revit.Elements.FamilyInstances.ByLine(familyType=family_types, line=byStartPointEndPoint)  # unwired: level
turnIntoList = Custom[CW.TurnIntoList]()  # frozen; Turns an element (or a nested list) into a flat list; unwired: VARunknownItem
uniqueItems = List.UniqueItems(list=turnIntoList)

# group: FindInserts (двери в стенах)
flatten = List.Flatten()  # frozen; unwired: list
python_script_findinserts = Python(IN[0]=flatten)
# ---------- python_script_findinserts.python (45 lines) ----------
import clr
clr.AddReference('RevitAPI')
from Autodesk.Revit.DB import *

clr.AddReference("RevitNodes")
import Revit
clr.ImportExtensions(Revit.Elements)

clr.AddReference("RevitServices")
import RevitServices
from RevitServices.Persistence import DocumentManager

doc = DocumentManager.Instance.CurrentDBDocument


def GetElemType(e):
	doc = DocumentManager.Instance.CurrentDBDocument
	try:
		elemType = doc.GetElement(e.GetTypeId())
		return elemType
	except:
		pass


walls = UnwrapElement(IN[0])
inserts = []

for w in walls:
	inserts.append(w.FindInserts(True, False, False, False))

elementlistA = []

for item in inserts:
	elementlistB = []
	for i in item:
		insert = doc.GetElement(i)
		elementlistB.append(insert.ToDSType(True))
	elementlistA.append(elementlistB)



levelFilter = ElementLevelFilter(UnwrapElement(walls[0].Level).Id)
OUT = FilteredElementCollector(doc).WhereElementIsNotElementType().OfCategory(BuiltInCategory.OST_Doors).WherePasses(levelFilter).ToElements()

OUT = elementlistA
# ----------------------------------------
flip = Custom[Wall.Flip]()  # Flips the orientation of a given wall - DO ***NOT*** USE IN AUTOMATIC MODE; unwired: wall

fromCurve = Custom[CW.DetailLine.FromCurve]()  # Creates a detail line based on a given curve; unwired: VARcurve, VARview
python_script_split_geometry = Python()  # frozen; unwired: IN[0], IN[1]
# ---------- python_script_split_geometry.python (30 lines) ----------
import clr
clr.AddReference('ProtoGeometry')
from Autodesk.DesignScript.Geometry import *

def Flatten2D(ls):
	flat = []	
	for x in ls:
		if type(x) is list:
			for y in x:
				flat.append(y)
		else:
			flat.append(x)	
	return flat

# Main function
geom = IN[0]
tools = IN[1]

pieces = []
pieces.append(geom)

for tool in tools:
	assert type(tool) is not list
	newPieces = []
	for piece in pieces:
		assert type(piece) is not list
		newPieces.append(Flatten2D(Geometry.Split(piece,tool)))
	pieces = Flatten2D(newPieces)

OUT = pieces
# ----------------------------------------

# group: Room collector by level
LINK = BoolSelector(true)  # graph input
link_name = StringInput("2603-CPR-ZZ-ZZ-M3-AR-0010")  # graph input
levels = Levels()  # nothing selected; graph input
pyscr_room_collector = Python(IN[0]=LINK, IN[1]=link_name, IN[2]=levels)  # frozen
# ---------- pyscr_room_collector.python (86 lines) ----------
# Default imports
import System
import clr
# Import RevitAPI
clr.AddReference("RevitAPI")
import Autodesk
from Autodesk.Revit.DB import *
# Import DocumentManager and TransactionManager
clr.AddReference("RevitServices")
import RevitServices
from RevitServices.Persistence import DocumentManager
from RevitServices.Transactions import TransactionManager
# Import ToDSType(bool) extension method
clr.AddReference("RevitNodes")
import Revit
clr.ImportExtensions(Revit.Elements)
clr.ImportExtensions(Revit.GeometryConversion)
#Import Collections
from System.Collections.Generic import List
#The inputs to this node will be stored as a list in the IN variable.
dataEnteringNode = IN

ToggleLink = IN[0]

Linkinstname = IN[1]

levelInput = IN[2]

app =  DocumentManager.Instance.CurrentUIApplication.Application
linkInstances = Autodesk.Revit.DB.FilteredElementCollector(DocumentManager.Instance.CurrentDBDocument).OfClass(Autodesk.Revit.DB.RevitLinkInstance)

if ToggleLink == False:

	selectDOC = DocumentManager.Instance.CurrentDBDocument
	levelFilter = ElementLevelFilter(UnwrapElement(levelInput).Id)
		
if ToggleLink == True:
	for i in linkInstances:
		if Linkinstname.ToLower() in i.Name.ToLower():
			selectDOC = i.GetLinkDocument()
	
	ruleValDb = UnwrapElement(levelInput).get_Parameter(BuiltInParameter.LEVEL_ELEV).AsDouble()
	pvp = ParameterValueProvider(ElementId(BuiltInParameter.LEVEL_ELEV))
	fnrv = FilterNumericEquals()
	levelparamfilter = ElementParameterFilter(FilterDoubleRule(pvp, fnrv, ruleValDb, 10.-3))
	levels = FilteredElementCollector(selectDOC).OfClass(Level)
	Levelcollect = FilteredElementCollector(selectDOC).OfClass(Level).WherePasses(levelparamfilter).FirstElement()
	levelFilter = ElementLevelFilter(Levelcollect.Id)

################################################# FIND VALID ROOMS ############################################

collector = FilteredElementCollector(selectDOC)

areaFilter = AreaFilter()
areaExcludes = collector.WherePasses(areaFilter).ToElements()
areaExcludes = list(areaExcludes)
element_set = ElementSet()
excludes = List[ElementId]()
if len(areaExcludes) == 0:
	logicalFilter = levelFilter
else:
	for i in areaExcludes:
		element_set.Insert(i)
		elemIter = element_set.ForwardIterator()
		elemIter.Reset()
		while elemIter.MoveNext():
			curElem = elemIter.Current
			excludes.Add(curElem.Id)
	filter = ExclusionFilter(excludes)
	logicalFilter = LogicalAndFilter(levelFilter, filter)

RoomsByLevel = FilteredElementCollector(selectDOC).OfClass(Autodesk.Revit.DB.SpatialElement).WherePasses(logicalFilter).ToElements()
ValidRooms = [valrmn for valrmn in RoomsByLevel if valrmn.Volume != 0]

try:
	allroom = FilteredElementCollector(selectDOC).OfClass(Autodesk.Revit.DB.SpatialElement).ToElements()
	TransactionManager.Instance.EnsureInTransaction(selectDOC)
	DeleteUnplaceRooms = [selectDOC.Delete(rmn.Id) for rmn in allroom if rmn.Location == None]
	TransactionManager.Instance.TransactionTaskDone()
except:
	pass
	
if ValidRooms:
	rnumbers = [rmn.Number for rmn in ValidRooms]
	OUT = [room for rnmb, room in sorted(zip(rnumbers, ValidRooms))]
	
# ----------------------------------------
py_script_getwallheightlimit = Python(IN[0]=pyscr_room_collector)  # "Py Script GetWallHeightLimit from Room"
# ---------- py_script_getwallheightlimit.python (179 lines) ----------
# -*- coding: UTF-8 -*-
import clr

clr.AddReference('System')
from System.Collections.Generic import List

clr.AddReference('RevitAPI')
from Autodesk.Revit.DB import *
import Autodesk

clr.AddReference('RevitAPIUI')
from Autodesk.Revit.UI import *

clr.AddReference('RevitNodes')
import Revit
clr.ImportExtensions(Revit.GeometryConversion)
clr.ImportExtensions(Revit.Elements)

clr.AddReference('RevitServices')
import RevitServices
from RevitServices.Persistence import DocumentManager
from RevitServices.Transactions import TransactionManager

doc = DocumentManager.Instance.CurrentDBDocument
app = DocumentManager.Instance.CurrentUIApplication.Application
UIunit = Document.GetUnits(doc).GetFormatOptions(UnitType.UT_Length).DisplayUnits

viewcollector = FilteredElementCollector(doc).OfClass(View3D).ToElements()

def tolist(x):
	if hasattr(x,'__iter__'): return x
	else : return [x]

def flatten(x):
    result = []
    for el in x:
        if hasattr(el, "__iter__") and not isinstance(el, basestring):
            result.extend(flatten(el))
        else:
            result.append(el)
    return result

def WallFromRoom(room):
	LevelFilter = ElementLevelFilter(room.Level.Id)
	BBox = room.get_BoundingBox(None)
	IntersectsFilter = BoundingBoxIntersectsFilter( Outline( BBox.Min, BBox.Max ))
	logicalFilter = LogicalAndFilter(LevelFilter, IntersectsFilter)
	return FilteredElementCollector(doc).WhereElementIsNotElementType().WhereElementIsViewIndependent().WherePasses(logicalFilter).OfClass(Wall).ToElements()

def GetLevelAbove(level):
	allLevels = FilteredElementCollector(doc).OfClass(Level).ToElements()
	elevations = [i.Elevation for i in allLevels]
	sortedLevels = [x for (y,x) in sorted(zip(elevations,allLevels))]
	sortedLevelNames = [i.Name for i in sortedLevels]
	index = sortedLevelNames.index(level.Name)
	if index + 1 >= len(sortedLevels):
		return None
	else:
		return sortedLevels[index+1]

def GetExteriorWallDirection(item):
	if type(item) == Autodesk.Revit.DB.Wall:
		locationCurve = item.Location
		if locationCurve != None:
			curve = locationCurve.Curve
			direction = XYZ.BasisX
			if type(curve) == Autodesk.Revit.DB.Line:
				direction = curve.ComputeDerivatives(0, True).BasisX.Normalize()
			else:
				direction = (curve.GetEndPoint(1) - curve.GetEndPoint(0)).Normalize()
			exteriorDirection = XYZ.BasisZ.CrossProduct(direction)
			if item.Flipped:
				exteriorDirection = -exteriorDirection
			return exteriorDirection

def GetWallLoctionPoints(item):
	curve = wall.Location.Curve
	halfthickness = 0.5 * wall.WallType.Width
	extvector = GetExteriorWallDirection(wall)
	startPoint = curve.GetEndPoint( 0 )
	endPoint = curve.GetEndPoint( 1 )
	vdirect = (endPoint - startPoint).Normalize()
	pstr = startPoint - vdirect + halfthickness * extvector
	pend = endPoint + vdirect + halfthickness * extvector
	pmidl = (pstr + pend)/2
	points = [pstr, pmidl, pend]
	return points

def View3D():
	viewlist = filter(lambda x: x, viewcollector)
	result = []
	for view in viewlist:
		if view.ViewType == ViewType.ThreeD:
			if not(view.IsTemplate):
				if view.Name in "{3D}":
					result = view
	return result

def GetHeightPoint(RayStartPoints):
    builtInCats = [BuiltInCategory.OST_Ceilings, BuiltInCategory.OST_Floors, BuiltInCategory.OST_Roofs, BuiltInCategory.OST_GenericModel]
    filter = ElementMulticategoryFilter(List[BuiltInCategory](builtInCats))
    ri = ReferenceIntersector(filter, FindReferenceTarget.All, View3D())
    ri.FindReferencesInRevitLinks = False
    direction = XYZ(0,0,1)
    Hpoint = []
    TopElements = []
    for p in RayStartPoints:
        ref = ri.FindNearest(p, direction)
        if ref != None:
			refp = ref.GetReference().GlobalPoint
			refp = refp - p
			pts = refp
			Hpoint.append(pts.Z)
			TopElements.append(doc.GetElement(ref.GetReference().ElementId))
	if TopElements:
		return min(tolist(Hpoint))

########################## INPUT ##################################
rooms = None
rooms = flatten(tolist(UnwrapElement(IN[0])))
TransactionManager.Instance.ForceCloseTransaction()
###################################################################

finishingwalls = []
for indx, rm in enumerate(rooms):
	wall = WallFromRoom(rm)
	finishingwalls.append(wall)

flattenwall = flatten(finishingwalls)

TransactionManager.Instance.EnsureInTransaction(doc)

raypoints = []
result = []
test = []
for wall in flattenwall:
    points = GetWallLoctionPoints(wall)
    toppoint = GetHeightPoint(points)
    raypoints.append(toppoint)
    wallheight = wall.get_Parameter(BuiltInParameter.WALL_USER_HEIGHT_PARAM).AsDouble()
    if toppoint != wallheight and toppoint:
        WallHeightPrm = wall.get_Parameter(BuiltInParameter.WALL_HEIGHT_TYPE)
        baselvlId = wall.get_Parameter(BuiltInParameter.WALL_BASE_CONSTRAINT).AsElementId()
        blevel = doc.GetElement(baselvlId)
        alevel = GetLevelAbove(blevel)
        if alevel and toppoint < alevel.Elevation:
            levelheight = alevel.Elevation - blevel.Elevation
            resultval = -(levelheight - toppoint)
            WallHeightPrm.Set(alevel.Id)
            SetHeightPrm = wall.get_Parameter(BuiltInParameter.WALL_TOP_OFFSET)
            SetHeightPrm.Set(resultval)
            test.append("Тест прошел условие // Верхний уровень выше")
            result.append(resultval * 304.8)
        elif alevel and toppoint > alevel.Elevation:
            levelheight = alevel.Elevation - blevel.Elevation
            resultval = toppoint - levelheight
            WallHeightPrm.Set(alevel.Id)
            SetHeightPrm = wall.get_Parameter(BuiltInParameter.WALL_TOP_OFFSET)
            SetHeightPrm.Set(resultval)
            test.append("Тест прошел условие // Верхний уровень ниже")
            result.append(resultval * 304.8)
        else:
            resultval = toppoint
            inv = ElementId.InvalidElementId
            WallHeightPrm.Set(inv)
            SetHeightPrm = wall.get_Parameter(BuiltInParameter.WALL_USER_HEIGHT_PARAM)
            SetHeightPrm.Set(resultval)
            test.append("Тест прошел условие // Неприсоединенный уровень")
            result.append(resultval * 304.8)

TransactionManager.Instance.TransactionTaskDone( )

"""
if IN[0]:
	levelFilter = ElementLevelFilter((rooms[0].Level).Id)
	DoorsInLevel = FilteredElementCollector(rooms[0].Document).WhereElementIsNotElementType().OfCategory(BuiltInCategory.OST_Doors).WherePasses(levelFilter).ToElements()
"""	

OUT =  test, result
# ----------------------------------------
watch = Watch(py_script_getwallheightlimit)

filter_parameter = CodeBlock { "Назначение"; }
string = StringInput("VIP")  # graph input
pyscript_elementfilter = Python(IN[1]=filter_parameter, IN[2]=string)  # "PyScript ElementFilter.ByParameterValueContains"; frozen; unwired: IN[0]
# ---------- pyscript_elementfilter.python (66 lines) ----------
import clr
clr.AddReference('RevitAPI')
from Autodesk.Revit.DB import *
import Autodesk

clr.AddReference("RevitNodes")
import Revit
clr.ImportExtensions(Revit.GeometryConversion)

import clr
clr.AddReference('ProtoGeometry')
from Autodesk.DesignScript.Geometry import *

clr.AddReference("RevitServices")
import RevitServices
from RevitServices.Persistence import DocumentManager
from RevitServices.Transactions import TransactionManager

from Autodesk.DesignScript.Geometry import *

import math

doc = DocumentManager.Instance.CurrentDBDocument

def tolist(input):
	if isinstance(input,list) == False:
		return [input]
	else:
		return input	

def flatten(x):
    result = []
    for el in x:
        if hasattr(el, "__iter__") and not isinstance(el, basestring):
            result.extend(flatten(el))
        else:
            result.append(el)
    return result
    
def GetParameter(element, parametername):
	sechname = parametername
	prmnames = []
	for prm in element.Parameters:
		prmname = prm.Definition.Name
		if prm.Definition.Name.Equals(sechname):
			return prmname
		elif prm.Definition.Name.Contains(sechname):
			return prmname
		else:
			prmnames.append(prmname)
			continue
	for prmname in sorted(flatten(prmnames)):
		lowername = prmname.ToLower()
		splitname = sechname.ToLower().split()
		if filter(lambda x: x in lowername, splitname):
			return prmname


dataEnteringNode = IN

elements = flatten(tolist(UnwrapElement(IN[0])))
parametername = IN[1]



OUT = [GetParameter(element, parametername) for element in elements]
# ----------------------------------------
categories = Categories(index=360)  # frozen
getBuiltInCategory = Custom[GetBuiltInCategory](Category=categories)
watch_2 = Watch(getBuiltInCategory.BuiltInCategoryObject)

# group: Element collector by level
LINK_2 = BoolSelector(false)  # graph input
link_name_2 = StringInput("BI TOWER_AR_B1_WIP_R18")  # graph input
categories_2 = Categories(index=512)  # graph input
levels_2 = Levels()  # nothing selected; graph input
pyscr_elements_collector = Python(IN[0]=LINK_2, IN[1]=link_name_2, IN[2]=categories_2, IN[3]=levels_2)
# ---------- pyscr_elements_collector.python (66 lines) ----------
# Default imports
import System
import clr
clr.AddReference('ProtoGeometry')
from Autodesk.DesignScript.Geometry import *

# Import RevitAPI
clr.AddReference("RevitAPI")
import Autodesk
from Autodesk.Revit.DB import *

# Import DocumentManager and TransactionManager
clr.AddReference("RevitServices")
import RevitServices
from RevitServices.Persistence import DocumentManager
from RevitServices.Transactions import TransactionManager

# Import ToDSType(bool) extension method
clr.AddReference("RevitNodes")
import Revit
clr.ImportExtensions(Revit.Elements)
clr.ImportExtensions(Revit.GeometryConversion)

#Import Collections
from System.Collections.Generic import *

#The inputs to this node will be stored as a list in the IN variable.
dataEnteringNode = IN

ToggleLink = IN[0]

Linkinstname = IN[1]

Category = IN[2]

levelInput = IN[3]

app =  DocumentManager.Instance.CurrentUIApplication.Application
doc = DocumentManager.Instance.CurrentDBDocument
linkInstances = Autodesk.Revit.DB.FilteredElementCollector(doc).OfClass(Autodesk.Revit.DB.RevitLinkInstance)
BuiltIn = System.Enum.ToObject(BuiltInCategory, Category.Id)


if ToggleLink == False:

	filter = ElementCategoryFilter(BuiltIn)
	Listelem = Autodesk.Revit.DB.FilteredElementCollector(doc).WherePasses(filter).WhereElementIsNotElementType().ToElements()
	levelFilter = ElementLevelFilter(UnwrapElement(levelInput).Id)
	logicalFilter = LogicalAndFilter(levelFilter, filter)
	OUT = FilteredElementCollector(doc).OfCategory(BuiltIn).WherePasses(logicalFilter).ToElements()
	
if ToggleLink == True:

	i = ()
	for i in linkInstances:
		if Linkinstname.ToLower() in i.Name.ToLower():
			linkDoc = i.GetLinkDocument()
			
	filter = ElementCategoryFilter(BuiltIn)			
	Listelem = FilteredElementCollector(linkDoc).WherePasses(filter).ToElements()
	#levelFilter = ElementLevelFilter(UnwrapElement(levelInput).Id)
	#logicalFilter = LogicalAndFilter(levelFilter, filter)
	OUT = FilteredElementCollector(linkDoc).OfCategory(BuiltIn).WherePasses(filter).ToElements()
	
	# Level filter does not work?
	
# ----------------------------------------

py_script_wallheightlimit = Python(IN[0]=pyscr_elements_collector)  # frozen
# ---------- py_script_wallheightlimit.python (163 lines) ----------
# -*- coding: UTF-8 -*-
import clr

clr.AddReference('RevitAPI')
from Autodesk.Revit.DB import *
import Autodesk

clr.AddReference('RevitAPIUI')
from Autodesk.Revit.UI import *

clr.AddReference('RevitNodes')
import Revit
clr.ImportExtensions(Revit.GeometryConversion)
clr.ImportExtensions(Revit.Elements)

clr.AddReference('RevitServices')
import RevitServices
from RevitServices.Persistence import DocumentManager
from RevitServices.Transactions import TransactionManager

doc = DocumentManager.Instance.CurrentDBDocument
viewcollector = FilteredElementCollector(doc).OfClass(View3D).ToElements()

def tolist(x):
    if hasattr(x ,'__iter__'): return x
    else : return [x]

def flatten(x):
    result = [ ]
    for el in x:
        if hasattr(el, "__iter__") and not isinstance(el, basestring):
            result.extend(flatten(el))
        else:
            result.append(el)
    return result

def GetLevelAbove(level):
    allLevels = FilteredElementCollector(doc).OfClass(Level).ToElements( )
    elevations = [ i.Elevation for i in allLevels ]
    sortedLevels = [ x for (y, x) in sorted(zip(elevations, allLevels)) ]
    sortedLevelNames = [ i.Name for i in sortedLevels ]
    index = sortedLevelNames.index(level.Name)
    if index + 1 >= len(sortedLevels):
        return None
    else:
        return sortedLevels[ index + 1 ]

def GetExteriorWallDirection(item):
    if type(item) == Autodesk.Revit.DB.Wall:
        locationCurve = item.Location
        if locationCurve != None:
            curve = locationCurve.Curve
            direction = XYZ.BasisX
            if type(curve) == Autodesk.Revit.DB.Line:
                direction = curve.ComputeDerivatives(0, True).BasisX.Normalize( )
            else:
                direction = (curve.GetEndPoint(1) - curve.GetEndPoint(0)).Normalize( )
            exteriorDirection = XYZ.BasisZ.CrossProduct(direction)
            if item.Flipped:
                exteriorDirection = -exteriorDirection
            return exteriorDirection

def GetWallLocationPoints(item):
    curve = wall.Location.Curve
    halfthickness = 0.5 * wall.WallType.Width
    extvector = GetExteriorWallDirection(wall)
    startPoint = curve.GetEndPoint(0)
    endPoint = curve.GetEndPoint(1)
    vdirect = (endPoint - startPoint).Normalize( )
    pstr = startPoint - vdirect + halfthickness * extvector
    pend = endPoint + vdirect + halfthickness * extvector
    pmidl = (pstr + pend) / 2
    points = [ pstr, pmidl, pend ]
    return points

def View3D():
	viewlist = filter(lambda x: x, viewcollector)
	result = []
	for view in viewlist:
		if view.ViewType == ViewType.ThreeD:
			if not(view.IsTemplate):
				if view.Name in "{3D}":
					result = view
	return result

def GetHeightPoint(RayStartPoints):
	clr.AddReference('System')
	from System.Collections.Generic import List
        builtInCats = List[ BuiltInCategory ]( )
        builtInCats.Add(BuiltInCategory.OST_Roofs)
        builtInCats.Add(BuiltInCategory.OST_Ceilings)
        builtInCats.Add(BuiltInCategory.OST_Floors)
        builtInCats.Add(BuiltInCategory.OST_GenericModel)
        filter = ElementMulticategoryFilter(List[ BuiltInCategory ](builtInCats))
        ri = ReferenceIntersector(filter, FindReferenceTarget.Element, View3D( ))
        ri.FindReferencesInRevitLinks = False
        direction = XYZ(0, 0, 1)
        Hpoint = [ ]
        TopElements = [ ]
        for p in RayStartPoints:
            ref = ri.FindNearest(p, direction)
            if ref != None:
                refp = ref.GetReference( ).GlobalPoint
                refp = refp - p
                pts = refp
                Hpoint.append(pts.Z)
                TopElements.append(doc.GetElement(ref.GetReference( ).ElementId))
        if TopElements:
            return min(tolist(Hpoint))

########################## INPUT ##################################
uwalls = None
uwalls = flatten(tolist(UnwrapElement(IN[ 0 ])))
###################################################################

TransactionManager.Instance.EnsureInTransaction(doc)

locpoints = [ ]
raypoints = [ ]
result = [ ]
test = [ ]
for wall in uwalls:
    points = GetWallLocationPoints(wall)
    locpoints.append(points)
    toppoint = GetHeightPoint(points)
    raypoints.append(toppoint)
    wallheight = wall.get_Parameter(BuiltInParameter.WALL_USER_HEIGHT_PARAM).AsDouble( )
    if toppoint == None:
        test.append("Нет Луча")
        result.append(None)
    elif toppoint and toppoint != wallheight and wallheight >= 2000 / 304.8:
        WallHeightPrm = wall.get_Parameter(BuiltInParameter.WALL_HEIGHT_TYPE)
        baselvlId = wall.get_Parameter(BuiltInParameter.WALL_BASE_CONSTRAINT).AsElementId( )
        blevel = doc.GetElement(baselvlId)
        alevel = GetLevelAbove(blevel)
        if alevel and toppoint < alevel.Elevation:
            levelheight = alevel.Elevation - blevel.Elevation
            resultval = -(levelheight - toppoint)
            WallHeightPrm.Set(alevel.Id)
            SetHeightPrm = wall.get_Parameter(BuiltInParameter.WALL_TOP_OFFSET)
            SetHeightPrm.Set(resultval)
            test.append("Тест прошел условие // Верхний уровень выше")
            result.append(resultval * 304.8)
        elif alevel and toppoint > alevel.Elevation:
            levelheight = alevel.Elevation - blevel.Elevation
            resultval = toppoint - levelheight
            WallHeightPrm.Set(alevel.Id)
            SetHeightPrm = wall.get_Parameter(BuiltInParameter.WALL_TOP_OFFSET)
            SetHeightPrm.Set(resultval)
            test.append("Тест прошел условие // Верхний уровень ниже")
            result.append(resultval * 304.8)
        else:
            resultval = toppoint
            inv = ElementId.InvalidElementId
            WallHeightPrm.Set(inv)
            SetHeightPrm = wall.get_Parameter(BuiltInParameter.WALL_USER_HEIGHT_PARAM)
            SetHeightPrm.Set(resultval)
            test.append("Тест прошел условие // Неприсоединенный уровень")
            result.append(resultval * 304.8)

TransactionManager.Instance.TransactionTaskDone( )

OUT =  locpoints
# ----------------------------------------
watch_3 = Watch(py_script_wallheightlimit)
py_script_getwallfinishes = Python(IN[0]=pyscr_elements_collector)  # frozen
# ---------- py_script_getwallfinishes.python (48 lines) ----------
# -*- coding: UTF-8 -*-
import clr
from _ast import List

clr.AddReference('RevitAPI')
from Autodesk.Revit.DB import *
import Autodesk

clr.AddReference('RevitAPIUI')
from Autodesk.Revit.UI import *

def tolist(x):
    if hasattr(x ,'__iter__'): return x
    else : return [x ]

def flatten(x):
    result = [ ]
    for el in x:
        if hasattr(el, "__iter__") and not isinstance(el, basestring):
            result.extend(flatten(el))
        else:
            result.append(el)
    return result

def GetFinishingWall(items):
    finishingwall = None
    items = tolist(items)
    finishingwall = [ ]
    doc = items[0].Document
    for idx, wall in enumerate(items):
        if type(wall) == Autodesk.Revit.DB.Wall:
                Compstruc = wall.WallType.GetCompoundStructure( )
                # ExtIndx = Compstruc.GetCoreBoundaryLayerIndex(ShellLayerType.Exterior)
                # IntIndx = Compstruc.GetCoreBoundaryLayerIndex(ShellLayerType.Interior)
                CoreIndx = Compstruc.GetFirstCoreLayerIndex( )  # Серцевина
                if CoreIndx >= 0:
					if Compstruc.GetLayerWidth(CoreIndx) * 304.8 < 40:
						finishingwall.append(wall)
    return finishingwall

########################## INPUT ##################################
uwalls = None
uwalls = flatten(tolist(UnwrapElement(IN[ 0 ])))
###################################################################

finishingwall = GetFinishingWall(uwalls)

OUT = finishingwall
# ----------------------------------------
py_script_wallheightlimit_2 = Python(IN[0]=pyscr_elements_collector)  # frozen
# ---------- py_script_wallheightlimit_2.python (176 lines) ----------
# -*- coding: UTF-8 -*-
import clr

clr.AddReference('RevitAPI')
from Autodesk.Revit.DB import *
import Autodesk

clr.AddReference('RevitAPIUI')
from Autodesk.Revit.UI import *

clr.AddReference('RevitNodes')
import Revit
clr.ImportExtensions(Revit.GeometryConversion)
clr.ImportExtensions(Revit.Elements)

clr.AddReference('RevitServices')
import RevitServices
from RevitServices.Persistence import DocumentManager
from RevitServices.Transactions import TransactionManager

doc = DocumentManager.Instance.CurrentDBDocument
viewcollector = FilteredElementCollector(doc).OfClass(View3D).ToElements()

def tolist(x):
    if hasattr(x ,'__iter__'): return x
    else : return [x]

def flatten(x):
    result = [ ]
    for el in x:
        if hasattr(el, "__iter__") and not isinstance(el, basestring):
            result.extend(flatten(el))
        else:
            result.append(el)
    return result

def GetLevelAbove(level):
    allLevels = FilteredElementCollector(doc).OfClass(Level).ToElements( )
    elevations = [ i.Elevation for i in allLevels ]
    sortedLevels = [ x for (y, x) in sorted(zip(elevations, allLevels)) ]
    sortedLevelNames = [ i.Name for i in sortedLevels ]
    index = sortedLevelNames.index(level.Name)
    if index + 1 >= len(sortedLevels):
        return None
    else:
        return sortedLevels[ index + 1 ]

def GetExteriorWallDirection(item):
    if type(item) == Autodesk.Revit.DB.Wall:
        locationCurve = item.Location
        if locationCurve != None:
            curve = locationCurve.Curve
            direction = XYZ.BasisX
            if type(curve) == Autodesk.Revit.DB.Line:
                direction = curve.ComputeDerivatives(0, True).BasisX.Normalize( )
            else:
                direction = (curve.GetEndPoint(1) - curve.GetEndPoint(0)).Normalize( )
            exteriorDirection = XYZ.BasisZ.CrossProduct(direction)
            if item.Flipped:
                exteriorDirection = -exteriorDirection
            return exteriorDirection

def GetWallLocationPoints(item):
    curve = wall.Location.Curve
    halfthickness = 0.5 * wall.WallType.Width
    extvector = GetExteriorWallDirection(wall)
    startPoint = curve.GetEndPoint(0)
    endPoint = curve.GetEndPoint(1)
    vdirect = (endPoint - startPoint).Normalize( )
    pstr = startPoint - vdirect + halfthickness * extvector
    pend = endPoint + vdirect + halfthickness * extvector
    pmidl = (pstr + pend) / 2
    points = [ pstr, pmidl, pend ]
    return points

def View3D():
	viewlist = filter(lambda x: x, viewcollector)
	result = []
	for view in viewlist:
		if view.ViewType == ViewType.ThreeD:
			if not(view.IsTemplate):
				if view.Name in "{3D}":
					result = view
	return result

def LoadByRoom(i):
	item = UnwrapElement(i)
	options = SpatialElementBoundaryOptions()
	segments = item.GetBoundarySegments(options)
	lines = [i.GetCurve() for i in segments[0]]
	#newlines = []
	floorCurves = CurveLoop()
	for i in lines:
		if i.GetType().Name == "Line":
			#newlines.append(i)
			floorCurves.Append(i)


def GetHeightPoint(RayStartPoints):
	clr.AddReference('System')
	from System.Collections.Generic import List
        builtInCats = List[ BuiltInCategory ]( )
        builtInCats.Add(BuiltInCategory.OST_Roofs)
        builtInCats.Add(BuiltInCategory.OST_Ceilings)
        builtInCats.Add(BuiltInCategory.OST_Floors)
        builtInCats.Add(BuiltInCategory.OST_GenericModel)
        filter = ElementMulticategoryFilter(List[ BuiltInCategory ](builtInCats))
        ri = ReferenceIntersector(filter, FindReferenceTarget.Element, View3D( ))
        ri.FindReferencesInRevitLinks = False
        direction = XYZ(0, 0, 1)
        Hpoint = [ ]
        TopElements = [ ]
        for p in RayStartPoints:
            ref = ri.FindNearest(p, direction)
            if ref != None:
                refp = ref.GetReference( ).GlobalPoint
                refp = refp - p
                pts = refp
                Hpoint.append(pts.Z)
                TopElements.append(doc.GetElement(ref.GetReference( ).ElementId))
        if TopElements:
            return min(tolist(Hpoint))

########################## INPUT ##################################
uwalls = None
uwalls = flatten(tolist(UnwrapElement(IN[ 0 ])))
###################################################################

TransactionManager.Instance.EnsureInTransaction(doc)

locpoints = [ ]
raypoints = [ ]
result = [ ]
test = [ ]
for wall in uwalls:
    points = GetWallLocationPoints(wall)
    locpoints.append(points)
    toppoint = GetHeightPoint(points)
    raypoints.append(toppoint)
    wallheight = wall.get_Parameter(BuiltInParameter.WALL_USER_HEIGHT_PARAM).AsDouble( )
    if toppoint == None:
        test.append("Нет Луча")
        result.append(None)
    elif toppoint and toppoint != wallheight and wallheight >= 2000 / 304.8:
        WallHeightPrm = wall.get_Parameter(BuiltInParameter.WALL_HEIGHT_TYPE)
        baselvlId = wall.get_Parameter(BuiltInParameter.WALL_BASE_CONSTRAINT).AsElementId( )
        blevel = doc.GetElement(baselvlId)
        alevel = GetLevelAbove(blevel)
        if alevel and toppoint < alevel.Elevation:
            levelheight = alevel.Elevation - blevel.Elevation
            resultval = -(levelheight - toppoint)
            WallHeightPrm.Set(alevel.Id)
            SetHeightPrm = wall.get_Parameter(BuiltInParameter.WALL_TOP_OFFSET)
            SetHeightPrm.Set(resultval)
            test.append("Тест прошел условие // Верхний уровень выше")
            result.append(resultval * 304.8)
        elif alevel and toppoint > alevel.Elevation:
            levelheight = alevel.Elevation - blevel.Elevation
            resultval = toppoint - levelheight
            WallHeightPrm.Set(alevel.Id)
            SetHeightPrm = wall.get_Parameter(BuiltInParameter.WALL_TOP_OFFSET)
            SetHeightPrm.Set(resultval)
            test.append("Тест прошел условие // Верхний уровень ниже")
            result.append(resultval * 304.8)
        else:
            resultval = toppoint
            inv = ElementId.InvalidElementId
            WallHeightPrm.Set(inv)
            SetHeightPrm = wall.get_Parameter(BuiltInParameter.WALL_USER_HEIGHT_PARAM)
            SetHeightPrm.Set(resultval)
            test.append("Тест прошел условие // Неприсоединенный уровень")
            result.append(resultval * 304.8)

TransactionManager.Instance.TransactionTaskDone( )

OUT =  locpoints
# ----------------------------------------
wallFinishesByRoom = Custom[WallFinishesByRoom]()  # frozen; Place wall finishes with the info contained in room parameters; unwired: Rooms_where_to_model_finishes_Rooms_var, WallFinishParam, CeilingHeightParam

# group: Взять линкованный элемент
elements_fom_linked_file_in_room = Custom[Elements Fom Linked File in Room]()  # unwired: Elements, Rooms, Link_Instance
ꟿ_selectlinkedelementsinorder = Custom[ꟿ SelectLinkedElementsInOrder]()  # Select the linked instance first. Then select multiple elements from the Revit document in the desired order. Hit ESC to stop picking. To refresh the node, connect a boolean switch node.
