# Dynamo graph GET PARAMETERS TESTING.dyn (Dynamo 1.3.4.6666)

# group: Element collector by level
LINK = BoolSelector(false)
link_name = StringInput("BI TOWER_AR_B1_WIP_R18")
categories = Categories("Rooms")
levels = Levels("Уровень 0")
pyscr_elements_collector = Python(IN[0]=LINK, IN[1]=link_name, IN[2]=categories, IN[3]=levels)  # frozen
# ---------- pyscr_elements_collector.python (66 lines) ----------
# Default imports
import System
import clr
clr.AddReference('ProtoGeometry')
from Autodesk.DesignScript.Geometry import *

# Import RevitAPI
clr.AddReference("RevitAPI")
import Autodesk
from Autodesk.Revit.DB import *

# Import DocumentManager and TransactionManager
clr.AddReference("RevitServices")
import RevitServices
from RevitServices.Persistence import DocumentManager
from RevitServices.Transactions import TransactionManager

# Import ToDSType(bool) extension method
clr.AddReference("RevitNodes")
import Revit
clr.ImportExtensions(Revit.Elements)
clr.ImportExtensions(Revit.GeometryConversion)

#Import Collections
from System.Collections.Generic import *

#The inputs to this node will be stored as a list in the IN variable.
dataEnteringNode = IN

ToggleLink = IN[0]

Linkinstname = IN[1]

Category = IN[2]

levelInput = IN[3]

app =  DocumentManager.Instance.CurrentUIApplication.Application
doc = DocumentManager.Instance.CurrentDBDocument
linkInstances = Autodesk.Revit.DB.FilteredElementCollector(doc).OfClass(Autodesk.Revit.DB.RevitLinkInstance)
BuiltIn = System.Enum.ToObject(BuiltInCategory, Category.Id)


if ToggleLink == False:

	filter = ElementCategoryFilter(BuiltIn)
	Listelem = Autodesk.Revit.DB.FilteredElementCollector(doc).WherePasses(filter).WhereElementIsNotElementType().ToElements()
	levelFilter = ElementLevelFilter(UnwrapElement(levelInput).Id)
	logicalFilter = LogicalAndFilter(levelFilter, filter)
	OUT = FilteredElementCollector(doc).OfCategory(BuiltIn).WherePasses(logicalFilter).ToElements()
	
if ToggleLink == True:

	i = ()
	for i in linkInstances:
		if Linkinstname.ToLower() in i.Name.ToLower():
			linkDoc = i.GetLinkDocument()
			
	filter = ElementCategoryFilter(BuiltIn)			
	Listelem = FilteredElementCollector(linkDoc).WherePasses(filter).ToElements()
	#levelFilter = ElementLevelFilter(UnwrapElement(levelInput).Id)
	#logicalFilter = LogicalAndFilter(levelFilter, filter)
	OUT = FilteredElementCollector(linkDoc).OfCategory(BuiltIn).WherePasses(filter).ToElements()
	
	# Level filter does not work?
	
# ----------------------------------------

# group: Room collector by level
LINK_2 = BoolSelector(false)
link_name_2 = StringInput("2603-CPR-ZZ-ZZ-M3-AR-0010")
levels_2 = Levels()
pyscr_room_collector = Python(IN[0]=LINK_2, IN[1]=link_name_2, IN[2]=levels_2)
# ---------- pyscr_room_collector.python (90 lines) ----------
# Default imports
import System
import clr
clr.AddReference('ProtoGeometry')
from Autodesk.DesignScript.Geometry import *

# Import RevitAPI
clr.AddReference("RevitAPI")
import Autodesk
from Autodesk.Revit.DB import *

# Import DocumentManager and TransactionManager
clr.AddReference("RevitServices")
import RevitServices
from RevitServices.Persistence import DocumentManager
from RevitServices.Transactions import TransactionManager

# Import ToDSType(bool) extension method
clr.AddReference("RevitNodes")
import Revit
clr.ImportExtensions(Revit.Elements)
clr.ImportExtensions(Revit.GeometryConversion)

#Import Collections
from System.Collections.Generic import *

#The inputs to this node will be stored as a list in the IN variable.
dataEnteringNode = IN

ToggleLink = IN[0]

Linkinstname = IN[1]

levelInput = IN[2]

app =  DocumentManager.Instance.CurrentUIApplication.Application
linkInstances = Autodesk.Revit.DB.FilteredElementCollector(DocumentManager.Instance.CurrentDBDocument).OfClass(Autodesk.Revit.DB.RevitLinkInstance)

if ToggleLink == False:

	selectDOC = DocumentManager.Instance.CurrentDBDocument
	levelFilter = ElementLevelFilter(UnwrapElement(levelInput).Id)
		
if ToggleLink == True:

	i = ()
	for i in linkInstances:
		if Linkinstname.ToLower() in i.Name.ToLower():
			selectDOC = i.GetLinkDocument()
	
	ruleValDb = UnwrapElement(levelInput).get_Parameter(BuiltInParameter.LEVEL_ELEV).AsDouble()
	pvp = ParameterValueProvider(ElementId(BuiltInParameter.LEVEL_ELEV))
	fnrv = FilterNumericEquals()
	levelparamfilter = ElementParameterFilter(FilterDoubleRule(pvp, fnrv, ruleValDb, 10.-3))
	levels = FilteredElementCollector(selectDOC).OfClass(Level)
	Levelcollect = FilteredElementCollector(selectDOC).OfClass(Level).WherePasses(levelparamfilter).FirstElement()
	levelFilter = ElementLevelFilter(Levelcollect.Id)


################################################# FIND VALID ROOMS ############################################

collector = FilteredElementCollector(selectDOC)

areaFilter = AreaFilter()
areaExcludes = collector.WherePasses(areaFilter).ToElements()
areaExcludes = list(areaExcludes)
element_set = ElementSet()
excludes = List[ElementId]()
if len(areaExcludes) == 0:
	logicalFilter = levelFilter
else:
	for i in areaExcludes:
		element_set.Insert(i)
		elemIter = element_set.ForwardIterator()
		elemIter.Reset()
		while elemIter.MoveNext():
			curElem = elemIter.Current
			excludes.Add(curElem.Id)
	filter = ExclusionFilter(excludes)
	logicalFilter = LogicalAndFilter(levelFilter, filter)

RoomsByLevel = FilteredElementCollector(selectDOC).OfClass(Autodesk.Revit.DB.SpatialElement).WherePasses(logicalFilter).ToElements()
ValidRooms = [valrmn for valrmn in RoomsByLevel if valrmn.Volume != 0]

AllRooms = FilteredElementCollector(selectDOC).OfClass(Autodesk.Revit.DB.SpatialElement).ToElements()
TransactionManager.Instance.EnsureInTransaction(selectDOC)
DeleteUnplaceRooms = [selectDOC.Delete(rmn.Id) for rmn in AllRooms if rmn.Location == None]
TransactionManager.Instance.TransactionTaskDone()

OUT = ValidRooms
# ----------------------------------------
python_script = Python(IN[0]=pyscr_room_collector)
# ---------- python_script.python (83 lines) ----------
import clr
clr.AddReference('RevitAPI')
from Autodesk.Revit.DB import *
import Autodesk

clr.AddReference("RevitNodes")
import Revit
clr.ImportExtensions(Revit.GeometryConversion)

def flatten(x):
    result = []
    for el in x:
        if hasattr(el, "__iter__") and not isinstance(el, basestring):
            result.extend(flatten(el))
        else:
            result.append(el)
    return result
    
def GetUniqueById(items):
	ClearList = filter(lambda x: x, flatten(items))
	mmap = {}
	Iset = []
	for item in ClearList:
		try:
			if item.Id not in mmap:
				mmap[item.Id] = 1
				Iset.append(item)
		except:
			pass
	return Iset

def GetWallsInRoom(room):
	doc = room.Document
	calculator = SpatialElementGeometryCalculator(doc)
	options = Autodesk.Revit.DB.SpatialElementBoundaryOptions()
	boundloc = Autodesk.Revit.DB.AreaVolumeSettings.GetAreaVolumeSettings(doc).GetSpatialElementBoundaryLocation(SpatialElementType.Room)
	options.SpatialElementBoundaryLocation = boundloc
	elist = []
	try:
		results = calculator.CalculateSpatialElementGeometry(room)
		for face in results.GetGeometry().Faces:
			for bface in results.GetBoundaryFaceInfo(face):
				faceelem = doc.GetElement(bface.SpatialBoundaryElement.HostElementId)
				if faceelem.GetType() == Autodesk.Revit.DB.Wall:
					elist.append(faceelem)
	except:
		pass
	return elist

def GetDoorInWall(walls):
	inserts = []
	for w in walls:
		curves = w.Location
		inserts.append(w.FindInserts(True, False, False, False))
	return inserts

def GetDoorWidth(Doors):
	doorwidth = []
	for door in Doors:
		try:
			width = door.Symbol.get_Parameter(BuiltInParameter.DOOR_WIDTH).AsDouble()*304.8
			if width > 0:	doorwidth.append(width)
		except:
			pass
	return doorwidth



rooms = UnwrapElement(IN[0])

levelFilter = ElementLevelFilter((rooms[0].Level).Id)
DoorsInLevel = FilteredElementCollector(rooms[0].Document).WhereElementIsNotElementType().OfCategory(BuiltInCategory.OST_Doors).WherePasses(levelFilter).ToElements()

walls = []
dwidht = []
for indx, rm in enumerate(rooms):
	walls.append(GetUniqueById(GetWallsInRoom(rm)))
	#dwidht.append(GetDoorInWall(wls))
	
curves = [w.Location for w in flatten(walls)]
offsetcurves = [crv.Curve.ToProtoType() for crv in curves]

OUT = DoorsInLevel
# ----------------------------------------
code_block = CodeBlock { "Назначение"; }

family_types = FamilyTypes()
getLocation = Element.GetLocation()  # unwired: arg0
getTotalWidth = Custom[Wall.GetTotalWidth]()  # Get Wall's Total Width parameter; unwired: Walls
exteriorDirection = Custom[Wall.ExteriorDirection]()  # This node returns exterior direction of the wall as a vector.; unwired: Wall
byThickeningCurve = PolyCurve.ByThickeningCurve(curve=getLocation, thickness=getTotalWidth, nor=exteriorDirection)  # frozen
deconstructPolyCurve = Geometry.Curves.DeconstructPolyCurve(byThickeningCurve)
length = Curve.Length(deconstructPolyCurve)
code_block_2 = CodeBlock { 100; }
ge = length >= code_block_2
filterByBoolMask = List.FilterByBoolMask(list=deconstructPolyCurve, mask=ge)
flatten = Flatten(filterByBoolMask.in)
uniqueItems = List.UniqueItems(flatten)
turnIntoList = Custom[CW.TurnIntoList]()  # frozen; Turns an element (or a nested list) into a flat list; unwired: unknownItem
uniqueItems_2 = List.UniqueItems(turnIntoList)
removeNulls = Lists.Manage.RemoveNulls(uniqueItems_2)
getLocation_2 = Element.GetLocation(removeNulls)
py_script_get_doors_in_room = Python(IN[0]=removeNulls)
# ---------- py_script_get_doors_in_room.python (78 lines) ----------
import clr
clr.AddReference('RevitAPI')
from Autodesk.Revit.DB import *
import Autodesk

clr.AddReference("RevitNodes")
import Revit
clr.ImportExtensions(Revit.GeometryConversion)

import clr
clr.AddReference('ProtoGeometry')
from Autodesk.DesignScript.Geometry import *

clr.AddReference("RevitServices")
import RevitServices
from RevitServices.Persistence import DocumentManager
from RevitServices.Transactions import TransactionManager

doc = DocumentManager.Instance.CurrentDBDocument

from System.Collections.Generic import *

def tolist(input):
	if isinstance(input,list) == False:
		return [input]
	else:
		return input

def flatten(x):
    result = []
    for el in x:
        if hasattr(el, "__iter__") and not isinstance(el, basestring):
            result.extend(flatten(el))
        else:
            result.append(el)
    return result


def FamilyInRoom(room):
	builtInCats = List[BuiltInCategory]()
	builtInCats.Add(BuiltInCategory.OST_Doors)

	MulticatFilter = ElementMulticategoryFilter(builtInCats)
	BBox = room.get_BoundingBox(None)
	IntersectsFilter = BoundingBoxIntersectsFilter(Outline( BBox.Min, BBox.Max ))
	logicalFilter = LogicalAndFilter(MulticatFilter, IntersectsFilter)
	Familycollector = FilteredElementCollector(doc).WhereElementIsNotElementType().WhereElementIsViewIndependent().OfClass(FamilyInstance).WherePasses(logicalFilter).ToElements()
        result = [fi for fi in Familycollector]
        return result

def GetDoorWidth(Doors):
	doorwidth = []
	for door in Doors:
		try:
			width = door.Symbol.get_Parameter(BuiltInParameter.DOOR_WIDTH).AsDouble()*304.8
			if width > 0:	doorwidth.append(width)
		except:
			pass
	return doorwidth
	
######################## INPUT ##################################

rooms = flatten(tolist(UnwrapElement(IN[0])))

#################### Elements in Room ##########################
"""
doorwidht = []
familyInstance = []
for index, room in enumerate(rooms):
	Rnumber = room.Number
	fiir = FamilyInRoom(room)
	doorwidht.append(GetDoorWidth(fiir))
	familyInstance.append(fiir)
    
"""
################### Get Door Widht #############################

OUT = GetDoorWidth(rooms)
# ----------------------------------------
code_block_3 = CodeBlock(x=py_script_get_doors_in_room) { x/2; }
byCenterPointRadius = Circle.ByCenterPointRadius(centerPoint=getLocation_2, radius=code_block_3)
join = List.Join(uniqueItems, byCenterPointRadius)
flatten_2 = Flatten(join)
intersectAll = Curve.IntersectAll(flatten_2)
splitByPoints = Curve.SplitByPoints(curve=uniqueItems, points=intersectAll)
flatten_3 = Flatten(splitByPoints)
uniqueItems_3 = List.UniqueItems(flatten_3)
superJoin = Custom[CW.Curve.SuperJoin](Curves=uniqueItems_3)  # Join all connected curves into Polycurves even they are intersected
startPoint = Curve.StartPoint(superJoin.Curves_PolyCurves)
endPoint = Curve.EndPoint(superJoin.Curves_PolyCurves)
byStartPointEndPoint = Line.ByStartPointEndPoint(startPoint=startPoint, endPoint=endPoint)
byLine = archilab.Revit.Elements.FamilyInstances.ByLine(family_types, byStartPointEndPoint)  # unwired: arg2
orientation = Custom[Wall.Orientation]()  # Gets the orientation of a given wall instance (normal of the exterior face of the wall). Will *not* work for walls hosted on mass faces or in-place walls.; unwired: wall
intersects = BoundingBox.Intersects()  # unwired: arg0, arg1
intersection = BoundingBox.Intersection()  # unwired: arg0, arg1
getElementsIntersect = Revit.BoundingBox.GetElementsIntersect()  # unwired: arg0, arg1
intersectAll_2 = Geometry.IntersectAll()  # unwired: geometry, others
superJoin_2 = Custom[CW.Curve.SuperJoin]()  # unwired: Curves
dyna_split = Custom[Dyna Split]()  # Dynamo Split Node; unwired: Geometry, Geometry_2
multiple_split = Custom[Multiple Split]()  # splits geometry with several cutting elements; unwired: entity, geometries
geometrySplit = Geometry.Intersection.GeometrySplit()  # unwired: arg0, arg1
addSplitLine = Custom[SlabShape.AddSplitLine]()  # Adds split lines to Revit Floors; unwired: Floor_element, Curve_s
split = Geometry.Split()  # unwired: geometry, other
goldenMean = Custom[GoldenMean]()  # Calculates the goldern mean of a rectangle (width and length) given an area input.; unwired: area
python_script_2 = Python()  # frozen; unwired: IN[0], IN[1], IN[2], IN[3], IN[4]
# ---------- python_script_2.python (102 lines) ----------
#Copyright(c) 2016 www.Learndynamo.com 
#Please contact at jeremy@learndynamo.com

import clr
clr.AddReference('RevitAPI')
clr.AddReference("RevitServices")
clr.AddReference("RevitNodes")
import RevitServices
import Revit
import Autodesk
from Autodesk.Revit.DB import *
from math import *

clr.ImportExtensions(Revit.GeometryConversion)

from RevitServices.Persistence import DocumentManager
from RevitServices.Transactions import TransactionManager

doc = DocumentManager.Instance.CurrentDBDocument

toggle = IN[0]
points = UnwrapElement(IN[1])
modelPoints = UnwrapElement(IN[2])
cropCurves = UnwrapElement(IN[3])
viewType = UnwrapElement(IN[4])

lst = []

#Get Family View Type
vft = 0
collector = FilteredElementCollector(doc).OfClass(ViewFamilyType).ToElements()

#eleViews = []
for i in collector:
	if i.ViewFamily == ViewFamily.Elevation:		
		vft = i.Id
		break
 
if toggle == True:
	
	TransactionManager.Instance.EnsureInTransaction(doc)
	
	for ind, point in enumerate(points):
	
		#Retrieve the mid point of model lines and get X,Y.		
		modelMP = modelPoints[ind].ToXyz()
		modelMPX = modelMP.X
		modelMPY = modelMP.Y
		
		#Retrieve individual lines of crop window.		
		cropLines = cropCurves[ind]
		l1 = cropLines[0].ToRevitType()
		l2 = cropLines[1].ToRevitType()
		l3 = cropLines[2].ToRevitType()
		l4 = cropLines[3].ToRevitType()
					
		# Create a line in the z-Axis for elevation marker to rotate around.			
		elevationPT = point.ToXyz()
		elptRotate = XYZ(elevationPT.X, elevationPT.Y, elevationPT.Z+100)
		ln = Line.CreateBound(elevationPT, elptRotate)

		#Calculate the angle between Model Mid Point and Elevation Point.
		elevationPTY = elevationPT.Y
		elevationPTX = elevationPT.X							
		combY = elevationPTY-modelMPY
		combX = elevationPTX-modelMPX			
		ang = atan2(combY, combX)

		#Create elevation marker and elevation in position 0.
		eleMarker = ElevationMarker.CreateElevationMarker(doc, viewType.Id, elevationPT, 100)
		ele = eleMarker.CreateElevation(doc, doc.ActiveView.Id , 0)
		
		#Rotate elevation marker towars model line.
		ElementTransformUtils.RotateElement(doc, eleMarker.Id, ln, ang)
		
		#	
		crManager = ele.GetCropRegionShapeManager()
		#crShape = crManager.GetCropRegionShape()

		newCurveLoop = []
		newCurveLoop.Add(l1)
		newCurveLoop.Add(l2)
		newCurveLoop.Add(l3)
		newCurveLoop.Add(l4)
			
		cLoop = CurveLoop.Create(newCurveLoop)

		try:			
			crManager.SetCropRegionShape(cLoop)
			lst.append("Elevation Created")
		
		except:
			pass
			lst.append("Missed Elevation")

	TransactionManager.Instance.TransactionTaskDone()
	
	OUT = lst
	
else:

	OUT = "Set toggle to TRUE"
# ----------------------------------------
flatten_4 = Flatten()  # frozen; unwired: arg0
python_script_3 = Python(IN[0]=flatten_4)
# ---------- python_script_3.python (45 lines) ----------
import clr
clr.AddReference('RevitAPI')
from Autodesk.Revit.DB import *

clr.AddReference("RevitNodes")
import Revit
clr.ImportExtensions(Revit.Elements)

clr.AddReference("RevitServices")
import RevitServices
from RevitServices.Persistence import DocumentManager

doc = DocumentManager.Instance.CurrentDBDocument


def GetElemType(e):
	doc = DocumentManager.Instance.CurrentDBDocument
	try:
		elemType = doc.GetElement(e.GetTypeId())
		return elemType
	except:
		pass


walls = UnwrapElement(IN[0])
inserts = []

for w in walls:
	inserts.append(w.FindInserts(True, False, False, False))

elementlistA = []

for item in inserts:
	elementlistB = []
	for i in item:
		insert = doc.GetElement(i)
		elementlistB.append(insert.ToDSType(True))
	elementlistA.append(elementlistB)



levelFilter = ElementLevelFilter(UnwrapElement(walls[0].Level).Id)
OUT = FilteredElementCollector(doc).WhereElementIsNotElementType().OfCategory(BuiltInCategory.OST_Doors).WherePasses(levelFilter).ToElements()

OUT = elementlistA
# ----------------------------------------
almostEqual = Custom[Springs.Math.AlmostEqual]()  # Checks if a number is almost equal to a value with a specified tollerance.; unwired: a, b
python_script_4 = Python(IN[0]=getLocation, IN[1]=getTotalWidth, IN[2]=exteriorDirection)  # frozen
# ---------- python_script_4.python (55 lines) ----------
import clr
clr.AddReference('RevitAPI')
from Autodesk.Revit.DB import *
clr.AddReference("RevitServices")
import RevitServices
from RevitServices.Persistence import DocumentManager
from RevitServices.Transactions import TransactionManager
clr.AddReference('RevitNodes')
import Revit
clr.ImportExtensions(Revit.GeometryConversion)
clr.ImportExtensions(Revit.Elements)
clr.AddReference('ProtoGeometry')
from Autodesk.DesignScript.Geometry import *

import System
from System.Collections.Generic import *

def process_list(_func, _list):
	return map( lambda x: process_list(_func, x) if type(x)==list else _func(x), _list )

def makeRvtDetailLines(crv, _lineStyle):
	detailLine = doc.Create.NewDetailCurve(doc.ActiveView, crv)
	if detailLine != None:
		detailLine.LineStyle = _lineStyle
	return detailLine

curves = IN[0]
offsetDist = IN[1]
vector = IN[2]

lenght = []
newcrv = []
for crv, dist, vct in zip(curves, offsetDist, vector):
    lenght.append(crv.Length)
    crv = crv.ToRevitType()
    vctr = UnwrapElement(vct).ToXyz(True)
    newcrv.append(crv.CreateOffset(dist, vctr))




	
"""
names.sort(key=lambda x: len(x))
for cof in loop:
	validcrvs = cof.CreateViaOffset(cof, offsetDist, vector)
	


Intersect(Curve, IntersectionResultArray )


"""

OUT = newcrv
# ----------------------------------------
fromCurve = Custom[CW.DetailLine.FromCurve]()  # Creates a detail line based on a given curve; unwired: curve, view
as_polycurve_bycurves = Custom[AS.[&] PolyCurve.ByCurves]()  # Create polycurves from an unordered list of curves.; unwired: curves
location = Custom[Element.Location+]()  # Returns the location of an element as an XYZ (or if it's line-based the start and end point of the line), along with some booleans to help filtering the results. Use this for some element types (e.g. walls or lines) that do not work with the built-in Get Family Instance Location node.; unwired: element
python_script_5 = Python()  # frozen; unwired: IN[0], IN[1]
# ---------- python_script_5.python (34 lines) ----------
# Colin McCrone
# https://twitter.com/ColinMcCrone
# 2016-05-15

import clr
clr.AddReference('ProtoGeometry')
from Autodesk.DesignScript.Geometry import *

def Flatten2D(ls):
	flat = []	
	for x in ls:
		if type(x) is list:
			for y in x:
				flat.append(y)
		else:
			flat.append(x)	
	return flat

# Main function
geom = IN[0]
tools = IN[1]

pieces = []
pieces.append(geom)

for tool in tools:
	assert type(tool) is not list
	newPieces = []
	for piece in pieces:
		assert type(piece) is not list
		newPieces.append(Flatten2D(Geometry.Split(piece,tool)))
	pieces = Flatten2D(newPieces)

OUT = pieces
# ----------------------------------------
rooms = Custom[Door.Rooms]()  # Gets the rooms that are connected by a given door; unwired: door
doors = Custom[Room.Doors]()  # Retrieves all doors that are associated with a room (hosted in walls and roofs).; unwired: room
rooms_2 = Custom[CW.Door.Rooms]()  # Gets the rooms that are connected by a given door; unwired: door, phase
