# Dynamo graph Group-2-Ungroup.dyn (Dynamo 2.0.2.6826)

# note: ArchiLab Package
get_all_detail_groups = Custom[Get All Detail Groups]()  # This node will retrieve all instances of Detail Groups in the model.
# note: Clockword Package
ungroup = Custom[Group.Ungroup](group=get_all_detail_groups.Groups)  # Ungroups a group and returns the ungrouped elements.
watch = Watch(ungroup)
