# Dynamo graph Ignore errors_v1.1.dyn (Dynamo 1.3.3.4651)

# group: ЭЛЕМЕНТЫ УПРАВЛЕНИЯ
# note: ПЕРЕМЕННЫЕ ЗНАЧЕНИЯ
# note: ЭЛЕМЕНТЫ УПРАВЛЕНИЯ

# group: ПОЛУЧАЕМ ДАННЫЕ
# note: ПОЛУЧАЕМ ДАННЫЕ ИЗ РЕВИТ и других источников

# group: ПРОВЕРОЧНЫЕ НОДЫ
# note: ПРОВЕРОЧНЫЕ НОДЫ

# group: КЛЮЧЕВЫЕ МОМЕНТЫ РАБОТЫ 1
# note: КОНСОЛИДАЦИЯ И СЛОЖНЫЕ ОБРАБОТКИ

# group: ИСПОЛНИТЕЛЬНЫЕ НОДЫ (фильтрование, подбор, списки и т.д.)
# note: ИСПОЛНИТЕЛЬНЫЕ НОДЫ

# group: ПЕРЕДАЁМ ИНФОРМАЦИЮ
# note: ПЕРЕДАЁМ ИНФОРМАЦИЮ В РЕВИТ
# note: ПЕРЕДАЁМ ИНФОРМАЦИЮ ЕЩЁ КУДА-ТО

# group: ЗАПАСНЫЕ ВАРИАНТЫ, ДОПОЛНИТЕЛЬНЫЕ ОПЦИИ
# note: ЗАПАСНЫЕ
# note: ДОПОЛНИТЕЛЬНЫЕ. Градации серово по важности, темнее - важнее

# group: ПРИМЕЧАНИЯ ПО ЦВЕТОВОЙ ГРУППИРОВКЕ
# note: GUIDELINES

# group: КЛЮЧЕВЫЕ МОМЕНТЫ РАБОТЫ 2
# note: УСЛОЖНЕННЫЕ КОНСТРУКЦИИ
# note: УСЛОЖНЕНЫЕ КОНСТРУКЦИИ

# group: Python ноды
# note: Python

# group: ЭЛЕМЕНТЫ УПРАВЛЕНИЯ 2 УРОВЕНЬ
# note: ЭЛЕМЕНТЫ УПРАВЛЕНИЯ
# note: ПЕРЕМЕННЫЕ ЗНАЧЕНИЯ

# group: Запуск питона из внешнего файла
# note: Py - files

boolean = BoolSelector(true)  # frozen
code_block = CodeBlock { 1; 2; }
if_ = Python(IN[0]=boolean, IN[1]=code_block.out0, IN[2]=code_block.out1)
# ---------- if_.python (12 lines) ----------
import clr
boolean = IN[0]
true = UnwrapElement(IN[1])
false = UnwrapElement(IN[2])

if boolean:
	out = true
else:
	out = false

#Назначьте вывод переменной OUT.
OUT = out
# ----------------------------------------
parameters = Element.Parameters()  # unwired: arg0
geometry = Element.Geometry()  # unwired: arg0
setParameterByName = Element.SetParameterByName()  # unwired: element, parameterName, value
# note: ВСЁ ОСТАЛЬНОЕ
select_model_elements = DSModelElementsSelection()  # frozen
code_block_2 = CodeBlock { "Марка"; }
getParameterValueByName = Element.GetParameterValueByName(element=select_model_elements, parameterName=code_block_2)

# group: Parameters name from language
parameters_name_from_language = Python()  # frozen
# ---------- parameters_name_from_language.python (18 lines) ----------
import clr
clr.AddReference('RevitServices')
import RevitServices
from RevitServices.Persistence import DocumentManager

uiapp = DocumentManager.Instance.CurrentUIApplication
app = uiapp.Application
lng = app.Language
rus = ["Тип","Имя семейства","Имя типа"]
enu = ["Type","Family name","Type name"]
out = []
if str(lng) == "Russian":
	out = rus
else:
	out = enu
#English_USA
#Russian
OUT = out
# ----------------------------------------

# group: элементы внутри групп
members = Python()  # "Group.Members"; frozen; unwired: IN[0]
# ---------- members.python (19 lines) ----------
import clr
clr.AddReference('RevitAPI')
from Autodesk.Revit.DB import *

clr.AddReference("RevitNodes")
import Revit
clr.ImportExtensions(Revit.Elements)

groups = UnwrapElement(IN[0])
elementlist = list()
for item in groups:
	try:
		memberlist = list()
		for member in item.GetMemberIds():
			memberlist.append(item.Document.GetElement(member))
		elementlist.append(memberlist)
	except:
		elementlist.append(list())
OUT = elementlist
# ----------------------------------------

путь_к_файлу_python = Filename(".\N.Отделка помещений_сбор элементов вокруг_1.7.py")  # frozen
forceChildrensEval = ForceChildrensEval(путь_к_файлу_python)
find_file_and_import_it = Python(IN[0]=forceChildrensEval)
# ---------- find_file_and_import_it.python (11 lines) ----------
import sys
sys.path.append('C:\Program Files (x86)\IronPython 2.7\Lib')
import codecs

try:
	filePath = IN[0]
	with codecs.open(filePath, 'rb', "utf-8") as inf:
		lines = inf.readlines()
	OUT = ''.join(lines)
except:
	OUT = "No file"
# ----------------------------------------
python_script_from_string = PythonStringNode(script=find_file_and_import_it)  # unwired: IN[0]
categories = Categories()  # frozen
all_elements_of_category = ElementsOfCategory(categories)
regenerate = Python()  # frozen; unwired: IN[0]
# ---------- regenerate.python (26 lines) ----------
import clr

# Import DocumentManager and TransactionManager
clr.AddReference("RevitServices")
import RevitServices
from RevitServices.Persistence import DocumentManager


# Import RevitAPI
clr.AddReference("RevitAPI")
import Autodesk
from Autodesk.Revit.DB import *

doc = DocumentManager.Instance.CurrentDBDocument


#The inputs to this node will be stored as a list in the IN variable.
list = IN[0]


if list:
	doc.Regenerate()
	out = "Regeneration complete"
else:
	out = "fail"
OUT = out
# ----------------------------------------
members_2 = Python()  # "Object.Members"; frozen; unwired: IN[0]
# ---------- members_2.python (14 lines) ----------
import clr

items = IN[0]
elementlist = list()

try:
	clr.AddReference('RevitAPI')
	from Autodesk.Revit.DB import *
	for item in items:
		elementlist.append(dir(UnwrapElement(item)))
except:
	for item in items:
		elementlist.append(dir(item))
OUT = elementlist
# ----------------------------------------

# group: Get Revit Selection:
forceChildrensEval_2 = ForceChildrensEval()  # frozen; unwired: arg0
pys_get_revit_selection = Python(IN[0]=forceChildrensEval_2)
# ---------- pys_get_revit_selection.python (22 lines) ----------
import clr
clr.AddReference('RevitServices')
clr.AddReference('RevitAPI')
from Autodesk.Revit.DB import *
import RevitServices
from RevitServices.Persistence import DocumentManager
from Autodesk.Revit.ApplicationServices import Application

reset = IN[0]

doc = DocumentManager.Instance.CurrentDBDocument
uidoc = DocumentManager.Instance.CurrentUIApplication.ActiveUIDocument
ids = uidoc.Selection.GetElementIds()

idd = [str(i) for i in ids]

if isinstance(idd, list) == True:
	elems = [doc.GetElement(ElementId(int(i))) for i in idd]
else:
	elems = doc.GetElement(ElementId(int(idd)))

OUT = elems
# ----------------------------------------

filteredElementCollector = Python(IN[0]=pys_get_revit_selection)
# ---------- filteredElementCollector.python (32 lines) ----------
import clr

# Import DocumentManager and TransactionManager
clr.AddReference("RevitServices")
import RevitServices
from RevitServices.Persistence import DocumentManager


# Import RevitAPI
clr.AddReference("RevitAPI")
import Autodesk
from Autodesk.Revit.DB import *

doc = DocumentManager.Instance.CurrentDBDocument
uiapp = DocumentManager.Instance.CurrentUIApplication
app = uiapp.Application

from System.Collections.Generic import *


#The inputs to this node will be stored as a list in the IN variable.
dataEnteringNode = IN
collector = FilteredElementCollector(doc)
elements = collector.OfCategory(BuiltInCategory.OST_Views).ToElements()

floors = UnwrapElement(IN[0])
test = []

for f in floors:
	test.append(f.Location.ToDSType(True))

OUT = test
# ----------------------------------------
shablon_python_shablon = Python(IN[0]=select_model_elements, IN[1]=code_block_2)
# ---------- shablon_python_shablon.python (31 lines) ----------
# -*- coding: utf-8 -*- 
#-----------------------Импоорт библиотек----------------------
import clr
clr.AddReference('RevitAPI')
import Autodesk
from Autodesk.Revit.DB import *

clr.AddReference("RevitNodes") 
import Revit
from Revit.Elements import *

"""
clr.ImportExtensions(Revit.Elements) #ToDSType не работает без
clr.ImportExtensions(Revit.GeometryConversion) #ToXyz не работает без

clr.AddReference("RevitServices")
import RevitServices
from RevitServices.Persistence import DocumentManager
from RevitServices.Transactions import TransactionManager

clr.AddReference('ProtoGeometry')
from Autodesk.DesignScript.Geometry import *
"""

y = IN[0]
param = IN[1]
test = Element.GetParameterValueByName(y,param)

#-----------------------КОНЕЦ СКРИПТА----------------------

OUT = test
# ----------------------------------------
forceChildrensEval_3 = ForceChildrensEval()  # unwired: arg0
warningswallower = Python(IN[0]=forceChildrensEval_3)  # "WarningSwallower ( IFailuresProcessor )"
# ---------- warningswallower.python (133 lines) ----------
# -*- coding: utf-8 -*- 
import sys 
sys.path.append("C:\Program Files (x86)\IronPython 2.7\Lib")

import clr
clr.AddReference('RevitAPI')
import Autodesk
from Autodesk.Revit.DB import IFailuresProcessor, FailureResolutionType, BuiltInFailures, FailureSeverity, FailureProcessingResult


clr.AddReference('RevitServices')
from RevitServices.Persistence import DocumentManager
from RevitServices.Transactions import TransactionManager

import System
from System import Type,Text,IO
clr.AddReference('System')
from System.Collections.Generic import List

import traceback

file_path = 'C:\\temp\\warning_log.txt'
current_doc = DocumentManager.Instance.CurrentDBDocument
uiapp = DocumentManager.Instance.CurrentUIApplication
app = uiapp.Application
#fail_def_reg = app.GetFailureDefinitionRegistry()

def flatten(container):
    for i in container:
        if isinstance(i, (list,tuple)):
            for j in flatten(i):
                yield j
        else:
            yield i
            
def combine_results(list):
	str_list = [str(i) for i in list]
	return ", ".join(str_list)
	
def LogSave(info):
	IO.File.AppendAllLines(file_path, flatten(info), Text.Encoding.Unicode)	            
            
def FailureResolutionTypes():
	fail_res_types = []
	fail_res_types.append(FailureResolutionType.Invalid)
	fail_res_types.append(FailureResolutionType.Default)
	fail_res_types.append(FailureResolutionType.CreateElements)
	fail_res_types.append(FailureResolutionType.DeleteElements)
	fail_res_types.append(FailureResolutionType.SkipElements)
	fail_res_types.append(FailureResolutionType.MoveElements)
	fail_res_types.append(FailureResolutionType.FixElements)
	fail_res_types.append(FailureResolutionType.DetachElements)
	fail_res_types.append(FailureResolutionType.QuitEditMode)
	fail_res_types.append(FailureResolutionType.UnlockConstraints)
	fail_res_types.append(FailureResolutionType.SetValue)
	fail_res_types.append(FailureResolutionType.SaveDocument)
	fail_res_types.append(FailureResolutionType.ShowElements)
	fail_res_types.append(FailureResolutionType.Others)
	return fail_res_types
	
def FailListDict():
	clr_binf_type = clr.GetClrType(BuiltInFailures) #BINGO
	clr_list_of_binf_fails = clr_binf_type.GetNestedTypes()
	#Словарь BuiltInFailures где key: имя класса ошибки + свойство ошибки; value: FailureDefinitionId 
	dict_binf_and_id = {"{0}.{1}".format(binf.FullName.replace("+","."),binfprop.Name):binfprop.GetGetMethod().Invoke(binf, None) for binf in clr_list_of_binf_fails for binfprop in binf.GetProperties()}
	return dict_binf_and_id

def fail_stat(fail_m):
	result = []
	ad_ids = [eid.IntegerValue for eid in fail_m.GetAdditionalElementIds()]
	fail_ids = [eid.IntegerValue for eid in fail_m.GetFailingElementIds()]
	has_res_of_type = ["{0} = {1}".format(str(res_type),str(fail_m.HasResolutionOfType(res_type))) for res_type in FailureResolutionTypes() if fail_m.HasResolutionOfType(res_type)]
	result.append("***")
	#result.append(fail_m.HasResolutions())# 0
	result.append("FailureType = {0}".format(fail_m.GetSeverity()))# 1
	#result.append(fail_m.GetDescriptionText())# 2
	#result.append(fail_m.GetDefaultResolutionCaption())# 3
	if fail_m.HasResolutions():
		result.append("CurrentResolutionType = {}".format(fail_m.GetCurrentResolutionType()))# 4
	else:
		result.append("CurrentResolutionType = {}".format("does not have any resolutions"))
	#result.append(fail_m.GetNumberOfResolutions())# 5
	result.append(fail_m.GetFailureDefinitionId().Guid)
	#result.append(fail_def_reg.FindFailureDefinition(fail_m.GetFailureDefinitionId()))# 6
	result.append("AdditionalElementIds: {}".format(ad_ids))# 7
	result.append("FailingElementIds: {}".format(fail_ids))# 8 
	result.append(has_res_of_type)# 9
	result.append([(item[0],str(item[1].Guid.ToString())) for item in FailListDict().items() if item[1] == fail_m.GetFailureDefinitionId()])
	result.append("***")
	string_list = [str(r) for r in result]
	return string_list

class WarningSwallower_BC(IFailuresProcessor):
	def ProcessFailures(self, failuresAccessor):
		fail_messages = failuresAccessor.GetFailureMessages() #IList<FailureMessageAccessor>
		LogFails = []
		try:
			for fail_m in fail_messages:
				info = fail_stat(fail_m)
				"""if fail_m.GetFailureDefinitionId() == Autodesk.Revit.DB.BuiltInFailures.CurtainWallFailures.DependentGridlineMayBeDeleted:
					#fail_m.SetCurrentResolutionType(FailureResolutionType.DeleteElements)
					failuresAccessor.ResolveFailure(fail_m)
					info = fail_stat(fail_m)
					LogSave(info)
					failuresAccessor.DeleteWarning(fail_m)
					return FailureProcessingResult.ProceedWithCommit
				if fail_m.GetFailureDefinitionId() == Autodesk.Revit.DB.BuiltInFailures.OverlapFailures.WallsOverlap:
					#failuresAccessor.DeleteElements(fail_m.GetFailingElementIds())
					#info = fail_stat(fail_m)
					LogSave(info)
					failuresAccessor.DeleteWarning(fail_m)
					return FailureProcessingResult.ProceedWithRollBack"""
				#elif fail_m.GetFailureDefinitionId() == Autodesk.Revit.DB.BuiltInFailures.OverlapFailures.DuplicateInstances:
				#	LogSave(info)
				#	return FailureProcessingResult.Continue
				if fail_m.GetSeverity() == FailureSeverity.Warning:
					failuresAccessor.DeleteWarning(fail_m)
					LogSave(info)
					return FailureProcessingResult.Continue
				else:
					failuresAccessor.ResolveFailure(fail_m)
					LogSave(info)
					return FailureProcessingResult.ProceedWithCommit
		except Exception as e:
			tb2 = sys.exc_info()[2]
			line = tb2.tb_lineno
			LogSave(["Code error on line: {0} Has failure: {1}".format(str(line),str(e))])
	def Dismiss(self, current_doc):
		pass	
	
app.RegisterFailuresProcessor(WarningSwallower_BC())

OUT = "WarningSwallower_ON"
# ----------------------------------------
