# Dynamo graph IldarScript_МаркаДверейНаЛегенде_ДваФасада_Final.dyn (Dynamo 1.3.3.4111)

forceChildrensEval = ForceChildrensEval()  # unwired: arg0
boolean = BoolSelector(true)
имя_вида_легенды = Views("Test")
выберите_двери_на_легенде = DSModelElementsSelection()  # 10 picked in the model

# group: Получаем центральные точки расположения дверей
solids = Element.Solids(выберите_двери_на_легенде)
isNull = Object.IsNull(solids, lacing=Longest)
filterByBoolMask = List.FilterByBoolMask(list=solids, mask=isNull)
byUnion = Solid.ByUnion(filterByBoolMask.out, lacing=Longest)
code_block = CodeBlock { 2; }
chop = List.Chop(list=byUnion, lengths=code_block)
byUnion_2 = Solid.ByUnion(chop, lacing=Longest)
centroid = Solid.Centroid(byUnion_2)
flatten = Flatten(centroid)

code_block_2 = CodeBlock { "Тип компонента"; }
getParameterValueByName = Element.GetParameterValueByName(element=выберите_двери_на_легенде, parameterName=code_block_2)
code_block_3 = CodeBlock { "Высота"; }
getParameterValueByName_2 = Element.GetParameterValueByName(element=getParameterValueByName, parameterName=code_block_3)
code_block_4 = CodeBlock { 300; }

# group: Линии для легенды дверей
boundingBox = Geometry.BoundingBox(byUnion_2)
toCuboid = BoundingBox.ToCuboid(boundingBox)
length = Cuboid.Length(toCuboid)
высота = CodeBlock(ф=length, b=code_block_4) { ф+(b*3)+b; }
centroid_2 = Solid.Centroid(byUnion_2)
byOrigin = CoordinateSystem.ByOrigin(centroid_2)
width = Cuboid.Width(toCuboid)

# group: Точка размещения текста маркировки
X = Point.X(flatten)
Y = Point.Y(flatten)
code_block_5 = CodeBlock(ф=getParameterValueByName_2) { (ф/2)+200; }
code_block_6 = CodeBlock(a=Y, b=code_block_5) { a+b; }
byCoordinates = Point.ByCoordinates(x=X, y=code_block_6)
YAxis = Vector.YAxis()
code_block_7 = CodeBlock(a=высота) { a-(a-400); }
translate = Geometry.Translate(geometry=byCoordinates, direction=YAxis, distance=code_block_7)

code_block_8 = CodeBlock { "Маркировка типоразмера"; }
getParameterValueByName_3 = Element.GetParameterValueByName(element=getParameterValueByName, parameterName=code_block_8)
uniqueItems = List.UniqueItems(getParameterValueByName_3)
тип_шрифта_для_маркировки = StringInput("ГОСТ_3.0_Ж")
byName = TextNoteType.ByName(тип_шрифта_для_маркировки)
code_block_9 = CodeBlock { 0.2; }
марка_двери = Python(IN[0]=forceChildrensEval, IN[1]=boolean, IN[2]=имя_вида_легенды, IN[3]=translate, IN[4]=uniqueItems, IN[5]=byName, IN[6]=code_block_9)
# ---------- марка_двери.python (63 lines) ----------
#Copyright(c) 2018, Ildar Kachurin
# ildar.kachurin@gmail.com
# YouTube Chanel: https://www.youtube.com/channel/UCB65mpqQH_rlNTs0MsCw2Lw?view_as=subscriber

reset = IN[0]
if IN[1] !=True: off = 1/0
import clr
clr.AddReference('RevitAPI')
import Autodesk
from Autodesk.Revit.DB import*
from Autodesk.Revit.DB.Structure import*

from System.Collections.Generic import*

import System
clr.AddReference('System.Core')
clr.ImportExtensions(System.Linq)

import math

clr.AddReference('ProtoGeometry')
from Autodesk.DesignScript.Geometry import*

clr.AddReference("RevitNodes")
import Revit
clr.ImportExtensions(Revit.Elements)
clr.ImportExtensions(Revit.GeometryConversion)

clr.AddReference("RevitServices")
import RevitServices
from RevitServices.Persistence import DocumentManager
from RevitServices.Transactions import TransactionManager

doc = DocumentManager.Instance.CurrentDBDocument

TransactionManager.Instance.EnsureInTransaction(doc)

view = UnwrapElement(IN[2])
points = UnwrapElement(IN[3])
string = IN[4]
typeText = UnwrapElement(IN[5])
width = IN[6]
xyzlist = []


for point in points:
	xyz = point.ToXyz()
	xyzlist.append(xyz)
	
opts = TextNoteOptions(typeText.Id)
opts.HorizontalAlignment = HorizontalTextAlignment.Center

i=0
while i<points.Count:
	newText = TextNote.Create(doc, view.Id, xyzlist[i], width, string[i], opts)
	i=i+1
	
TransactionManager.Instance.TransactionTaskDone()
		



OUT = IN[4]
# ----------------------------------------
maximumItem = List.MaximumItem(width)

# group (continued): Линии для легенды дверей
ширина = CodeBlock(ф=maximumItem, b=code_block_4) { ф+(b*3); }
byWidthLength = Rectangle.ByWidthLength(cs=byOrigin, width=ширина, length=высота)
explode = Geometry.Explode(byWidthLength)
byCurve = Custom[DetailCurve.ByCurve+](curve=explode, view=имя_вида_легенды)  # Creates a detail line based on a given curve

geometry = Element.Geometry(выберите_двери_на_легенде)
lastItem = List.LastItem(geometry, lacing=Longest)
perimeterCurves = Surface.PerimeterCurves(lastItem)
byJoinedCurves = PolyCurve.ByJoinedCurves(perimeterCurves, lacing=Longest)
offset = Curve.Offset(curve=byJoinedCurves, distance=code_block_4, lacing=Longest)
explode_2 = Geometry.Explode(offset)
lastItem_2 = List.LastItem(explode_2, lacing=Longest)
byCurve_2 = Custom[DetailCurve.ByCurve+](curve=lastItem_2, view=имя_вида_легенды)

# group: Линии вертикальных размеров
explode_3 = Geometry.Explode(byJoinedCurves)
code_block_10 = CodeBlock { 2; }
chop_2 = List.Chop(list=explode_3, lengths=code_block_10, lacing=Longest)
code_block_11 = CodeBlock { 1; }
flatten_2 = List.Flatten(list=chop_2, amt=code_block_11)

# group: Линии горизонтальных размеров
firstItem = List.FirstItem(flatten_2, lacing=Longest)
code_block_12 = CodeBlock { 2; }
chop_3 = List.Chop(list=firstItem, lengths=code_block_12)
для_горизотальных_размеров = CodeBlock(x=chop_3) { x; }

byCurve_3 = Custom[DetailCurve.ByCurve+](curve=для_горизотальных_размеров, view=имя_вида_легенды)
создание_горизонтальных_размеров = Python(IN[0]=имя_вида_легенды, IN[1]=byCurve_2, IN[2]=byCurve_3)
# ---------- создание_горизонтальных_размеров.python (57 lines) ----------
#Copyright(c) 2018, Ildar Kachurin
# ildar.kachurin@gmail.com
# YouTube Chanel: https://www.youtube.com/channel/UCB65mpqQH_rlNTs0MsCw2Lw?view_as=subscriber


import clr
clr.AddReference('RevitAPI')
import Autodesk
from Autodesk.Revit.DB import*
from Autodesk.Revit.DB.Structure import*

from System.Collections.Generic import*

import System
clr.AddReference('System.Core')
clr.ImportExtensions(System.Linq)

import math

clr.AddReference('ProtoGeometry')
from Autodesk.DesignScript.Geometry import*

clr.AddReference("RevitNodes")
import Revit
clr.ImportExtensions(Revit.Elements)
clr.ImportExtensions(Revit.GeometryConversion)

clr.AddReference("RevitServices")
import RevitServices
from RevitServices.Persistence import DocumentManager
from RevitServices.Transactions import TransactionManager

doc = DocumentManager.Instance.CurrentDBDocument

TransactionManager.Instance.EnsureInTransaction(doc)

view = UnwrapElement(IN[0])
line = UnwrapElement(IN[1])
elements = UnwrapElement(IN[2])
elementsRef = []
linelist = []
outList = []

for i in line:
	linelist.append(i.GeometryCurve)

for elementlist in elements:
	arr = ReferenceArray()
	for e in elementlist:
		arr.Append(Reference(e))
	elementsRef.append(arr)

for l, r in zip(linelist,elementsRef):
	outList.append(doc.Create.NewDimension(view, l, r))

TransactionManager.Instance.TransactionTaskDone()
OUT = outList, line
# ----------------------------------------
lastItem_3 = List.LastItem(создание_горизонтальных_размеров)
delete = Elements.Element.Delete(lastItem_3)
firstItem_2 = List.FirstItem(explode_2, lacing=Longest)
byCurve_4 = Custom[DetailCurve.ByCurve+](curve=firstItem_2, view=имя_вида_легенды)

# group: Линии для вертикальных размеров
lastItem_4 = List.LastItem(flatten_2, lacing=Longest)
code_block_13 = CodeBlock { 2; }
chop_4 = List.Chop(list=lastItem_4, lengths=code_block_13)
для_вертикальных_размеров = CodeBlock(x=chop_4) { x; }

byCurve_5 = Custom[DetailCurve.ByCurve+](curve=для_вертикальных_размеров, view=имя_вида_легенды)
создание_вертикальных_размеров = Python(IN[0]=имя_вида_легенды, IN[1]=byCurve_4, IN[2]=byCurve_5)
# ---------- создание_вертикальных_размеров.python (57 lines) ----------
#Copyright(c) 2018, Ildar Kachurin
# ildar.kachurin@gmail.com
# YouTube Chanel: https://www.youtube.com/channel/UCB65mpqQH_rlNTs0MsCw2Lw?view_as=subscriber


import clr
clr.AddReference('RevitAPI')
import Autodesk
from Autodesk.Revit.DB import*
from Autodesk.Revit.DB.Structure import*

from System.Collections.Generic import*

import System
clr.AddReference('System.Core')
clr.ImportExtensions(System.Linq)

import math

clr.AddReference('ProtoGeometry')
from Autodesk.DesignScript.Geometry import*

clr.AddReference("RevitNodes")
import Revit
clr.ImportExtensions(Revit.Elements)
clr.ImportExtensions(Revit.GeometryConversion)

clr.AddReference("RevitServices")
import RevitServices
from RevitServices.Persistence import DocumentManager
from RevitServices.Transactions import TransactionManager

doc = DocumentManager.Instance.CurrentDBDocument

TransactionManager.Instance.EnsureInTransaction(doc)

view = UnwrapElement(IN[0])
line = UnwrapElement(IN[1])
elements = UnwrapElement(IN[2])
elementsRef = []
linelist = []
outList = []

for i in line:
	linelist.append(i.GeometryCurve)

for elementlist in elements:
	arr = ReferenceArray()
	for e in elementlist:
		arr.Append(Reference(e))
	elementsRef.append(arr)

for l, r in zip(linelist,elementsRef):
	outList.append(doc.Create.NewDimension(view, l, r))

TransactionManager.Instance.TransactionTaskDone()
OUT = outList,line
# ----------------------------------------
lastItem_5 = List.LastItem(создание_вертикальных_размеров)
delete_2 = Elements.Element.Delete(lastItem_5)
forceChildrensEval_2 = ForceChildrensEval()  # unwired: arg0
boolean_2 = BoolSelector(true)

# group: Точка размещения надписи внешнего фасада
centroid_3 = Solid.Centroid(chop, lacing=Longest)
firstItem_3 = List.FirstItem(centroid_3, lacing=Longest)
YAxis_2 = Vector.YAxis()
code_block_14 = CodeBlock(a=getParameterValueByName_2) { (a/2)+300; }
translate_2 = Geometry.Translate(geometry=firstItem_3, direction=YAxis_2, distance=code_block_14)

наименование_внешнего_фасада = StringInput("Вид 1 ")
count = Count(translate_2)
ofRepeatedItem = List.OfRepeatedItem(item=наименование_внешнего_фасада, amount=count)
тип_шрифта_для_описание_фасадов = StringInput("ГОСТ_2.0")
byName_2 = TextNoteType.ByName(тип_шрифта_для_описание_фасадов)
code_block_15 = CodeBlock { 0.2; }
наименование_внешнего_фасада_2 = Python(IN[0]=forceChildrensEval_2, IN[1]=boolean_2, IN[2]=имя_вида_легенды, IN[3]=translate_2, IN[4]=ofRepeatedItem, IN[5]=byName_2, IN[6]=code_block_15)  # same code as марка_двери
forceChildrensEval_3 = ForceChildrensEval()  # unwired: arg0
boolean_3 = BoolSelector(true)

# group: Точка размещения надписи внутреннего фасада
centroid_4 = Solid.Centroid(chop, lacing=Longest)
lastItem_6 = List.LastItem(centroid_4, lacing=Longest)
YAxis_3 = Vector.YAxis()
code_block_16 = CodeBlock(a=getParameterValueByName_2) { (a/2)+300; }
translate_3 = Geometry.Translate(geometry=lastItem_6, direction=YAxis_3, distance=code_block_16)

наименование_внутреннего_фасада = StringInput("Вид 2")
count_2 = Count(translate_3)
ofRepeatedItem_2 = List.OfRepeatedItem(item=наименование_внутреннего_фасада, amount=count_2)
byName_3 = TextNoteType.ByName(тип_шрифта_для_описание_фасадов)
code_block_17 = CodeBlock { 0.2; }
наименование_внутреннего_фасада_2 = Python(IN[0]=forceChildrensEval_3, IN[1]=boolean_3, IN[2]=имя_вида_легенды, IN[3]=translate_3, IN[4]=ofRepeatedItem_2, IN[5]=byName_3, IN[6]=code_block_17)  # same code as марка_двери
