# Dynamo graph Master automation.dyn (Dynamo 1.2.0.2690)

# group: Input
directory_path_journal_files = Directory("C:\Users\DDF\Documents\Dynamo\Test_Project_2016")
overwrite_existing_journal_file = BoolSelector(false)
directory_path_revit_models = Directory("C:\Users\DDF\Documents\Dynamo\Test_Project_2016")
file_path_dynamo_file = Filename("..\..\..\Documents\Dynamo\Test_Project_2016\Change_sheet_issue_date.dyn")
code_block = CodeBlock { "Dynamo_Journal_File"; }
revit_version = CodeBlock { 2016; }

byVersion = Custom[RevitExecutablePath.ByVersion]()  # Returns the path of Revit.exe based on a given Revit version

# group: List of Revit Files
fromPath = DirectoryObject(directory_path_revit_models)  # "Directory.FromPath"
code_block_2 = CodeBlock { "*.rvt"; }
contents = Directory.Contents(fromPath, code_block_2)

string = StringInput("\")

# group: Create Journal File
byVersion_2 = Custom[RevitAddinsPath.ByVersion]()  # Returns the path of Revit Addins folder based on a given Revit version
count = List.Count(contents)
code_block_3 = CodeBlock(n=count) { 1..n; }
string_from_object = FromObject(code_block_3)
code_block_4 = CodeBlock(jdir=byVersion_2, delimiter=string, jfilename=code_block, n=string_from_object)
# ---------- code_block_4.designscript (2 lines) ----------
// Create file names for journal files
jdir + delimiter + jfilename + "_" + n + ".txt";
# ----------------------------------------
byWorkspacePath = Dynamo.Automation.Journal.ByWorkspacePath(contents, file_path_dynamo_file, code_block_4, revit_version)

code_block_5 = CodeBlock(jpath=byWorkspacePath) { " /language ENU " + jpath; }
byPathAndArguments = ProcessRunner.Process.ByPathAndArguments(byVersion, code_block_5)
cleanup = Custom[JournalFiles.Cleanup](destinationDirectory=directory_path_journal_files, overwriteExistingFiles=overwrite_existing_journal_file, executionDone=byPathAndArguments, generatedJournalFiles=byWorkspacePath)  # Moves all journal files created during a batch-processing operation to a specified directory
