# Dynamo graph MathTransit.dyn (Dynamo 0.7.0.40046)

# note: Documentation for the formula node can be found at http://ncalc.codeplex.com/
code_block = CodeBlock { -10..10..#20; }
byCoordinates = Point.ByCoordinates(code_block, code_block, lacing=CrossProduct)
flatten = Flatten(byCoordinates)
X = Point.X(flatten)
Y = Point.Y(flatten)
# note: This just moves
# the geometry over
# for comparison.
code_block_2 = CodeBlock(x=Y) { x-60; }
amplitude = DoubleSlider(5.51, range=0..10)
C = DoubleSlider(1.724, range=0..5)
# note: The formula node, since it uses external functionalities, treats angles as radians.
formula = Formula("A * sin( sqrt( pow(x,2) + pow(y,2) + pow(c,2) ) ) / sqrt( pow(x,2) + pow(y,2) + pow(c,2) )", A=amplitude, x=X, y=Y, c=C)
byCoordinates_2 = Point.ByCoordinates(X, code_block_2, formula)
count = List.Count(byCoordinates)
chop = List.Chop(byCoordinates_2, count)
byPoints = NurbsCurve.ByPoints(chop)
byLoft = Surface.ByLoft(byPoints)
# note: This example shows four different ways to approach dealing with Math functions.  Each of these examples starts with a grid of points, calculates z-coordinates for the points and then makes a surface.  Only the calculation method differs; these methods all salove the same.
# 1. Nodes. Math nodes are in Core/Math/
# 2. Python.
# 2. Formula Node. This is a separate open-source project made available through Dynamo. Documentation for the formula node can be found at http://ncalc.codeplex.com/
# 3. Code Block Node.  Double-click anywhere in the canvas to create a code block node.  Syntax for each function matches the name of the node in Dynamo.
# ** Note: You can adjust the resolution of the geometry preview through the Settings Menu.
code_block_3 = CodeBlock { -10..10..#20; }
# note: Makes a grid of points.
# Note lacing behavior is
# "cross product."
byCoordinates_3 = Point.ByCoordinates(code_block_3, code_block_3, lacing=CrossProduct)
flatten_2 = Flatten(byCoordinates_3)
X_2 = Point.X(flatten_2)
Y_2 = Point.Y(flatten_2)
amplitude_2 = DoubleSlider(5.51, range=0..10)
number = DoubleInput(2)
pow = Math.Pow(X_2, number)
number_2 = DoubleInput(2)
pow_2 = Math.Pow(Y_2, number_2)
add = pow + pow_2
C_2 = DoubleSlider(1.724, range=0..5)
number_3 = DoubleInput(2)
pow_3 = Math.Pow(C_2, number_3)
add_2 = add + pow_3
sqrt = Math.Sqrt(add_2)
# note: Angles in Dynamo are in Degrees
radiansToDegrees = Math.RadiansToDegrees(sqrt)
sin = Math.Sin(radiansToDegrees)
div = sin / sqrt
mul = amplitude_2 * div
byCoordinates_4 = Point.ByCoordinates(X_2, Y_2, mul)
count_2 = List.Count(byCoordinates_3)
# note: Divides flat list into series
# of lists by row
chop_2 = List.Chop(byCoordinates_4, count_2)
# note: Creates NURBS curves
# through points
byPoints_2 = NurbsCurve.ByPoints(chop_2)
# note: Creates a surface
byLoft_2 = Surface.ByLoft(byPoints_2)
code_block_4 = CodeBlock { -10..10..#20; }
byCoordinates_5 = Point.ByCoordinates(code_block_4, code_block_4, lacing=CrossProduct)
flatten_3 = Flatten(byCoordinates_5)
X_3 = Point.X(flatten_3)
Y_3 = Point.Y(flatten_3)
code_block_5 = CodeBlock(x=Y_3) { x-90; }
C_3 = DoubleSlider(1.724, range=0..5)
amplitude_3 = DoubleSlider(5.51, range=0..10)
# note: Names for math methods match the names of the Dynamo nodes used in the first example.
code_block_6 = CodeBlock(x=X_3, y=Y_3, c=C_3, A=amplitude_3)
# ---------- code_block_6.designscript (6 lines) ----------
sum = Math.Pow(x,2) + Math.Pow(y,2) + Math.Pow(c,2);

num1 = Math.Sqrt(sum);
num2 = Math.Sin( Math.RadiansToDegrees(num1) );

A * num2 / num1;
# ----------------------------------------
byCoordinates_6 = Point.ByCoordinates(X_3, code_block_5, code_block_6.out3)
count_3 = List.Count(byCoordinates_5)
chop_3 = List.Chop(byCoordinates_6, count_3)
byPoints_3 = NurbsCurve.ByPoints(chop_3)
byLoft_3 = Surface.ByLoft(byPoints_3)
code_block_7 = CodeBlock { -10..10..#20; }
byCoordinates_7 = Point.ByCoordinates(code_block_7, code_block_7, lacing=CrossProduct)
flatten_4 = Flatten(byCoordinates_7)
X_4 = Point.X(flatten_4)
Y_4 = Point.Y(flatten_4)
code_block_8 = CodeBlock(x=Y_4) { x-30; }
amplitude_4 = DoubleSlider(5.51, range=0..10)
C_4 = DoubleSlider(1.724, range=0..5)
python_script = Python(IN[0]=amplitude_4, IN[1]=X_4, IN[2]=Y_4, IN[3]=C_4)
# ---------- python_script.python (27 lines) ----------
import clr
clr.AddReference('ProtoGeometry')
from Autodesk.DesignScript.Geometry import *

import math

# The inputs to this node will be stored as a list in the IN variable.
amp = IN[0]   # single value
x = IN[1]     # list
y = IN[2]     # list (expect same length as x)
c = IN[3]     # single value

# Declare an empty array of z-values
z = []

# Solve the equation for each x and y value
for index in range(len(x)):
	sum = math.pow(x[index],2) + math.pow(y[index],2) + math.pow(c,2)
	num1 = math.sqrt(sum)
	num2 = math.sin(num1)
	zVal = amp * num2 / num1
	
	# Append the answer to the list of z values
	z.append(zVal)

# Assign the z-values to the OUT variable
OUT = z
# ----------------------------------------
byCoordinates_8 = Point.ByCoordinates(X_4, code_block_8, python_script)
count_4 = List.Count(byCoordinates_7)
chop_4 = List.Chop(byCoordinates_8, count_4)
byPoints_4 = NurbsCurve.ByPoints(chop_4)
byLoft_4 = Surface.ByLoft(byPoints_4)
