# Dynamo graph O_ChangeTextFontInAllFamilies.dyn (Dynamo 1.3.2.2480)

# group: Параметры шрифта
run = BoolSelector(true)
шрифт = CodeBlock { "ISOCPEUR"; "Arial"; "GOST Common"; }
размер = DoubleInput(2.5)
коэф_ширины = DoubleInput(0.8)
курсив_0_1 = DoubleInput(0)

get_categories_with_builtins_py = Python()
# ---------- get_categories_with_builtins_py.python (55 lines) ----------
import clr
clr.AddReference('ProtoGeometry')
from Autodesk.DesignScript.Geometry import *

# Import DocumentManager
clr.AddReference("RevitServices")
import RevitServices
from RevitServices.Persistence import DocumentManager

# Import RevitAPI
clr.AddReference("RevitAPI")
import Autodesk

# Import ToDSType(bool) extension method
clr.AddReference("RevitNodes")
import Revit
from Autodesk.Revit.DB import *
clr.ImportExtensions(Revit.Elements)

import System

#The inputs to this node will be stored as a list in the IN variable.
#doc = DocumentManager.Instance.CurrentDBDocument
uiapp = DocumentManager.Instance.CurrentUIApplication
app = uiapp.Application
doc = DocumentManager.Instance.CurrentDBDocument

#create workset collector
userCategories = doc.Settings.Categories
#extract workset's name and ids
names, ids, builtInNames = [], [], []
for i in userCategories:
	try:
		names.append(i.Name)
	except:
		names.append("failure")
	try:
		tempID = i.Id.IntegerValue
	except:
		tempID = "failure"
	try:
		builtInNames.append(System.Enum.ToObject(BuiltInCategory, tempID))
	except:
		builtInNames.append("failure")

builtInNameStr = []
for y in builtInNames:
	try:
		builtInNameStr.append(str(y))
	except:
		builtInNameStr.append("stringConversionFailure")

#Assign your output to the OUT variable
#OUT = userCategories, names, ids, builtInNameStr, builtInNames
OUT = names, builtInNameStr
# ----------------------------------------
code_block = CodeBlock(i=get_categories_with_builtins_py) { i[1]; }
code_block_2 = CodeBlock(i=get_categories_with_builtins_py) { i[0]; }

# group: Сбор всех марок
# note: Загружаемые семейства
code_block_3 = CodeBlock { "Марки"; }
contains = String.Contains(str=code_block_2, searchFor=code_block_3)
filterByBoolMask = List.FilterByBoolMask(list=code_block, mask=contains)

# group: Ручное добавление категорий загружаемых семейств
code_block_4 = CodeBlock { {"OST_GridHeads"}; }

join = List.Join(filterByBoolMask.in, code_block_4)
byName = Category.ByName(join)
boolean = BoolSelector(true)

# group: Clockwork. All Families Of Category
all_families_of_category = Custom[All Families Of Category](category=byName, toggle=boolean)  # Gets all famiies of a given category in the model (does *not *work for system families)

flatten = Flatten(all_families_of_category)

# group: Системные семейства (размеры, высотные отметки)
# note: Системные семейства
code_block_5 = CodeBlock()
# ---------- code_block_5.designscript (2 lines) ----------
{"OST_SpotElevations",
"OST_Dimensions"};
# ----------------------------------------

byName_2 = Category.ByName(code_block_5)
all_elements_of_category = ElementsOfCategory(byName_2)
type = archilab.Revit.Elements.Elements.Type(all_elements_of_category)
uniqueItems = List.UniqueItems(type, lacing=Longest)
flatten_2 = Flatten(uniqueItems)

# group: Текстовые примечания
element_types = ElementTypes("TextNoteType")

all_elements_of_type = ElementsOfType(element_types)
join_2 = List.Join(flatten_2, all_elements_of_type)
inputs = CodeBlock(run=run, family1=flatten, family2=join_2, font=шрифт.out1, size=размер, scale=коэф_ширины, italic=курсив_0_1) { run; family1; family2; font; size; scale; italic; }
family_changefont_py = Python(IN[0]=inputs.run, IN[1]=inputs.family1, IN[2]=inputs.family2, IN[3]=inputs.font, IN[4]=inputs.size, IN[5]=inputs.scale, IN[6]=inputs.italic)
# ---------- family_changefont_py.python (123 lines) ----------
import clr

# Import DocumentManager and TransactionManager
clr.AddReference("RevitServices")
import RevitServices
from RevitServices.Persistence import DocumentManager
from RevitServices.Transactions import TransactionManager
doc = DocumentManager.Instance.CurrentDBDocument
uidoc = DocumentManager.Instance.CurrentUIDocument

# Import RevitAPI
clr.AddReference("RevitAPI")
import Autodesk
from Autodesk.Revit.DB import *
import System

import sys
pyt_path = r'C:\Program Files (x86)\IronPython 2.7\Lib'
sys.path.append(pyt_path)

################# Classes ##################

class FamilyOption(IFamilyLoadOptions):
	def OnFamilyFound(self,familyInUse,overwriteParameterValues):
		overwriteParameterValues = True
		return True
		
	def OnSharedFamilyFound(self, sharedFamily, familyInUse, familySrc, overwriteParameterValues):
		familySrc = FamilySource.Family
		overwriteParameterValues = True
		return True

################# Definitions ##################
# Convert single object to list if not list already
def tolist(obj1):
	if hasattr(obj1,"__iter__"): return obj1
	else: return [obj1]
	# Change font
	
p1 = []
p2 = []	
p3 = []
p4 = []

def changeFontParameters(elems):
	for i in elems:
		try:
			p1 = i.get_Parameter(BuiltInParameter.TEXT_FONT)
			p1.Set(font)
										
			p2 = i.get_Parameter(BuiltInParameter.TEXT_SIZE)
			if p2 >= 0.02:
				p2.Set(size7)
			if p2 == 0.01640419947507:
				p2.Set(size5)
			elif p2 == 0.01148293963255:
				p2.Set(size3)
			else:
				p2.Set(size2)

			p3 = i.get_Parameter(BuiltInParameter.TEXT_WIDTH_SCALE)
			p3.Set(scale)
			
			p4 = i.get_Parameter(BuiltInParameter.TEXT_STYLE_ITALIC)
			p4.Set(italic)
			
		except:
			continue		


# Open and search family doc for suitable Element Types to set font...
def setWhatYouNeed(doc, f):
	#TransactionManager.Instance.ForceCloseTransaction()
	TransactionManager.Instance.ForceCloseTransaction()
	try:
		fDoc = doc.EditFamily(f)
		ElementTypes = FilteredElementCollector(fDoc).OfClass(ElementType).ToElements()
		
		TransactionManager.Instance.EnsureInTransaction(fDoc)			

		# Search all ElementTypes for Parameter and set if found...
		changeFontParameters(ElementTypes)

		# Load Family back into project and Close Family Document...
		TransactionManager.Instance.ForceCloseTransaction()
		fDoc.LoadFamily(doc, FamilyOption())
		fDoc.Close(False)
		TransactionManager.Instance.ForceCloseTransaction()
	except Exception,e:
		result.append(f.Name + " Failed:-\n" + e.message)		



# Work with System families (dimensions)
def correctInPlaceFams(elems):
	
	TransactionManager.Instance.EnsureInTransaction(doc)
	changeFontParameters(elems)		
	TransactionManager.Instance.ForceCloseTransaction()

################# Inputs ##################

run = tolist(IN[0])[0]
fams1 = tolist(UnwrapElement(IN[1]))
fams2 = tolist(UnwrapElement(IN[2]))
font = tolist(IN[3])[0]
size7 = tolist(7.0)[0]/304.8
size5 = tolist(5.0)[0]/304.8
size3 = tolist(3.5)[0]/304.8
size2 = tolist(2.5)[0]/304.8
scale = tolist(IN[5])[0]
italic = tolist(IN[6])[0]

result = []
################# Main ##################
if run:
	for f in fams1:
		setWhatYouNeed(f.Document,f)
	correctInPlaceFams(fams2)
	uidoc.RefreshActiveView()
	OUT = result
else:
	OUT = "Please set Run to True"
# ----------------------------------------
