# Dynamo graph O_TagByCategoryInActiveView.dyn (Dynamo 1.3.4.6666)

# group: Gets Active View
current = Document.Current()
activeView = Document.ActiveView(current)

categories = Categories("DuctTerminal")

# group: Collect Elements in View
all_elements_in_active_view = ElementsInView()
byCategory = Revit.Collector.ByCategory(categories)
setIntersection = SetIntersection(all_elements_in_active_view, byCategory)

# note: We want a Horizontal Tag
# with a Leader
boolean = BoolSelector(true)
code_block = CodeBlock { "Center"; "Middle"; }
byElement = Tag.ByElement(activeView, setIntersection, boolean, boolean, code_block.out0, code_block.out1)
# note: We use the diffuser location to position
# the Leader End and Elbow Location.
getLocation = Element.GetLocation(setIntersection)
diffuser_width_height_for_tag = CodeBlock { 2; }  # "Diffuser Width/Height for Tag Leader Offset"
# note: <Parameters>
# Tags = IN[0]
# Diffuser Locations = IN[1]
# Diffuser Width = IN[2]
# Diffuser Height = IN[3]
# OUT = Tags
# </Parameters>
python_script = Python(IN[0]=byElement, IN[1]=getLocation, IN[2]=diffuser_width_height_for_tag, IN[3]=diffuser_width_height_for_tag)
# ---------- python_script.python (46 lines) ----------
#EvolveLAB Membership Script
#EvolveBIM.com
#mark.mendez@evolvelab-inc.com

import clr
# Import RevitAPI
clr.AddReference("RevitAPI")
import Autodesk
from Autodesk.Revit.DB import *

# Import DocumentManager and TransactionManager
clr.AddReference("RevitServices")
import RevitServices
from RevitServices.Persistence import DocumentManager
from RevitServices.Transactions import TransactionManager

# Import ToXyz(bool) extension method
clr.AddReference("RevitNodes")
import Revit
clr.ImportExtensions(Revit.GeometryConversion)


allTags = map(UnwrapElement, IN[0])
locations = map(UnwrapElement, IN[1])
diffuserWidth = IN[2]
diffuserHeight = IN[3]

#API Requires this small fix to straighting LeaderElbow to Tag Line
elbowToHeadPositionFix = .010

#Grab the current document and start a Transaction
doc = DocumentManager.Instance.CurrentDBDocument
TransactionManager.Instance.EnsureInTransaction(doc)

#Loop through the tags and locations, setting the leader
for tag, location in zip(allTags, locations):
	tag.LeaderEndCondition = LeaderEndCondition.Free
	tag.LeaderEnd = location.ToXyz() + XYZ(diffuserWidth / 2,-diffuserHeight / 2,0)
	tag.LeaderElbow = tag.LeaderEnd + XYZ(diffuserWidth,-diffuserHeight,0)
	tag.TagHeadPosition = tag.LeaderElbow + XYZ(diffuserWidth, diffuserHeight + elbowToHeadPositionFix,0)
	
#Commit Transaction
TransactionManager.Instance.TransactionTaskDone()

#Assign your output to the OUT variable.
OUT = allTags
# ----------------------------------------
