# Dynamo graph O_Стены по этажам.dyn (Dynamo 1.3.4.6666)

# group: Параметр Этажа
string = StringInput("CP_этаж_цифра")

# group: Element collector by level
LINK = BoolSelector(false)
link_name = StringInput("BI TOWER_AR_B1_WIP_R18")
categories = Categories("Walls")
levels = Levels("-01 Подвал")
pyscr_elements_collector = Python(IN[0]=LINK, IN[1]=link_name, IN[2]=categories, IN[3]=levels)
# ---------- pyscr_elements_collector.python (66 lines) ----------
# Default imports
import System
import clr
clr.AddReference('ProtoGeometry')
from Autodesk.DesignScript.Geometry import *

# Import RevitAPI
clr.AddReference("RevitAPI")
import Autodesk
from Autodesk.Revit.DB import *

# Import DocumentManager and TransactionManager
clr.AddReference("RevitServices")
import RevitServices
from RevitServices.Persistence import DocumentManager
from RevitServices.Transactions import TransactionManager

# Import ToDSType(bool) extension method
clr.AddReference("RevitNodes")
import Revit
clr.ImportExtensions(Revit.Elements)
clr.ImportExtensions(Revit.GeometryConversion)

#Import Collections
from System.Collections.Generic import *

#The inputs to this node will be stored as a list in the IN variable.
dataEnteringNode = IN

ToggleLink = IN[0]

Linkinstname = IN[1]

Category = IN[2]

levelInput = IN[3]

app =  DocumentManager.Instance.CurrentUIApplication.Application
doc = DocumentManager.Instance.CurrentDBDocument
linkInstances = Autodesk.Revit.DB.FilteredElementCollector(doc).OfClass(Autodesk.Revit.DB.RevitLinkInstance)
BuiltIn = System.Enum.ToObject(BuiltInCategory, Category.Id)


if ToggleLink == False:

	filter = ElementCategoryFilter(BuiltIn)
	Listelem = Autodesk.Revit.DB.FilteredElementCollector(doc).WherePasses(filter).WhereElementIsNotElementType().ToElements()
	levelFilter = ElementLevelFilter(UnwrapElement(levelInput).Id)
	logicalFilter = LogicalAndFilter(levelFilter, filter)
	OUT = FilteredElementCollector(doc).OfCategory(BuiltIn).WherePasses(logicalFilter).ToElements()
	
if ToggleLink == True:

	i = ()
	for i in linkInstances:
		if Linkinstname.ToLower() in i.Name.ToLower():
			linkDoc = i.GetLinkDocument()
			
	filter = ElementCategoryFilter(BuiltIn)			
	Listelem = FilteredElementCollector(linkDoc).WherePasses(filter).ToElements()
	#levelFilter = ElementLevelFilter(UnwrapElement(levelInput).Id)
	#logicalFilter = LogicalAndFilter(levelFilter, filter)
	OUT = FilteredElementCollector(linkDoc).OfCategory(BuiltIn).WherePasses(filter).ToElements()
	
	# Level filter does not work?
	
# ----------------------------------------
removeNulls = Lists.Manage.RemoveNulls(pyscr_elements_collector)
flatten = Flatten(removeNulls)
elevation = Level.Elevation(levels)
code_block = CodeBlock { -4050; }
name = Level.Name(levels)
code_block_2 = CodeBlock { "Уровень"; }
split = String.Split(name, code_block_2)
code_block_3 = CodeBlock { "-1"; }
count = Count(flatten)
code_block_4 = CodeBlock { 1; }

ge = elevation >= code_block

# group (continued): Element collector by level
if_ = If(test=ge, true=split, false=code_block_3)
toNumber = String.ToNumber(if_)
code_block_5 = CodeBlock(x=toNumber) { x+1; }
ofRepeatedItem = List.OfRepeatedItem(item=code_block_5, amount=count)
flatten_2 = Flatten(ofRepeatedItem)
setParameterByName = Element.SetParameterByName(element=flatten, parameterName=string, value=flatten_2)
watch = Watch(flatten_2)
