# Dynamo graph ParameterGetFromLinkedRoomHost.dyn (Dynamo 1.3.4.6666)

# group: ParameterGetFromLinkedRoomHost
# note: RoomHostForLinkedElements
# Writes room data from linked file to parameters of objects within those rooms.
# http://wrw.is/collect-elements-in-rooms-across-linked/
# INSTRUCTIONS: Select Category, type in parameter names of data from rooms, then element parameter names data is to be written to. Unplug element parameter to be written to if only 1 or 2 are required.
# NOTE: Parameters written to in elements must be Project Parameters that can vary between groups.
# !! WARNING: Will fail if there are redundant or not placed rooms.

# group: Category to write data to
categories = Categories("Furniture")
categories_2 = Categories("SpecialityEquipment")

join = List.Join(categories, categories_2)
all_elements_of_category = ElementsOfCategory(join)
flatten = Flatten(all_elements_of_category)
# note: ArchiLab
get_documents = Custom[Get Documents]()  # Queries all linked Revit files and retrieves their Name, LinkInstance and Document properties.
# note: !!! WARNING !!!
# Only uses first Link found in list. Use List.GetItemAtIndex for alternative linked file.
firstItem = List.FirstItem(get_documents.Link_Doc)
categories_3 = Categories("Rooms")
get_all_elements_from_linked = Custom[Get All Elements From Linked Model](LinkDoc=firstItem, Category=categories_3)  # This node is based on code posted by Julien Benoit. Big thanks to Julien for sharing his work. This node will retrieve all elements of a given category from a given linked model.

# group: Room Parameters
parameter_1 = CodeBlock { "Имя"; }
parameter_2 = CodeBlock { "Номер"; }
parameter_3 = CodeBlock { "Базовая отделка"; }

# note: Ant (based on Bakery 'Collect Elements in Rooms and Show Detailed List)
linked_rooms_collect_elements = Custom[Linked Rooms Collect Elements](Elements=flatten, Rooms=get_all_elements_from_linked, RoomParameterOne=parameter_1, RoomParameterTwo=parameter_2, RoomParameterThree=parameter_3)  # Ant: Writes room data from linked file to parameters of objects that are in those rooms. Based on Bakery 'Collect Elements in Rooms and Show Detailed List', which is based on 'Family.InRoom' work by Konrad, which was built on others.
PLUG = Object.Identity(linked_rooms_collect_elements.ElementsInRooms)

# group: Element Parameter 2 name
parameter_2_2 = CodeBlock { "Комментарии"; }
PLUG_2 = Object.Identity(parameter_2_2)
code_block = CodeBlock { "Room No. Reported"; }

watch_2 = Watch(linked_rooms_collect_elements.RoomParameterTwo)

# group: Write to Element Parameter 2
create = List.Create(PLUG_2)
count = List.Count(PLUG)
cycle = List.Cycle(list=create, amount=count)
setParameterByName = Element.SetParameterByName(element=PLUG, parameterName=cycle, value=watch_2)

# group: Element Parameter 1 name
parameter_1_2 = CodeBlock { "Марка"; }
PLUG_3 = Object.Identity(parameter_1_2)
code_block_2 = CodeBlock { "Room Name Reported"; }

watch_1 = Watch(linked_rooms_collect_elements.RoomParameterOne)

# group: Write to Element Parameter 1
create_2 = List.Create(PLUG_3)
count_2 = List.Count(PLUG)
cycle_2 = List.Cycle(list=create_2, amount=count_2)
setParameterByName_2 = Element.SetParameterByName(element=PLUG, parameterName=cycle_2, value=watch_1)

watch = Watch(get_documents.Link_Doc)
watch_3 = Watch(get_all_elements_from_linked)
watch_4 = Watch(all_elements_of_category)

# group: Element Parameter 3 name
parameter_3_2 = CodeBlock { "BI_этаж "; }
PLUG_4 = Object.Identity(parameter_3_2)
code_block_3 = CodeBlock { "Room Type Reported"; }

watch_3_2 = Watch(linked_rooms_collect_elements.RoomParameterThree)

# group: Write to Element Parameter 3
create_3 = List.Create(PLUG_4)
count_3 = List.Count(PLUG)
cycle_3 = List.Cycle(list=create_3, amount=count_3)
setParameterByName_3 = Element.SetParameterByName(element=PLUG, parameterName=cycle_3, value=watch_3_2)  # frozen

code_block_4 = CodeBlock { 1; }
getItemAtIndex = List.GetItemAtIndex(index=code_block_4)  # unwired: list
python_script = Python()  # frozen; unwired: IN[0], IN[1]
# ---------- python_script.python (53 lines) ----------
#Copyright(c) 2015, Konrad Sobon
# @arch_laboratory, http://archi-lab.net

# This code is based on Family.InRoom node originally created
# by Peter Kompolschek and published on Dynamo blog. Big thanks 
# to Peter for sharing his work so graciously.

import clr
clr.AddReference('ProtoGeometry')
from Autodesk.DesignScript.Geometry import *

# Import DocumentManager and TransactionManager
clr.AddReference("RevitServices")
import RevitServices
from RevitServices.Persistence import DocumentManager
from RevitServices.Transactions import TransactionManager

# Import RevitAPI
clr.AddReference("RevitAPI")
import Autodesk
from Autodesk.Revit.DB import *

doc = DocumentManager.Instance.CurrentDBDocument
uiapp = DocumentManager.Instance.CurrentUIApplication
app = uiapp.Application

from System.Collections.Generic import *

#The inputs to this node will be stored as a list in the IN variable.
def FamiliesInRoom(_room, _families):
	outList = []
	for family in _families:
		try:
			pt = family.Location.Point
		except:
			pt = family.Location.Curve.Origin
		if _room.IsPointInRoom(pt):
			outList.append(family)
	return outList

families = []
for i in IN[0]:
	families.append(UnwrapElement(i))

rooms = []
for i in IN[1]:
	rooms.append(UnwrapElement(i))

outData = [[] for i in range(len(rooms))]
for index, room in enumerate(rooms):
	outData[index].extend(FamiliesInRoom(room, families))

OUT = outData
# ----------------------------------------
