# Dynamo graph Py from string OLD.dyn (Dynamo 2.0.4.12684)

путь_к_файлу_python = Filename("..\MyPythonScripts\GRIDFINDDEF01.py")
find_file_and_import_it = Python(IN[0]=путь_к_файлу_python)
# ---------- find_file_and_import_it.python (12 lines) ----------
import sys
#sys.path.append('C:\Program Files\IronPython 2.7\Lib')
sys.path.append('C:\Program Files (x86)\IronPython 2.7\Lib')
import codecs

try:
	filePath = IN[0]
	with codecs.open(filePath, 'rb', "utf-8") as inf:
		lines = inf.readlines()
	OUT = ''.join(lines)
except:
	OUT = "No file"
# ----------------------------------------
boolean = BoolSelector(true)
python_script_from_string = PythonStringNode(script=find_file_and_import_it, IN[0]=boolean)
watch = Watch(python_script_from_string)

# group: Room collector by level
filter_on_off = BoolSelector(false)  # graph input
levels = Levels()  # nothing selected; frozen
pyscr_room_collector_by_level = Python(IN[0]=levels)
# ---------- pyscr_room_collector_by_level.python (61 lines) ----------
import clr

clr.AddReference("RevitAPI")
import Autodesk
from Autodesk.Revit.DB import *

clr.AddReference("RevitServices")
import RevitServices
from RevitServices.Persistence import DocumentManager
from RevitServices.Transactions import TransactionManager

clr.AddReference("RevitNodes")
import Revit
clr.ImportExtensions(Revit.Elements)
clr.ImportExtensions(Revit.GeometryConversion)

doc = DocumentManager.Instance.CurrentDBDocument

def tolist(input):
	if isinstance(input,list) == False:
		return [input]
	else:
		return input

def GetValidRooms( doc, level ):
	levelFilter = ElementLevelFilter( level.Id )
	TransactionManager.Instance.EnsureInTransaction(doc)
	rooms = FilteredElementCollector(doc).OfClass(Autodesk.Revit.DB.SpatialElement).WherePasses(levelFilter).ToElements()
	check = [ doc.Delete(room) for room in rooms if room.Level is None ]
	rooms = [ room for room in rooms if room.Area ]
	TransactionManager.Instance.TransactionTaskDone()
	if len(rooms) >= 5: return rooms
	collector = FilteredElementCollector(doc)
	LinkInstance = collector.OfClass(RevitLinkInstance).WhereElementIsNotElementType().ToElements()
	if LinkInstance == None: pass
	for link in LinkInstance:
		try:
			doc = link.GetLinkDocument()
			if doc == None: continue
			collector = FilteredElementCollector(doc)
			rooms = collector.OfClass(Autodesk.Revit.DB.SpatialElement).WherePasses(levelFilter).ToElements()
			if rooms: rooms = [ room for room in rooms if room.Area ]
			if rooms and len(rooms) >= 5: return rooms
		except: continue

def LevelIdByElevation( value ):
	provider = ParameterValueProvider( ElementId(BuiltInParameter.LEVEL_ELEV) )
	filterrule = FilterDoubleRule( provider, FilterNumericEquals(), value, 1.5 )
	levelfilter = ElementParameterFilter( filterrule )
	return FilteredElementCollector(DocumentManager.Instance.CurrentDBDocument).OfClass(Level).WherePasses(levelfilter).FirstElement()

############################################### INPUT ############################################
if IN[0]: levelInput = UnwrapElement(IN[0])
else: levelInput = DocumentManager.Instance.CurrentDBDocument.ActiveView.GenLevel
if levelInput: levelElevation =  levelInput.get_Parameter(BuiltInParameter.LEVEL_ELEV).AsDouble()
else: levelElevation = 0.000
level = LevelIdByElevation( levelElevation )
##################################################################################################
rooms = GetValidRooms( doc, level )

OUT = rooms 
# ----------------------------------------
parameter_name = CodeBlock { "Номер"; }
parameter_value = StringInput("2.185")  # graph input
pyscript = Python(IN[0]=filter_on_off, IN[1]=pyscr_room_collector_by_level, IN[2]=parameter_name, IN[3]=parameter_value)  # "PyScript FilterElementsByParameterValue"; frozen
# ---------- pyscript.python (82 lines) ----------
import clr
clr.AddReference('ProtoGeometry')
from Autodesk.DesignScript.Geometry import *

clr.AddReference("RevitAPI")
import Autodesk
from Autodesk.Revit.DB import *

clr.AddReference("RevitServices")
import RevitServices
from RevitServices.Persistence import DocumentManager
from RevitServices.Transactions import TransactionManager

clr.AddReference("RevitNodes")
import Revit
clr.ImportExtensions(Revit.Elements)
clr.ImportExtensions(Revit.GeometryConversion)

import System
from System.Collections.Generic import *

doc = DocumentManager.Instance.CurrentDBDocument

def tolist(input):
	if isinstance(input,list) == False:
		return [input]
	else:
		return input	

def flatten(x):
    result = []
    for el in tolist(x):
        if hasattr(el, "__iter__") and not isinstance(el, basestring):
            result.extend(flatten(el))
        else:
            result.append(el)
    return result


def GetParameter(item, sechname):
	try: params = item.Parameters
	except: return
	prmnames = [prm.Definition.Name.ToLower() for prm in params]
	sechname = sechname.ToLower()
	zipped = sorted(zip(prmnames, params))
	for prmname, prm in zipped:
	    if prm.Definition.Name.Equals(sechname):
	        return prm
	    elif prmname == sechname:
	        return prm
	for prmname, prm in zipped:
	    if prm.Definition.Name.Contains(sechname):
	        return prm
	    elif sechname in prmname:
	        return prm
	
def FilterElementsByParameter( items, parameter_name, filter_string_value ):
	item = items[0]
	doc = item.Document
	ids = [ i.Id for i in items if i ]
	icollection = List[ElementId]( ids )
	parameter = GetParameter( item, parameter_name )
	FilterableValueProvider = ParameterValueProvider( parameter.Id )
	FilterStringRuleEvaluator = FilterStringContains()
	FilterRule = FilterStringRule( FilterableValueProvider, FilterStringRuleEvaluator, filter_string_value, False )
	ParameterFilter = ElementParameterFilter( FilterRule )
	items = FilteredElementCollector( doc, icollection ).WherePasses( ParameterFilter ).WhereElementIsNotElementType().ToElements()
	return items

dataEnteringNode = IN
################################################
items = None
items = [ UnwrapElement(i) for i in flatten(IN[1]) if i ]
parameter_name = IN[2]
filter_string_value = IN[3]
################################################

if IN[0] == True and items:
	items = FilterElementsByParameter( items, parameter_name, filter_string_value )
else: items = items

OUT = items
# ----------------------------------------
number = Room.Number(room=pyscript)
watch_2 = Watch(number)
