# Dynamo graph Py from string.dyn (Dynamo 2.0.4.12684)

путь_к_файлу_python = Filename("..\MyPythonScripts\FloorReinforcing.py")
find_file_and_import_it = Python(IN[0]=путь_к_файлу_python)
# ---------- find_file_and_import_it.python (12 lines) ----------
import sys
#sys.path.append('C:\Program Files\IronPython 2.7\Lib')
sys.path.append('C:\Program Files (x86)\IronPython 2.7\Lib')
import codecs

try:
	filePath = IN[0]
	with codecs.open(filePath, 'rb', "utf-8") as inf:
		lines = inf.readlines()
	OUT = ''.join(lines)
except:
	OUT = "No file"
# ----------------------------------------
boolean = BoolSelector(true)
python_script_from_string = PythonStringNode(script=find_file_and_import_it, IN[0]=boolean)
watch = Watch(python_script_from_string)
pointlist_sortazimuthally = Custom[[&] PointList.SortAzimuthally]()  # Sort points azimuthally (like sorting numbers around a clock face) in a plane. Points are ordered about the origin of the plane, proceeding from the positive x-axis of the plane in a counter-clockwise direction about the plane normal vector.; unwired: points
byRayBounce = Revit.LinkElement.ByRayBounce()  # unwired: origin, direction, view3D
