# Dynamo graph ROOM FINISH DEMO WIP VAR_001.dyn (Dynamo 2.0.4.12684)

# group: Room collector by level
LINK = BoolSelector(false)  # graph input
link_name = StringInput("BI TOWER_AR_B1_WIP_R18")  # graph input
levels = Levels()  # nothing selected; graph input
pyscr_room_collector = Python(IN[0]=LINK, IN[1]=link_name, IN[2]=levels)  # unwired: IN[3]
# ---------- pyscr_room_collector.python (95 lines) ----------
# Default imports
import System
import clr
clr.AddReference('ProtoGeometry')
from Autodesk.DesignScript.Geometry import *

# Import RevitAPI
clr.AddReference("RevitAPI")
import Autodesk
from Autodesk.Revit.DB import *

# Import DocumentManager and TransactionManager
clr.AddReference("RevitServices")
import RevitServices
from RevitServices.Persistence import DocumentManager
from RevitServices.Transactions import TransactionManager

# Import ToDSType(bool) extension method
clr.AddReference("RevitNodes")
import Revit
clr.ImportExtensions(Revit.Elements)
clr.ImportExtensions(Revit.GeometryConversion)

#Import Collections
from System.Collections.Generic import *

#The inputs to this node will be stored as a list in the IN variable.
dataEnteringNode = IN

ToggleLink = IN[0]

Linkinstname = IN[1]

levelInput = IN[2]

reset = IN[3]

app =  DocumentManager.Instance.CurrentUIApplication.Application
linkInstances = Autodesk.Revit.DB.FilteredElementCollector(DocumentManager.Instance.CurrentDBDocument).OfClass(Autodesk.Revit.DB.RevitLinkInstance)

if ToggleLink == False:

	selectDOC = DocumentManager.Instance.CurrentDBDocument
	levelFilter = ElementLevelFilter(UnwrapElement(levelInput).Id)
		
if ToggleLink == True:

	i = ()
	for i in linkInstances:
		if Linkinstname.ToLower() in i.Name.ToLower():
			selectDOC = i.GetLinkDocument()
	
	bipELEV = BuiltInParameter.LEVEL_ELEV
	LevelElev = UnwrapElement(levelInput).get_Parameter(bipELEV).AsDouble()
			
	ruleValDb = LevelElev
	pvp = ParameterValueProvider(ElementId(bipELEV))
	fnrv = FilterNumericEquals()
	levelparamfilter = ElementParameterFilter(FilterDoubleRule(pvp, fnrv, ruleValDb, 10.-3))
	levels = FilteredElementCollector(selectDOC).OfClass(Level)
	Levelcollect = FilteredElementCollector(selectDOC).OfClass(Level).WherePasses(levelparamfilter).FirstElement()
	levelFilter = ElementLevelFilter(Levelcollect.Id)


################################################# FIND VALID ROOMS ############################################

collector = FilteredElementCollector(selectDOC)

areaFilter = AreaFilter()
areaExcludes = collector.WherePasses(areaFilter).ToElements()
areaExcludes = list(areaExcludes)
element_set = ElementSet()
excludes = List[ElementId]()
if len(areaExcludes) == 0:
	logicalFilter = levelFilter
else:
	for i in areaExcludes:
		element_set.Insert(i)
		elemIter = element_set.ForwardIterator()
		elemIter.Reset()
		while elemIter.MoveNext():
			curElem = elemIter.Current
			excludes.Add(curElem.Id)
	filter = ExclusionFilter(excludes)
	logicalFilter = LogicalAndFilter(levelFilter, filter)


allRoomsOnLevel = FilteredElementCollector(selectDOC).OfClass(Autodesk.Revit.DB.SpatialElement).WherePasses(logicalFilter).ToElements()
validRooms = []

for i in allRoomsOnLevel:
	if i.Area != 0:
		validRooms.append(i)

OUT = validRooms
# ----------------------------------------

# group: РЕДАКТИРУЕМЫЙ СКРИПТ
code_block = CodeBlock(rooms=pyscr_room_collector) { rooms; }
string_from_object = FromObject()  # unwired: obj
python_script = Python(IN[0]=code_block, IN[1]=string_from_object)  # frozen
# ---------- python_script.python (181 lines) ----------
import clr
clr.AddReference('ProtoGeometry')
from Autodesk.DesignScript.Geometry import *

#Load Dynamo wrappers
clr.AddReference("RevitNodes")
import Revit
from Revit.Elements import *
clr.ImportExtensions(Revit.GeometryConversion)
clr.ImportExtensions(Revit.Elements)

#Load Revit API
clr.AddReference('RevitAPI')
from Autodesk.Revit.DB import *
import Autodesk

#Load document reference
clr.AddReference("RevitServices")
import RevitServices
from RevitServices.Persistence import DocumentManager
from RevitServices.Transactions import TransactionManager

doc = DocumentManager.Instance.CurrentDBDocument
uiapp = DocumentManager.Instance.CurrentUIApplication
app = uiapp.Application

def toList(input):
	if isinstance(input,list) == False:
		return [input]
	else:
		return input

def flatten(x):
    result = []
    for el in x:
        if hasattr(el, "__iter__") and not isinstance(el, basestring):
            result.extend(flatten(el))
        else:
            result.append(el)
    return result

def vecSimilarity(v1,v2):
	tolerance = 0.000001
	if abs(v1.X - v2.X) <= tolerance and abs(v1.Y - v2.Y) <= tolerance and abs(v1.Z - v2.Z) <= tolerance:
		return True
	else:
		return False
#Параметры входные
rooms = flatten(toList(UnwrapElement(IN[0])))
wfParam = IN[1] #WallType

#Get room boundaries, repeatedRooms and disjoined curves
roomElems = []
disjoinedCurves = []
options = Autodesk.Revit.DB.SpatialElementBoundaryOptions()

roomBounds = []
for r in rooms:
	roomBounds.append(r.GetBoundarySegments(options))

for rb in roomBounds:
	tempCrvList = []
	for closedCrv in rb:
		tempCCCrvList = []
		for elem in closedCrv:
			if doc.GetElement(elem.ElementId) is None:
				roomElems.append(None)
				tempCCCrvList.append(elem.GetCurve().ToProtoType())
			else:
				roomElems.append(doc.GetElement(elem.ElementId))
				tempCCCrvList.append(elem.GetCurve().ToProtoType())
		tempCrvList.append(tempCCCrvList)
	disjoinedCurves.append(tempCrvList)

#Join curves in polycurves
joinedCurves = []
for d in disjoinedCurves:
	tempList = []
	for item in d:
		tempList.append(PolyCurve.ByJoinedCurves(item))
	joinedCurves.append(tempList)

#Check the sense of the polycurve
for j in joinedCurves:
	for crv in j:
		if crv.BasePlane().Normal.Z > 0:
			crv = crv
		else:
			crv = crv.Reverse()

repeatedRooms = []
count = 0
for j in joinedCurves:
	tempList = []
	for crv in j:
		tempList.append(rooms[count])
	repeatedRooms.append(tempList)
	count += 1

joinedCurves = flatten(joinedCurves)
repeatedRooms = flatten(repeatedRooms)

RoomVol= []
RoomArea = []
levels = []
wTypes = []
wHeights = []
RoomWallPrm = []

allWallTypes = FilteredElementCollector(doc).OfClass(WallType)
for r in repeatedRooms:
	for wt in allWallTypes:
		if Element.Name.__get__(wt) == r.GetParameterValueByName(wfParam):
			wTypes.append(wt.ToDSType(True))
			
for r in repeatedRooms:
	RoomVol.append(r.Volume * 0.0283168)
	RoomArea.append(r.Area * 0.09290304)
	RoomHeght.append(r.get_Parameter(BuiltInParameter.ROOM_UPPER_OFFSET).AsDouble() * 304.8)
	RoomWallPrm.append(r.get_Parameter(BuiltInParameter.ROOM_FINISH_WALL).AsString()
	levels.append((r).Level)

wHeights = list(map(lambda x,y: round((x / y) * 1000), RoomVol, RoomArea))
	
#Create an offseted curve to place finishes. Wall by curve are modeled by Wall Centerline
offsetedCurves = []
count = 0
for j in joinedCurves:
	if UnwrapElement(repeatedRooms[count]).IsPointInRoom(j.Offset(wTypes[count].GetParameterValueByName("Ширина")*0.5,False).StartPoint.ToXyz()) == True:
		offsetedCurves.append(j.Offset(wTypes[count].GetParameterValueByName("Ширина")*0.5,False))
	else:
		offsetedCurves.append(j.Offset(wTypes[count].GetParameterValueByName("Ширина")*-0.5,False))
	count +=1

explodedCurves = []
for oc in offsetedCurves:
	explodedCurves.append(oc.Explode())

"""
#Create walls on top of the curves with fixed height
wHeightsList = [] #List of height for each wall
distances = [] #distance to move a probe point to check the paralel wall
walls = []
TransactionManager.Instance.EnsureInTransaction(doc)
count = 0
for group in explodedCurves:
	for crv in group:
		if vecSimilarity(crv.TangentAtParameter(0),crv.TangentAtParameter(1)):
			rbldCrv = Autodesk.DesignScript.Geometry.Line.ByStartPointEndPoint(crv.StartPoint, crv.EndPoint)
		else:
			rbldCrv = Autodesk.DesignScript.Geometry.Arc.ByThreePoints(crv.PointAtParameter(0), crv.PointAtParameter(0.5), crv.PointAtParameter(1))
		w = Wall.Create(doc, rbldCrv.ToRevitType(), UnwrapElement(wTypes[count]).Id, UnwrapElement(levels[count]).Id, 5, 0, True, False);
		wHeightsList.append(wHeights[count])
		walls.append(w.ToDSType(False))
	count +=1
TransactionManager.Instance.TransactionTaskDone()

#Change the height of the walls to meet requirements, change Location line to Finish Face Exterior and turn off Room Bounding
count = 0
for w in walls:
	w.SetParameterByName("Неприсоединенная высота", wHeightsList[count])
	w.SetParameterByName("Линия привязки", 2)
	w.SetParameterByName("Граница помещения", 1)
	#Here is the best location to add any room parameter to the walls p.e. Room Number
	#w.SetParameterByName("RoomNumber", UnwrapElement(repeatedRooms[count]).GetParameterValueByName(Number))
	count +=1

#If the suport wall has inserts, this will join it to the finish wall.
#If the suport wall is a curtain wall, this will delete the finish associated to it.

TransactionManager.Instance.EnsureInTransaction(doc)
count = 0
for r in roomElems:
	if r is not None and UnwrapElement(r).Category.Name.ToString() == "Cтены" and len(UnwrapElement(r).FindInserts(True, True, True, True)) != 0:
		JoinGeometryUtils.JoinGeometry(doc, UnwrapElement(walls[count]), UnwrapElement(r))
	if r is not None and UnwrapElement(r).Category.Name.ToString() == "Стены" and UnwrapElement(r).WallType.Kind == WallKind.Curtain:
		doc.Delete(UnwrapElement(walls[count]).Id)
	count += 1
TransactionManager.Instance.TransactionTaskDone()
"""
OUT = offsetedCurves
# ----------------------------------------
watch = Watch(python_script)

pyscr_getwalltypes_by_parameters = Python(IN[0]=pyscr_room_collector, IN[1]=string_from_object)  # frozen
# ---------- pyscr_getwalltypes_by_parameters.python (40 lines) ----------
import clr
clr.AddReference('ProtoGeometry')
from Autodesk.DesignScript.Geometry import *

#Load Dynamo wrappers
clr.AddReference("RevitNodes")
import Revit
from Revit.Elements import *
clr.ImportExtensions(Revit.GeometryConversion)
clr.ImportExtensions(Revit.Elements)

#Load Revit API
clr.AddReference('RevitAPI')
from Autodesk.Revit.DB import *
import Autodesk

#Load document reference
clr.AddReference("RevitServices")
import RevitServices
from RevitServices.Persistence import DocumentManager
from RevitServices.Transactions import TransactionManager

doc = DocumentManager.Instance.CurrentDBDocument
uiapp = DocumentManager.Instance.CurrentUIApplication
app = uiapp.Application

repeatedRooms = UnwrapElement(IN[0])

valueProvider = ParameterValueProvider(ElementId(BuiltInParameter.ALL_MODEL_TYPE_NAME))
evaluator = FilterStringContains()
ruleString = UnwrapElement(IN[1])
Wfilter = ElementParameterFilter(FilterStringRule(valueProvider, evaluator, ruleString, False))
wallTypeCollector =  FilteredElementCollector(doc).OfCategory(BuiltInCategory.OST_Walls).WhereElementIsElementType().WherePasses(Wfilter).FirstElement()

allWallTypes = FilteredElementCollector(doc).OfClass(WallType).WhereElementIsElementType().ToElements()

RFW_PRM = (r.get_Parameter(BuiltInParameter.ROOM_FINISH_WALL).AsString() for r in repeatedRooms if r != None)
RFW_RNAME = (r.get_Parameter(BuiltInParameter.ROOM_NAME).AsString() for r in repeatedRooms)
 
OUT = allWallTypes
# ----------------------------------------
watch_2 = Watch(pyscr_getwalltypes_by_parameters)

# group: Определить высоту помещения
raybounce_by_links = BoolSelector(false)  # graph input
pyscr_set_room_height = Python(IN[0]=pyscr_room_collector, IN[1]=raybounce_by_links)  # "PyScr Set Room Height Definishing"
# ---------- pyscr_set_room_height.python (158 lines) ----------
import clr
clr.AddReference("RevitAPI")
clr.AddReference("ProtoGeometry")
clr.AddReference("RevitNodes")
clr.AddReference("RevitServices")
clr.AddReference('RevitAPIUI') 
import Autodesk
from Autodesk.DesignScript.Geometry import *
import Revit
clr.ImportExtensions(Revit.GeometryConversion)
import RevitServices
from Autodesk.Revit.DB import *
from Autodesk.DesignScript.Geometry import *
from RevitServices.Persistence import DocumentManager
from RevitServices.Transactions import TransactionManager
import System
from System import Array
from System.Collections.Generic import*
import sys
pyt_path = r'C:\Program Files (x86)\IronPython 2.7\Lib'
sys.path.append(pyt_path)

doc = DocumentManager.Instance.CurrentDBDocument
app = DocumentManager.Instance.CurrentUIApplication.Application
UIunit = Document.GetUnits(doc).GetFormatOptions(UnitType.UT_Length).DisplayUnits

def tolist(input):
	if isinstance(input,list) == False:
		return [input]
	else:
		return input

def flatten(x):
    result = []
    for el in x:
        if hasattr(el, "__iter__") and not isinstance(el, basestring):
            result.extend(flatten(el))
        else:
            result.append(el)
    return result
	

def GetLevelAbove(e):
	allLevels = FilteredElementCollector(doc).OfCategory(BuiltInCategory.OST_Levels).WhereElementIsNotElementType().ToElements()
	elevations = [i.Elevation for i in allLevels]
	sortedLevels = [x for (y,x) in sorted(zip(elevations,allLevels))]
	sortedLevelNames = [i.Name for i in sortedLevels]
	index = sortedLevelNames.index(e.Name)
	if index + 1 >= len(sortedLevels):
		return None
	else:
		return sortedLevels[index+1]
		
def SetParameterValues(elems, PrmVals):
	pNames = tolist("Высота помещения")
	pVals = tolist(PrmVals)
	if len(pNames) == len(pVals):
		TransactionManager.Instance.EnsureInTransaction(doc)
		for n,v in zip(pNames,pVals):
			p = elems.LookupParameter(n)
			if p.Definition.ParameterType == ParameterType.Length:
				v = UnitUtils.ConvertToInternalUnits(v,UIunit)
				p.Set(v)
		TransactionManager.Instance.TransactionTaskDone()
	return		
#############################################################################
urooms = flatten(tolist(UnwrapElement(IN[0])))
#######################    Get Room Parameters   ############################# 
RoomValid = []
RoomHeght = []
RoomHVolume = []
RoomlvlElevation = []

count = 0
for rmn in urooms:
	if rmn.Area != 0:
		RoomValid.append(rmn)
		RoomHeght.append(rmn.get_Parameter(BuiltInParameter.ROOM_UPPER_OFFSET).AsDouble() * 304.8)
		RoomVol = rmn.Volume
		RoomArea = rmn.Area
		RoomHVolume.append(round((RoomVol/RoomArea) * 304.8 / 100) * 100)
		Roomlvl = rmn.Level
		if GetLevelAbove(Roomlvl):	RoomlvlElevation.append((GetLevelAbove(Roomlvl).ProjectElevation - Roomlvl.Elevation) * 304.8)
		elif rmn.Level.Elevation != 0: RoomlvlElevation.append(rmn.Level.Elevation *304.8)
		else: RoomlvlElevation.append(3300)
		count += 1
		
###############################   Centering Room   ###################################

elevation = []
RoomCenterPoints = []
count = 0
for crmn in RoomValid:
	TransactionManager.Instance.EnsureInTransaction(doc)
	elevation = crmn.Level.Elevation * 304.8
	geoelem = crmn.GetGeometryObjectFromReference(Reference(crmn))
	geoobj = geoelem.GetEnumerator()
	for obj in geoobj:
		room_geometry = obj.ToProtoType()
		point = room_geometry.Centroid()
		center = Point.ByCoordinates(point.X,point.Y,elevation)
		newlocation = center.ToXyz() - crmn.Location.Point
		roombypoint = doc.GetRoomAtPoint(center.ToXyz())
		if roombypoint:
			if crmn.Id == roombypoint.Id:
				crmn.Location.Move(newlocation)
		else: continue
	RoomCenterPoints.append(crmn.Location.Point)
	TransactionManager.Instance.TransactionTaskDone()
	count += 1
	
########################### RayBounce On Link Category #################################
# Points, Direction, 3D View
ValidRoomPoints = [XYZ(UnitUtils.ConvertToInternalUnits(i.X,UIunit),UnitUtils.ConvertToInternalUnits(i.Y,UIunit),UnitUtils.ConvertToInternalUnits(i.Z+1200/304.8,UIunit)) for i in RoomCenterPoints]
view3D = FilteredElementCollector(doc).OfClass(View3D).FirstElement()
direction = XYZ(0,0,1)

ex = []
TopElems = []
Zcoord = []

builtInCats = [BuiltInCategory.OST_Roofs, BuiltInCategory.OST_Ceilings, BuiltInCategory.OST_Floors]
filter = ElementMulticategoryFilter(List[BuiltInCategory](builtInCats))
ri = ReferenceIntersector(filter, FindReferenceTarget.All, view3D)
ri.FindReferencesInRevitLinks = True

count = 0
for p in RoomCenterPoints:
	ref = ri.FindNearest(p,direction)
	count += 1
	if ref == None:
		pts.append(None)
		TopElems.append(None)
		Zcoord.append(0)
	else:
		refel = ref.GetReference()
		linkinstance = doc.GetElement(refel.ElementId)
		try:
			TopElems.append(linkinstance.GetLinkDocument().GetElement(refel.LinkedElementId))
			refp = ref.GetReference().GlobalPoint
			pts = (Point.ByCoordinates(UnitUtils.ConvertFromInternalUnits(refp.X,UIunit),UnitUtils.ConvertFromInternalUnits(refp.Y,UIunit),UnitUtils.ConvertFromInternalUnits(refp.Z,UIunit)))
			Zcoord.append(pts.Z)
		except:
			if not IN[1]:
				TopElems.append(linkinstance)
				refp = ref.GetReference().GlobalPoint
				pts = (Point.ByCoordinates(UnitUtils.ConvertFromInternalUnits(refp.X,UIunit),UnitUtils.ConvertFromInternalUnits(refp.Y,UIunit),UnitUtils.ConvertFromInternalUnits(refp.Z,UIunit)))
				Zcoord.append(pts.Z)
			else:
				pass

########################   Set Height Parameters    #############################
count = 0
for rrr in RoomValid:
	SetParameterValues(rrr,  Zcoord[count] + 300)
	count += 1

OUT =  RoomValid
# ----------------------------------------
