# Dynamo graph Revit_Noob_w_Excel.dyn (Dynamo 2.10.0.3455)

element_types = ElementTypes("PipeType")
watch = Watch(element_types)
all_elements_of_type = ElementsOfType(element_type=element_types)

# group: Select the Families of interest
name = Element.Name(element=all_elements_of_type)
code_block = CodeBlock { "KDS_GALV_MLBL_TnC_CrossRed"; }
boolean = BoolSelector(false)
contains = String.Contains(str=name, searchFor=code_block, ignoreCase=boolean)

watch_2 = Watch(name)
filterByBoolMask = List.FilterByBoolMask(list=all_elements_of_type, mask=contains)

# group: Add family parameters from Excel into current document.
file_path = Filename("..\Families\FamilySharedParameter_Dynamo.xlsx")  # graph input
fromPath = FileObject(path=file_path)  # "File.FromPath"
code_block_2 = CodeBlock { "KDS_Param"; }
code_block_3 = CodeBlock { false; }
importExcel = Data.ImportExcel(file=fromPath, sheetName=code_block_2, readAsStrings=code_block_3)
code_block_4 = CodeBlock(data=importExcel)
# ---------- code_block_4.designscript (11 lines) ----------
// Drop Header Row from Excel File//
dropped = DSCore.List.DropItems(data,1);
data_t = DSCore.List.Transpose(dropped);

// Values For Shared Parameter Nodes //
parNames = data_t[0];
paraTypes= data_t[1];
paraBIgroup= data_t[2];
paraInstance= data_t[3] == "Yes";
paraFormula= data_t[4];
paraNewName= data_t[5];
# ----------------------------------------

paraName = Watch(code_block_4.parNames)
formula = Watch(code_block_4.paraFormula)
setformula_for_excel = Python(IN[0]=filterByBoolMask.in, IN[1]=paraName, IN[2]=formula)  # IronPython2
# ---------- setformula_for_excel.python (94 lines) ----------
import clr

clr.AddReference("RevitServices")
import RevitServices
from RevitServices.Persistence import DocumentManager
from RevitServices.Transactions import TransactionManager
doc = DocumentManager.Instance.CurrentDBDocument

clr.AddReference("RevitAPI")
import Autodesk
from Autodesk.Revit.DB import *

clr.AddReference("RevitNodes")
import Revit
clr.ImportExtensions(Revit.Elements)
clr.ImportExtensions(Revit.GeometryConversion)

families = UnwrapElement(IN[0])


param_name_lst = IN[1]
param_value_lst = IN[2]
if not isinstance(param_name_lst, list): param_name_lst = [param_name_lst]
if not isinstance(param_value_lst, list): param_value_lst = [param_value_lst]

validFormula = ["validFormula"]
notValidFormula = ["notValidFormula"]
found = ["found"]
notfound = ["notfound"]
reload = ["reload"]
failed = ["failed"]
locked = ["locked"]
canassignformula = ["canAssign"]
cannotassignformula = ["cannotAssign"]

class FamilyLoadOption(IFamilyLoadOptions):
	def OnFamilyFound(self,familyInUse,overwriteParameterValues):
		overwriteParameterValues = True
		return True
	
	def OnSharedFamilyFound(self,sharedFamily,familyInUse,FamilySource,overwriteParameterValues):
		return True

for family in families:
	TransactionManager.Instance.ForceCloseTransaction()
	famdoc = doc.EditFamily(family)
	FamilyMan = famdoc.FamilyManager
	found.append(family.Name)


	TransactionManager.Instance.EnsureInTransaction(famdoc)
	check = 0
	# Loop thru the list of parameters to assign formula values to them... these are given as imput 
	for r in range(len(param_name_lst)):
		# Loop thru the list of parameters in the current family per the families outter loop above.
		for param in FamilyMan.Parameters:
		#for param in FamilyMan.get_Parameter(param_name_lst[r]):
			# for each of the parameters get their name and store in paramName.

			paramName = param.Definition.Name
			# Check if we have a match in parameter name.
			if param_name_lst[r] in paramName:
				if param.CanAssignFormula:
					canassignformula.append(param_name_lst[r])
				else:
					cannotassignformula.append(param_name_lst[r])
					
				try:
					# Make sure that the parameter is not locked.
					if FamilyMan.IsParameterLocked(param):
						FamilyMan.SetParameterLocked(param,False)
						locked.append(paraName)
					# Enter formula value to parameter.
					FamilyMan.SetFormula(param, '"' + param_value_lst[r] + '"')
					#FamilyMan.SetFormula(param, param_value_lst[r])
					#lstparam =[param_value_lst[r]]
					#paramParam = FamilyMan.FamilyManager.get_Parameter(param_value_lst[r])
					#FamilyMan.SetFormula(paramParam, lstparam)
					#FamilyMan.SetFormula(param, param_value_lst[r])
					check += 1
				except:
					failed.append(paramName)
			else:
				continue
		
	if check > 0:
		reload.append(famdoc.LoadFamily(doc,FamilyLoadOption()))
		
	TransactionManager.Instance.TransactionTaskDone()
	TransactionManager.Instance.ForceCloseTransaction()
	famdoc.Close(False)
	
OUT = found, reload, failed, locked, canassignformula, cannotassignformula,validFormula,notValidFormula
	
# ----------------------------------------
watch_3 = Watch(setformula_for_excel)
code_block_5 = CodeBlock { "test"; }
code_block_6 = CodeBlock { "my test param Value 2"; }
watch_4 = Watch(contains)
watch_5 = Watch(filterByBoolMask.in)
watch_6 = Watch(all_elements_of_type)
paraType = Watch(code_block_4.paraTypes)
isInstance = Watch(code_block_4.paraInstance)
builtin_group = Watch(code_block_4.paraBIgroup)
new_param_name = Watch(code_block_4.paraNewName)
