# Dynamo graph Visibility_polygon_1.0.dyn (Dynamo 2.0.2.6826)

# group: ПРОЧИТАЙТЕ ПЕРЕД ЗАПУСКОМ ● НАЗВАНИЕ: Создание области видимости ● ОПИСАНИЕ: Скрипт создает область видимости из точки, в которой находится выбранный элемент. ● ПОРЯДОК ВЫПОЛНЕНИЯ: 1. Выберите элемент, из базовой точки которой будет производиться проверка видимости. 2. Выберите тип области заливки. 3. Выберите 3д вид, с которого будут браться стены для проверки. 4. Выберите количество точек провеки, определяюих точность посроения области 5. Запустите скрипт. ● КОММЕНТАРИИ: ● ЗАКАЗЧИК: Горпроект ● РАЗДЕЛЫ: АР ● СОФТ: Revit 2019.1 ● DYNAMO: Dynamo 2.0.3
# note: Разработчик:
# Всеволод Чугреев
# vschugr@gmail.com

# group: Выберите управляющий объект
select_model_element = DSModelElementSelection()  # 1 picked in the model

select_filled_region_type = FilledRegionTypes(index=0)

# group: Выберите 3д вид, на котором расположены стены, которые нужно пересекать
views = Views(index=0)

# group: Количество точек полигона
integer_slider = IntegerSlider(353, range=0..360 step 1)

# group: Код
python_script = Python(IN[0]=select_model_element, IN[1]=select_filled_region_type, IN[2]=views, IN[3]=integer_slider)
# ---------- python_script.python (79 lines) ----------
import clr

import sys 
sys.path.append(r'C:\Program Files (x86)\IronPython 2.7\Lib')


clr.AddReference("RevitNodes") 
import Revit.Elements as DR

import Revit
clr.ImportExtensions(Revit.Elements)
clr.ImportExtensions(Revit.GeometryConversion) 
#
clr.AddReference("RevitAPI") 
from Autodesk.Revit.DB import *
from Autodesk.Revit.DB.Mechanical import *
from Autodesk.Revit.DB.Structure import *
clr.AddReference("RevitAPIUI")
from Autodesk.Revit.UI import *

clr.AddReference("RevitServices") 
import RevitServices
from RevitServices.Persistence import DocumentManager
from RevitServices.Transactions import TransactionManager
doc = DocumentManager.Instance.CurrentDBDocument


clr.AddReference("System") 
from System.Collections.Generic import List as CList

import time
import math 


time1 = time.time()


	
def maincode():
	
	element = UnwrapElement(IN[0])
	view3d = UnwrapElement(IN[2])
	filledRegionType = UnwrapElement(IN[1])
	stepCount = IN[3]
		
	point = element.Location.Point
	point = point.Add(XYZ(0,0,1))
	
	elements = FilteredElementCollector(doc,view3d.Id).OfClass(Wall).ToElements()
	elementIds = [e.Id for e in elements]
	refInt = ReferenceIntersector(CList[ElementId](elementIds),FindReferenceTarget.Element,view3d)
	
	points = []
	
	for s in range(stepCount):
	
		angle = math.radians(float(s)/stepCount*360)
		vector = XYZ(1*math.sin(angle),math.cos(angle),0)
		result = refInt.FindNearest(point,vector)
		if result is not None:
			p = result.GetReference().GlobalPoint
			points.append(p)
		
	curveLoop = CurveLoop()
	for i in range(len(points)):
		l = Line.CreateBound(points[i-1],points[i])
		curveLoop.Append(l) 
	
	filledRegion = FilledRegion.Create(doc,filledRegionType.Id,doc.ActiveView.Id,CList[CurveLoop]([curveLoop]))
	DetailElementOrderUtils.SendToBack(doc,doc.ActiveView,CList[ElementId]([filledRegion.Id]))
	filledRegion = filledRegion.ToDSType(False)
	return filledRegion
	


TransactionManager.Instance.EnsureInTransaction(doc)
x = maincode()
TransactionManager.Instance.TransactionTaskDone()	
OUT = time.time()-time1,x		
# ----------------------------------------

watch = Watch(python_script)
