# Dynamo graph floor_hole.dyn (Dynamo 2.0.3.8810)

select_model_elements = DSModelElementsSelection()  # 4 picked in the model
curve = CurveElement.Curve(curveElement=select_model_elements)
select_model_elements_2 = DSModelElementsSelection()  # 4 picked in the model
curve_2 = CurveElement.Curve(curveElement=select_model_elements_2)
list_create = List.Create(item0=curve, item1=curve_2)
select_model_elements_3 = DSModelElementsSelection()  # 4 picked in the model
curve_3 = CurveElement.Curve(curveElement=select_model_elements_3)
select_model_elements_4 = DSModelElementsSelection()  # 4 picked in the model
curve_4 = CurveElement.Curve(curveElement=select_model_elements_4)
list_create_2 = List.Create(item0=curve_3, item1=curve_4)
python_script = Python(IN[0]=list_create, IN[1]=list_create_2)
# ---------- python_script.python (49 lines) ----------
# Enable Python support and load DesignScript library
import clr

clr.AddReference("RevitAPI")
from Autodesk.Revit.DB import *

import Autodesk

clr.AddReference("RevitServices")
import RevitServices
from RevitServices.Persistence import DocumentManager

clr.AddReference("RevitNodes")
import Revit
clr.ImportExtensions(Revit.GeometryConversion)

borders = UnwrapElement(IN[0])
holes = UnwrapElement(IN[1])

output=[]

doc = DocumentManager.Instance.CurrentDBDocument
tg=TransactionGroup(doc, 'Floors')
tg.Start()

for b,h in zip(borders,holes):
	border = CurveArray()
	for c in b:
		border.Append(c.ToRevitType())
		
	t0 = Transaction(doc, 'Floor border')
	t0.Start()
	floor = doc.Create.NewFloor(border,False)
	t0.Commit()
	
	hole = CurveArray()
	for c in h:
		hole.Append(c.ToRevitType())
		
	t1 = Transaction(doc, 'Floor hole')
	t1.Start()
	opening = doc.Create.NewOpening(floor,hole,True)
	t1.Commit()
		
	output.append([floor,opening])

tg.Assimilate()
# Assign your output to the OUT variable.
OUT = output
# ----------------------------------------
