# Dynamo graph АP_Установка высоты отделочных стен.dyn (Dynamo 2.0.4.12684)

# group: Element collector by level
LINK = BoolSelector(false)  # graph input
link_name = StringInput("BI TOWER_AR_B1_WIP_R18")  # graph input
categories = Categories(index=525)  # graph input
levels = Levels(index=1)  # graph input
pyscr_elements_collector = Python(IN[0]=LINK, IN[1]=link_name, IN[2]=categories, IN[3]=levels)
# ---------- pyscr_elements_collector.python (66 lines) ----------
# Default imports
import System
import clr
clr.AddReference('ProtoGeometry')
from Autodesk.DesignScript.Geometry import *

# Import RevitAPI
clr.AddReference("RevitAPI")
import Autodesk
from Autodesk.Revit.DB import *

# Import DocumentManager and TransactionManager
clr.AddReference("RevitServices")
import RevitServices
from RevitServices.Persistence import DocumentManager
from RevitServices.Transactions import TransactionManager

# Import ToDSType(bool) extension method
clr.AddReference("RevitNodes")
import Revit
clr.ImportExtensions(Revit.Elements)
clr.ImportExtensions(Revit.GeometryConversion)

#Import Collections
from System.Collections.Generic import *

#The inputs to this node will be stored as a list in the IN variable.
dataEnteringNode = IN

ToggleLink = IN[0]

Linkinstname = IN[1]

Category = IN[2]

levelInput = IN[3]

app =  DocumentManager.Instance.CurrentUIApplication.Application
doc = DocumentManager.Instance.CurrentDBDocument
linkInstances = Autodesk.Revit.DB.FilteredElementCollector(doc).OfClass(Autodesk.Revit.DB.RevitLinkInstance)
BuiltIn = System.Enum.ToObject(BuiltInCategory, Category.Id)


if ToggleLink == False:

	filter = ElementCategoryFilter(BuiltIn)
	Listelem = Autodesk.Revit.DB.FilteredElementCollector(doc).WherePasses(filter).WhereElementIsNotElementType().ToElements()
	levelFilter = ElementLevelFilter(UnwrapElement(levelInput).Id)
	logicalFilter = LogicalAndFilter(levelFilter, filter)
	OUT = FilteredElementCollector(doc).OfCategory(BuiltIn).WherePasses(logicalFilter).ToElements()
	
if ToggleLink == True:

	i = ()
	for i in linkInstances:
		if Linkinstname.ToLower() in i.Name.ToLower():
			linkDoc = i.GetLinkDocument()
			
	filter = ElementCategoryFilter(BuiltIn)			
	Listelem = FilteredElementCollector(linkDoc).WherePasses(filter).ToElements()
	#levelFilter = ElementLevelFilter(UnwrapElement(levelInput).Id)
	#logicalFilter = LogicalAndFilter(levelFilter, filter)
	OUT = FilteredElementCollector(linkDoc).OfCategory(BuiltIn).WherePasses(filter).ToElements()
	
	# Level filter does not work?
	
# ----------------------------------------

pyscript_wall_filter = Python(IN[0]=pyscr_elements_collector)
# ---------- pyscript_wall_filter.python (39 lines) ----------
import clr
clr.AddReference('RevitAPI')
from Autodesk.Revit.DB import *
import Autodesk

clr.AddReference("RevitNodes")
import Revit
clr.ImportExtensions(Revit.GeometryConversion)

def flatten(x):
    result = []
    for el in x:
        if hasattr(el, "__iter__") and not isinstance(el, basestring):
            result.extend(flatten(el))
        else:
            result.append(el)
    return result
    
def Clearlist(items):
	ClearList = filter(lambda x: x, flatten(items))
	return ClearList
	
def GetElemType(e):
	doc = DocumentManager.Instance.CurrentDBDocument
	try:
		elemType = doc.GetElement(e.GetTypeId())
		return elemType
	except:
		pass

items = UnwrapElement(IN[0])

try:
	walls = [wall for wall in Clearlist(items) if wall.GetType() == Autodesk.Revit.DB.Wall]
except:
	pass


OUT = walls
# ----------------------------------------
elementType = Element.ElementType(element=pyscript_wall_filter)
string = StringInput("Ширина")  # graph input
getParameterValueByName = Element.GetParameterValueByName(element=elementType, parameterName=string)
code_block = CodeBlock { 30; }
le = getParameterValueByName <= code_block
filterByBoolMask = List.FilterByBoolMask(list=pyscript_wall_filter, mask=le)
flatten = List.Flatten(list=filterByBoolMask.in)
string_2 = StringInput("Неприсоединенная высота")  # graph input
getParameterValueByName_2 = Element.GetParameterValueByName(element=flatten, parameterName=string_2)
round = Custom[Math.Round+](dbl=getParameterValueByName_2)  # Rounds a number to a specified precision
allFalse = List.AllFalse()  # unwired: list
if_ = If(test=round, true=flatten, false=allFalse)
string_3 = StringInput("Смещение сверху")  # graph input
code_block_2 = CodeBlock { 4200; }
setParameterByName = Element.SetParameterByName(element=if_, parameterName=string_3, value=code_block_2)
string_4 = StringInput("Зависимость сверху")  # graph input
count = List.Count(list=setParameterByName)
ofRepeatedItem = List.OfRepeatedItem(item=levels, amount=count)
setParameterByName_2 = Element.SetParameterByName(element=setParameterByName, parameterName=string_4, value=ofRepeatedItem)
