# Dynamo graph АР_Building Finishing Walls.dyn (Dynamo 1.3.4.6666)

# group: Get Link Elements
levels = Levels()
name = Room.Name()  # unwired: arg0
groupByFunction = GroupByFunction(arg1=name)  # unwired: arg0
links = Links()
categories = Categories("Rooms")
ofCategory = Revit.LinkElement.OfCategory(links, categories)
flatten = Flatten(ofCategory)
isEmpty = List.IsEmpty(flatten)
filterByBoolMask = List.FilterByBoolMask(list=flatten, mask=isEmpty)
code_block = CodeBlock { "Уровень"; }
getParameterValueByName = Element.GetParameterValueByName(element=flatten, parameterName=code_block)
name_2 = Level.Name(levels)
eq = getParameterValueByName == name_2
filterByBoolMask_2 = List.FilterByBoolMask(list=filterByBoolMask.out, mask=eq)
removeNulls = Lists.Manage.RemoveNulls(filterByBoolMask_2.in)

code_block_2 = CodeBlock { 5; }

# group: Wall Line in Room
flatten_2 = Flatten(lacing=Longest)  # frozen; unwired: arg0
group_curves = Custom[Group Curves](Curves=flatten_2)  # This node will take any input of flat list of curves and group them into sublists containing "joinable" curves that is continous curves. They might form closed curves or open curves. Use PolyCurve.ByJoinedCurves to convert output groups of curves into single PolyCurves
removeDuplicates = Curve.RemoveDuplicates(group_curves)
code_block_3 = CodeBlock(Rooms=removeNulls) { Rooms; }
categories_2 = Categories("Walls")
wall_types = WallTypes()
name_3 = WallType.Name(wall_types)

# group: Wall
list_clear = Python(IN[0]=removeDuplicates)
# ---------- list_clear.python (23 lines) ----------
#Copyright(c) 2015, Konrad K Sobon
# @arch_laboratory, http://archi-lab.net

import clr
clr.AddReference('ProtoGeometry')
from Autodesk.DesignScript.Geometry import *
#The inputs to this node will be stored as a list in the IN variable.
dataEnteringNode = IN

def ClearList(_list):
    out = []
    for _list1 in _list:
        if _list1 is None:
            continue
        if isinstance(_list1, list):
             _list1 = ClearList(_list1)
             if not _list1:
                 continue
        out.append(_list1)
    return out

#Assign your output to the OUT variable
OUT = ClearList(IN[0])
# ----------------------------------------
code_block_4 = CodeBlock { 3000; }
wall_types_2 = WallTypes()
byCurveAndHeight = Wall.ByCurveAndHeight(curve=list_clear, height=code_block_4, level=levels, wallType=wall_types_2)  # frozen

# group: Room Boundary to Clear Curve
solids = Revit.LinkElement.Solids(code_block_3)  # frozen
flatten_3 = Flatten(solids)
boundingBox = Geometry.BoundingBox(flatten_3)
minPoint = BoundingBox.MinPoint(boundingBox)
ZAxis = Vector.ZAxis()
byOriginNormal = Plane.ByOriginNormal(origin=minPoint, normal=ZAxis)
intersect = Geometry.Intersect(geometry=byOriginNormal, other=flatten_3)
flatten_4 = Flatten(intersect)
perimeterCurves = Surface.PerimeterCurves(flatten_4)
approximateWithArcAndLineSegments = Curve.ApproximateWithArcAndLineSegments(perimeterCurves)
flatten_5 = Flatten()  # unwired: arg0
map = List.Map(list=approximateWithArcAndLineSegments, f_x=flatten_5)

all_elements_of_category = ElementsOfCategory(categories_2)

# group (continued): Wall Line in Room
allInstancesAtLevel = Custom[Element.AllInstancesAtLevel](element=all_elements_of_category, level=levels)  # Retrieves all instances of an element on a given level
flatten_6 = Flatten(allInstancesAtLevel)
getElementsIntersect = Revit.BoundingBox.GetElementsIntersect(boundingBox, flatten_6, code_block_2)
flatten_7 = Flatten(getElementsIntersect)
name_4 = WallType.Name(flatten_7)
eq_2 = name_4 == name_3
filterByBoolMask_3 = List.FilterByBoolMask(list=flatten_7, mask=eq_2)

solids_2 = Element.Solids(filterByBoolMask_3.in)
flatten_8 = Flatten(solids_2)
XY = Plane.XY()
intersect_2 = Geometry.Intersect(geometry=flatten_8, other=XY)
endPoints = Geometry.Curves.EndPoints()  # unwired: arg0
removeDuplicates_2 = Curve.RemoveDuplicates(map)
