# Dynamo graph АР_Ceiling Height.dyn (Dynamo 1.3.4.6666)

# group: Picked rooms on level 1
forceChildrensEval = ForceChildrensEval()  # unwired: arg0
categories = Categories("Rooms")
isolated_pick_model_elements = Custom[Isolated Pick Model Elements](refresh=forceChildrensEval, Category=categories)  # This allows a multiple selection of elements of specified category.
room_location_centering = Custom[Room Location Centering](Rooms=isolated_pick_model_elements)  # Move room location point to its centroid. If centroid is located outside the room, location point stays at its origin coords. It's a good tool for auto-tagging.
getLocation = Element.GetLocation(room_location_centering.Rooms_Moved)

ZAxis = Vector.ZAxis()
code_block = CodeBlock { 5; }
views = Views("{3D}")
byOriginDirection = Revit.References.RayBounce.ByOriginDirection(getLocation, ZAxis, code_block, views)

# group: Determines if the room has a ceiling above it
getCategory = Element.GetCategory(byOriginDirection.out1)
string_from_object = FromObject(getCategory)
categories_2 = Categories("Ceilings")
string_from_object_2 = FromObject(categories_2)
eq = string_from_object == string_from_object_2

flatten = Flatten(eq)
flatten_2 = Flatten(byOriginDirection.out1)

# group: Filters out for just rooms with ceilings
filterByBoolMask = List.FilterByBoolMask(list=isolated_pick_model_elements, mask=flatten)
filterByBoolMask_2 = List.FilterByBoolMask(list=flatten_2, mask=flatten)

# group: Gets the ceiling parameter and sets the room parameter.
code_block_2 = CodeBlock { "Limit Offset"; }
code_block_3 = CodeBlock { "Height Offset From Level"; }
getParameterValueByName = Element.GetParameterValueByName(element=filterByBoolMask_2.in, parameterName=code_block_3)
setParameterByName = Element.SetParameterByName(element=filterByBoolMask.in, parameterName=code_block_2, value=getParameterValueByName)
