# Dynamo graph АР_EXPORT DATA TO EXCEL.dyn (Dynamo 2.0.1.5055)

file_path = Filename("C:\Users\user\Desktop\Книга1.xlsx")

# group: Выбор элементов по категории
categories = Categories(index=512)
name = Category.Name(category=categories)
all_elements_of_category = ElementsOfCategory(Category=categories)
type = archilab.Revit.Elements.Elements.Type(element=all_elements_of_category)
parameters = Element.Parameters(element=type)
watch = Watch(parameters)

# group: Get parameter типа
string = StringInput("Маркировка типоразмера")
getParameterValueByName = Element.GetParameterValueByName(element=type, parameterName=string)

# group: Get parameter типа
string_2 = StringInput("Имя типа")
getParameterValueByName_2 = Element.GetParameterValueByName(element=type, parameterName=string_2)

# group: Get parameter типа
string_3 = StringInput("Комментаррии к типоразмеру")
getParameterValueByName_3 = Element.GetParameterValueByName(element=type, parameterName=string_3)

list_create = List.Create(item0=getParameterValueByName, item1=getParameterValueByName_2, item2=getParameterValueByName_3)

# group: Экспорт в excel
number = DoubleInput(0)
transpose = List.Transpose(lists=list_create)
boolean = BoolSelector(true)
exportExcel = Data.ExportExcel(filePath=file_path, sheetName=name, startRow=number, startCol=number, data=transpose, overWrite=boolean)
watch_2 = Watch(transpose)

# group: Import в excel
boolean_2 = BoolSelector(true)
importExcel = Data.ImportExcel(file=file_path, sheetName=name, readAsStrings=boolean_2)  # frozen
watch_3 = Watch()  # unwired: arg0

setParameterByName = Element.SetParameterByName(element=all_elements_of_category, parameterName=string_3, value=importExcel)

# group: Get parameter экземпляра
string_4 = StringInput("Марка")
getParameterValueByName_4 = Element.GetParameterValueByName(element=all_elements_of_category, parameterName=string_4)
string_5 = StringInput("Комментарии")
