# Dynamo graph АР_FINISHING MARK BY ROOM NUMBER.dyn (Dynamo 2.0.4.12684)

# group: Проверьте наличие параметра в модели
заполняемый_параметр = StringInput("Комментарии")  # graph input

categories = Categories(index=512)  # graph input
all_elements_of_category = ElementsOfCategory(Category=categories)

# group: Фильтр по параметру
string = StringInput("Группа модели")  # graph input
getParameterValueByName = Element.GetParameterValueByName(element=all_elements_of_category, parameterName=string)
code_block = CodeBlock { "Отделка стен"; }
eq = getParameterValueByName == code_block

categories_2 = Categories(index=423)  # graph input
all_elements_of_category_2 = ElementsOfCategory(Category=categories_2)
categories_3 = Categories(index=442)  # graph input
all_elements_of_category_3 = ElementsOfCategory(Category=categories_3)
categories_4 = Categories(index=173)  # graph input
all_elements_of_category_4 = ElementsOfCategory(Category=categories_4)

# group: Запись номеров помещений
categories_5 = Categories(index=438)  # graph input
all_elements_of_category_5 = ElementsOfCategory(Category=categories_5)
filterByBoolMask = List.FilterByBoolMask(list=all_elements_of_category, mask=eq)
join = List.Join(list0=filterByBoolMask.in, list1=all_elements_of_category_2, list2=all_elements_of_category_3, list3=all_elements_of_category_4)
pys_заполнить = Python(IN[0]=all_elements_of_category_5, IN[1]=заполняемый_параметр, IN[2]=join)
# ---------- pys_заполнить.python (47 lines) ----------
import clr
clr.AddReference('ProtoGeometry')
from Autodesk.DesignScript.Geometry import *
clr.AddReference('RevitAPI')
from Autodesk.Revit.DB import *
clr.AddReference("RevitServices")
import RevitServices
from RevitServices.Persistence import DocumentManager
from RevitServices.Transactions import TransactionManager
doc = DocumentManager.Instance.CurrentDBDocument

rooms = UnwrapElement(IN[0])
elements = UnwrapElement(IN[2])
comm = IN[1]
list=[]
list1=[]
list2=[]
opt = SpatialElementBoundaryOptions()
opt.SpatialElementBoundaryLocation = SpatialElementBoundaryLocation.Finish
calc = SpatialElementGeometryCalculator(doc,opt)
for room in rooms:
	if room.Area > 0:
		list.append(room)
		
TransactionManager.Instance.EnsureInTransaction(doc)
for element in elements:
	element.LookupParameter(comm).Set("")

for room in list:
	surf = calc.CalculateSpatialElementGeometry(room)
	roomSolid = surf.GetGeometry()
	faces = roomSolid.Faces
	id = room.Id
	for face in faces:
		bounds = surf.GetBoundaryFaceInfo(face)
		for bound in bounds:
			element = doc.GetElement(bound.SpatialBoundaryElement.HostElementId)
			if element is not None:
				par = element.LookupParameter(comm).AsString()
				if par is None or par == "":
					a = element.LookupParameter(comm).Set(room.Number)
				else:
					a = element.LookupParameter(comm).Set(par+";"+room.Number)					
				list1.append(a)
TransactionManager.Instance.TransactionTaskDone()					

OUT = list1
# ----------------------------------------
pys_очистить = Python(IN[0]=filterByBoolMask.out, IN[1]=заполняемый_параметр)
# ---------- pys_очистить.python (19 lines) ----------
import clr
clr.AddReference('ProtoGeometry')
from Autodesk.DesignScript.Geometry import *
clr.AddReference('RevitAPI')
from Autodesk.Revit.DB import *
clr.AddReference("RevitServices")
import RevitServices
from RevitServices.Persistence import DocumentManager
from RevitServices.Transactions import TransactionManager
doc = DocumentManager.Instance.CurrentDBDocument
elements = UnwrapElement(IN[0])
comm = IN[1]

TransactionManager.Instance.EnsureInTransaction(doc)
for element in elements:
	element.LookupParameter(comm).Set("")
TransactionManager.Instance.TransactionTaskDone()					
#Назначьте вывод переменной OUT.
OUT = 0
# ----------------------------------------

# group: Фильтр по типам стен
string_2 = StringInput("Тип")  # graph input
getParameterValueByName_2 = Element.GetParameterValueByName(element=all_elements_of_category, parameterName=string_2)
id = Element.Id(element=getParameterValueByName_2)
wall_types = WallTypes(index=25)  # graph input
wall_types_2 = WallTypes(index=15)  # graph input
wall_types_3 = WallTypes(index=15)  # graph input
join_2 = List.Join(list0=wall_types, list1=wall_types_2, list2=wall_types_3)
id_2 = Element.Id(element=join_2)
contains = List.Contains(list=id_2)  # unwired: item
map = List.Map(list=id, f_x=contains)
