# Dynamo graph АР_HOLE HEIGHT.dyn (Dynamo 2.0.1.5055)

family_types = FamilyTypes(index=123)
all_elements_of_family_type = ElementsOfFamilyType(Family_Type=family_types)
parameters = Element.Parameters(element=all_elements_of_family_type)
name = Parameter.Name(parameter=parameters)
flatten = List.Flatten(list=all_elements_of_family_type)
code_block = CodeBlock { "BI_отметка_этажа"; }
level = Custom[Element.Level](element=flatten)  # Gets an element's level
projectElevation = Level.ProjectElevation(level=level)
setParameterByName = Element.SetParameterByName(element=flatten, parameterName=code_block, value=projectElevation)
code_block_2 = CodeBlock { "BI_отверстие_отметка_от_этажа"; }
code_block_3 = CodeBlock { "Высота нижнего бруса"; }
getParameterValueByName = Element.GetParameterValueByName(element=flatten, parameterName=code_block_3)
setParameterByName_2 = Element.SetParameterByName(element=flatten, parameterName=code_block_2, value=getParameterValueByName)
name_2 = Family.Name(family=family_types)
этаж = Watch(name_2)

# group: ПРИКРЕПИТЬ (ЗАБЛОКИРОВАТЬ)
ПРИКРЕПИТЬ = BoolSelector(true)  # graph input
# note: Pin all inputted revit elements
python_script = Python(IN[0]=all_elements_of_family_type, IN[1]=ПРИКРЕПИТЬ)
# ---------- python_script.python (33 lines) ----------
#By Brendan Cassidy - twitter @brencass86
import clr
# Import DocumentManager and TransactionManager
clr.AddReference("RevitServices")
import RevitServices
from RevitServices.Persistence import DocumentManager
from RevitServices.Transactions import TransactionManager
# Import RevitAPI
clr.AddReference("RevitAPI")
import Autodesk
from Autodesk.Revit.DB import *

doc = DocumentManager.Instance.CurrentDBDocument

#Input
input=UnwrapElement(IN[0])

# Start Transaction
TransactionManager.Instance.EnsureInTransaction(doc)

for a in input:
	Element.Pinned.SetValue(a,IN[1])
# End Transaction
TransactionManager.Instance.TransactionTaskDone()

if IN[1]:
	output_text="All Elements inputted have been pinned"
else:
	output_text="All Elements inputted have been unpinned"


#Output
OUT = [output_text,IN[0]]
# ----------------------------------------
