# Dynamo graph АР_WORKSET.dyn (Dynamo 2.0.1.5055)

# group: Выбор стен
categories = Categories(index=512)  # graph input
all_elements_of_category = ElementsOfCategory(Category=categories)

# group: "Отделка стен"
flatten = List.Flatten(list=all_elements_of_category)
code_block = CodeBlock { "Группа модели"; }
getParameterValueByName = Element.GetParameterValueByName(element=flatten, parameterName=code_block)
code_block_2 = CodeBlock { "Отделка внутренняя"; }
byName = archilab.Revit.Elements.Workset.ByName(name=code_block_2)
get_type_parameter = Custom[Get Type Parameter](element=flatten, parameterName=code_block)  # This node will retrieve a type parameter by its name.
code_block_3 = CodeBlock { "Отделка стен"; }
eq = get_type_parameter == code_block_3
filterByBoolMask = List.FilterByBoolMask(list=flatten, mask=eq)
setWorkset = Custom[Element.SetWorkset](workset=byName, element=filterByBoolMask.in)  # Sets the workset of a given element
watch = Watch(filterByBoolMask.in)

# group: "Лестницы и пандусы"
code_block_4 = CodeBlock { "Лестницы и пандусы"; }
byName_2 = archilab.Revit.Elements.Workset.ByName(name=code_block_4)
categories_2 = Categories(index=192)  # graph input
all_elements_of_category_2 = ElementsOfCategory(Category=categories_2)
setWorkset_2 = Custom[Element.SetWorkset](workset=byName_2, element=all_elements_of_category_2)

# group: "Копированные несущие стены"
code_block_5 = CodeBlock { "#Копированые несущие стены"; }
byName_3 = archilab.Revit.Elements.Workset.ByName(name=code_block_5)
flatten_2 = List.Flatten(list=all_elements_of_category)
code_block_6 = CodeBlock { "Группа модели"; }
get_type_parameter_2 = Custom[Get Type Parameter](element=flatten_2, parameterName=code_block_6)
code_block_7 = CodeBlock { "Стены копированные монолитные железобетонные"; }
eq_2 = get_type_parameter_2 == code_block_7
filterByBoolMask_2 = List.FilterByBoolMask(list=flatten_2, mask=eq_2)
watch_2 = Watch(filterByBoolMask_2.in)
setWorkset_3 = Custom[Element.SetWorkset](workset=byName_3, element=watch_2)
getParameterValueByName_2 = Element.GetParameterValueByName(element=flatten_2, parameterName=code_block_6)

# group: "Внутренние стены и перегородки"
flatten_3 = List.Flatten(list=all_elements_of_category)
code_block_8 = CodeBlock { "Группа модели"; }
getParameterValueByName_3 = Element.GetParameterValueByName(element=flatten_3, parameterName=code_block_8)
code_block_9 = CodeBlock { "Внутренние стены и перегородки"; }
byName_4 = archilab.Revit.Elements.Workset.ByName(name=code_block_9)
get_type_parameter_3 = Custom[Get Type Parameter](element=flatten_3, parameterName=code_block_8)
code_block_10 = CodeBlock { "Перегородки"; }
eq_3 = get_type_parameter_3 == code_block_10
filterByBoolMask_3 = List.FilterByBoolMask(list=flatten_3, mask=eq_3)
watch_3 = Watch(filterByBoolMask_3.in)
flatten_4 = List.Flatten(list=all_elements_of_category)
code_block_11 = CodeBlock { "Группа модели"; }
get_type_parameter_4 = Custom[Get Type Parameter](element=flatten_4, parameterName=code_block_11)
code_block_12 = CodeBlock { "Стены внутренние"; }
eq_4 = get_type_parameter_4 == code_block_12
filterByBoolMask_4 = List.FilterByBoolMask(list=flatten_4, mask=eq_4)
watch_4 = Watch(filterByBoolMask_4.in)
flatten_5 = List.Flatten(list=all_elements_of_category)
code_block_13 = CodeBlock { "Группа модели"; }
get_type_parameter_5 = Custom[Get Type Parameter](element=flatten_5, parameterName=code_block_13)
code_block_14 = CodeBlock { "Стены кирпичные"; }
eq_5 = get_type_parameter_5 == code_block_14
filterByBoolMask_5 = List.FilterByBoolMask(list=flatten_5, mask=eq_5)
watch_5 = Watch(filterByBoolMask_5.in)
create = List.Create(item0=watch_3, item1=watch_4, item2=watch_5)
setWorkset_4 = Custom[Element.SetWorkset](workset=byName_4, element=create)
getParameterValueByName_4 = Element.GetParameterValueByName(element=flatten_4, parameterName=code_block_11)
getParameterValueByName_5 = Element.GetParameterValueByName(element=flatten_5, parameterName=code_block_13)

# group: "Проемы"
code_block_15 = CodeBlock { "Проемы"; }
byName_5 = archilab.Revit.Elements.Workset.ByName(name=code_block_15)
categories_3 = Categories(index=123)  # graph input
categories_4 = Categories(index=386)  # graph input
create_2 = List.Create(item0=categories_3, item1=categories_4)
all_elements_of_category_3 = ElementsOfCategory(Category=create_2)
setWorkset_5 = Custom[Element.SetWorkset](workset=byName_5, element=all_elements_of_category_3)

# group: "Санитарные приборы"
code_block_16 = CodeBlock { "Санитарные приборы"; }
byName_6 = archilab.Revit.Elements.Workset.ByName(name=code_block_16)
categories_5 = Categories(index=471)  # graph input
all_elements_of_category_4 = ElementsOfCategory(Category=categories_5)
setWorkset_6 = Custom[Element.SetWorkset](workset=byName_6, element=all_elements_of_category_4)

# group: #Связанные файлы
code_block_17 = CodeBlock { "#Связанные файлы"; }
byName_7 = archilab.Revit.Elements.Workset.ByName(name=code_block_17)
element_types = ElementTypes(index=266)  # graph input
all_elements_of_type = ElementsOfType(element_type=element_types)
setWorkset_7 = Custom[Element.SetWorkset](workset=byName_7, element=all_elements_of_type)

# group: "Потолки"
code_block_18 = CodeBlock { "Потолки"; }
byName_8 = archilab.Revit.Elements.Workset.ByName(name=code_block_18)
string = StringInput("Потолки")
byName_9 = Category.ByName(name=string)
all_elements_of_category_5 = ElementsOfCategory(Category=byName_9)
setWorkset_8 = Custom[Element.SetWorkset](workset=byName_8, element=all_elements_of_category_5)

# group: "Полы"
code_block_19 = CodeBlock { "Полы"; }
byName_10 = archilab.Revit.Elements.Workset.ByName(name=code_block_19)
string_2 = StringInput("Перекрытия")
byName_11 = Category.ByName(name=string_2)
all_elements_of_category_6 = ElementsOfCategory(Category=byName_11)
setWorkset_9 = Custom[Element.SetWorkset](workset=byName_10, element=all_elements_of_category_6)

# group: "Помещения"
code_block_20 = CodeBlock { "Помещения"; }
byName_12 = archilab.Revit.Elements.Workset.ByName(name=code_block_20)
categories_6 = Categories(index=438)  # graph input
all_elements_of_category_7 = ElementsOfCategory(Category=categories_6)
setWorkset_10 = Custom[Element.SetWorkset](workset=byName_12, element=all_elements_of_category_7)

# group: "#Опорные плоскости"
code_block_21 = CodeBlock { "#Опорные плоскости"; }
byName_13 = archilab.Revit.Elements.Workset.ByName(name=code_block_21)
categories_7 = Categories(index=392)  # graph input
all_elements_of_category_8 = ElementsOfCategory(Category=categories_7)
setWorkset_11 = Custom[Element.SetWorkset](workset=byName_13, element=all_elements_of_category_8)

# group: "#Оси и уровни"
code_block_22 = CodeBlock { "#Оси и уровни"; }
byName_14 = archilab.Revit.Elements.Workset.ByName(name=code_block_22)
categories_8 = Categories(index=403)  # graph input
categories_9 = Categories(index=558)  # graph input
categories_10 = Categories(index=78)  # graph input
categories_11 = Categories(index=356)  # graph input
create_3 = List.Create(item0=categories_8, item1=categories_9, item2=categories_10, item3=categories_11)
all_elements_of_category_9 = ElementsOfCategory(Category=create_3)
setWorkset_12 = Custom[Element.SetWorkset](workset=byName_14, element=all_elements_of_category_9)
