# Dynamo graph АР_Расстановка плинтуса.dyn (Dynamo 1.3.4.6666)

# group: Параметр номера помещения
string_parameter = StringInput("CP_номер_помещения")
string_parameter_2 = StringInput("BI_индекс_помещения")

# group: Room collector by level
LINK = BoolSelector(false)
link_name = StringInput("2603-CPR-ZZ-ZZ-M3-AR-0010")
levels = Levels("01 Этаж")
pyscr_room_collector = Python(IN[0]=LINK, IN[1]=link_name, IN[2]=levels)
# ---------- pyscr_room_collector.python (88 lines) ----------
# Default imports
import System
import clr
clr.AddReference('ProtoGeometry')
from Autodesk.DesignScript.Geometry import *

# Import RevitAPI
clr.AddReference("RevitAPI")
import Autodesk
from Autodesk.Revit.DB import *

# Import DocumentManager and TransactionManager
clr.AddReference("RevitServices")
import RevitServices
from RevitServices.Persistence import DocumentManager
from RevitServices.Transactions import TransactionManager

# Import ToDSType(bool) extension method
clr.AddReference("RevitNodes")
import Revit
clr.ImportExtensions(Revit.Elements)
clr.ImportExtensions(Revit.GeometryConversion)

#Import Collections
from System.Collections.Generic import *

#The inputs to this node will be stored as a list in the IN variable.
dataEnteringNode = IN

ToggleLink = IN[0]

Linkinstname = IN[1]

levelInput = IN[2]

app =  DocumentManager.Instance.CurrentUIApplication.Application
linkInstances = Autodesk.Revit.DB.FilteredElementCollector(DocumentManager.Instance.CurrentDBDocument).OfClass(Autodesk.Revit.DB.RevitLinkInstance)

if ToggleLink == False:

	selectDOC = DocumentManager.Instance.CurrentDBDocument
	levelFilter = ElementLevelFilter(UnwrapElement(levelInput).Id)
		
if ToggleLink == True:

	i = ()
	for i in linkInstances:
		if Linkinstname.ToLower() in i.Name.ToLower():
			selectDOC = i.GetLinkDocument()
	
	ruleValDb = UnwrapElement(levelInput).get_Parameter(BuiltInParameter.LEVEL_ELEV).AsDouble()
	pvp = ParameterValueProvider(ElementId(BuiltInParameter.LEVEL_ELEV))
	fnrv = FilterNumericEquals()
	levelparamfilter = ElementParameterFilter(FilterDoubleRule(pvp, fnrv, ruleValDb, 10.-3))
	levels = FilteredElementCollector(selectDOC).OfClass(Level)
	Levelcollect = FilteredElementCollector(selectDOC).OfClass(Level).WherePasses(levelparamfilter).FirstElement()
	levelFilter = ElementLevelFilter(Levelcollect.Id)


################################################# FIND VALID ROOMS ############################################

collector = FilteredElementCollector(selectDOC)

areaFilter = AreaFilter()
areaExcludes = collector.WherePasses(areaFilter).ToElements()
areaExcludes = list(areaExcludes)
element_set = ElementSet()
excludes = List[ElementId]()
if len(areaExcludes) == 0:
	logicalFilter = levelFilter
else:
	for i in areaExcludes:
		element_set.Insert(i)
		elemIter = element_set.ForwardIterator()
		elemIter.Reset()
		while elemIter.MoveNext():
			curElem = elemIter.Current
			excludes.Add(curElem.Id)
	filter = ExclusionFilter(excludes)
	logicalFilter = LogicalAndFilter(levelFilter, filter)


allRoomsOnLevel = FilteredElementCollector(selectDOC).OfClass(Autodesk.Revit.DB.SpatialElement).WherePasses(logicalFilter).ToElements()
DeleteUnplaceRooms = [selectDOC.Delete(rmn) for rmn in allRoomsOnLevel if rmn.Level is None]
validRooms = [valrmn for valrmn in allRoomsOnLevel if valrmn.Volume != 0]


OUT = validRooms, selectDOC
# ----------------------------------------
rooms_doc = CodeBlock(input=pyscr_room_collector) { input[0]; input[1]; }
code_block = CodeBlock { "Назначение"; }
string = StringInput("")
byParameterValueContains = Revit.ElementFilter.ByParameterValueContains(rooms_doc.out0, code_block, string)
watch = Watch(rooms_doc.out1)

flatten = Flatten(byParameterValueContains)
removeNulls = Lists.Manage.RemoveNulls(flatten)
uniqueItems = List.UniqueItems(removeNulls)
number = Room.Number(uniqueItems)
sort = List.Sort(number)
sortByKey = List.SortByKey(list=uniqueItems, keys=sort)

# group: Определить высоту помещения
forceChildrensEval = ForceChildrensEval()  # unwired: arg0
pyscr_set_room_height_definition = Python(IN[0]=sortByKey.sorted_list, IN[1]=forceChildrensEval)  # frozen
# ---------- pyscr_set_room_height_definition.python (186 lines) ----------
import clr
clr.AddReference("RevitAPI")
clr.AddReference("ProtoGeometry")
clr.AddReference("RevitNodes")
clr.AddReference("RevitServices")
clr.AddReference('RevitAPIUI') 
import Autodesk
from Autodesk.DesignScript.Geometry import *
import Revit
clr.ImportExtensions(Revit.GeometryConversion)
import RevitServices
from Autodesk.Revit.DB import *
from Autodesk.DesignScript.Geometry import *
from RevitServices.Persistence import DocumentManager
from RevitServices.Transactions import TransactionManager

from System.Collections.Generic import*
import sys
pyt_path = r'C:\Program Files (x86)\IronPython 2.7\Lib'
sys.path.append(pyt_path)

doc = DocumentManager.Instance.CurrentDBDocument
app = DocumentManager.Instance.CurrentUIApplication.Application
UIunit = Document.GetUnits(doc).GetFormatOptions(UnitType.UT_Length).DisplayUnits
allLevels = FilteredElementCollector(doc).OfCategory(BuiltInCategory.OST_Levels).WhereElementIsNotElementType().ToElements()
viewcollect = FilteredElementCollector(doc).OfClass(View3D).ToElements()

reset = IN[1]

def tolist(input):
	if isinstance(input,list) == False:
		return [input]
	else:
		return input

def flatten(x):
    result = []
    for el in x:
        if hasattr(el, "__iter__") and not isinstance(el, basestring):
            result.extend(flatten(el))
        else:
            result.append(el)
    return result

def AllPoints(Curve):
	StartPoint = Curve.StartPoint
	EndPoint = Curve.EndPoint
	result = [StartPoint, EndPoint]
	return result

def MiddlePoint(AllPoints):
	flattenPts = flatten(AllPoints)
	Pxyz = [pts.ToXyz() for pts in flattenPts]
	pX = [i.X for i in Pxyz]
	pY = [i.Y for i in Pxyz]
	pZ = [i.Z for i in Pxyz]
	CentroidX = (max(pX) + min(pX))/2
	CentroidY = (max(pY) + min(pY))/2
	if	pZ != 0:	CentroidZ = min(pZ)
	else:	CentroidZ = 0
	result = XYZ(CentroidX, CentroidY, CentroidZ)
	return result

def GetLevelAbove(e):
	elevations = [i.Elevation for i in allLevels]
	sortedLevels = [x for (y,x) in sorted(zip(elevations,allLevels))]
	sortedLevelNames = [i.Name for i in sortedLevels]
	index = sortedLevelNames.index(e.Name)
	if index + 1 >= len(sortedLevels):
		return None
	else:
		return sortedLevels[index+1]

def View3D():
	result = []
	for view in viewcollect:
		if view.ViewType == ViewType.ThreeD:
			if not(view.IsTemplate):
				if view.Name in "{3D}":
					result = view
	return result
	
def SetParameterValues(elems, PrmVals):
	pNames = tolist("Высота помещения")
	pVals = tolist(PrmVals)
	if len(pNames) == len(pVals):
		TransactionManager.Instance.EnsureInTransaction(doc)
		for n,v in zip(pNames,pVals):
			p = elems.LookupParameter(n)
			if p.Definition.ParameterType == ParameterType.Length:
				v = UnitUtils.ConvertToInternalUnits(v,UIunit)
				p.Set(v)
				TransactionManager.Instance.TransactionTaskDone()
	return
#############################################################################
urooms = flatten(tolist(UnwrapElement(IN[0])))
#######################    Get Room Parameters   #############################
RoomValid = []
RoomHeght = []
RoomHVolume = []
RoomNumber = []
RoomlvlElevation = []
count = 0
for rmn in urooms:
	if rmn.Area != 0:
		RoomValid.append(rmn)
		RoomHeght.append(rmn.get_Parameter(BuiltInParameter.ROOM_UPPER_OFFSET).AsDouble() * 304.8)
		RoomVol = rmn.Volume
		RoomArea = rmn.Area
		RoomHVolume.append(round((RoomVol/RoomArea) * 304.8/100) * 100)
		Roomlvl = rmn.Level
		RoomNumber.append(rmn.Number)
		if GetLevelAbove(Roomlvl):	RoomlvlElevation.append(round((GetLevelAbove(Roomlvl).ProjectElevation - Roomlvl.Elevation) * 304.8/100)*100)
		else: RoomlvlElevation.append(3000)
		count += 1
		
###############################   Centering Room   ###################################
RoomCenterPoints = []
for count, brmn in enumerate(RoomValid, start = 0):
	try:
		TransactionManager.Instance.EnsureInTransaction(doc)
		boundsegs = brmn.GetBoundarySegments(Autodesk.Revit.DB.SpatialElementBoundaryOptions())
		boundpoints = []
		for bound in boundsegs:
			EndPoints = []
			for seg in bound:
				CrV = Revit.GeometryConversion.RevitToProtoCurve.ToProtoType(seg.GetCurve(),True)
				EndPoints.append(AllPoints(CrV))
			boundpoints.append(flatten(EndPoints))
    		center = (MiddlePoint(boundpoints))
    		newlocation = center - brmn.Location.Point
    		roombypoint = doc.GetRoomAtPoint(center)
    	        if brmn.Id == roombypoint.Id:
                    brmn.Location.Move(newlocation)
                else: pass
		TransactionManager.Instance.TransactionTaskDone()
	except:
		center = brmn.Location.Point
	RoomCenterPoints.append(center)

################################## RayBounce #########################################
# Points, Direction, 3D View
direction = XYZ(0,0,1)
RaceHPoint = XYZ(0,0,UnitUtils.ConvertToInternalUnits(1500,UIunit))
RayStartPoint = [RaceHPoint + rcp for rcp in RoomCenterPoints]
builtInCats = [BuiltInCategory.OST_Ceilings, BuiltInCategory.OST_Floors, BuiltInCategory.OST_Roofs]
filter = ElementMulticategoryFilter(List[BuiltInCategory](builtInCats))
ri = ReferenceIntersector(filter, FindReferenceTarget.All, View3D())
ri.FindReferencesInRevitLinks = True

Zcoord = []
TopElems = []
roomElev = []
count = 0
for rph, p in zip (RoomValid, RayStartPoint):
	ref = ri.FindNearest(p,direction)
	count += 1
	if ref == None:
		Zcoord.append(0)
	else:
		try:
			refp = ref.GetReference().GlobalPoint
			pts = (Point.ByCoordinates(UnitUtils.ConvertFromInternalUnits(refp.X,UIunit),UnitUtils.ConvertFromInternalUnits(refp.Y,UIunit),UnitUtils.ConvertFromInternalUnits(refp.Z,UIunit)))
			roomElev = UnitUtils.ConvertFromInternalUnits(rph.Level.Elevation,UIunit)
			Zcoord.append(round((pts.Z-roomElev)/100)*100)
			TopElems.append(DocumentManager.Instance.CurrentDBDocument.GetElement(ref.GetReference().ElementId))
		except: pass
		
########################   Set Height Parameters    #############################
RoomHSet = []
for count, rrr in enumerate(RoomValid, start = 0):
	if Zcoord[count] == (RoomlvlElevation[count]-300):
		SetParameterValues(rrr, Zcoord[count])
		RoomHSet.append(Zcoord[count])	
	elif Zcoord[count] >= 1800:
		SetParameterValues(rrr, Zcoord[count] + 300)
		RoomHSet.append(Zcoord[count] + 300)
	else:
		if RoomlvlElevation[count] >= 1800:
			SetParameterValues(rrr, RoomlvlElevation[count] - 300)
			RoomHSet.append(RoomlvlElevation[count] - 300)
		else:
			SetParameterValues(rrr, 4500)
			RoomHSet.append(4500)
			
OUT = RoomValid
# ----------------------------------------

# group: ПРИГОДИТСЯ
properties = Custom[BoundingBox.Properties]()  # Retrieves the centroid, width, depth and height of a given bounding box; unwired: boundingBox
cleanNulls = Custom[RoomBoundaries.CleanNulls]()  # This node will take a set of room boundary curves and elements and remove nulls from element list while joining curves to mainatain matching list structure.; unwired: Element, Curve
centerPoint = Custom[BoundingBox.CenterPoint]()  # Input Bounding Box element to get its center point. This node is little and lightweight, as it doesn't convert bounding box to geometry to get its centroid point.; unwired: boundingBox
byElements = Custom[BoundingBox.ByElements]()  # Retrieves a bounding box for a list of elements; unwired: elements
finishes = Custom[Room.Finishes]()  # Returns all room bounding faces and their materials; unwired: room

# group: Категории
categories = Categories("Doors")  # frozen
category_to_builtincategory = Custom[Category to BuiltinCategory](category=categories)  # convert Category to BuiltinCategory
string_from_array = FromArray(category_to_builtincategory)
sendTo = Custom[Clipboard.SendTo](str=string_from_array)  # Copies a string to the clipboard.

py_script_get_familyinstance_in = Python(IN[0]=sortByKey.sorted_list, IN[1]=string_parameter_2)  # "Py Script Get FamilyInstance in Room"
# ---------- py_script_get_familyinstance_in.python (83 lines) ----------
import clr
clr.AddReference('RevitAPI')
from Autodesk.Revit.DB import *
import Autodesk

clr.AddReference("RevitNodes")
import Revit
clr.ImportExtensions(Revit.GeometryConversion)

import clr
clr.AddReference('ProtoGeometry')
from Autodesk.DesignScript.Geometry import *

clr.AddReference("RevitServices")
import RevitServices
from RevitServices.Persistence import DocumentManager
from RevitServices.Transactions import TransactionManager

doc = DocumentManager.Instance.CurrentDBDocument

from System.Collections.Generic import *

def tolist(input):
	if isinstance(input,list) == False:
		return [input]
	else:
		return input	
		
def flatten(x):
    result = []
    for el in x:
        if hasattr(el, "__iter__") and not isinstance(el, basestring):
            result.extend(flatten(el))
        else:
            result.append(el)
    return result

def SetParameter( element, values):
	param = IN[1]
	if element is not None:
		try:
			elems = UnwrapElement(element)
		        if elems.LookupParameter(param):
		            elems.LookupParameter(param).Set(values)
		            return elems
		            
		except:	pass

def FamilyInRoom(room):
	builtInCats = List[BuiltInCategory]()
	builtInCats.Add(BuiltInCategory.OST_Furniture) 
	builtInCats.Add(BuiltInCategory.OST_GenericModel)
	builtInCats.Add(BuiltInCategory.OST_CeilingOpening)
	builtInCats.Add(BuiltInCategory.OST_Entourage)
	builtInCats.Add(BuiltInCategory.OST_PlumbingFixtures) 
	builtInCats.Add(BuiltInCategory.OST_Cornices)
	builtInCats.Add(BuiltInCategory.OST_Doors)
	
	MulticatFilter = ElementMulticategoryFilter(builtInCats)
	BBox = room.get_BoundingBox(None)
	IntersectsFilter = BoundingBoxIntersectsFilter(Outline( BBox.Min, BBox.Max ))
	logicalFilter = LogicalAndFilter(MulticatFilter, IntersectsFilter)
	Familycollector = FilteredElementCollector(doc).WhereElementIsNotElementType().WhereElementIsViewIndependent().OfClass(FamilyInstance).WherePasses(logicalFilter).ToElements()
        result = [fi for fi in Familycollector]
        return result
          


######################## INPUT ##################################

rooms = flatten(tolist(UnwrapElement(IN[0])))
	
#################### Elements in Room ##########################
	
familyInstance = [[] for i in range(len(rooms))]
for index, room in enumerate(rooms):
	Rnumber = room.Number
	OutFamilyInRoom = FamilyInRoom(room)
        for fis in OutFamilyInRoom:
			familyInstance[index].Add(SetParameter(fis, Rnumber))
			
ClearList = filter(lambda x: x, flatten(familyInstance))
OUT = (ClearList)
# ----------------------------------------

# group: Выбор элементов на виде
forceChildrensEval_2 = ForceChildrensEval()  # unwired: arg0
selectInView = Custom[Element.SelectInView](Refresh_Boolean=forceChildrensEval_2)  # Select the input elements in active view. Disconnect / Connect to refresh.; unwired: Element

# group: REDACT Family by line
имя_типа = StringInput("ППЛ")
py_script_get_elements_in_room = Python(IN[1]=имя_типа)  # frozen; unwired: IN[0]
# ---------- py_script_get_elements_in_room.python (127 lines) ----------
import clr
clr.AddReference('RevitAPI')
from Autodesk.Revit.DB import *
import Autodesk

clr.AddReference("RevitNodes")
import Revit
clr.ImportExtensions(Revit.GeometryConversion)

import clr
clr.AddReference('ProtoGeometry')
from Autodesk.DesignScript.Geometry import *

clr.AddReference("RevitServices")
import RevitServices
from RevitServices.Persistence import DocumentManager
from RevitServices.Transactions import TransactionManager

from Autodesk.DesignScript.Geometry import *

doc = DocumentManager.Instance.CurrentDBDocument
uidoc = DocumentManager.Instance.CurrentUIApplication.ActiveUIDocument
uiapp = DocumentManager.Instance.CurrentUIApplication
app = uiapp.Application

def tolist(input):
	if isinstance(input,list) == False:
		return [input]
	else:
		return input

def flatten(x):
    result = []
    for el in x:
        if hasattr(el, "__iter__") and not isinstance(el, basestring):
            result.extend(flatten(el))
        else:
            result.append(el)
    return result
   
def ProcessList(_func, _list):
	return map( lambda x: ProcessList(_func, x) if type(x)==list else _func(x), _list )

def GetElemType(e):
	doc = DocumentManager.Instance.CurrentDBDocument
	try:
		elemType = doc.GetElement(e.GetTypeId())
		return elemType
	except:
		pass
		return None
		
def unique(elist):
	mmap = {} 
	listset = [] 
	for item in elist:
		if item.Id not in mmap:
			mmap[item.Id] = 1
			listset.append(item)
	return listset

def GetWallCurve(item):
	if type(item) == Autodesk.Revit.DB.Wall:
		locationCurve = item.Location
		if locationCurve != None:
			curve = locationCurve.Curve
			return curve
	else:	pass

def FamilyInRoom(room):
	builtInCats = List[BuiltInCategory]()
	builtInCats.Add(BuiltInCategory.OST_Furniture) 
	builtInCats.Add(BuiltInCategory.OST_GenericModel)
	MulticatFilter = ElementMulticategoryFilter(builtInCats)
	BBox = room.get_BoundingBox(None)
	IntersectsFilter = BoundingBoxIntersectsFilter(Outline( BBox.Min, BBox.Max ))
	logicalFilter = LogicalAndFilter(MulticatFilter, IntersectsFilter)
	Familycollector = FilteredElementCollector(doc).WhereElementIsNotElementType().WhereElementIsViewIndependent().OfClass(FamilyInstance).WherePasses(logicalFilter).ToElements()
        result = [fi for fi in Familycollector]
        return result

######################## INPUT #####################################

elements = filter(lambda x: x, flatten(tolist(UnwrapElement(IN[0]))))

TypeNameStr = IN[1]
	
####################################################################

WallFinishin = []

for elem in unique(elements):
	if elem.GetType() == Autodesk.Revit.DB.Wall:
		wall_width = GetElemType(elem).Width
		if wall_width <= 0.098:
			WallFinishin.Add(elem)

lines = ProcessList(GetWallCurve, WallFinishin)
					
# list 
if isinstance(lines, list):
	lines = UnwrapElement(lines)
else:
	lines = UnwrapElement([lines])

#current view level
level = doc.ActiveView.GenLevel

bip =  BuiltInParameter.ALL_MODEL_TYPE_NAME
pvp = ParameterValueProvider(ElementId(bip))
fnrvStr = FilterStringContains()
paramFr = FilterStringRule(pvp, fnrvStr, TypeNameStr, False)
prmFilter = ElementParameterFilter(paramFr)
fsymbol = FilteredElementCollector(doc).OfClass(FamilySymbol).OfCategory(BuiltInCategory.OST_GenericModel).WherePasses(prmFilter).FirstElement()

FamilyByLine = []

TransactionManager.Instance.EnsureInTransaction(doc)

for line in lines:
	
	newFamily = doc.Create.NewFamilyInstance(line, fsymbol, level, Structure.StructuralType.NonStructural)
	FamilyByLine.append(newFamily)

TransactionManager.Instance.TransactionTaskDone()

OUT = FamilyByLine					
# ----------------------------------------
python_script = Python()  # frozen; unwired: IN[0]
# ---------- python_script.python (56 lines) ----------
import clr
clr.AddReference('RevitAPI')
from Autodesk.Revit.DB import *

clr.AddReference("RevitNodes")
import Revit
clr.ImportExtensions(Revit.Elements)

items = UnwrapElement(IN[0])
elemlayers = list()
elemmat = list()
elemfunc = list()
elemwidth = list()
elemcore = list()
elemwraps = list()
elemvar = list()
elemdeck = list()

for item in items:
	try:
		counter = 0
		layers = list()
		layermat = list()
		layerfunc = list()
		layerwidth = list()
		layercore = list()
		layerwraps = list()
		layervar = list()
		layerdeck = list()
		compstruc = item.GetCompoundStructure()
		num = compstruc.LayerCount
		vertcomp = compstruc.IsVerticallyCompound
		varlayer = compstruc.VariableLayerIndex
		while counter < num:
			layers.append(compstruc.GetLayers()[counter])
			layermat.append(item.Document.GetElement(compstruc.GetMaterialId(counter)))
			layerfunc.append(compstruc.GetLayerFunction(counter))
			layerwidth.append(compstruc.GetLayerWidth(counter))
			layercore.append(compstruc.IsCoreLayer(counter))
			if compstruc.IsCoreLayer(counter): layerwraps.append(False)
			else: layerwraps.append(compstruc.ParticipatesInWrapping(counter))
			if varlayer == counter: layervar.append(True)
			else: layervar.append(False)
			layerdeck.append(compstruc.IsStructuralDeck(counter))
			counter += 1
	except:
		pass
	elemlayers.append(layers)
	elemmat.append(layermat)
	elemfunc.append(layerfunc)
	elemwidth.append(layerwidth)
	elemcore.append(layercore)
	elemwraps.append(layerwraps)
	elemvar.append(layervar)
	elemdeck.append(layerdeck)
OUT = (elemlayers, elemmat, elemfunc, elemwidth, elemcore, elemwraps, elemvar, elemdeck)
# ----------------------------------------

change_family_type = Custom[Change Family Type]()  # Changes family type of a family by passing in an Element and type id of the type we want to change it to.; unwired: element, typeId
get_type_parameter = Custom[Get Type Parameter]()  # This node will retrieve a type parameter by its name.; unwired: element, parameterName
set_type_parameter = Custom[Set Type Parameter]()  # This node will set a type parameter for an element.; unwired: element, parameterName, parameterValue
lunchbox_get_parameter_value = Custom[LunchBox Get Parameter Value]()  # Gets parameter values from a Revit element.; unwired: Element, ParamName
greatestDistanceToPoint = Custom[PointSequence.GreatestDistanceToPoint]()  # Retrieves the furthest point in a sequence of points; unwired: seq, point
compoundStructureLayers = Custom[FamilyType.CompoundStructureLayers]()  # Retrieves the compound layers of any layered family type (wall types, roof types, floor types etc.); unwired: elementType
wall_inserts = Custom[Wall inserts]()  # Get all the inserts in a wall (windows, doors and openings).; unwired: Walls
code_block_2 = CodeBlock(Selected_Document=watch) { Selected_Document; }
py_script_get_elements_in_room_2 = Python(IN[0]=sortByKey.sorted_list, IN[1]=string_parameter_2, IN[2]=code_block_2)
# ---------- py_script_get_elements_in_room_2.python (107 lines) ----------
import clr
clr.AddReference('RevitAPI')
from Autodesk.Revit.DB import *
import Autodesk

clr.AddReference("RevitNodes")
import Revit
clr.ImportExtensions(Revit.GeometryConversion)

import clr
clr.AddReference('ProtoGeometry')
from Autodesk.DesignScript.Geometry import *

clr.AddReference("RevitServices")
import RevitServices
from RevitServices.Persistence import DocumentManager
from RevitServices.Transactions import TransactionManager

from Autodesk.DesignScript.Geometry import *

doc = DocumentManager.Instance.CurrentDBDocument
uidoc = DocumentManager.Instance.CurrentUIApplication.ActiveUIDocument
uiapp = DocumentManager.Instance.CurrentUIApplication
app = uiapp.Application
linkdoc = IN[2]

def tolist(input):
	if isinstance(input,list) == False:
		return [input]
	else:
		return input

def flatten(x):
    result = []
    for el in x:
        if hasattr(el, "__iter__") and not isinstance(el, basestring):
            result.extend(flatten(el))
        else:
            result.append(el)
    return result
   
def SetParameter( element, values):
	param = IN[1]
	if element is not None:
		try:
			elems = UnwrapElement(element)
		        if elems.LookupParameter(param):
		            elems.LookupParameter(param).Set(values)
		            return elems
		except:	pass

def GetElemType(e):
	doc = DocumentManager.Instance.CurrentDBDocument
	try:
		elemType = doc.GetElement(e.GetTypeId())
		return elemType
	except:
		pass
						
######################## INPUT ##################################

rooms = flatten(tolist(UnwrapElement(IN[0])))
	
#################### Elements in Room ##########################

FaceTypes = [[] for i in range(len(rooms))]
FaceElements = [[] for i in range(len(rooms))]

for index, item in enumerate(rooms):
	boundloc = Autodesk.Revit.DB.AreaVolumeSettings.GetAreaVolumeSettings(linkdoc).GetSpatialElementBoundaryLocation(SpatialElementType.Room)
	Autodesk.Revit.DB.SpatialElementBoundaryOptions().SpatialElementBoundaryLocation = boundloc
	results = SpatialElementGeometryCalculator(item.Document).CalculateSpatialElementGeometry(item)
	Rnumber = item.Number
	for face in results.GetGeometry().Faces:
		for bface in results.GetBoundaryFaceInfo(face):
			FaceTypes[index].Add(str(bface.SubfaceType))
			face_elem = linkdoc.GetElement(bface.SpatialBoundaryElement.HostElementId)
			FaceElements[index].append(SetParameter(face_elem, Rnumber))
			
ClearList = filter(lambda x: x, flatten(FaceElements))
ClearList = [x for x in ClearList if x is not None]

layermaterial = []
layerwidht = []

for indx, elem in enumerate(ClearList):
    try:
        Compstruc = GetElemType(elem).GetCompoundStructure()
    	LayerIndx = Compstruc.GetLayers()
    	ExtIndx = Compstruc.GetCoreBoundaryLayerIndex(ShellLayerType.Exterior)
    	IntIndx = Compstruc.GetCoreBoundaryLayerIndex(ShellLayerType.Interior)
        CoreIndx = Compstruc.GetFirstCoreLayerIndex()
        if CoreIndx:
            layermaterial.append(elem.Document.GetElement(Compstruc.GetMaterialId(CoreIndx)))
            layerwidht.append(Compstruc.GetLayerWidth(CoreIndx)*304.8)
        elif ExtIndx:
            layermaterial.append(elem.Document.GetElement(Compstruc.GetMaterialId(ExtIndx)))
            layerwidht.append(Compstruc.GetLayerWidth(ExtIndx)*304.8)
        elif IntIndx:
            layermaterial.append(elem.Document.GetElement(Compstruc.GetMaterialId(IntIndx)))
            layerwidht.append(Compstruc.GetLayerWidth(IntIndx)*304.8)
        else:
            layerwidht.append(Compstruc.GetLayerWidth(LayerIndx)*304.8)
    except:
           pass

OUT = layerwidht
# ----------------------------------------
watch_2 = Watch(py_script_get_elements_in_room_2)
byFace = Wall.ByFace()  # unwired: arg0, arg1, arg2
panels = Custom[Element.Panels]()  # Retrieves the panels nested in a curtain wall, curtain system or glazed roof. Differences to OOTB node CurtainPanel.ByElement: - Returns embedded walls - Panels of curtain systems and glazed roofs are returned in a nested list, with one sublist for each face of the curtain system. PLEASE NOTE: Will not work for glazed roofs created by RoofByFace method.; unwired: hostElement

# group: Наименования параметров
площадь_проемов = StringInput("Ширина дверных проемов")

py_script_get_doors_in_room = Python(IN[0]=sortByKey.sorted_list)
# ---------- py_script_get_doors_in_room.python (77 lines) ----------
import clr
clr.AddReference('RevitAPI')
from Autodesk.Revit.DB import *
import Autodesk

clr.AddReference("RevitNodes")
import Revit
clr.ImportExtensions(Revit.GeometryConversion)

import clr
clr.AddReference('ProtoGeometry')
from Autodesk.DesignScript.Geometry import *

clr.AddReference("RevitServices")
import RevitServices
from RevitServices.Persistence import DocumentManager
from RevitServices.Transactions import TransactionManager

doc = DocumentManager.Instance.CurrentDBDocument

from System.Collections.Generic import *

def tolist(input):
	if isinstance(input,list) == False:
		return [input]
	else:
		return input

def flatten(x):
    result = []
    for el in x:
        if hasattr(el, "__iter__") and not isinstance(el, basestring):
            result.extend(flatten(el))
        else:
            result.append(el)
    return result


def FamilyInRoom(room):
	builtInCats = List[BuiltInCategory]()
	builtInCats.Add(BuiltInCategory.OST_Doors)

	MulticatFilter = ElementMulticategoryFilter(builtInCats)
	BBox = room.get_BoundingBox(None)
	IntersectsFilter = BoundingBoxIntersectsFilter(Outline( BBox.Min, BBox.Max ))
	logicalFilter = LogicalAndFilter(MulticatFilter, IntersectsFilter)
	Familycollector = FilteredElementCollector(doc).WhereElementIsNotElementType().WhereElementIsViewIndependent().OfClass(FamilyInstance).WherePasses(logicalFilter).ToElements()
        result = [fi for fi in Familycollector]
        return result

def GetDoorWidth(Doors):
	doorwidth = []
	for door in Doors:
		try:
			width = door.Symbol.get_Parameter(BuiltInParameter.DOOR_WIDTH).AsDouble()*304.8
			if width > 0:	doorwidth.append(width)
		except:
			pass
	return doorwidth
	
######################## INPUT ##################################

rooms = flatten(tolist(UnwrapElement(IN[0])))

#################### Elements in Room ##########################
doorwidht = []
familyInstance = []
for index, room in enumerate(rooms):
	Rnumber = room.Number
	fiir = FamilyInRoom(room)
	doorwidht.append(GetDoorWidth(fiir))
	familyInstance.append(fiir)
    

################### Get Door Widht #############################

OUT = doorwidht
# ----------------------------------------
