# Dynamo graph АР_Установка концов примыкания.dyn (Dynamo 1.3.4.6666)

# group: Family INSERT
family_type = FamilyTypes("TEST ПДЭП:ПДЭП 114х230(h)")
all_elements_of_family_type = ElementsOfFamilyType(family_type)
getLocation = Element.GetLocation(all_elements_of_family_type)

forceChildrensEval = ForceChildrensEval()  # unwired: arg0
python_script = Python(IN[0]=all_elements_of_family_type, IN[1]=forceChildrensEval)
# ---------- python_script.python (81 lines) ----------
import clr
clr.AddReference("RevitAPI")
clr.AddReference("ProtoGeometry")
from Autodesk.DesignScript.Geometry import *
clr.AddReference("RevitNodes")
import Revit
clr.ImportExtensions(Revit.GeometryConversion)
clr.AddReference("RevitServices")
from RevitServices.Persistence import DocumentManager
from RevitServices.Transactions import TransactionManager

import System
from System.Collections.Generic import*

import Autodesk
from Autodesk.Revit.DB import *

def tolist(input):
	if isinstance(input,list) == False:
		return [input]
	else:
		return input

def flatten(x):
    result = []
    for el in x:
        if hasattr(el, "__iter__") and not isinstance(el, basestring):
            result.extend(flatten(el))
        else:
            result.append(el)
    return result
	
def SetParameterValue(elems, value, prmname):
	TransactionManager.Instance.EnsureInTransaction(doc)
	for n,v in zip(prmname,value):
		p = elems.LookupParameter(n)
		if p.Definition.ParameterType:
			p.Set(v)
	TransactionManager.Instance.TransactionTaskDone()
	return

Items = UnwrapElement(flatten(IN[0]))
reset = IN[1]
PrmNameLINS = "Левый внутренний угол"
PrmNameLOUT = "Левый наружный угол"
PrmNameRINS = "Правый внутренний угол"
PrmNameROUT = "Правый наружный угол"

angel = []
pt1 = []
pt2 = []
Curve = []
for indx, i in enumerate(Items):
	crv = i.Location.Curve
	p1 = (crv.GetEndPoint(0))
	p2 = (crv.GetEndPoint(1))
	vector = (p2 - p1).Normalize()
	degrees = round((vector.AngleTo(XYZ.BasisX))*180/3.1416)
	angel.append(degrees)
	pt1.append(p1)
	pt2.append(p2)
	Curve.append(crv)
	#xyzList.append(crv.ComputeDerivatives(0, 1).BasisX.Normalize())

LIntersect = []
RIntersect = []
for p1, p2, crv, item in zip (pt1, pt2, Curve, Items):
	for c in Curve:
		pc1 = c.GetEndPoint(0)
		pc2 = c.GetEndPoint(1)
		if p1.IsAlmostEqualTo(pc2) != False:
			LIntersect.append(item)
		elif p2.IsAlmostEqualTo(pc1) != False:
			RIntersect.append(item)
		else:	continue

test = set(pt1).intersection(pt2)
"""	
#offsetcurves = [crv.Curve.ToProtoType() for crv in curves]
"""
OUT = angel
# ----------------------------------------
getRotation = Custom[Element.GetRotation]()  # This node calculates rotation angle between selected element's vector and Y axis. Vector Z is used as rotation axis. Use resulting degree as an input to the FamilyInstance.SetRotation node.; unwired: InputVector
