# Dynamo graph АС_Расстановка элементов по объекту.dyn (Dynamo 1.3.4.6666)

# group: Выделить элемент в Revit
forceChildrensEval = ForceChildrensEval()  # unwired: arg0
currentSelection = Custom[Springs.Collector.CurrentSelection](refresh=forceChildrensEval)  # Gets the currently selected elements. Connect a boolean switch to refresh the selection.
watch = Watch(currentSelection)

byElements = Custom[BoundingBox.ByElements](elements=watch)  # Retrieves a bounding box for a list of elements
dimensions = Custom[BoundingBox.Dimensions](boundingBox=byElements)  # Input Bounding Box element to get its dimensions (Width, Length, Height). Setting Boolean switch to True rounds output values.
offset = Custom[Springs.ClosedCurve.Offset+]()  # Offsets a curve both ways and correctly differenciates the external and internal offset. If an offset goes beyond the curve's bounds, the result will fail and a null value will be appended instead. Also works for convex curves like arcs.; unwired: curve, distance
code_block = CodeBlock { "Смещение от уровня"; }
getParameterAsValueString = Custom[GetParameterAsValueString](Elements=watch, ParameterName=code_block)  # Returns the parameter values without conversion to the revit internal unit system. The suffix boolean toggles the project units on or off
level = Custom[Element.Level](element=watch)  # Gets an element's level

# group: Семейство
family_types = FamilyTypes()

centerPoint = Custom[ZK.BoundingBox.CenterPoint](boundingBox=byElements)  # Input Bounding Box element to get its center point. This node is little and lightweight, as it doesn't convert bounding box to geometry to get its centroid point.
python_script = Python(IN[0]=level, IN[1]=family_types, IN[2]=centerPoint)
# ---------- python_script.python (51 lines) ----------
#Copyright(c) 2016, Dimitar Venkov
# @5devene, dimitar.ven@gmail.com

import clr

clr.AddReference("RevitServices")
import RevitServices
from RevitServices.Persistence import DocumentManager
from RevitServices.Transactions import TransactionManager
doc = DocumentManager.Instance.CurrentDBDocument

clr.AddReference("RevitAPI")
import Autodesk

clr.AddReference("RevitNodes")
import Revit
clr.ImportExtensions(Revit.Elements)
clr.ImportExtensions(Revit.GeometryConversion)

def tolist(obj1):
	if hasattr(obj1,"__iter__"): return obj1
	else: return [obj1]
def output1(l1):
	if len(l1) == 1: return l1[0]
	else: return l1

host = UnwrapElement(tolist(IN[0]))
ftype = UnwrapElement(tolist(IN[1]))
fpts = UnwrapElement(tolist(IN[2]))

Rpts =[p.ToXyz(True) for p in fpts]

nfl = []
strt = Autodesk.Revit.DB.Structure.StructuralType.NonStructural
ftp_len = len(ftype) == 1
hst_len = len(host) == 1

TransactionManager.Instance.EnsureInTransaction(doc)
for i in xrange(len(Rpts) ):
	j = 0 if ftp_len else i
	k = 0 if hst_len else i
	try:
		if not ftype[j].IsActive : ftype[j].Activate()
		level = doc.GetElement(host[k].LevelId)
		nf = doc.Create.NewFamilyInstance(Rpts[i],ftype[j],host[k],level,strt)
		nfl.append(nf.ToDSType(False))
	except:
		nfl.append(None)
TransactionManager.Instance.TransactionTaskDone()

OUT = output1(nfl)
# ----------------------------------------
setLocation = Element.SetLocation(python_script, centerPoint)
levels = Levels()
elements_change_level = Custom[Elements change Level](Elements=setLocation, Level=levels)  # Change the elements to the selected level without moving the elements. Only works for non-hosted (level-hosted) MEP elements.
byLine = archilab.Revit.Elements.FamilyInstances.ByLine()  # unwired: arg0, arg1, arg2
