# Dynamo graph Авторазмер-между-стенами-и-осями-2018.dyn (Dynamo 2.0.1.5055)

select_model_elements = DSModelElementsSelection()  # 31 picked in the model; graph input
restart = BoolSelector(false)  # graph input
python_script = Python(IN[0]=select_model_elements, IN[1]=restart)
# ---------- python_script.python (79 lines) ----------
import clr
clr.AddReference('RevitAPI')
from Autodesk.Revit.DB import *

clr.AddReference('RevitNodes')
import Revit
clr.ImportExtensions(Revit.GeometryConversion)
clr.ImportExtensions(Revit.Elements)

clr.AddReference('RevitServices')
import RevitServices
from RevitServices.Persistence import DocumentManager
from RevitServices.Transactions import TransactionManager

clr.AddReference('ProtoGeometry')
#from Autodesk.DesignScript.Geometry import *
import Autodesk.DesignScript.Geometry as ge # ИБО КОНФЛИКТ REFERENCE !!!!!!!!

doc = DocumentManager.Instance.CurrentDBDocument 

walls=[]
grids=[]
lengths=[]
inc = 304.8
for i in IN[0]:
	typename = i.GetType().Name
	if typename == "Wall":
		walls.append(i)
		lengths.append(UnwrapElement(i).Location.Curve.Length * 304.8)
	elif typename == "Grid":
		grids.append(i)

for i in walls:
	if (UnwrapElement(i).Location.Curve.Length * 304.8) == min(lengths):
		shortWall = i


curve = UnwrapElement(shortWall).Location.Curve.ToProtoType()
pt0=curve.PointAtParameter(0.5)
x0 = curve.PointAtParameter(0).X
x1 = curve.PointAtParameter(1).X
y0 = curve.PointAtParameter(0).Y
y1 = curve.PointAtParameter(1).Y
if abs(y0-y1)<10:
	pt1= ge.Point.ByCoordinates(pt0.X, pt0.Y+1000, pt0.Z)
	line= ge.Line.ByStartPointEndPoint(pt0,pt1).ToRevitType()
elif abs(x0-x1)<10:
	pt1= ge.Point.ByCoordinates(pt0.X+1000, pt0.Y, pt0.Z)
	line= ge.Line.ByStartPointEndPoint(pt0,pt1).ToRevitType()


walls = UnwrapElement(walls)
grids = UnwrapElement(grids)
Ref = ReferenceArray()
opt = Options()
opt.ComputeReferences = True
opt.IncludeNonVisibleObjects = True
opt.View = doc.ActiveView

for grid in grids:
	for obj in grid.get_Geometry(opt):
		if isinstance(obj, Line):
			gline = obj
			Ref.Append(gline.Reference)
		
for element in walls:
	a = HostObjectUtils.GetSideFaces(element, ShellLayerType.Exterior)
	for i in a:
		Ref.Append(i)
	b = HostObjectUtils.GetSideFaces(element, ShellLayerType.Interior)
	for i in b:
		Ref.Append(i)

TransactionManager.Instance.EnsureInTransaction(doc)

newdim = doc.Create.NewDimension(doc.ActiveView, line, Ref).ToDSType(False)

TransactionManager.Instance.TransactionTaskDone()
OUT=newdim
# ----------------------------------------
