# Dynamo graph Квартирография RVT2019 Dynamo1.0.dyn (Dynamo 1.1.0.2094)

categories = Categories("Rooms")
all_elements_of_category = ElementsOfCategory(categories)
watch = Watch(all_elements_of_category)
# note: Оригинал взят с сайта "REVIT MASTER": http://www.revitmaster.ru/2016/06/revit-2016-dynamo-10.html
# Причина доработки скрипта - использование рекомендованных параметров Autodesk.
# Благодарности: Алексею Лобанову, Дмитрию Дмитриеву, Марии Львовой, Алексею Савватееву, Владу Хону и другим.
# Скрипт для Revit 2016 - 2017, Dinamo 1.0 и выше
# Сбор параметров из Revit: Площадь помещения, ADSK_Тип помещения, ADSK_Номер квартиры
# Расчет в динамо:
# "ADSK_Площадь квартиры";
# "ADSK_Площадь квартиры общая";
# "ADSK_Площадь квартиры жилая";
# "ADSK_Число комнат";
# "ADSK_Коэффициент площади";
# "ADSK_Площадь с коэффициентом"
# "ADSK_Индекс помещения" (служебный)
code_block = CodeBlock { "ADSK_Номер квартиры"; "ADSK_Тип помещения"; }
getParameterValueByName = Element.GetParameterValueByName(element=watch, parameterName=code_block.out0)
getParameterValueByName_2 = Element.GetParameterValueByName(element=watch, parameterName=code_block.out1)
округлить_до___знаков = CodeBlock { 2; }
python_script = Python(IN[0]=watch, IN[1]=getParameterValueByName, IN[2]=getParameterValueByName_2, IN[3]=округлить_до___знаков)
# ---------- python_script.python (99 lines) ----------
import clr
#crl.AddReference("DynamoUnits")
#from DynamoUnits import *

apartNumbers = [] #Массив номеров квартир
aparts = [] #Массив квартир
roomsAreaCoeff = []
roomsAreaMultipliedByCoeff = []
roomsArea = []
 #Переменная списка комнат
outRooms=[] #Массив списка комнат на выход


rooms = IN[0]
parAptNumber = IN[1] # № КВАРТИРЫ
parAptTip = IN[2]  #Это Тип помещения 
roundCount = IN[3]  #Это Округление площади
i=0

for room in rooms: 
	uroom = UnwrapElement(room) #Находим нативный элемент комнаты Ревита
	aptNum = parAptNumber[i]
	#aptNum = uroom.get_Parameter(parAptNumber).AsString()
	area = round(uroom.Area*0.09290304,roundCount) #
	karea = area #Area multiplied by coefficient
	if area: 
		contains = apartNumbers.IndexOf(aptNum) 
		koeff = 1
		if parAptTip[i]==5:
		#if uroom.get_Parameter(parAptTip).AsInteger()==5: #Тип помещения 3
			koeff = 0
		elif parAptTip[i]==3:
		#elif uroom.get_Parameter(parAptTip).AsInteger()==3: #Тип помещения 3
			koeff = 0.5
		elif parAptTip[i]==4:
		#elif uroom.get_Parameter(parAptTip).AsInteger()==4:#Тип помещения 4
			koeff = 0.3
		if contains>-1:
   
			if parAptTip[i]==1:
			#if uroom.get_Parameter(parAptTip).AsInteger()==1: #Тип помещения 1
				aparts[contains][0]+=1 #По индексу квартиры добавляем еще одну комнату
				aparts[contains][2]+=area #Прибавляем площадь к Жилой площади квартиры
				aparts[contains][3]+=area
			elif parAptTip[i]==2:
			#elif uroom.get_Parameter(parAptTip).AsInteger()==2: #Тип помещения 1
				aparts[contains][3]+=area
			karea = round(koeff *area,roundCount)
			aparts[contains][1]+=karea #Прибавляем площадь к Общей площади квартиры

		else:
			apartNumbers.append(aptNum)			
			aptRoomsCount = 0
			uarea=0
			apartarea = 0
			if parAptTip[i]==1:
			#if uroom.get_Parameter(parAptTip).AsInteger() == 1:
				aptRoomsCount = 1 
				uarea = area
				apartarea = area
			elif parAptTip[i]==2:
			#elif uroom.get_Parameter(parAptTip).AsInteger()==2:
				apartarea = area
			karea = round(koeff *area,roundCount)
			aparts.append([aptRoomsCount,karea,uarea,apartarea]) 
	roomsAreaCoeff.append(koeff);
	roomsAreaMultipliedByCoeff.append(karea)
	roomsArea.append(area)
	i=i+1
				
i=0
for room in rooms:
	uroom = UnwrapElement(room)
	aptNum = parAptNumber[i]
	#aptNum = uroom.get_Parameter(parAptNumber).AsString() 
	aptPos = apartNumbers.IndexOf(aptNum) 
	indx = rooms.IndexOf(room)
	if aptPos>-1 and uroom.Area: 
		apt = aparts[aptPos] 
		outRooms.append([room, aptNum+"_"+str(parAptTip[i]),
		apt[0],
		apt[1],
		apt[2],
		apt[3],
		roomsAreaCoeff[indx],
		roomsAreaMultipliedByCoeff[indx],
		roomsArea[indx]])
	i=i+1
OUT = outRooms

# На выходе 8 списков
# l[0] - комнаты
# l[1] - Категория
# l[2] - Номер квартиры
# l[3] - Общая площадь квартиры
# l[4] - Жилая площадь квартиры
# l[5] - Площадь квартиры
# l[6] - Коэффициент площади комнаты
# l[7] - Площадь комнаты, умноженная на коэффициент
# ----------------------------------------
# note: # На выходе 8 списков:
# # l[0] - комнаты
# # l[1] - Индекс
# # l[2] - Номер квартиры
# # l[3] - Общая площадь квартиры
# # l[4] - Жилая площадь квартиры
# # l[5] - Площадь квартиры
# # l[6] - Коэффициент площади комнаты
# # l[7] - Площадь комнаты, умноженная на коэффициент
transpose = List.Transpose(python_script)
watch_2 = Watch(transpose)
code_block_2 = CodeBlock(l=watch_2) { l[0]; l[1]; l[2]; l[3]; l[4]; l[5]; l[6]; l[7]; }
code_block_3 = CodeBlock()
# ---------- code_block_3.designscript (8 lines) ----------
"ADSK_Номер квартиры";
"ADSK_Площадь квартиры общая";
"ADSK_Площадь квартиры жилая";
"ADSK_Количество комнат";
"ADSK_Индекс помещения";
"ADSK_Коэффициент площади";
"ADSK_Площадь с коэффициентом";
"ADSK_Площадь квартиры";
# ----------------------------------------
# note: Назначить - Общая площадь
setParameterByName = Element.SetParameterByName(element=code_block_2.out0, parameterName=code_block_3.out2, value=code_block_2.out4)
# note: Назначить - Число комнат
setParameterByName_2 = Element.SetParameterByName(element=code_block_2.out0, parameterName=code_block_3.out1, value=code_block_2.out3)
setParameterByName_3 = Element.SetParameterByName(element=code_block_2.out0, parameterName=code_block_3.out3, value=code_block_2.out2)
# note: Назначить - Индекс помещения
setParameterByName_4 = Element.SetParameterByName(element=code_block_2.out0, parameterName=code_block_3.out4, value=code_block_2.out1)
# note: Назначить - Коэффициент площади
setParameterByName_5 = Element.SetParameterByName(element=code_block_2.out0, parameterName=code_block_3.out5, value=code_block_2.out6)
# note: Назначить -Площадь с коэффициентом
setParameterByName_6 = Element.SetParameterByName(element=code_block_2.out0, parameterName=code_block_3.out6, value=code_block_2.out7)
# note: Назначить - Жилая площадь
# note: Назначить - Площадь квартиры
setParameterByName_7 = Element.SetParameterByName(element=code_block_2.out0, parameterName=code_block_3.out7, value=code_block_2.out5)
