# Dynamo graph Нумерация_сваи_2-типа.dyn (Dynamo 1.3.4.6666)

select_model_element = DSModelElementSelection()  # 1 picked in the model
elementType = Element.ElementType(select_model_element)
all_elements_of_family_type = ElementsOfFamilyType(elementType)
watch = Watch(all_elements_of_family_type)

# group: Сортировка по оси Y
code_block = CodeBlock(x=watch) { x; }
getLocation = Element.GetLocation(code_block@L1)
Y = Point.Y(getLocation)
sortIndexByValue = SortIndexByValue(Y)
getItemAtIndex = List.GetItemAtIndex(list=code_block@L2, index=sortIndexByValue@L2)

# group: Сортировка по шагу Y
code_block_2 = CodeBlock(x=getItemAtIndex) { x; }
getLocation_2 = Element.GetLocation(code_block_2)
Y_2 = Point.Y(getLocation_2)
minimumItem = List.MinimumItem(Y_2)
sub = Y_2 - minimumItem
шаг_по_y = DoubleSlider(2500, range=0..10000 step 100)
div = sub / шаг_по_y
floor = Math.Floor(div)
groupByKey = List.GroupByKey(list=code_block_2@L2, keys=floor@L2)

# group: Сортировка по оси X
code_block_3 = CodeBlock(x=groupByKey.groups) { x; }
getLocation_3 = Element.GetLocation(code_block_3)
Y_3 = Point.Y(getLocation_3)
sortIndexByValue_2 = SortIndexByValue(Y_3)
getItemAtIndex_2 = List.GetItemAtIndex(list=code_block_3@L2, index=sortIndexByValue_2@L2)

# group: Сортировка по шагу X
code_block_4 = CodeBlock(x=getItemAtIndex_2) { x; }
getLocation_4 = Element.GetLocation(code_block_4)
X = Point.X(getLocation_4)
minimumItem_2 = List.MinimumItem(X)
sub_2 = X - minimumItem_2
шаг_по_x = DoubleSlider(3000, range=0..10000 step 100)
div_2 = sub_2 / шаг_по_x
floor_2 = Math.Floor(div_2)
groupByKey_2 = List.GroupByKey(list=code_block_4@L2, keys=floor_2@L2)

flatten = Flatten(groupByKey_2.groups)

# group: Нумерация
code_block_5 = CodeBlock(x=flatten) { x; }
string = StringInput("Марка")
number = DoubleInput(1)
count = List.Count(code_block_5)
sequence = Sequence(start=number, amount=count, lacing=Longest)
string_from_object = FromObject(sequence)
setParameterByName = Element.SetParameterByName(element=code_block_5, parameterName=string, value=string_from_object)

# group: Фильтр по типу УГО
code_block_6 = CodeBlock(x=all_elements_of_family_type) { x; }
code_block_7 = CodeBlock { "УГО тип 1"; }
getParameterValueByName = Element.GetParameterValueByName(element=code_block_6@L2, parameterName=code_block_7)
boolean = BoolSelector(true)
eq = getParameterValueByName == boolean
filterByBoolMask = List.FilterByBoolMask(list=code_block_6, mask=eq)
watch_2 = Watch(filterByBoolMask.in)

deconstruct = List.Deconstruct(list=filterByBoolMask.out)

# group (continued): Фильтр по типу УГО
watch_3 = Watch(deconstruct.rest)

# group: Сортировка по оси Y
code_block_8 = CodeBlock(x=watch_3) { x; }
getLocation_5 = Element.GetLocation(code_block_8)
Y_4 = Point.Y(getLocation_5)
sortIndexByValue_3 = SortIndexByValue(Y_4)
getItemAtIndex_3 = List.GetItemAtIndex(list=code_block_8@L2, index=sortIndexByValue_3@L2)

# group: Сортировка по шагу Y C3
code_block_9 = CodeBlock(x=getItemAtIndex_3) { x; }
getLocation_6 = Element.GetLocation(code_block_9)
Y_5 = Point.Y(getLocation_6)
minimumItem_3 = List.MinimumItem(Y_5)
sub_3 = Y_5 - minimumItem_3
шаг_по_y_2 = DoubleSlider(5000, range=0..10000 step 100)
div_3 = sub_3 / шаг_по_y_2
floor_3 = Math.Floor(div_3)
groupByKey_3 = List.GroupByKey(list=code_block_9@L2, keys=floor_3@L2)

# group: Сортировка по оси X
code_block_10 = CodeBlock(x=groupByKey_3.groups) { x; }
getLocation_7 = Element.GetLocation(code_block_10)
Y_6 = Point.Y(getLocation_7)
sortIndexByValue_4 = SortIndexByValue(Y_6)
getItemAtIndex_4 = List.GetItemAtIndex(list=code_block_10@L2, index=sortIndexByValue_4@L2)

# group: Сортировка по шагу X
code_block_11 = CodeBlock(x=getItemAtIndex_4) { x; }
getLocation_8 = Element.GetLocation(code_block_11)
X_2 = Point.X(getLocation_8)
minimumItem_4 = List.MinimumItem(X_2)
sub_4 = X_2 - minimumItem_4
шаг_по_x_2 = DoubleSlider(3000, range=0..10000 step 100)
div_4 = sub_4 / шаг_по_x_2
floor_4 = Math.Floor(div_4)
groupByKey_4 = List.GroupByKey(list=code_block_11@L2, keys=floor_4@L2)

flatten_2 = Flatten(groupByKey_4.groups)
count_2 = Count(watch_2@L1)
count_3 = Count(count_2)

# group: Нумерация
code_block_12 = CodeBlock(x=flatten_2) { x; }
string_2 = StringInput("Марка")
code_block_13 = CodeBlock { 1; }
add = count_3 + code_block_13
count_4 = List.Count(code_block_12)
sequence_2 = Sequence(start=add, amount=count_4, lacing=Longest)
string_from_object_2 = FromObject(sequence_2)
setParameterByName_2 = Element.SetParameterByName(element=code_block_12, parameterName=string_2, value=string_from_object_2)

select_model_elements = DSModelElementsSelection()
