# Dynamo graph О_Маркировка элементов.dyn (Dynamo 1.3.4.6666)

forceChildrensEval = ForceChildrensEval()  # unwired: arg0
activeView = Custom[Springs.Doc.ActiveView](refresh=forceChildrensEval)  # Selects the current document's active view. Supports more view types than the built-in option. Will be depreciated once the bult in node works with all plan types.
family_types = FamilyTypes("Марка потолка:Имя")

# group: Выделить элемент в Revit
forceChildrensEval_2 = ForceChildrensEval()  # unwired: arg0
currentSelection = Custom[Springs.Collector.CurrentSelection](refresh=forceChildrensEval_2)  # Gets the currently selected elements. Connect a boolean switch to refresh the selection.
watch = Watch(currentSelection)

byElements = Custom[BoundingBox.ByElements](elements=watch)  # Retrieves a bounding box for a list of elements
centerPoint = Custom[ZK.BoundingBox.CenterPoint](boundingBox=byElements)  # Input Bounding Box element to get its center point. This node is little and lightweight, as it doesn't convert bounding box to geometry to get its centroid point.
watch_2 = Watch(centerPoint)
boolean = BoolSelector(true)
byElementAndLocation = Tag.ByElementAndLocation(view=activeView, element=family_types, location=watch_2, addLeader=boolean)
XAxis = Vector.XAxis()
byPoint = Custom[SpotElevation.ByPoint](point=watch_2, view=activeView, bend=XAxis, end=XAxis, hasLeader=boolean)  # Places a spot elevation at a given point in a given view. May not work in all view types.
setLocation = Element.SetLocation(byPoint)  # unwired: arg1
dimensions = Custom[BoundingBox.Dimensions](boundingBox=byElements)  # Input Bounding Box element to get its dimensions (Width, Length, Height). Setting Boolean switch to True rounds output values.
