# Dynamo graph О_Подсчет общей длины Линейных элементов.dyn (Dynamo 1.3.4.6666)

forceChildrensEval = ForceChildrensEval()  # unwired: arg0
currentSelection = Custom[Springs.Collector.CurrentSelection](refresh=forceChildrensEval)  # Gets the currently selected elements. Connect a boolean switch to refresh the selection.
type = Object.Type(currentSelection)
code_block = CodeBlock { "UnknownElement"; }
contains = String.Contains(str=type, searchFor=code_block)
filterByBoolMask = List.FilterByBoolMask(list=currentSelection, mask=contains)
elementSketch = Custom[Springs.Collector.ElementSketch](element=filterByBoolMask.in)  # Get the actual sketch lines of a sketch based element (floor, ceiling, modified wall, etc.) . You can optionally fetch the matching model curves, however this might prove comptationally heavy on larger data sets.
clear_list = Custom[Clear List](Input=elementSketch.curves)  # This node will remove all Null and Empty Lists from any list.
flatten = Flatten(clear_list)
curves = Element.Curves(filterByBoolMask.out)
removeNulls = Lists.Manage.RemoveNulls(curves)
join = List.Join(flatten, removeNulls)
removeNulls_2 = Lists.Manage.RemoveNulls(join)
flatten_2 = Flatten(removeNulls_2)
length = Curve.Length(flatten_2)
sum = Math.Sum(length)
code_block_2 = CodeBlock { "Autodesk.Line"; }
removeIfNot = RemoveIfNot(flatten_2, code_block_2)
direction = Line.Direction(removeIfNot)
XAxis = Vector.XAxis()
angleWithVector = Vector.AngleWithVector(vector=direction, otherVector=XAxis)
code_block_3 = CodeBlock { 0; }
eq = angleWithVector == code_block_3
filterByBoolMask_2 = List.FilterByBoolMask(list=angleWithVector, mask=eq)
count = Count(filterByBoolMask_2.in)
count_2 = Count(filterByBoolMask_2.out)
create = List.Create(count, count_2)
maximumItem = List.MaximumItem(create)
ширина_профиля = CodeBlock { 45; }
mul = maximumItem * ширина_профиля
add = sum + mul
round = Math.Round(add)
string_from_object = FromObject(round)
sendTo = Custom[Clipboard.SendTo](str=string_from_object)  # Copies a string to the clipboard.
watch = Watch(sendTo)
count_3 = Count(currentSelection)
watch_2 = Watch(count_3)
code_block_4 = CodeBlock { "Autodesk.Arc"; }
removeIfNot_2 = RemoveIfNot(flatten_2, code_block_4)
