# Dynamo graph Параметры в проект.dyn (Dynamo 0.9.1.4062)

file_path = Filename("C:\Users\Дом\Desktop\Параметры в проект.xlsx")
fromPath = FileObject(file_path)  # "File.FromPath"
string = StringInput("Общая таблица")
boolean = BoolSelector(true)
readFromFile = Excel.ReadFromFile(file=fromPath, sheetName=string, readAsStrings=boolean)
нужные_ячейки = Python(IN[0]=readFromFile)
# ---------- нужные_ячейки.python (18 lines) ----------
import clr
clr.AddReference('ProtoGeometry')
from Autodesk.DesignScript.Geometry import *
#Введенные в этом узле данные сохраняется в виде списка в переменных IN.
excel=IN[0]
i=2
list=[]
number=[]
number.append([0,1,3,5,7,9,11])
while i<excel.Count:
	param=[]
	for j in number[0]:
		param.append(excel[i][j])
	list.append(param)
	i=i+1

#Назначьте вывод переменной OUT.
OUT = list
# ----------------------------------------
transpose = List.Transpose(нужные_ячейки)
code_block = CodeBlock(a=transpose) { a[2]; }
list_parametertype = Python(IN[0]=code_block)
# ---------- list_parametertype.python (27 lines) ----------
#Copyright(c) 2015, Konrad Sobon
# @arch_laboratory, http://archi-lab.net

import clr
clr.AddReference("ProtoGeometry")
from Autodesk.DesignScript.Geometry import *

# Import DocumentManager and TransactionManager
clr.AddReference("RevitServices")
import RevitServices
from RevitServices.Persistence import DocumentManager
from RevitServices.Transactions import TransactionManager

# Import RevitAPI
clr.AddReference("RevitAPI")
import Autodesk
from Autodesk.Revit.DB import *
import System

excel=IN[0]
list=[]
types=System.Enum.GetValues(ParameterType)
for i in excel:
	for j in types:
		if str(j)==str(i):
			list.append(j)
OUT = list
# ----------------------------------------
code_block_2 = CodeBlock(a=transpose) { a[4]; }
byName = Category.ByName(code_block_2)
code_block_3 = CodeBlock(a=transpose) { a[5]; }
parameter_group = Python(IN[0]=code_block_3)
# ---------- parameter_group.python (28 lines) ----------
#Copyright(c) 2015, Konrad Sobon
# @arch_laboratory, http://archi-lab.net

import clr
clr.AddReference('ProtoGeometry')
from Autodesk.DesignScript.Geometry import *

# Import DocumentManager and TransactionManager
clr.AddReference("RevitServices")
import RevitServices
from RevitServices.Persistence import DocumentManager
from RevitServices.Transactions import TransactionManager

# Import RevitAPI
clr.AddReference("RevitAPI")
import Autodesk
from Autodesk.Revit.DB import *
import System

excel=IN[0]
list=[]
groups=System.Enum.GetValues(BuiltInParameterGroup)
for i in excel:
	for j in groups:
		if str(j)==str(i):
			list.append(j)
#Assign your output to the OUT variable
OUT = list
# ----------------------------------------
python_script = Python(IN[0]=transpose, IN[1]=list_parametertype, IN[2]=byName, IN[3]=parameter_group)
# ---------- python_script.python (119 lines) ----------
#Copyright(c) 2015, Konrad Sobon
# @arch_laboratory, http://archi-lab.net

import clr
clr.AddReference('ProtoGeometry')
from Autodesk.DesignScript.Geometry import *

# Import DocumentManager and TransactionManager
clr.AddReference("RevitServices")
import RevitServices
from RevitServices.Persistence import DocumentManager
from RevitServices.Transactions import TransactionManager

# Import RevitAPI
clr.AddReference("RevitAPI")
import Autodesk
from Autodesk.Revit.DB import *

doc = DocumentManager.Instance.CurrentDBDocument
uiapp = DocumentManager.Instance.CurrentUIApplication
app = uiapp.Application

from System.Collections.Generic import *

# Import ToDSType(bool) extension method
clr.AddReference("RevitNodes")
import Revit
clr.ImportExtensions(Revit.Elements)
import System
#The inputs to this node will be stored as a list in the IN variable.
dataEnteringNode = IN

_paramName = IN[0][0]
_groupName = IN[0][1]
_paramType = IN[1]
_visible = IN[0][3]
_category = IN[2]
_paramGroup = IN[3]
_instance = IN[0][6]

def ParamBindingExists(_doc, _paramName, _paramType):
	map = doc.ParameterBindings
	iterator = map.ForwardIterator()
	iterator.Reset()
	while iterator.MoveNext():
		if iterator.Key != None and iterator.Key.Name == _paramName and iterator.Key.ParameterType == _paramType:
			paramExists = True
			break
		else:
			paramExists = False
	return paramExists

def RemoveParamBinding(_doc, _paramName, _paramType):
	map = doc.ParameterBindings
	iterator = map.ForwardIterator()
	iterator.Reset()
	while iterator.MoveNext():
		if iterator.Key != None and iterator.Key.Name == _paramName and iterator.Key.ParameterType == _paramType:
			definition = iterator.Key
			break
	message = None
	if definition != None:
		map.Remove(definition)
		message = "Success"
	return message

def addParam(doc, _paramName, _visible, _instance, _groupName, _paramGroup,k):
	message = None
	if ParamBindingExists(doc, _paramName, _paramType):
		if not RemoveParamBinding(doc, _paramName, _paramType) == "Success":
			message = "Param Binding Not Removed Successfully"
		else:
			message = None
			
	group = file.Groups.get_Item(_groupName)
	if group == None:
		group = file.Groups.Create(_groupName)
	if group.Definitions.Contains(group.Definitions.Item[_paramName]):
		_def = group.Definitions.Item[_paramName]
	else:
   		_def = group.Definitions.Create(opt)
	param = doc.ParameterBindings.Insert(_def, bind, _paramGroup)
	return message
#"Start" the transaction
TransactionManager.Instance.EnsureInTransaction(doc)

try:
	file = app.OpenSharedParameterFile()
except:
	message = "No Shared Parameter file found."
	pass
k=0
while k<_paramName.Count:
	builtInCategory = System.Enum.ToObject(BuiltInCategory, _category[k].Id)
	cats = app.Create.NewCategorySet()
	cats.Insert(doc.Settings.Categories.get_Item(builtInCategory))
	if _instance[k]:
		bind = app.Create.NewInstanceBinding(cats)
	else:
		bind = app.Create.NewTypeBinding(cats)
	opt = ExternalDefinitionCreationOptions(_paramName[k], _paramType[k])	
	opt.Visible = _visible[k]
	if isinstance(_paramName[k], list):
		for i in _paramName[k]:
			message = addParam(doc, i, _visible[k], _instance[k], _groupName[k], _paramGroup[k], k)
	else:
		message = addParam(doc, _paramName[k], _visible[k], _instance[k], _groupName[k], _paramGroup[k],k)
	k=k+1

# "End" the transaction
TransactionManager.Instance.TransactionTaskDone()
	

	#Assign your output to the OUT variable

if message == None:
	OUT = "Success"
else:
	OUT = message
# ----------------------------------------
