# Dynamo graph Схема полов.dyn (Dynamo 2.0.1.5055)

boolean = BoolSelector(true)
выбор_и_фильтрация = Python(IN[0]=boolean)
# ---------- выбор_и_фильтрация.python (35 lines) ----------
import System
import clr

# Import DocumentManager and TransactionManager
clr.AddReference("RevitServices")
import RevitServices
from RevitServices.Persistence import DocumentManager
from System.Collections.Generic import *
# Import RevitAPI
clr.AddReference("RevitAPI")
import Autodesk
from Autodesk.Revit.DB import *

doc = DocumentManager.Instance.CurrentDBDocument

def floors(floor_string):
	#фильтр по параметру
	id = ElementId(BuiltInParameter.SYMBOL_NAME_PARAM)
	provider = ParameterValueProvider(id)
	evaluator = FilterStringContains()
	#значение параметра
	FloorName = floor_string
	#Соответствие параметра
	rule = FilterStringRule( provider, evaluator, FloorName, False)
	FloorFilter = ElementParameterFilter(rule)
	#Перекрытия в проекте
	Collector = FilteredElementCollector(doc).OfCategory(BuiltInCategory.OST_Floors).WhereElementIsElementType()
	#Полы
	Collector = Collector.WherePasses(FloorFilter).ToElements()
	return Collector

if IN[0] == True:
	OUT = floors("Пол")
else:
	OUT = "Обновить"
# ----------------------------------------
схема_пола = Python(IN[0]=выбор_и_фильтрация, IN[1]=boolean)
# ---------- схема_пола.python (322 lines) ----------
#Загрузка библиотек
import System
import clr

from System import Array
from System.Collections.Generic import *

clr.AddReference('RevitAPI')
from Autodesk.Revit.DB import *
import Autodesk

clr.AddReference('System')
from System.Collections.Generic import List

clr.AddReference("RevitServices")
import RevitServices
from RevitServices.Persistence import DocumentManager
from RevitServices.Transactions import TransactionManager

from System import Array
from System.Collections.Generic import *

import sys

pyt_path = r'C:\Program Files (x86)\IronPython 2.7\Lib'
sys.path.append(pyt_path)

import os


#ФУНКЦИИ ДЛЯ СОЗДАНИЯ ЧЕРТЕЖНЫХ ВИДОВ
# Функция выбора типоразмера данного экземпляра
def get_type(element):
	return doc.GetElement(element.GetTypeId()) 
#Является ли элемент списком	
def to_list(item):
	listA = []
	if hasattr(item, "__iter__"):
		for i in range(0,len(item)):
			listA.append(item[i])
	else:
		listA.append(item)
	return listA	
	
	
#функция последовательного приращения толщины слоя
def thickness(lst):
	a, b = [], [0]
	for e in lst:
		if e !=0:
			a.append(e)
			b.append(sum(a))
	return b	

#функция добавления толщины слоя
def result(lst):
	a, b = [], []
	for  e in lst:
		a.append(e)
		b.append(sum(a))
	return b
	
#Функция отрисовки линий для привязки размера
def dim_lines(structure):
	structure.insert(0,0)
	# Линии для привязки размера
	for i, f in enumerate(structure):
		#Создание линий
		if i == 0:
			DL0 = doc.Create.NewDetailCurve(View, draw_line(f))
			LR0 = DL0.GeometryCurve.Reference	 	
			RA.Append(LR0)		
		elif i<len(structure) and structure[i] != structure[i-1]:	 		
			DL = doc.Create.NewDetailCurve(View, draw_line(f))
			LR = DL.GeometryCurve.Reference 	 		
			RA.Append(LR)
			#Линия гидроизоляции
			if i+1<len(structure) and structure[i] == structure[i+1]:
				DL.LineStyle = Dashed
	return RA

#Получение толщин слоев с учетом нулевых толщин	
def getThickness(lst):
	h = result(lst)
	container = []
	t = 15 #толщина зазора
	for i, e in enumerate(lst):
		# значение, если следующий слой улевой толщины
		if i+1<len(lst) and lst[i+1] == 0:
			container.append([h[i]-e, h[i]-t/304.8])
		# значение, если предыдущий слой улевой толщины	
		elif i<len(lst) and lst[i-1] == 0:
			container.append([h[i]-e + t/304.8, h[i]])
		# значение, если слой улевой толщины	
		elif lst[i] == 0:
			pass
		#Общий случай			
		else:
			container.append([h[i]-e, h[i]])
	return container
	
def draw_line(f):
	pt0 = XYZ(0,f,0)
	pt1 = XYZ(1,f,0)
	line = Autodesk.Revit.DB.Line.CreateBound(pt0,pt1)
	return line		
	
#Контуры для областей
def fillloop(l):	
	profileloops = List[CurveLoop]()
	profileloop = []
	pt0 = XYZ(0,l[0],0)
	pt1 = XYZ(0,l[1],0)
	pt2 = XYZ(1,l[1],0)
	pt3 = XYZ(1,l[0],0)
	pt4 = XYZ(0,l[0],0)
	p = [pt0,pt1,pt2,pt3,pt4]			
	for i, e in zip(p,p[1:]):
		ln = Autodesk.Revit.DB.Line.CreateBound(i,e)
		profileloop.append(ln)
	profileloops.Add(CurveLoop.Create(profileloop))
	return profileloops
	
#Линии детализации для размеров
def detlines(m, u):
	c = sum(m)
	m.append(u)
	v = sum(m)
	pt0 = XYZ(0,v,0)
	pt1 = XYZ(2,v,0)
	return Autodesk.Revit.DB.Line.CreateBound(pt0,pt1)
	
#Размерная линия
def perpline(x):
	pt0 = XYZ(x,0,0)
	pt1 = XYZ(x,3,0)
	return Autodesk.Revit.DB.Line.CreateBound(pt0,pt1)
	
#Фнкция создание новых типов цветовых областей или выбор существующих	
def fillpatternCreate(mat):
	FillRegionsCollector = FilteredElementCollector(doc).OfClass(FilledRegionType)
	f = FillRegionsCollector.FirstElement().Id
	FillRegions = [fr for fr in FillRegionsCollector]
	FPNames = [fill.LookupParameter("Имя типа").AsString() for fill in FillRegions]
	if mat:
		name = 'Штриховка ' + mat.Name
		#Если у материала задана штриховка
		if str(mat.CutPatternId) != "-1" :
			#Id образца штриховки материал
			MaterialPattern = mat.CutPatternId
		#Если материал без штриховки	
		else:
			MaterialPattern = ElementId(-1)
	else:
		name = 'Штриховка без образца'
		MaterialPattern = ElementId(-1)
	#Если область с таким именем уже есть
	if name in FPNames:
		#Область штриховки
		fill = FillRegions[FPNames.index(name)]
		#Параметр образца штриховки области штриховки
		PatternParameter = fill.get_Parameter(BuiltInParameter.FOREGROUND_ANY_PATTERN_ID_PARAM)
		#Id образца штриховки
		PatternId = PatternParameter.AsElementId()
		#Если образцы штриховки материала и области штриховки совпадают
		if str(MaterialPattern) == str(PatternId):
			return fill
		else:
			PatternParameter.Set(MaterialPattern)
			return	fill
	else:
		fill = doc.GetElement(f).Duplicate(name)
		fillpattern = fill.get_Parameter(BuiltInParameter.FOREGROUND_ANY_PATTERN_ID_PARAM).Set(MaterialPattern)
		return fill	

#Изъятие первого элемента из коллекции элементов на виде, являющийся собственно видом	
def elemToIds(collection):
	ids = []
	for e in collection:
		ids.append(e)
	return List[ElementId](ids[1:])
	
#Создание нового чертежного вида
def draftviewCreate(arg):
	viewFamilyType = FilteredElementCollector(doc).OfClass(ViewFamilyType)
	draftViews = []
	DWTpesNames = []
	DWNames = []
	for v in viewFamilyType:
		# Выбор первого типоразмера чертежного вида для создания копий
		if "Drafting" in v.ViewFamily.ToString():
			draftViews.append(v)
			DWTpesNames.append(v.LookupParameter("Имя типа").AsString())
			view = v
	# Проверка, существует ли уже такой типоразмер
	if "Схема полов" in DWTpesNames:
		i = draftViews[DWTpesNames.index("Схема полов")]	
	else:
		i = doc.GetElement(view.Id).Duplicate("Схема полов")
	AllDW = FilteredElementCollector(doc).OfClass(ViewDrafting).WhereElementIsNotElementType()	
	for draftView in AllDW:
		if draftView.Name == arg:
			ElementsInView = FilteredElementCollector(doc, draftView.Id).ToElementIds()
			elements = elemToIds(ElementsInView)
			doc.Delete(elements)
			return draftView
	NewDraftView = ViewDrafting.Create(doc,view.Id)
	NewDraftView.LookupParameter("Имя вида").Set(arg)			
	return NewDraftView
	
#ФУНКЦИИ ДЛЯ СОЗДАНИЯ ИЗОБРАЖЕНИЯ
#Создание набора видов
def CreateViewSet(views):
	viewSet = List[ElementId]()
	for i in views:
		viewSet.Add(i.Id)
	return viewSet
	
#Параметры экспорта изображения
def export_option(views):
	ieo = ImageExportOptions()
	ieo.FilePath = filePath
	ieo.HLRandWFViewsFileType = ImageFileType.PNG
	ieo.ZoomType  = ZoomFitType.FitToPage
	ieo.PixelSize = 512
	ieo.ExportRange = ExportRange.SetOfViews
	ieo.SetViewsAndSheets(CreateViewSet(to_list(views)))
	ieo.FitDirection = FitDirectionType.Horizontal
	return ieo
#Удаление существующих изображений	
def del_images():
	Builtin = BuiltInCategory.OST_RasterImages
	filter = ElementCategoryFilter(Builtin)
	Collector = FilteredElementCollector(doc).WherePasses(filter)
	RasterImages = Collector.ToElements()
	if len(RasterImages)>0:
		for image in RasterImages:
			ImageName = Element.Name.__get__(image)
			if "Пол" in ImageName:
				doc.Delete(image.Id)
	else:
		pass
	return "Выполненно"
	
#Данные
doc = DocumentManager.Instance.CurrentDBDocument
floors = UnwrapElement(IN[0])
filePath = 'C:/Temp/'

#Выбор графического стиля линии гидроизоляции
LinesCat = doc.Settings.Categories.get_Item(BuiltInCategory.OST_Lines);
GrStyle = LinesCat.SubCategories.get_Item("Невидимые линии");
Dashed = GrStyle.GetGraphicsStyle( GraphicsStyleType.Projection)

views = []

if IN[1] == True:
	TransactionManager.Instance.EnsureInTransaction(doc)
	#Все типоразмеры цветовых областей в проекте
	fills = FilteredElementCollector(doc).OfClass(FilledRegionType) 
	#Все типоразмеры видов в проекте
	viewFamilyType = FilteredElementCollector(doc).OfClass(ViewFamilyType)
	#Удаление существующих изображений полов
	del_images()
	
	for floor in floors:
		RA = ReferenceArray()
		# Создание нового чертежного видавида
		View = draftviewCreate(Element.Name.__get__(floor))
		# Структура пола		
		compstruc = floor.GetCompoundStructure()	
		count = list(range(compstruc.LayerCount))
		#Список толщин
		LayersHeight = [compstruc.GetLayerWidth(i) for i in count]
		h = list(reversed(LayersHeight))
		#Список материалов
		LayersMaterial = [floor.Document.GetElement(compstruc.GetMaterialId(i)) for i in count if LayersHeight[i]!=0]
		Materials = list(reversed(LayersMaterial))
		#Диапозон толщин
	 	Thickness = getThickness(h)
	 	#Штриховки для материалов
	 	FillTypes = [fillpatternCreate(material) for material in Materials]
	 	#Контуры штриховок
	 	loops = [fillloop(thick) for thick in Thickness]
	 	
	 	#Создание цветовых областей
	 	for ft, loop in zip(FillTypes, loops):
	 		Fill = FilledRegion.Create(doc, ft.Id, View.Id, loop)
	 		
	 	#Добавление толщин слоев	
	 	structure = result(h)
	 	#Линии привязки размера
	 	RA = dim_lines(structure)
	 	#Размерная линия		
		Perp = perpline(1.3)
		#Создание размера	
		dim = doc.Create.NewDimension(View, Perp, RA) 
		#ЭКСПОРТ ВИДА В .PNG
		#Параметры экспорта
		ieo = export_option(View)
		#Экспорт изображения
		doc.ExportImage(ieo)
		#Имя, присваемое изображению
		ImageName = ImageExportOptions.GetFileName(doc,View.Id ) + '.PNG' 
		#Полное имя изображения на диске
		FileName = os.path.join(filePath, ImageName)
		#Новое имя изображения на диске
		NewFileName = os.path.join(filePath, View.Name+ '.PNG')
		#Переименование файла изображения
		os.rename(FileName, NewFileName)
		#Загрузка зображений в проект
		FloorImage = ImageType.Create(doc,  NewFileName)
		#Заполнение параметра
		floor.get_Parameter(BuiltInParameter.ALL_MODEL_TYPE_IMAGE).Set(FloorImage.Id)
		#Удаление файлов изображений с диска	
		os.remove(NewFileName)
		views.append(View) 		
		
	TransactionManager.Instance.TransactionTaskDone()
	OUT = views
else:
	OUT = IN[0]
# ----------------------------------------
состав_пола = Python(IN[0]=выбор_и_фильтрация)
# ---------- состав_пола.python (72 lines) ----------
import clr
clr.AddReference('RevitAPI')
from Autodesk.Revit.DB import *
import Autodesk

clr.AddReference('ProtoGeometry')
from Autodesk.DesignScript.Geometry import *

clr.AddReference("RevitNodes")
import Revit
clr.ImportExtensions(Revit.GeometryConversion)

clr.AddReference("RevitNodes")
import Revit
clr.ImportExtensions(Revit.Elements)

clr.AddReference("RevitServices")
import RevitServices
from RevitServices.Persistence import DocumentManager
from RevitServices.Transactions import TransactionManager
from System.Collections.Generic import *

doc = DocumentManager.Instance.CurrentDBDocument

def layer_discription(floor, num):
	compstruc = floor.GetCompoundStructure() 
	material = floor.Document.GetElement(compstruc.GetMaterialId(num))
	if material:
		#Описание материала
		discription = material.LookupParameter("Описание").AsString() 
		return discription
	else:
		return "Не определено"

def layer_thickness(floor, num):
	compstruc = floor.GetCompoundStructure()
	LayerThick = compstruc.GetLayerWidth(num)*304.8 #Толщина слоя
	if 	LayerThick > 0:
		return " - " + str(LayerThick)[:-2]+" мм"
	else:
		return ""

def layers(floor):
	DataSring = [] 
	Comm = floor.LookupParameter("Комментарии к типоразмеру").AsString()		
	compstruc = floor.GetCompoundStructure() 
	num = compstruc.LayerCount #Счётчик слоёв пола
	count = list(range(compstruc.LayerCount))
	#Список толщин
	LayersThickness = [layer_thickness(floor, i) for i in count]
	#Список материалов
	LayersMaterial = [layer_discription(floor, i) for i in count]
	#Составление описания слоев
	for num, (mat, thick) in enumerate(zip(LayersMaterial, LayersThickness)):			
		DataSring.append( "".join([str(num +1)+". " + mat, thick])) #Сборка строки состава пола
	if Comm != None:
		DataSring.append(str(num + 1) + ". " + Comm) #Добавление комментария
	param = "\r\n".join(DataSring)
	return param

AllFloors = UnwrapElement(IN[0])
FloorData = [] #пустой список для общего списка слоёв и их толщин

if isinstance(AllFloors, str):
	OUT = AllFloors
else:
	TransactionManager.Instance.EnsureInTransaction(doc)
	for floor in AllFloors:
		Param = floor.LookupParameter("Описание").Set(layers(floor))
		FloorData.append(layers(floor))
	TransactionManager.Instance.TransactionTaskDone()
	OUT =  FloorData
# ----------------------------------------
