# Dynamo graph Purge Current Document.dyn (Dynamo 2.0.2.6826)

directory_path = Directory("X:\Revit\_Families to Process\mail box\Parts")
directory_from_path = DirectoryObject(path=directory_path)
getDirectoryContents = FileSystem.GetDirectoryContents(directory=directory_from_path)
openDocumentFile = Rhythm.Revit.Application.Applications.OpenDocumentFile(filePath=getDirectoryContents.files)
boolean = BoolSelector(true)
purge = Orchid.Revit.Core.Document.Purge(document=openDocumentFile, completely=boolean)
passthrough = Custom[Passthrough](passThrough=openDocumentFile, waitFor=purge)  # Forces a sequential order of execution. The node wired into the output of the Passthrough node will be executed *after* the node wired into the waitFor input (e.g. important for some Revit operations). The value of the passThrough input will be passed on to the node wired into the output port of the Passthrough node.
boolean_2 = BoolSelector(true)
close = Orchid.Revit.Core.Document.Close(document=passthrough, save=boolean_2)
