# Dynamo graph ReloadFamilies.dyn (Dynamo 2.0.4.12684)

путь_к_файлу_python = Filename("..\DynamoScripts\ReloadFamilies.py")
find_file_and_import_it = Python(IN[0]=путь_к_файлу_python)
# ---------- find_file_and_import_it.python (12 lines) ----------
import sys
#sys.path.append('C:\Program Files\IronPython 2.7\Lib')
sys.path.append('C:\Program Files (x86)\IronPython 2.7\Lib')
import codecs

try:
	filePath = IN[0]
	with codecs.open(filePath, 'rb', "utf-8") as inf:
		lines = inf.readlines()
	OUT = ''.join(lines)
except:
	OUT = "No file"
# ----------------------------------------
директория_библиотеки = Directory("K:\02_Библиотека")  # graph input
categories = Categories(index=124)
python_script_from_string = PythonStringNode(script=find_file_and_import_it, IN[0]=директория_библиотеки, IN[1]=categories)
watch = Watch(python_script_from_string)
