# Dynamo graph ReloadLinksWithSelectedWorksets.dyn (Dynamo 2.3.0.5885)

# group: IN_Get Revit Link Types...
link_getrevitlinktypes_py = Python()
# ---------- link_getrevitlinktypes_py.python (45 lines) ----------
"""
Description: Returns all RevitLinkTypes in the active Revit Document as well as their Filepath and Names.
Author: Dan Woodcock
Website: https://danimosite.wordpress.com
Licence: N/A
"""

###### Imports ######

import clr

import sys
pyt_path = r'C:\Program Files (x86)\IronPython 2.7\Lib'
sys.path.append(pyt_path)
import os
import ntpath

clr.AddReference("RevitServices")
import RevitServices
from RevitServices.Persistence import DocumentManager
doc =  DocumentManager.Instance.CurrentDBDocument

clr.AddReference("RevitAPI")
from Autodesk.Revit.DB import *

###### Main Script ######

rlTypes = []
fPaths = []
names = []

rvtLinkTypes = FilteredElementCollector(doc).OfClass(RevitLinkType)

if rvtLinkTypes:    
	for rlt in rvtLinkTypes:
		rlTypes.append(rlt)    
		efr = rlt.GetExternalFileReference()
		if rlt.PathType == PathType.Relative:		
			fPath = os.path.join(os.path.dirname(doc.PathName),ModelPathUtils.ConvertModelPathToUserVisiblePath(efr.GetPath()))
		else:
			fPath = ModelPathUtils.ConvertModelPathToUserVisiblePath(efr.GetPath())
		fPaths.append(fPath)
		names.append(ntpath.basename(fPath))                    

OUT = rlTypes, fPaths, names
# ----------------------------------------
code_block = CodeBlock(a=link_getrevitlinktypes_py) { RevitLinkTypes = a[0]; RevitLinkPaths = a[1]; RevitLinkNames = a[2]; }

# group: Choose Link (select one only)
# note: Here you should choose which link to operate on. I am choosing the first item in the list, but you should use your own logic here. It could be based on the RevitLinkName. See example below...
code_block_2 = CodeBlock(a=code_block.RevitLinkTypes) { a[0]; }

# group: OP_Get Worksets from Link...
code_block_3 = CodeBlock(revitLinkType=code_block_2) { revitLinkType; }
# note: A list of Worksets in the Link you can use to choose which gets loaded or not.
revitlinktype_getmodelpath_py = Python(IN[0]=code_block_3)
# ---------- revitlinktype_getmodelpath_py.python (55 lines) ----------
"""
Description: Gets the Filepath of the given RevitLinkType(s).
Author: Dan Woodcock
Website: https://danimosite.wordpress.com
Licence: N/A
"""

###### Imports ######

import clr
import sys
pyt_path = r'C:\Program Files (x86)\IronPython 2.7\Lib'
sys.path.append(pyt_path)
import os
import ntpath

clr.AddReference("RevitServices")
import RevitServices
from RevitServices.Persistence import DocumentManager
from RevitServices.Transactions import TransactionManager
doc =  DocumentManager.Instance.CurrentDBDocument

clr.AddReference("RevitAPI")
from Autodesk.Revit.DB import *

###### Definitions ######

# Convert to list should we need to...
def tolist(obj1):
	if hasattr(obj1,"__iter__"): return obj1
	else: return [obj1]

def GetModelNameFromRevitLinkType(rlt):		
	pt = rlt.PathType	
	efr = rlt.GetExternalFileReference()
	
	if pt == PathType.Relative:		
		return os.path.join(os.path.dirname(doc.PathName),ModelPathUtils.ConvertModelPathToUserVisiblePath(efr.GetPath()))
	else:
		return ModelPathUtils.ConvertModelPathToUserVisiblePath(efr.GetPath())

###### Inputs ######

rvtLinkTypes = tolist(UnwrapElement(IN[0]))

###### Outputs ######

outList = []

###### Main Script ######

for rlt in rvtLinkTypes:
	outList.append(GetModelNameFromRevitLinkType(rlt))

OUT = outList
# ----------------------------------------
modelpath_worksetinfo_py = Python(IN[0]=revitlinktype_getmodelpath_py)
# ---------- modelpath_worksetinfo_py.python (44 lines) ----------
"""
Description: Gets the Filepath of the given RevitLinkType(s).
Author: Dan Woodcock
Website: https://danimosite.wordpress.com
Licence: N/A
"""

###### Imports ######

import clr
import sys
pyt_path = r'C:\Program Files (x86)\IronPython 2.7\Lib'
sys.path.append(pyt_path)
import os
import ntpath

clr.AddReference("RevitServices")
import RevitServices
from RevitServices.Persistence import DocumentManager
from RevitServices.Transactions import TransactionManager
doc =  DocumentManager.Instance.CurrentDBDocument

clr.AddReference("RevitAPI")
from Autodesk.Revit.DB import *

###### Definitions ######

# Convert to list should we need to...
def tolist(obj1):
	if hasattr(obj1,"__iter__"): return obj1
	else: return [obj1]

p = tolist(IN[0])[0]

outList = []

p = ModelPathUtils.ConvertUserVisiblePathToModelPath(p)

wksts = WorksharingUtils.GetUserWorksetInfo(p)

for wkst in wksts:
	outList.append(wkst.Name)
	
OUT = outList
# ----------------------------------------

# group: DATA_Filter by Name... (use whatever logic you want)
# note: You need to specify what Worksets you want to Open here. I am doing it by Name, but you can choose how you want to select these.
code_block_4 = CodeBlock()
# ---------- code_block_4.designscript (5 lines) ----------
["Workset1",
"Shared Levels and Grids",
"Test1",
"Test2",
"Test3"];
# ----------------------------------------
contains = List.Contains(list=modelpath_worksetinfo_py, item=code_block_4, lacing=Longest)
filterByBoolMask = List.FilterByBoolMask(list=modelpath_worksetinfo_py, mask=contains)
code_block_5 = CodeBlock(foundWksets=filterByBoolMask.in) { foundWksets; }

# group: OP_Create new WorksetConfig...
# note: Creates a new WorksetConfiguration to be used when reloading the Revit Link.
code_block_6 = CodeBlock(modelPath=revitlinktype_getmodelpath_py, worksetNamesToOpen=code_block_5) { modelPath; worksetNamesToOpen; }
worksetconfig_create_py = Python(IN[0]=code_block_6.modelPath, IN[1]=code_block_6.worksetNamesToOpen)
# ---------- worksetconfig_create_py.python (53 lines) ----------
"""
Description: Gets the Filepath of the given RevitLinkType(s).
Author: Dan Woodcock
Website: https://danimosite.wordpress.com
Licence: N/A
"""

###### Imports ######

import clr
import sys
pyt_path = r'C:\Program Files (x86)\IronPython 2.7\Lib'
sys.path.append(pyt_path)
import os
import ntpath

clr.AddReference("RevitServices")
import RevitServices
from RevitServices.Persistence import DocumentManager
from RevitServices.Transactions import TransactionManager
doc =  DocumentManager.Instance.CurrentDBDocument

clr.AddReference("RevitAPI")
from Autodesk.Revit.DB import *

###### Definitions ######

# Convert to list should we need to...
def tolist(obj1):
	if hasattr(obj1,"__iter__"): return obj1
	else: return [obj1]


p = tolist(IN[0])[0]
wkstNames = tolist(IN[1])

outList = []

p = ModelPathUtils.ConvertUserVisiblePathToModelPath(p)
wksts = WorksharingUtils.GetUserWorksetInfo(p)

ids = []

for wkst in wksts:
	if wkst.Name in wkstNames:
		ids.append(wkst.Id)

wkstConfig = WorksetConfiguration(WorksetConfigurationOption.CloseAllWorksets)

if not ids == None and len(ids) > 0:
	wkstConfig.Open(ids)

OUT = wkstConfig
# ----------------------------------------

# group: OP_Reload Link with new WorksetConfig...
# note: ONLY set Run to true once you have created the Workset Config from the given worksets.
run = BoolSelector(true)
code_block_7 = CodeBlock(run=run, revitLinkType=code_block_2, worksetConfig=worksetconfig_create_py) { run; revitLinkType; worksetConfig; }
revitlinktype_loadfrom_py = Python(IN[0]=code_block_7.run, IN[1]=code_block_7.revitLinkType, IN[2]=code_block_7.worksetConfig)
# ---------- revitlinktype_loadfrom_py.python (55 lines) ----------
"""
Description: Gets the Filepath of the given RevitLinkType(s).
Author: Dan Woodcock
Website: https://danimosite.wordpress.com
Licence: N/A
"""

###### Imports ######

import clr
import sys
pyt_path = r'C:\Program Files (x86)\IronPython 2.7\Lib'
sys.path.append(pyt_path)
import os
import ntpath

clr.AddReference("RevitServices")
import RevitServices
from RevitServices.Persistence import DocumentManager
from RevitServices.Transactions import TransactionManager
doc =  DocumentManager.Instance.CurrentDBDocument

clr.AddReference("RevitAPI")
from Autodesk.Revit.DB import *

###### Definitions ######

# Convert to list should we need to...
def tolist(obj1):
	if hasattr(obj1,"__iter__"): return obj1
	else: return [obj1]

def GetModelPathFromRevitLinkType(rlt):		
	pt = rlt.PathType	
	efr = rlt.GetExternalFileReference()
	
	if pt == PathType.Relative:		
		return os.path.join(os.path.dirname(doc.PathName),ModelPathUtils.ConvertModelPathToUserVisiblePath(efr.GetPath()))
	else:
		return ModelPathUtils.ConvertModelPathToUserVisiblePath(efr.GetPath())

run = tolist(IN[0])[0]

if not run == True:
	run = False

rlt = tolist(UnwrapElement(IN[1]))[0]
wkstConfig = tolist(IN[2])[0]

if run:
	p = ModelPathUtils.ConvertUserVisiblePathToModelPath(GetModelPathFromRevitLinkType(rlt))
	
	OUT = RevitLinkType.LoadFrom(rlt, p, wkstConfig).LoadResult
else:
	OUT = "Please set Run to True"
# ----------------------------------------

# group: Example_Filter by RevitLink Name...
# note: Filter the RevitLinkTypes by the Revit Links Document Name (this is the name of the Revit File).
code_block_8 = CodeBlock { "TestLinkedModel.rvt"; }
eq = code_block.RevitLinkNames == code_block_8  # lacing=Longest
filterByBoolMask_2 = List.FilterByBoolMask(list=code_block.RevitLinkTypes, mask=eq)
# note: Plug the output of this to any input that reads "revitLinkType"
code_block_9 = CodeBlock(revitLinkType=filterByBoolMask_2.in) { revitLinkType; }
