# Dynamo graph ReloadNestedFamily.dyn (Dynamo 2.0.4.12684)

путь_к_файлу_python = Filename("..\DynamoScripts\ReloadNestedFamilies.py")
find_file_and_import_it = Python(IN[0]=путь_к_файлу_python)
# ---------- find_file_and_import_it.python (12 lines) ----------
import sys
#sys.path.append('C:\Program Files\IronPython 2.7\Lib')
sys.path.append('C:\Program Files (x86)\IronPython 2.7\Lib')
import codecs

try:
	filePath = IN[0]
	with codecs.open(filePath, 'rb', "utf-8") as inf:
		lines = inf.readlines()
	OUT = ''.join(lines)
except:
	OUT = "No file"
# ----------------------------------------
путь_к_вложенному_семейству = Filename("K:\02_Библиотека\AR\01_Семейства\Каркас несущий и Перемычка\Перемычка\Металлическая перемычка.rfa")
categories = Categories(index=398)
python_script_from_string = PythonStringNode(script=find_file_and_import_it, IN[0]=путь_к_вложенному_семейству, IN[1]=categories)
watch = Watch(python_script_from_string)
