# Dynamo graph RenameFamilyTypesByExel.dyn (Dynamo 2.0.4.12684)

# group: GetDataFromExel
file_path = Filename("..\DataBase\ELRenameFamilyNames.xlsx")
file_from_path = FileObject(path=file_path)
code_block = CodeBlock { "Data"; }
boolean = BoolSelector(true)
boolean_2 = BoolSelector(false)
importExcel = Data.ImportExcel(file=file_from_path, sheetName=code_block, readAsStrings=boolean, showExcel=boolean_2)
deconstruct = List.Deconstruct(list=importExcel)
transpose = List.Transpose(lists=deconstruct.rest)
HEADERS = Watch(deconstruct.first)

# group: Python Script From String
путь_к_файлу_python = Filename("..\DynamoScripts\RenameFamilyTypeByExel.py")
find_file_and_import_it = Python(IN[0]=путь_к_файлу_python)
# ---------- find_file_and_import_it.python (12 lines) ----------
import sys
#sys.path.append('C:\Program Files\IronPython 2.7\Lib')
sys.path.append('C:\Program Files (x86)\IronPython 2.7\Lib')
import codecs

try:
	filePath = IN[0]
	with codecs.open(filePath, 'rb', "utf-8") as inf:
		lines = inf.readlines()
	OUT = ''.join(lines)
except:
	OUT = "No file"
# ----------------------------------------
python_script_from_string = PythonStringNode(script=find_file_and_import_it, IN[0]=transpose)
LOST = Watch(python_script_from_string)
code_block_2 = CodeBlock(data=python_script_from_string) { data[0]; data[1]; }

# group: ExportExcel
code_block_3 = CodeBlock { 1; 0; }
exportExcel = Data.ExportExcel(filePath=file_path, sheetName=code_block_2.out0, startRow=code_block_3.out0, startCol=code_block_3.out1, data=code_block_2.out1)
