# Dynamo graph RenamePrefixFamilyTypes.dyn (Dynamo 2.0.4.12684)

путь_к_файлу_python = Filename("..\DynamoScripts\RenamePrefixFamilyTypes.py")
find_file_and_import_it = Python(IN[0]=путь_к_файлу_python)
# ---------- find_file_and_import_it.python (12 lines) ----------
import sys
#sys.path.append('C:\Program Files\IronPython 2.7\Lib')
sys.path.append('C:\Program Files (x86)\IronPython 2.7\Lib')
import codecs

try:
	filePath = IN[0]
	with codecs.open(filePath, 'rb', "utf-8") as inf:
		lines = inf.readlines()
	OUT = ''.join(lines)
except:
	OUT = "No file"
# ----------------------------------------
префикс = StringInput("(дверь)")
categories = Categories(index=124)
группа_модели = StringInput("Двери")
python_script_from_string = PythonStringNode(script=find_file_and_import_it, IN[0]=префикс, IN[1]=categories, IN[2]=группа_модели)
watch = Watch(python_script_from_string)
