# Dynamo graph Заполнение BI_этаж по нижней границе.dyn (Dynamo 2.16.1.2727)

parameters = Element.Parameters()  # frozen; unwired: element
name = Parameter.Name(parameter=parameters)
заполняемый_параметр = StringInput("BI_этаж")  # frozen
# note: Фильтрация по наличию параметра этажа
contains = List.Contains(list=name@L2, item=заполняемый_параметр)
filterByBoolMask = List.FilterByBoolMask(mask=contains)  # unwired: list
parameterByName = Parameter.ParameterByName(element=filterByBoolMask.in, name=заполняемый_параметр)
# note: Исключение элементов с нередактируемым параметром этажа
isReadOnly = Parameter.IsReadOnly(parameter=parameterByName)
filterByBoolMask_2 = List.FilterByBoolMask(list=filterByBoolMask.in, mask=isReadOnly)
boundingBox = Element.BoundingBox(element=filterByBoolMask_2.out)
# note: Получение нижних координат
minPoint = BoundingBox.MinPoint(boundingBox=boundingBox)
Z = Point.Z(point=minPoint)
смещение_уровня_от_плиты = IntegerSlider(0, range=0..300 step 10)  # graph input; frozen
code_block = CodeBlock(a=Z, delta=смещение_уровня_от_плиты) { Math.Ceiling(a/5)*5+delta; }
categories = Categories("OST_Levels")
all_elements_of_category = ElementsOfCategory(Category=categories)
code_block_2 = CodeBlock { "Имя"; "Фасад"; }
getParameterValueByName = Element.GetParameterValueByName(element=all_elements_of_category, parameterName=code_block_2.out0)
code_block_3 = CodeBlock { " "; 0; }
split = String.Split(string=getParameterValueByName, separator0=code_block_3.out0)
# note: Получение номеров и отметок этажей
getItemAtIndex = List.GetItemAtIndex(list=split@L2, index=code_block_3.out1)
getNumber = String.GetNumber(string=getItemAtIndex)
getParameterValueByName_2 = Element.GetParameterValueByName(element=all_elements_of_category, parameterName=code_block_2.out1)
sortByKey = List.SortByKey(list=getNumber, keys=getParameterValueByName_2)
основной_код = Python(IN[0]=code_block, IN[1]=sortByKey.sortedList, IN[2]=sortByKey.sortedKeys)  # CPython3
# ---------- основной_код.python (18 lines) ----------
H = IN[0]
Lv_number = IN[1]
Lv_h = IN[2]
OUT = []
#цик для каждой арматуры
for i_h in H:
	#проверка принадлежности для самой нижней отметки
	if i_h < Lv_h[1]:
		OUT.append(Lv_number[0])
	#проверка для последнего этажа
	elif i_h > Lv_h[-1]:
		OUT.append(Lv_number[-1])
	#проверка на всех этаж кроме нижней и верхней
	else:
		for i_lv in range(len(Lv_number)-2):
			if Lv_h[i_lv+1] <= i_h < Lv_h[i_lv+2]:
				OUT.append(Lv_number[i_lv+1])
				break
# ----------------------------------------
setParameterByName = Element.SetParameterByName(element=filterByBoolMask_2.out, parameterName=заполняемый_параметр, value=основной_код)
примечание = StringInput("""Данный скрипт заполняет параметр BI_этаж определяя где по высоте находится самая низкая точка объека
Номер этажа скрипт берет из названия уровня
Прнцип наименования уровня должна быть следующим:
12 Этаж, 100 Кровля ...""")  # graph input
byName = Category.ByName()  # frozen; unwired: name
all_elements_of_category_2 = ElementsOfCategory(Category=byName)
flatten = List.Flatten()  # frozen; unwired: list
категории = Python()  # CPython3; graph input
# ---------- категории.python (57 lines) ----------
OUT = ("Арматура воздуховодов",
	"Арматура трубопроводов",
	"Воздуховоды",
	"Воздухораспределители",
	"Гибкие воздуховоды",
	"Гибкие трубы",
	"Датчики",
	"Двери",
	"Импосты витража",
	"Кабельные лотки",
	"Каркас несущий",
	"Колонны",
	"Комплекты мебели",
	"Короба",
	"Крыши",
	"Лестницы",
	"Лестницы - Марши",
	"Лестницы - Площадки",
	"Лестницы - Опоры",
	"Материалы изоляции воздуховодов",
	"Материалы изоляции труб",
	"Мебель",
	"Наборы оборудования",
	"Несущая арматура",
	"Несущие колонны",
	"Обобщенные модели",
	"Оборудование",
	"Ограждение",
	"Окна",
	"Осветительные приборы",
	"Охранная сигнализация",
	"Пандус",
	"Панели витража",
	"Парковка",
	"Перекрытия",
	"Пожарная сигнализация",
	"Помещения",
	"Потолки",
	"Провода",
	"Сантехнические приборы",
	"Соединения несущих конструкций",
	"Соединители несущей арматуры",
	"Соединительные детали воздуховодов",
	"Соединительные детали кабельных лотков",
	"Соединительные детали коробов",
	"Соединительные детали трубопроводов",
	"Специальное оборудование",
	"Спринклеры",
	"Стены",
	"Телефонные устройства",
	"Трубы",
	"Устройства вызова и оповещения",
	"Устройства связи",
	"Фундамент несущей конструкции",
	"Шкафы",
	"Электрические приборы",
	"Электрооборудование")
# ----------------------------------------
code_block_4 = CodeBlock { 0; }
add = _ + _  # unwired: x, y
getItemAtIndex_2 = List.GetItemAtIndex()  # unwired: list, index
loopWhile = LoopWhile(initialValue=code_block_4, continueWhile=add, loopBody=getItemAtIndex_2)
map = List.Map(list=категории, function=loopWhile)
watch = Watch(map)
