# Dynamo graph SET OPENINGS.dyn (Dynamo 2.0.4.12684)

выбрать_revit_link_связь = RevitLinks(index=0)

# group: Установить пакет Orchid Выбрать в Revit Link необходимый связанный фаил Необходимо соединить отделку и утеплитель к стенам с отверстиями Можно выделить необходимые конструкции если необходимо Если не находит пересечений то необходимо перегрузить Revit
путь_к_файлу_python = Filename("..\DynamoScripts\SetCommunicationOpenings.py")
find_file_and_import_it = Python(IN[0]=путь_к_файлу_python)
# ---------- find_file_and_import_it.python (12 lines) ----------
import sys
#sys.path.append('C:\Program Files\IronPython 2.7\Lib')
sys.path.append('C:\Program Files (x86)\IronPython 2.7\Lib')
import codecs

try:
	filePath = IN[0]
	with codecs.open(filePath, 'rb', "utf-8") as inf:
		lines = inf.readlines()
	OUT = ''.join(lines)
except:
	OUT = "No file"
# ----------------------------------------
имя_типа_отверстия_стен = StringInput("PointLocation")
имя_типа_отверстия_перекрытий = StringInput("(отверстия) ВК")
python_script_from_string = PythonStringNode(script=find_file_and_import_it, IN[0]=выбрать_revit_link_связь, IN[1]=имя_типа_отверстия_стен, IN[2]=имя_типа_отверстия_перекрытий)
watch = Watch(python_script_from_string)
