# Dynamo graph SetElevationMarks.dyn (Dynamo 2.0.4.12684)

# group: Откройте спецификацию
set_parameters = BoolSelector(true)
get_by_parameter = CodeBlock { "TMS_отметка"; }
set_by_parameter = CodeBlock { "Отметка"; }
python_script = Python(IN[0]=set_parameters, IN[1]=get_by_parameter, IN[2]=set_by_parameter)
# ---------- python_script.python (87 lines) ----------
#!/usr/bin/python
# -*- coding: UTF-8 -*-

import sys
sys.path.append(r"C:\Program Files (x86)\IronPython 2.7\Lib")

import clr
clr.AddReference("RevitAPI")
from Autodesk.Revit.DB import FilteredElementCollector, Transaction, SubTransaction
from Autodesk.Revit.DB import SectionType, ViewType

clr.AddReference('RevitServices')
from RevitServices.Persistence import DocumentManager
from RevitServices.Transactions import TransactionManager

doc = DocumentManager.Instance.CurrentDBDocument
uidoc = DocumentManager.Instance.CurrentUIApplication.ActiveUIDocument

TransactionManager.Instance.ForceCloseTransaction()


def tolist(obj1):
    if hasattr(obj1, "__iter__"):
        return obj1
    else:
        return [obj1]


get_parameter = IN[1]
set_parameter = IN[2]

igroups = []
schedule = doc.ActiveView
if schedule.ViewType == ViewType.Schedule:
    definition = schedule.Definition
    table = schedule.GetTableData()
    section = table.GetSectionData(SectionType.Body)
    headings = [definition.GetField(id).GetName() for id in definition.GetFieldOrder()]
    num_rows, num_columns = section.NumberOfRows, section.NumberOfColumns
    element_ids = FilteredElementCollector(doc, schedule.Id).ToElementIds()
    for row_analyse in range(num_rows):
        with Transaction(doc, "dummy") as t:
            t.Start()
            with  SubTransaction(doc) as st:
                st.Start()
                if section.CanRemoveRow(row_analyse):
                    section.RemoveRow(row_analyse)
                    section.RefreshData()
                st.Commit()
            remaining = FilteredElementCollector(doc, schedule.Id).ToElementIds()
            t.RollBack()
        group = [doc.GetElement(id) for id in element_ids if id not in remaining]
        if any(group): igroups.append(group)

TransactionManager.Instance.EnsureInTransaction(doc)

outlist = []

for elements in tolist(igroups):
    set_elevations = set()
    str_elevations = []
    revit_elements = []
    elements = tolist(elements)
    if not IN[0]: outlist.append(elements)
    elif isinstance(elements, list):
        for object in elements:
            element = UnwrapElement(object)
            val = element.LookupParameter(get_parameter).AsDouble()
            if bool(val):
                set_elevations.add(val)
                revit_elements.append(element)

        for value in sorted(set_elevations, reverse=True):
            if value > 0:
                string_value = "+" + str(format(value / 1000, '.3f'))
            else:
                string_value = str(format(value / 1000, '.3f'))
            string_value = string_value.replace(".", ",")
            str_elevations.append(string_value)

        result = "; ".join([string_value for string_value in str_elevations])
        set(e.LookupParameter(set_parameter).Set(result) for e in revit_elements)
        outlist.append(result)

TransactionManager.Instance.TransactionTaskDone()

OUT = outlist
# ----------------------------------------
watch = Watch(python_script)
