# Dynamo graph SetFamilyParameterAndValueInDirectory.dyn (Dynamo 2.0.4.12684)

# group: // Вставка общего параметра в семейства (в папке) // Необходимо что бы в проект был загружен ФОП общего параметра
путь_к_файлу_python = Filename("..\DynamoScripts\SetFamilyParameterAndValueInDirectory.py")
find_file_and_import_it = Python(IN[0]=путь_к_файлу_python)
# ---------- find_file_and_import_it.python (12 lines) ----------
import sys
#sys.path.append('C:\Program Files\IronPython 2.7\Lib')
sys.path.append('C:\Program Files (x86)\IronPython 2.7\Lib')
import codecs

try:
	filePath = IN[0]
	with codecs.open(filePath, 'rb', "utf-8") as inf:
		lines = inf.readlines()
	OUT = ''.join(lines)
except:
	OUT = "No file"
# ----------------------------------------
директория_библиотеки = Directory("K:\02_Библиотека\AR\01_Семейства\Окна")  # graph input
shared_parameters = SharedParameter(index=86)
isinstance_parameter_экзепляр = BoolSelector(true)
назначить_значение = CodeBlock { ""; }
python_script_from_string = PythonStringNode(script=find_file_and_import_it, IN[0]=директория_библиотеки, IN[1]=shared_parameters, IN[2]=isinstance_parameter_экзепляр, IN[3]=назначить_значение)
watch = Watch(python_script_from_string)
