# Dynamo graph SetFamilyParameterAndValueInProject.dyn (Dynamo 2.0.4.12684)

# group: Вставка общего параметра в семейства (в проекте, без сохранения семейства) Параметр будет установлен во все семейства по связанной категории параметра Необходимо что бы в проект был загружен ФОП общего параметра
путь_к_файлу_python = Filename("..\DynamoScripts\SetFamilyParameterAndValueInProject.py")
find_file_and_import_it = Python(IN[0]=путь_к_файлу_python)
# ---------- find_file_and_import_it.python (12 lines) ----------
import sys
#sys.path.append('C:\Program Files\IronPython 2.7\Lib')
sys.path.append('C:\Program Files (x86)\IronPython 2.7\Lib')
import codecs

try:
	filePath = IN[0]
	with codecs.open(filePath, 'rb', "utf-8") as inf:
		lines = inf.readlines()
	OUT = ''.join(lines)
except:
	OUT = "No file"
# ----------------------------------------
shared_parameters = SharedParameter()  # nothing selected
isinstance_parameter_экзепляр = BoolSelector(true)
python_script_from_string = PythonStringNode(script=find_file_and_import_it, IN[0]=shared_parameters, IN[1]=isinstance_parameter_экзепляр)
watch = Watch(python_script_from_string)
