# Dynamo graph SharedParameters.dyn (Dynamo 2.0.4.12684)

путь_к_файлу_python = Filename("..\DynamoScripts\ReloadSharedParameters.py")
find_file_and_import_it = Python(IN[0]=путь_к_файлу_python)
# ---------- find_file_and_import_it.python (12 lines) ----------
import sys
#sys.path.append('C:\Program Files\IronPython 2.7\Lib')
sys.path.append('C:\Program Files (x86)\IronPython 2.7\Lib')
import codecs

try:
	filePath = IN[0]
	with codecs.open(filePath, 'rb', "utf-8") as inf:
		lines = inf.readlines()
	OUT = ''.join(lines)
except:
	OUT = "No file"
# ----------------------------------------
file_path = Filename("K:\02_Библиотека\BIM\BID-BIM-CRT-004-RU_Файл общих параметров от 13.08.2021.txt")
python_script_from_string = PythonStringNode(script=find_file_and_import_it, IN[0]=file_path)
watch = Watch(python_script_from_string)
sharedparameters_from_txt_file = Custom[SharedParameters from txt file](FilePath=file_path)  # Gets parameters from SharedParameter .txt file
