# Dynamo graph Ungroup-Change-Regroup.dyn (Dynamo 0.9.1.4062)

# group: Input - Switch to alternate value between runs
boolean = BoolSelector(false)

active_view = Custom[Active View](refresh=boolean)  # Selects the current document's active view. Supports more view types than the built-in option. Will be depreciated once the bult in node works with all plan types.
elementsInView = Custom[Collector.ElementsInView](view_s=active_view, refresh=boolean)  # Selects all elements visible in the input view.
element_types = ElementTypes("GroupType")
all_elements_of_type = ElementsOfType(element_types)
code_block = CodeBlock { "Family"; }
getParameterValueByName = Element.GetParameterValueByName(element=elementsInView, parameterName=code_block)
if_equal_return_index = Custom[If Equal Return Index](listA=all_elements_of_type, listB=getParameterValueByName)  # If element in list A is equal to an element in list B then return index from list B.
getItemAtIndex = List.GetItemAtIndex(list=elementsInView, index=if_equal_return_index)
members = Custom[Group.Members](group=getItemAtIndex)  # Retrieves the members of a group
wait = Custom[Input.Wait](WaitForMe=members, Output=getItemAtIndex)  # Waits for all inputs to be completed before continuing the execution process.Part of the SmartCopyMon workflow.
ungroup = Custom[Group.Ungroup](group=wait)  # Ungroups a group and returns the ungrouped elements.
wait_2 = Custom[Input.Wait](WaitForMe=ungroup, Output=wait)
deleteElements = Custom[Doc.DeleteElements](element_s=wait_2)  # Attempts to delete the input list of elements from the active Revit document.The node returns the number of successfully deleted elements and their Ids as a string. Carefully observe the deleted elements count. It may be greater than the input list because hosted elements or tags will be deleted as well. If an element in the list can not be deleted (for example last revision or last view), the whole list will fail to be deleted.
wait_3 = Custom[Input.Wait](WaitForMe=deleteElements.count, Output=members)
code_block_2 = CodeBlock { "Type Name"; }
getParameterValueByName_2 = Element.GetParameterValueByName(element=all_elements_of_type, parameterName=code_block_2)
if_equal_return_index_2 = Custom[If Equal Return Index](listA=getParameterValueByName, listB=all_elements_of_type)
getItemAtIndex_2 = List.GetItemAtIndex(list=getParameterValueByName_2, index=if_equal_return_index_2)
wait_4 = Custom[Input.Wait](WaitForMe=deleteElements.count, Output=getItemAtIndex_2)

# group: Will ungroup/edit/regroup sucessfully when there is only 1 group instance, but then fails (makes a new group containing all the ungrouped elements) when there are more than 1 instance of a group.
fromElements = Custom[Group.FromElements](elements=wait_3, groupName=wait_4)  # Creates a group from a list of Revit elements

create = List.Create(ungroup)
flatten = Flatten(create)
element_types_2 = ElementTypes("AnalyticalModel")
element_types_3 = ElementTypes("AnalyticalModelStick")
element_types_4 = ElementTypes("AnalyticalModelColumn")
create_2 = List.Create(element_types_2, element_types_3, element_types_4)
all_elements_of_type_2 = ElementsOfType(create_2)
string_from_object = FromObject(all_elements_of_type_2)
uniqueItems = List.UniqueItems(string_from_object)
flatten_2 = Flatten(uniqueItems)
string_from_object_2 = FromObject(ungroup)
flatten_3 = Flatten(string_from_object_2)
if_equal_return_index_3 = Custom[If Equal Return Index](listA=flatten_2, listB=flatten_3)
uniqueItems_2 = List.UniqueItems(if_equal_return_index_3)
removeItemAtIndex = List.RemoveItemAtIndex(list=flatten, indices=uniqueItems_2)
code_block_3 = CodeBlock { "Structural Material"; }
code_block_4 = CodeBlock { "Copper"; }
byName = Material.ByName(code_block_4)
setParameterByName = Element.SetParameterByName(element=removeItemAtIndex, parameterName=code_block_3, value=byName)
