# Dynamo graph Авто-соединения-конструктивных-элементов.dyn "Struct.AutoJoinElems_Publish" (Dynamo 2.0.1.5055)

# note: Скрипт объединяет элементы включенной категории с пересекающимися элементами категорий Стена, Перекрытие, Фундменты, Несущие колонны, Каркас несущий.
соединить_стены = BoolSelector(true)
соединить_перекрытия = BoolSelector(true)
соединить_фундаменты = BoolSelector(true)  # graph input
соединить_колонны = BoolSelector(true)
соединить_балки = BoolSelector(true)
python_script = Python(IN[0]=соединить_стены, IN[1]=соединить_перекрытия, IN[2]=соединить_фундаменты, IN[3]=соединить_колонны, IN[4]=соединить_балки)
# ---------- python_script.python (102 lines) ----------
import clr

import System
from System.Collections.Generic import *

clr.AddReference("RevitAPI")
import Autodesk
from Autodesk.Revit.DB import *

clr.AddReference('RevitServices')
import RevitServices
from RevitServices.Persistence import DocumentManager
from RevitServices.Transactions import TransactionManager

#Получение текущего документа
doc = DocumentManager.Instance.CurrentDBDocument

#Получение текущего интерфейса пользователья
uiapp = DocumentManager.Instance.CurrentUIApplication
app = uiapp.Application

def get_InterCollector(el):
    gopt = Options()
    el_geom = UnwrapElement(el).get_Geometry(gopt)
    bb = el_geom.GetBoundingBox()
    outline = Outline(bb.Min, bb.Max)
    bb_filter = BoundingBoxIntersectsFilter(outline)
    collector = FilteredElementCollector(doc)
    el_intersect = collector.WherePasses(bb_filter).WhereElementIsNotElementType()#.ToElements()
    return el_intersect


def get_bb_elems(el):
    bb_elems = []
    bb_elems.extend(get_InterCollector(el).OfCategory(BuiltInCategory.OST_Floors).ToElements())
    bb_elems.extend(get_InterCollector(el).OfCategory(BuiltInCategory.OST_Walls).ToElements())
    bb_elems.extend(get_InterCollector(el).OfCategory(BuiltInCategory.OST_StructuralFraming).ToElements())
    bb_elems.extend(get_InterCollector(el).OfCategory(BuiltInCategory.OST_StructuralColumns).ToElements())
    bb_elems.extend(get_InterCollector(el).OfCategory(BuiltInCategory.OST_StructuralFoundation).ToElements())
    return bb_elems

def get_solid(el):
    gopt = Options()
    el_geom = UnwrapElement(el).get_Geometry(gopt)
    geo = [i for i in el_geom]
    sol = None
    if len(geo) == 1 and geo[0].GetType() == Autodesk.Revit.DB.GeometryInstance:
        geo = geo[0].GetInstanceGeometry()
    for i in geo:
        if i.GetType() == Autodesk.Revit.DB.Solid:
            if i.Volume != 0:
                sol = (i)
    return sol

def check_intesectSolid(el_1, el_2):
    el1_solid = get_solid(el_1)
    el2_solid = get_solid(el_2)
    if  el2_solid != None and BooleanOperationsUtils.ExecuteBooleanOperation(el1_solid, el2_solid, BooleanOperationsType.Intersect).Volume > 0:
        return True
    else:
        return False

def joint_geom(el):
    try:
        for i in get_bb_elems(el):
            try:
                if el.Id != i.Id and check_intesectSolid(el, i) and not JoinGeometryUtils.AreElementsJoined(doc, el, i):
                    try:
                        JoinGeometryUtils.JoinGeometry(doc, el, i)
                        success.append('Обединяем {0} id {2} и {1} id {3}'.format(el.Category.Name, i.Category.Name, el.Id.ToString(),i.Id.ToString()))
                    except Exception as e: err.append('Ошибка в объединении {0} id {2} и {1} id {3}. Ошибка: {4}'.format(el.Category.Name, i.Category.Name, el.Id.ToString(),i.Id.ToString(), e))
            except Exception as e: err.append('Ошибка в поиске солидов {0} id {2} и {1} id {3}. Ошибка: {4}'.format(el.Category.Name, i.Category.Name, el.Id.ToString(),i.Id.ToString(), e))
    except Exception as e: err.append('Ошибка в получение прилегающих элементов {0} id {1} . Ошибка: {2}'.format(el.Category.Name, el.Id.ToString(),e))
    return success, err

success = []
err = []

TransactionManager.Instance.EnsureInTransaction(doc)
if IN[0]:
    walls = FilteredElementCollector(doc).OfClass(Wall).WhereElementIsNotElementType().ToElements()
    [joint_geom(wall) for wall in walls if wall.CurtainGrid == None]

if IN[1]:
    floors =  FilteredElementCollector(doc).OfCategory(BuiltInCategory.OST_Floors).WhereElementIsNotElementType().ToElements()
    map(joint_geom, floors)

if IN[2]:
    foundation = FilteredElementCollector(doc).OfCategory(BuiltInCategory.OST_StructuralFoundation).WhereElementIsNotElementType().ToElements()
    map(joint_geom, foundation)

if IN[3]:
    columns = FilteredElementCollector(doc).OfCategory(BuiltInCategory.OST_StructuralColumns).WhereElementIsNotElementType().ToElements()
    map(joint_geom, columns)

if IN[4]:
    beams = FilteredElementCollector(doc).OfCategory(BuiltInCategory.OST_StructuralFraming).WhereElementIsNotElementType().ToElements()
    map(joint_geom, beams)

TransactionManager.Instance.TransactionTaskDone()

OUT = success, err
# ----------------------------------------
